# Dynamo graph !3d View_By Selected__Filter_Node Inputs by string contains_xxx2.dyn (Dynamo 1.3.2.2480)

string = StringInput("""Grids
Levels
Matchline
Scope Boxes
Crop Boundaries
Reference Planes
Section Boxes""")
code_block = CodeBlock { Refresh: bool = true; }
code_block_2 = CodeBlock(string, code_block)
# ---------- code_block_2.designscript (11 lines) ----------
list;
come;

[Imperative]

{
 if (come ==true)
  return = list;
 else
  return = list;
};
# ----------------------------------------
multilinestring_list = Custom[MultilineString➜List](String_In=code_block_2.out2)  # converts a string with line breaks in to a list of strings
byName = Category.ByName(multilinestring_list)
all_elements_of_category = ElementsOfCategory(byName)
list_CleanOutput = Custom[List_CleanOutput+](List_In=all_elements_of_category)  # Removes and or places nulls and empties up to 2 dimentional_!!List
removeItemAtIndex = List.RemoveItemAtIndex(list=byName, indices=list_CleanOutput.IndicesOut)
string_2 = StringInput("""Plan Region
Callout Boundary""")  # frozen
code_block_3 = CodeBlock { 1; }
type = Object.Type(code_block_3)
code_block_4 = CodeBlock { "System.String"; }
eq = type == code_block_4
if_ = If(test=eq)  # unwired: true, false
object_string_contains_basic = Custom[Object➜String.Contains_Basic](List_In=multilinestring_list, Search_For=code_block_3)  # filters a list of objects for input string values
code_block_5 = CodeBlock(Match=object_string_contains_basic.Match) { {null,Match}; }
isEmpty = List.IsEmpty(object_string_contains_basic.Match)
filterByBoolMask = List.FilterByBoolMask(list=code_block_5, mask=isEmpty)
getItemAtIndex = List.GetItemAtIndex(list=multilinestring_list, index=code_block_3)
combine = List.Combine(if_, filterByBoolMask.in, getItemAtIndex)
