# Dynamo custom node !^Rpt_InstanceParametersToExcel_byCategory.dyf (Dynamo 1.3.2.2480)
# category: ArupBimSF.Revit.Reports
# Report out family instance parameters to an excel file by category

ExcelFilePath = Input()
location = Watch(ExcelFilePath)
# note: Add Element Location, and Forced Parameters to this one!
category = Input(category : Category)
name = Category.Name(category)
code_block = CodeBlock { 0; false; }
code_block_2 = CodeBlock { "Element Id"; "Element Guid"; "Family Name"; }
all_elements_of_category = ElementsOfCategory(category)
connect = Flatten(all_elements_of_category)
watch = Watch(connect)
parameters = Element.Parameters(watch)
code_block_3 = CodeBlock(list=parameters) { Flatten({list}); }
get_name_clockworks = Python(IN[0]=code_block_3)
# ---------- get_name_clockworks.python (17 lines) ----------
import clr
clr.AddReference('RevitAPI')
clr.AddReference('RevitAPIUI')
from Autodesk.Revit.DB import *
import Autodesk

items = IN[0]
elementlist = list()
for item in items:
	try:
		elementlist.append(item.Name)
	except:
		try:
			elementlist.append(item.get_Parameter(BuiltInParameter.SYMBOL_NAME_PARAM).AsString())
		except:
			donothing = 1
OUT = elementlist
# ----------------------------------------
code_block_4 = CodeBlock(a=get_name_clockworks, b=watch)
# ---------- code_block_4.designscript (15 lines) ----------
//Get Parameter Name
A=List.Sort(a);
B=List.UniqueItems(A);

//Get Element list*Parameter no.
C=List.Count(B);
D=List.Cycle(b,C);

//Get Parameter Name*Element no.
E=List.Count(b);
F=List.Cycle(B,E);

G=List.Sort(F);
//Get Element Parameter
I=D.GetParameterValueByName(G);
# ----------------------------------------
join = List.Join(code_block_2.out0, code_block_2.out1, code_block_2.out2, code_block_4.B)
create = List.Create(join)
get_element_id = Custom[Get_Element Id+](Elements=watch)  # Gets Revit element Id and GUID for input elements
code_block_5 = CodeBlock(list=watch) { Flatten({list}); }
get_name_clockworks_2 = Python(IN[0]=code_block_5)  # same code as get_name_clockworks
create_2 = List.Create(get_element_id.Id_As_Integer, get_element_id.Id_As_String, get_name_clockworks_2)
code_block_6 = CodeBlock(x=code_block_4.E) { 0..x-1; x; }
sublists = List.Sublists(list=code_block_4.I, ranges=code_block_6.out0, offset=code_block_6.x)
join_2 = List.Join(create_2, sublists)
transpose = List.Transpose(join_2)
join_3 = List.Join(create, transpose)
writeToFile = Excel.WriteToFile(filePath=location, sheetName=name, startRow=code_block.out0, startCol=code_block.out0, data=join_3)
Data = Output(writeToFile)
code_block_7 = CodeBlock { "Last Export Info"; }
code_block_8 = CodeBlock { list={"Version","Build","File Path","Excel Path","Time"}; }
application_version_clock_works = Python()
# ---------- application_version_clock_works.python (10 lines) ----------
import clr
clr.AddReference("RevitServices")
import RevitServices
from RevitServices.Persistence import DocumentManager

doc = DocumentManager.Instance.CurrentDBDocument
uiapp = DocumentManager.Instance.CurrentUIApplication
app = uiapp.Application

OUT = app.VersionName, app.VersionNumber, app.VersionBuild
# ----------------------------------------
code_block_9 = CodeBlock(seq=application_version_clock_works)
# ---------- code_block_9.designscript (6 lines) ----------
seq[0];
//Name;
seq[1];
//Version;
seq[2];
//Build;
# ----------------------------------------
doc_path_from_clockworks = Python()
# ---------- doc_path_from_clockworks.python (11 lines) ----------
import clr
clr.AddReference('RevitAPI')
from Autodesk.Revit.DB import *

clr.AddReference("RevitServices")
import RevitServices
from RevitServices.Persistence import DocumentManager

doc = DocumentManager.Instance.CurrentDBDocument

OUT = doc.PathName
# ----------------------------------------
string_from_object = FromObject(location)
now = DateTime.Now()
create_3 = List.Create(code_block_9.out0, code_block_9.out2, doc_path_from_clockworks, string_from_object, now)
create_4 = List.Create(code_block_8, create_3)
writeToFile_2 = Excel.WriteToFile(filePath=location, sheetName=code_block_7, startRow=code_block.out0, startCol=code_block.out0, data=create_4)
FileInfo = Output(writeToFile_2)
