# Dynamo graph !3d View_By Selected__Filter_Node Inputs by string contains.dyn (Dynamo 1.3.2.2480)

code_block = CodeBlock { 0_Categories; }
code_block_2 = CodeBlock { ➜Elem_All_Categories; }
code_block_3 = CodeBlock { 3➜Chosen_Elements; }
string = StringInput("""Grids
Levels
Matchline
Scope Boxes
Crop Boundaries
Reference Planes
Section Boxes""")
code_block_4 = CodeBlock { Refresh: bool = true; }
code_block_5 = CodeBlock(string, code_block_4)
# ---------- code_block_5.designscript (11 lines) ----------
list;
come;

[Imperative]

{
 if (come ==true)
  return = list;
 else
  return = list;
};
# ----------------------------------------
multilinestring_list = Custom[MultilineString➜List](String_In=code_block_5.out2)  # converts a string with line breaks in to a list of strings
byName = Category.ByName(multilinestring_list)
all_elements_of_category = ElementsOfCategory(byName)
list_CleanOutput = Custom[List_CleanOutput+](List_In=all_elements_of_category)  # Removes and or places nulls and empties up to 2 dimentional_!!List
removeItemAtIndex = List.RemoveItemAtIndex(list=byName, indices=list_CleanOutput.IndicesOut)
code_block_6 = CodeBlock { 1; }
type = Object.Type(code_block_6)
code_block_7 = CodeBlock { "System.String"; }
eq = type == code_block_7
code_block_8 = CodeBlock { 1; }
list_FilterByStringMatch = Custom[List_FilterByStringMatch](SearchString=code_block_6, Contains_Or_Equals=code_block_8)  # Filters a list of elements by whether or not they contain a search string. I added an option to run it by string match as well._!fi!Li; unwired: list
code_block_9 = CodeBlock { true; }
indexOf = IndexOf(list_FilterByStringMatch.Other, code_block_9)
if_ = If(test=eq, true=indexOf, false=code_block_6)
getItemAtIndex = List.GetItemAtIndex(list=removeItemAtIndex, index=if_)
code_block_10 = CodeBlock { 2➜Chosen_Category; }
getItemAtIndex_2 = List.GetItemAtIndex(list=list_CleanOutput.Cleaned, index=if_)
name = Element.Name(getItemAtIndex_2)
code_block_11 = CodeBlock { 4➜➜TypeNames; }
code_block_12 = CodeBlock { 5➜➜➜Chosen_Type; }
code_block_13 = CodeBlock { "06"; }
type_2 = Object.Type(code_block_13)
code_block_14 = CodeBlock { "System.String"; }
eq_2 = type_2 == code_block_14
if_2 = If(test=eq_2)  # unwired: true, false
object_string_contains_basic = Custom[Object➜String.Contains_Basic](List_In=getItemAtIndex_2, Search_For=code_block_13)  # filters a list of objects for input string values
getItemAtIndex_3 = List.GetItemAtIndex(list=getItemAtIndex_2, index=code_block_13)
combine = List.Combine(if_2, object_string_contains_basic.Match, getItemAtIndex_3)
code_block_15 = CodeBlock { "06"; }
type_3 = Object.Type(code_block_15)
code_block_16 = CodeBlock { "System.String"; }
eq_3 = type_3 == code_block_16
if_3 = If(test=eq_3)  # unwired: true, false
object_string_contains_basic_2 = Custom[Object➜String.Contains_Basic](List_In=multilinestring_list, Search_For=code_block_15)
code_block_17 = CodeBlock(Match=object_string_contains_basic_2.Match) { {null,Match}; }
isEmpty = List.IsEmpty(object_string_contains_basic_2.Match)
# note: The List.Combine node cannot handle an empty list so I use the boolean mask to swap out the empty with a null.  This makes it operate smoothly.
filterByBoolMask = List.FilterByBoolMask(list=code_block_17, mask=isEmpty)
getItemAtIndex_4 = List.GetItemAtIndex(list=multilinestring_list, index=code_block_15)
combine_2 = List.Combine(if_3, filterByBoolMask.in, getItemAtIndex_4)
get_RefElements_ByCategory = Custom[Get_RefElements_ByCategory+]()  # Gets reference elements from active doc
get_RefElements_ByCategory_2 = Custom[Get_RefElements_ByCategory++]()  # Gets reference elements from active doc
list_CleanEmpties = Custom[List_CleanEmpties]()  # remove empty indices from input lists; unwired: List_In
