# Dynamo custom node MEP_Elements_By CategoryGroup.dyf (Dynamo 1.3.2.2480)
# category: ArupBimSF.Revit.Links & Imports
# Get Link instance, Doc, Name & Path. Use With Get Docs or Get Loaded RVT Links To get a link from a list of links.  Use the all link names output to review the linked file names and chose the one you want by entering the index number of the desired link_#Lnk

string = StringInput("01_SpacesRooms&Zones,22_Plumbing,23_Mechanical,26_Electrical,27_ComDevices")
deliminated_string_list = Custom[Deliminated String ➜ List](Strings_In=string)  # Splits a comma deliminated String to a list of strings_!!List DeliminatedStringToList
n0_CategoryGroups = Output(deliminated_string_list)  # "0_CategoryGroups"
deliminated_string_list_2 = Custom[Deliminated String ➜ List](Strings_In=string)
Index_Or_Search = Input(Index_Or_Search:var="---")
type = Object.Type(Index_Or_Search)
code_block = CodeBlock { "Int"; }
contains = String.Contains(str=type, searchFor=code_block)
code_block_2 = CodeBlock { 1; }
list_FilterByStringMatch = Custom[List_FilterByStringMatch](list=deliminated_string_list_2, SearchString=Index_Or_Search, Contains_Or_Equals=code_block_2)  # Filters a list of elements by whether or not they contain a search string. I added an option to run it by string match as well._!fi!Li
code_block_3 = CodeBlock { true; }
allIndicesOf = List.AllIndicesOf(list=list_FilterByStringMatch.Bool, item=code_block_3)
if_ = If(test=contains, true=Index_Or_Search, false=allIndicesOf)
getItemAtIndex = List.GetItemAtIndex(list=deliminated_string_list_2, index=if_)
n1_ChosenGroup = Output(getItemAtIndex)  # "1_ChosenGroup"
mep_Categories_Db = Custom[Mep_Categories_Db]()  # A collection of MEP Categories
Refresh = Input(Refresh : bool = true)
code_block_4 = CodeBlock(mep_Categories_Db.All_Categories, Refresh)
# ---------- code_block_4.designscript (11 lines) ----------
list;
come;

[Imperative]

{
 if (come ==true)
  return = list;
 else
  return = list;
};
# ----------------------------------------
getItemAtIndex_2 = List.GetItemAtIndex(list=code_block_4.out2, index=if_)
flatten = Flatten(getItemAtIndex_2)
all_elements_of_category = ElementsOfCategory(flatten)
list_CleanOutput = Custom[List_CleanOutput](List_In=all_elements_of_category)  # Removes and Replaces Nulls and Empty Lists from input lists. *only works with flat or 2 dimentional lists_Need to fix it to go deeper or use list.map_!!List
removeItemAtIndex = List.RemoveItemAtIndex(list=flatten, indices=list_CleanOutput.Indices)
n2_ChosenCategories = Output(removeItemAtIndex)  # "2_ChosenCategories"
n3_Elements_ByCat = Output(list_CleanOutput.Cleaned)  # "3_Elements_ByCat"
getItemAtIndex_3 = List.GetItemAtIndex(list=flatten, index=list_CleanOutput.Indices)
n4_ChosenCat_NoElem = Output(getItemAtIndex_3)  # "4_ChosenCat_NoElem"
code_block_5 = CodeBlock {  }
