# Dynamo custom node String.Join With Seperator+.dyf (Dynamo 1.3.2.2480)
# category: ArupBimSF.String
# Joins two strings into one with a seperator

separator = Input()
stringA = Input()
stringB = Input()
join = String.Join(separator, stringA, stringB)
joinedString = Output(join)
