# Dynamo custom node 3d View_bySelected.dyf (Dynamo 1.3.2.2480)
# category: ArupBimSF.Revit.Views & Sheets
# sets the 3d section box to actively select elements

RunIt = Input(RunIt : bool = false)
Refresh = Input(Refresh : bool = false)
code_block = CodeBlock(RunIt, Refresh)
# ---------- code_block.designscript (11 lines) ----------
list;
come;

[Imperative]

{
 if (come ==true)
  return = list;
 else
  return = list;
};
# ----------------------------------------
python_script = Python(IN[0]=code_block.out2)
# ---------- python_script.python (28 lines) ----------
import clr

clr.AddReference("RevitServices")
import RevitServices
from RevitServices.Persistence import DocumentManager
from RevitServices.Transactions import TransactionManager
doc =  DocumentManager.Instance.CurrentDBDocument
uidoc = DocumentManager.Instance.CurrentUIDocument
app = DocumentManager.Instance.CurrentUIApplication.Application
uiapp = DocumentManager.Instance.CurrentUIApplication

clr.AddReference("RevitNodes")
import Revit
clr.ImportExtensions(Revit.Elements)
clr.ImportExtensions(Revit.GeometryConversion)

clr.AddReference("RevitAPI")
from Autodesk.Revit.DB import *
clr.AddReference("RevitAPIUI")
from Autodesk.Revit.UI import *
output = []
postcmd = RevitCommandId.LookupPostableCommandId(PostableCommand.SelectionBox)
if IN[0] == True:
	uiapp.PostCommand(postcmd)
	output = True
else :
	output = 'Set RunIt to true'
OUT = output
# ----------------------------------------
Result = Output(python_script)
