# Dynamo custom node 3dSectionBox_Set by Bounding Box.dyf (Dynamo 1.3.2.2480)
# category: ArupBimSF.Revit.Views & Sheets
# set the extents of a 3d section box by an imput bounding box

BoundingBox = Input()
View = Input()
python_script = Python(IN[0]=BoundingBox, IN[1]=View)
# ---------- python_script.python (31 lines) ----------
import clr
clr.AddReference("RevitAPI")
import Autodesk
from Autodesk.Revit.DB import *

clr.AddReference("RevitNodes")
import Revit
clr.ImportExtensions(Revit.GeometryConversion)
clr.ImportExtensions(Revit.Elements)

clr.AddReference("RevitServices")
import RevitServices
from RevitServices.Persistence import DocumentManager
from RevitServices.Transactions import TransactionManager

doc = DocumentManager.Instance.CurrentDBDocument
bbox = IN[0]
view = UnwrapElement(IN[1])
try:
    TransactionManager.Instance.EnsureInTransaction(doc)
    newmax = UnwrapElement(bbox.MaxPoint).ToRevitType()
    newmin = UnwrapElement(bbox.MinPoint).ToRevitType()
    newbox = BoundingBoxXYZ()
    newbox.Max = newmax
    newbox.Min = newmin

    z = view.SetSectionBox(newbox)

    OUT = "Done"
except:
    OUT = "Error"
# ----------------------------------------
Result = Output(python_script)
