# Dynamo custom node Access_ProjectDirectories.dyf (Dynamo 1.3.2.2480)
# category: ArupBim.Directory
# Gets the J: Drive drawings folder path for the active document.  Uses Project Info ootb Project Number parameter

string = StringInput("J:\S-F")
string_2 = StringInput("\")
code_block = CodeBlock { ""; }
get_ProjectNumber = Custom[Get_ProjectNumber]()  # gets the project number for the active Project
# note: Add a search by string
code_block_2 = CodeBlock { 0..1; }
get_CharachterAtIndex = Custom[Get_CharachterAtIndex](Strings_In=get_ProjectNumber, Index=code_block_2, lacing=Longest)  # get charachters from strings at index. Powerful tool to use along with a key group or as headers, sheet and view names.
join = String.Join(code_block, get_CharachterAtIndex, lacing=Longest)
code_block_3 = CodeBlock { 6; }
code_block_4 = CodeBlock { "0"; }
padRight = String.PadRight(join, code_block_3, code_block_4)
code_block_5 = CodeBlock { "-00"; }
code_block_6 = CodeBlock(a=string, b=string_2, c=padRight, d=get_ProjectNumber, e=code_block_5) { a+b+c+b+d+e; }
fromPath = DirectoryObject(code_block_6)  # "Directory.FromPath"
Refresh = Input(Refresh: bool=false)
code_block_7 = CodeBlock(fromPath, Refresh)
# ---------- code_block_7.designscript (11 lines) ----------
list;
come;

[Imperative]

{
 if (come ==true)
  return = list;
 else
  return = list;
};
# ----------------------------------------
n0_Project_Folder = Output(code_block_7.out2)  # "0_Project Folder"
contents = Directory.Contents(code_block_7.out2)
flatten = Flatten(contents.out1)
code_block_8 = CodeBlock { "Internal Project"; }
list_FilterByStringMatch = Custom[List_FilterByStringMatch](list=flatten, SearchString=code_block_8)  # Filters a list of elements by whether or not they contain a search string. I added an option to run it by string match as well._!fi!Li
flatten_2 = Flatten(list_FilterByStringMatch.Match)
fromPath_2 = DirectoryObject(flatten_2)  # "Directory.FromPath"
contents_2 = Directory.Contents(fromPath_2)
flatten_3 = Flatten(contents_2.out1)
code_block_9 = CodeBlock { "Drawings"; }
object_string_contains = Custom[Object➜String.Contains+](List_In=flatten_3, Extra_In=flatten_3, SearchString=code_block_9)  # Filters an input list by imput sting contains plus an extra list to run through the same filter._!!Filter
n1_04_03_Drawings = Output(object_string_contains.0_Match_IN)  # "1_04-03 Drawings"
join_2 = List.Join(object_string_contains.0_Match_IN, object_string_contains.1_Match_Out)
string_from_object = FromObject(fromPath_2)
string_SplitByCharachters = Custom[String_SplitByCharachters+](String_List=join_2, TrimBy=string_from_object, lacing=Longest)  # This node allows you to get the portion of a string after, before a defined charachter (or sequence of) within the string. Additionally you can get combined output of the string removing only the Charachter(s) chosen_!!String.SplitByCharachter
GetDirectoryAtIndex = Input(GetDirectoryAtIndex: var = -1)
code_block_10 = CodeBlock(s=string_SplitByCharachters.Char_Removed, p=GetDirectoryAtIndex) { s[p]; }
n2_Chosen_Directory = Output(code_block_10)  # "2_Chosen Directory"
code_block_11 = CodeBlock { 0; }
gt = GetDirectoryAtIndex > code_block_11
code_block_12 = CodeBlock(s=join_2, p=GetDirectoryAtIndex) { s[p]; }
identity = Object.Identity(code_block_7.out2)
if_ = If(test=gt, true=code_block_12, false=identity)
OpenChosen_Directory = Input(OpenChosen_Directory: bool=false)
filterByBoolMask = List.FilterByBoolMask(list=if_, mask=OpenChosen_Directory)
flatten_4 = Flatten(filterByBoolMask.in)
openFile_FromPath_OS = Custom[OpenFile_FromPath_OS](FilePath_String=flatten_4)  # Open a file or folder from a designated path In its native program
n2_DirectoryNames = Output(string_SplitByCharachters.Char_Removed)  # "2_DirectoryNames"
