# Dynamo custom node Action_ReFresh.dyf (Dynamo 1.3.2.2480)
# category: ArupBimSF.Boolean
# add to the front of a workflow to allow it to be refreshed with a boolean node

list = Input()
Refresh = Input(Refresh : bool=true)
code_block = CodeBlock(list, Refresh)
# ---------- code_block.designscript (11 lines) ----------
list;
come;

[Imperative]

{
 if (come ==true)
  return = list;
 else
  return = list;
};
# ----------------------------------------
data = Output(code_block.out2)
