# Dynamo custom node Action_RunMe.dyf (Dynamo 1.3.2.2480)
# category: ArupBimSF.Boolean
# Uses A boolean to determine whether to run a function or sequence.

Should_I = Input(Should_I : bool=True)
ThingToDo = Input()
python_script = Python(IN[0]=Should_I, IN[1]=ThingToDo)
# ---------- python_script.python (6 lines) ----------
bool=IN[0]

if bool == True:
	OUT=IN[True]
else:
	OUT=False
# ----------------------------------------
Result = Output(python_script)
