# Dynamo custom node Action_RunMe_If.dyf (Dynamo 1.3.2.2480)
# category: ArupBimSF.Boolean
# uses a run_me node if input does note eqaul ""#Action

List_In = Input(List_In : var = "")
Run_If = Input(Run_If : string = "")
code_block = CodeBlock(t3=List_In, t4=Run_If) { t2 = t3 == t4; t5 = t2 == true; }
python_script = Python(IN[0]=code_block.t5, IN[1]=List_In)
# ---------- python_script.python (6 lines) ----------
bool=IN[0]

if bool == True:
	OUT=IN[1]
else:
	OUT=0
# ----------------------------------------
OUT = Output(python_script)
