# Dynamo custom node Action_This Or That.dyf (Dynamo 1.3.2.2480)
# category: ArupBimSF.Boolean
# toggles between two choices

Item1 = Input(Item1 : var[]..[])
Item2 = Input(Item2 : var[]..[])
create = List.Create(Item1, Item2)
Bool_Switch = Input(Bool_Switch : bool = true)
code_block = CodeBlock { 0; 1; }
if_ = If(test=Bool_Switch, true=code_block.out0, false=code_block.out1)
getItemAtIndex = List.GetItemAtIndex(list=create, index=if_)
python_script = Python(IN[0]=getItemAtIndex)
# ---------- python_script.python (20 lines) ----------
import clr
clr.AddReference('ProtoGeometry')
from Autodesk.DesignScript.Geometry import *
#The inputs to this node will be stored as a list in the IN variable.
dataEnteringNode = IN

def ClearList(_list):
    out = []
    for _list1 in _list:
        if _list1 is None:
            continue
        if isinstance(_list1, list):
             _list1 = ClearList(_list1)
             if not _list1:
                 continue
        out.append(_list1)
    return out

#Assign your output to the OUT variable
OUT = ClearList(IN[0])
# ----------------------------------------
var = Output(python_script)  # "var[]..[]"
