# Dynamo custom node Add_RevitLink.dyf (Dynamo 1.3.2.2480)
# category: ArupBimSF.Revit.Links & Imports
# Adds a link to current revit Document

filePath = Input(filePath : string)
code_block = CodeBlock(item=filePath) { Flatten({item}); }
python_script = Python(IN[0]=code_block)
# ---------- python_script.python (26 lines) ----------
import clr
clr.AddReference('RevitAPI')
from Autodesk.Revit.DB import *

clr.AddReference("RevitServices")
import RevitServices
from RevitServices.Persistence import DocumentManager
from RevitServices.Transactions import TransactionManager

doc = DocumentManager.Instance.CurrentDBDocument
linkpaths = IN[0]
elementlist = list()
booleans = list()

TransactionManager.Instance.EnsureInTransaction(doc)
for path in linkpaths:
	try:
		linkpath = ModelPathUtils.ConvertUserVisiblePathToModelPath(path)
		linkoptions = RevitLinkOptions(False)
		linkloadresult = RevitLinkType.Create(doc, linkpath, linkoptions)
		elementlist.append(RevitLinkInstance.Create(doc, linkloadresult.ElementId))
		booleans.append(True)
	except:
		booleans.append(False)
TransactionManager.Instance.TransactionTaskDone()
OUT = (elementlist, booleans)
# ----------------------------------------
code_block_2 = CodeBlock(seq=python_script) { seq[0]; seq[1]; }
return_list_or_single_value = Python(IN[0]=filePath, IN[1]=code_block_2.out0)
# ---------- return_list_or_single_value.python (4 lines) ----------
check = IN[0]
items = IN[1]
if isinstance(check, (list)): OUT = items
else: OUT = items[0]
# ----------------------------------------
RevitLinkInstance = Output(return_list_or_single_value)
return_list_or_single_value_2 = Python(IN[0]=filePath, IN[1]=code_block_2.out1)  # same code as return_list_or_single_value
code_block_3 = CodeBlock { "!!Link_Added!!"; "Fail-SomeThing MisFired Captain"; }
boolean_string_output = Custom[Boolean_String Output](Boolean_In=return_list_or_single_value_2, String_if_True=code_block_3.out0, String_if_False=code_block_3.out1)  # takes a boolean input to a this or that String output
Success = Output(boolean_string_output)  # "Success?"
