# Dynamo custom node Add_SharedParameterToFamily_FE.dyf (Dynamo 1.3.2.2480)
# category: ArupBimSF.Revit.FamilyEditor
# Add a Shared Parameter To A family inside family editor._!!Fe!Shp

ParameterDef = Input()
Instance = Input()
ParameterGroup = Input()
Family = Input()
get_FamilyDoc_FromFamily = Custom[Get_FamilyDoc_FromFamily](Family=Family)  # gets the family document from input family
Save_Path = Input()  # "Save.Path"
python_script = Python(IN[0]=ParameterDef, IN[1]=Instance, IN[2]=ParameterGroup, IN[3]=get_FamilyDoc_FromFamily, IN[4]=Save_Path)
# ---------- python_script.python (54 lines) ----------
import clr
clr.AddReference('ProtoGeometry')
from Autodesk.DesignScript.Geometry import *

clr.AddReference("RevitAPI")
import Autodesk
from Autodesk.Revit.DB import *

clr.AddReference("RevitServices")
import RevitServices
from RevitServices.Persistence import DocumentManager
from RevitServices.Transactions import TransactionManager
from System.Collections.Generic import *

clr.AddReference("RevitNodes")
import Revit
clr.ImportExtensions(Revit.Elements)

import System

doc = DocumentManager.Instance.CurrentDBDocument
uiapp = DocumentManager.Instance.CurrentUIApplication
app = uiapp.Application

_def = IN[0]
_instance = IN[1]
_paramGroup = IN[2]
_fdoc = IN[3]
_FM = IN[3][0].FamilyManager
_path = IN[4]
message = []
familyname = []
paths = []

def addParameter(_def,_paramGroup,_instance):
	try:
		param = FamilyManager.AddParameter(_FM, _def, _paramGroup, _instance)
		message = 'Add Parameter Success'
	except Exception,e:
		message = str(e)
	return message

TransactionManager.Instance.EnsureInTransaction(_fdoc[0])
#add parameter
for i, j, k in zip(_def,_paramGroup,_instance):
	message = addParameter(i,j,k)
#get family doc & name
for i in _fdoc:
	familyname.append(i.Title)
for i in familyname:
	paths.append(_path + "\\" + i + '.rfa')
TransactionManager.Instance.TransactionTaskDone()

OUT = message,_fdoc,paths
# ----------------------------------------
code_block = CodeBlock(x=python_script) { x[2]; x[1]; x[0]; }
end = Revit.Transaction.Transaction.End(code_block.out1)
saveAs_Document_ByPath = Custom[SaveAs_Document_ByPath](SavePath=code_block.out0, Doc=end)  # Saves a document to a path of choice
Save_Result = Output(saveAs_Document_ByPath)  # "Save.Result"
Save_Path_2 = Output(code_block.out0)  # "Save.Path"
Add_Result = Output(code_block.out2)  # "Add.Result"
