# Dynamo custom node Align_SheetViews_ByTemplate.dyf (Dynamo 1.3.2.2480)
# category: ArupBimSF.Revit.Views_Sheets
# Align the views on input sheets based on the location of views on a template sheet.  Set your view perfectly on one sheet and match the location on many

Sheets = Input()
code_block = CodeBlock(a=Sheets) { Flatten({a}); }

# group: Get schedules from other sheets
python_script = Python(IN[0]=code_block)
# ---------- python_script.python (22 lines) ----------
import clr
clr.AddReference('RevitAPI')
from Autodesk.Revit.DB import *

clr.AddReference("RevitServices")
import RevitServices
from RevitServices.Persistence import DocumentManager

doc = DocumentManager.Instance.CurrentDBDocument
sheets = UnwrapElement(IN[0])
elementlist = list()

for sheet in sheets:
	try:
		viewlist = list()
		collector = FilteredElementCollector(doc, sheet.Id).OfClass(ScheduleSheetInstance)
		for item in collector:
			viewlist.append(doc.GetElement(item.ScheduleId))
		elementlist.append(viewlist)
	except:
		elementlist.append(list())
OUT = elementlist
# ----------------------------------------

TemplateSheet = Input()
code_block_2 = CodeBlock(a=TemplateSheet) { Flatten({a}); }

# group: Get schedules from template sheet, and get columns width
python_script_2 = Python(IN[0]=code_block_2)  # same code as python_script
sched_get_column_width = Custom[Sched_Get Column Width](Sched_In=python_script_2)  # Get the Width of schedule on sheet

# group: Set schedule column width
sched_set_column_width = Custom[Sched_Set Column Width](Width_list=sched_get_column_width)  # SEt the Column Width of Schedules on sheets; unwired: Sched_in
map = List.Map(list=python_script, f_x=sched_set_column_width)

get_Viewports_FromSheets = Custom[Get_Viewports_FromSheets](Sheet=code_block_2)  # Get the Viewports from input sheets
get_Viewports_FromSheets_2 = Custom[Get_Viewports_FromSheets](Sheet=code_block_2)

# group: Get viewports from template sheet, get center points from viewport
code_block_3 = CodeBlock(a=get_Viewports_FromSheets_2) { Flatten({a}); }
viewport_get_center_point = Custom[Viewport_Get Center Point](Viewports=code_block_3)  # get the centerpoint of input views

# group: Set viewport center
viewport_set_box_center = Custom[Viewport_Set Box Center](Points=viewport_get_center_point)  # Sets the location of the viewport Center point (moving the view on its sheet); unwired: Viewport_list
map_2 = List.Map(list=get_Viewports_FromSheets, f_x=viewport_set_box_center)

# group: Get schedule on sheet, get point and set point for others
python_script_3 = Python(IN[0]=code_block_2)
# ---------- python_script_3.python (22 lines) ----------
import clr
clr.AddReference('RevitAPI')
from Autodesk.Revit.DB import *

clr.AddReference("RevitServices")
import RevitServices
from RevitServices.Persistence import DocumentManager

doc = DocumentManager.Instance.CurrentDBDocument
sheets = UnwrapElement(IN[0])
elementlist = list()

for sheet in sheets:
	viewlist = list()
	collector = FilteredElementCollector(doc, sheet.Id).OfClass(ScheduleSheetInstance)
	for item in collector:
		try:
			viewlist.append(item.Point)
		except:
			0
	
OUT = viewlist
# ----------------------------------------
python_script_4 = Python(IN[0]=code_block, IN[1]=python_script_3)
# ---------- python_script_4.python (31 lines) ----------
import clr
clr.AddReference('RevitAPI')
from Autodesk.Revit.DB import *

clr.AddReference("RevitServices")
import RevitServices
from RevitServices.Persistence import DocumentManager
from RevitServices.Transactions import TransactionManager

doc = DocumentManager.Instance.CurrentDBDocument
sheets = UnwrapElement(IN[0])
pts = UnwrapElement(IN[1])
elementlist = list()

# Start Transaction
TransactionManager.Instance.EnsureInTransaction(doc)


for sheet in sheets:
	viewlist = list()
	collector = FilteredElementCollector(doc, sheet.Id).OfClass(ScheduleSheetInstance)
	for item,p in zip(collector,pts):
		if item.IsTitleblockRevisionSchedule == 0:
			item.Point=p
			elementlist.append(viewlist)			
		else:
			0
#doc.Regenerate()
# End Transaction
TransactionManager.Instance.TransactionTaskDone()	
OUT = elementlist
# ----------------------------------------
