# Dynamo custom node Analyze_CreateLinearLoad.dyf (Dynamo 1.3.2.2480)
# category: ArupBimSF.Revit.Structural
# Creation of linear loads on analytical stick elements

elements = Input()  # "elements[]"; Set of elements that need to be provided with linear loads
force = Input(force:Vector)  # Linear force expressed in N/m Direction indicated by a vector
moment = Input(moment:Vector)  # Moment expressed in N.m Direction indicated by a vector
LineLoadType = Input()  # Line Load Type (hosted or non-hosted) Input should be of type Autodesk.Revit.DB.Structure.LineLoadType;
loadCase = Input(loadCase:int)
python_script = Python(IN[0]=elements, IN[1]=force, IN[2]=moment, IN[3]=LineLoadType, IN[4]=loadCase)
# ---------- python_script.python (56 lines) ----------
import clr
clr.AddReference('ProtoGeometry')
from Autodesk.DesignScript.Geometry import *

clr.AddReference('RevitAPI')
from Autodesk.Revit.DB import *
from Autodesk.Revit.DB.Structure import *

clr.AddReference('System')
from System.Collections.Generic import List

clr.AddReference('RevitNodes')
import Revit
clr.ImportExtensions(Revit.GeometryConversion)
clr.ImportExtensions(Revit.Elements)

clr.AddReference('RevitServices')
import RevitServices
from RevitServices.Persistence import DocumentManager
from RevitServices.Transactions import TransactionManager

doc = DocumentManager.Instance.CurrentDBDocument

lineloads = []

#The inputs to this node will be stored as a list in the IN variables.
elements = UnwrapElement(IN[0])
force = IN[1].ToXyz()
moment = IN[2].ToXyz()
LLType = UnwrapElement(IN[3])
case = IN[4]

TransactionManager.Instance.EnsureInTransaction(doc)

loadCasesCollector = FilteredElementCollector(doc).OfClass(LoadCase)
loadCases = []
for c in loadCasesCollector:
	loadCases.append(c)


if len(loadCases)>0 and case<=len(loadCases):
	loadCase = loadCases[case-1]
else:
	loadCase = 0


for i in range(0, len(elements)):
	ll = LineLoad.Create(doc, elements[i], force, moment, LLType)
	if loadCase != 0:
		ll.LoadCaseId = loadCase.Id
	lineloads.append(ll)
	
TransactionManager.Instance.TransactionTaskDone()

#Assign your output to the OUT variable.
OUT = lineloads
# ----------------------------------------
LineLoads = Output(python_script)
