# Dynamo custom node Boolean_Reverse.dyf (Dynamo 1.3.2.2480)
# category: ArupBimSF.Boolean
# Reverses a boolean Input.

Input = Input()
code_block = CodeBlock { true; }
eq = _ == code_block  # unwired: arg0; lacing=Longest
code_block_2 = CodeBlock { false; }
if_ = If(test=eq, true=code_block_2)  # unwired: false
map = List.Map(list=Input, f_x=if_)
Output = Output(map)
