# Dynamo custom node Boolean_String Output.dyf (Dynamo 1.3.2.2480)
# category: ArupBimSF.Boolean
# takes a boolean input to a this or that String output

string = StringInput("""import clr
clr.AddReference('ProtoGeometry')
from Autodesk.DesignScript.Geometry import *
#The inputs to this node will be stored as a list in the IN variable.
dataEnteringNode = IN

stringList = []
for x in dataEnteringNode[0]:
 try:
  tempString = str(x)
 except:
  tempString = "stringConversionFailed"
 stringList.append(tempString)
#Assign your output to the OUT variable
OUT = stringList""")
String_if_True = Input()
String_if_False = Input()
create = List.Create(String_if_True, String_if_False)
flatten = Flatten(create)
python_script_from_string = PythonStringNode(script=string, IN[0]=flatten)
Boolean_In = Input()
create_2 = List.Create(Boolean_In)
flatten_2 = Flatten(create_2)
python_script_from_string_2 = PythonStringNode(script=string, IN[0]=flatten_2)
boolean = BoolSelector(true)
boolean_2 = BoolSelector(false)
create_3 = List.Create(boolean, boolean_2)
flatten_3 = Flatten(create_3)
python_script_from_string_3 = PythonStringNode(script=string, IN[0]=flatten_3)
list_compare_match_index = Custom[List.Compare_Match Index](searchForThese=python_script_from_string_2, inThisList=python_script_from_string_3)  # Find matching index values, IF equal value found, return index of equals
getItemAtIndex = List.GetItemAtIndex(list=python_script_from_string, index=list_compare_match_index)
firstItem = List.FirstItem(getItemAtIndex)
String_Output = Output(firstItem)
