# Dynamo custom node Boolean_To_Integer.dyf "Boolean➜Integer" (Dynamo 1.3.2.2480)
# category: ArupBimSF.Boolean
# converts a boolean input to an integer

code_block = CodeBlock { false; }
code_block_2 = CodeBlock { true; }
create = List.Create(code_block, code_block_2)
item = Input(item : var)
firstIndexOf = List.FirstIndexOf(list=create, item=item)
int = Output(firstIndexOf)
