# Dynamo custom node BoundingBox_CenterPoint.dyf (Dynamo 1.3.2.2480)
# category: ArupBimSF.Revit.Views & Sheets
# Input Bounding Box element to get its center point. This node is little and lightweight, as it doesn't convert bounding box to geometry to get its centroid point.

boundingBox = Input(boundingBox : BoundingBox)  # Input Bounding Box element(s)
minPoint = BoundingBox.MinPoint(boundingBox)
maxPoint = BoundingBox.MaxPoint(boundingBox)
byStartPointEndPoint = Line.ByStartPointEndPoint(startPoint=minPoint, endPoint=maxPoint)
code_block = CodeBlock { 0.5; }
pointAtParameter = Curve.PointAtParameter(curve=byStartPointEndPoint, param=code_block)
Point = Output(pointAtParameter)  # Bounding Box center point
