# Dynamo custom node BoundingBox_Dimensions.dyf (Dynamo 1.3.2.2480)
# category: ArupBimSF.Revit.Views & Sheets
# Input Bounding Box element to get its dimensions (Width, Length, Height). Setting Boolean switch to True rounds output values.

roundValues = Input(roundValues : Boolean = false)  # Setting Boolean switch to True rounds output values
boundingBox = Input(boundingBox : BoundingBox)  # Input Bounding Box element(s)
toCuboid = BoundingBox.ToCuboid(boundingBox)
width = Cuboid.Width(toCuboid)
round = Math.Round(width)
if_ = If(test=roundValues, true=round, false=width)
Width = Output(if_)
length = Cuboid.Length(toCuboid)
round_2 = Math.Round(length)
if_2 = If(test=roundValues, true=round_2, false=length)
Length = Output(if_2)
height = Cuboid.Height(toCuboid)
round_3 = Math.Round(height)
if_3 = If(test=roundValues, true=round_3, false=height)
Height = Output(if_3)
