# Dynamo custom node Bracing_V.dyf (Dynamo 1.3.2.2480)
# category: ArupBimSF.Geometry
# Creates V bracing between two lists of points

PointsList_Curve1 = Input()
code_block = CodeBlock { n=2; offset=1; }
takeEveryNthItem = List.TakeEveryNthItem(arg1=code_block.n)  # unwired: arg0
map = List.Map(list=PointsList_Curve1, f_x=takeEveryNthItem)
PointsList_Curve2 = Input()
takeEveryNthItem_2 = List.TakeEveryNthItem(arg1=code_block.n, arg2=code_block.offset)  # unwired: arg0
map_2 = List.Map(list=PointsList_Curve2, f_x=takeEveryNthItem_2)
byStartPointEndPoint = Line.ByStartPointEndPoint(startPoint=map, endPoint=map_2)
restOfItems = List.RestOfItems()  # unwired: arg0
map_3 = List.Map(list=map_2, f_x=restOfItems)
byStartPointEndPoint_2 = Line.ByStartPointEndPoint(startPoint=map, endPoint=map_3)
join = List.Join(byStartPointEndPoint, byStartPointEndPoint_2)
DiagonalLines = Output(join)
