# Dynamo custom node Bracing_X.dyf (Dynamo 1.3.2.2480)
# category: ArupBimSF.Geometry
# Create bracing between two lists of points

PointsListCurve1 = Input()
code_block = CodeBlock { n=2; offset=1; }
takeEveryNthItem = List.TakeEveryNthItem(PointsListCurve1@L2, code_block.n)
PointsListCurve2 = Input()
takeEveryNthItem_2 = List.TakeEveryNthItem(PointsListCurve2@L2, code_block.n, code_block.offset)
byStartPointEndPoint = Line.ByStartPointEndPoint(startPoint=takeEveryNthItem, endPoint=takeEveryNthItem_2)
restOfItems = List.RestOfItems(takeEveryNthItem_2@L2)
byStartPointEndPoint_2 = Line.ByStartPointEndPoint(startPoint=takeEveryNthItem, endPoint=restOfItems)
code_block_2 = CodeBlock { n=2; offset=1; }
takeEveryNthItem_3 = List.TakeEveryNthItem(PointsListCurve2@L2, code_block_2.n)
takeEveryNthItem_4 = List.TakeEveryNthItem(PointsListCurve1@L2, code_block_2.n, code_block_2.offset)
byStartPointEndPoint_3 = Line.ByStartPointEndPoint(startPoint=takeEveryNthItem_3, endPoint=takeEveryNthItem_4)
restOfItems_2 = List.RestOfItems(takeEveryNthItem_4@L2)
byStartPointEndPoint_4 = Line.ByStartPointEndPoint(startPoint=takeEveryNthItem_3, endPoint=restOfItems_2)
create = List.Create(byStartPointEndPoint, byStartPointEndPoint_2, byStartPointEndPoint_3, byStartPointEndPoint_4)
DiagonalLines = Output(create)
