# Dynamo custom node Collect All_LineStyles In Document.dyf (Dynamo 1.3.2.2480)
# category: Revit.Elements.CurveElement
# get linstyle attributes for all styles in project

ReFresh = Input(ReFresh:bool=true)  # To refresh, input a bool and switch its current state
python_script = Python()
# ---------- python_script.python (34 lines) ----------
import clr

# Import DocumentManager and TransactionManager
clr.AddReference("RevitServices")
import RevitServices
from RevitServices.Persistence import DocumentManager

# Import RevitAPI
clr.AddReference("RevitAPI")
import Autodesk
from Autodesk.Revit.DB import *

doc = DocumentManager.Instance.CurrentDBDocument

lineStyle = doc.Settings.Categories.get_Item( BuiltInCategory.OST_Lines )
lineStyleSubTypes = lineStyle.SubCategories

listNames = []
listRGB = []
lineWeight = []
graphicStyles = []
for i in lineStyleSubTypes:
	rgb = [i.LineColor.Red, i.LineColor.Green, i.LineColor.Blue]
	weight = i.GetLineWeight(GraphicsStyleType.Projection)
	
	listNames.append(i.Name)
	listRGB.append(rgb)
	lineWeight.append(weight)
	graphicStyles.Add( i.GetGraphicsStyle(GraphicsStyleType.Projection) )


syncSort = sorted( zip(listNames, lineWeight, listRGB, graphicStyles), key=lambda name: name[0] )

OUT = syncSort
# ----------------------------------------
transpose = List.Transpose(python_script)
code_block = CodeBlock(lineStyles=transpose)
# ---------- code_block.designscript (4 lines) ----------
lineStyleNames = lineStyles[0];
lineStyleWeights = lineStyles[1];
lineStyleColour = lineStyles[2];
revitLineStyles = lineStyles[3];
# ----------------------------------------
LineStyle_Name = Output(code_block.lineStyleNames)
LineStyle_Weight = Output(code_block.lineStyleWeights)
list_merge_array_to_delim_string = Custom[List_Merge Array to Delim String+](Array_In=code_block.lineStyleColour, lacing=Longest)  # Converts a list into a comma deliminated string
LineStyle_Color = Output(list_merge_array_to_delim_string.String_Out)
code_block_2 = CodeBlock { RightEnd : string = "}"; }
code_block_3 = CodeBlock { ","; }
string_from_object = FromObject()  # unwired: arg0
join = String.Join(code_block_3, string_from_object)
GraphicStyle = Output(code_block.revitLineStyles)
code_block_4 = CodeBlock { {"lineStyleName","LinstyleWeight","LineStyleColor","Element Id"}; }
id = Element.Id(code_block.revitLineStyles)
create = List.Create(code_block.lineStyleNames, code_block.lineStyleWeights, list_merge_array_to_delim_string.String, id)
addItemToFront = List.AddItemToFront(item=code_block_4, list=create, lacing=Longest)
DataOut_LineStyles = Output(addItemToFront)
