# Dynamo custom node Collect_Categories_FromDocument.dyf (Dynamo 1.3.2.2480)
# category: ArupBimSF.Revit.Document
# collect all categories in active document

python_script = Python()  # unwired: IN[0]
# ---------- python_script.python (37 lines) ----------
import clr
clr.AddReference('RevitAPI')
from Autodesk.Revit.DB import *

clr.AddReference("RevitNodes")
import Revit
clr.ImportExtensions(Revit.Elements)
clr.ImportExtensions(Revit.GeometryConversion)

clr.AddReference("RevitServices")
import RevitServices
from RevitServices.Persistence import DocumentManager
from RevitServices.Transactions import TransactionManager

doc = DocumentManager.Instance.CurrentDBDocument
categories = doc.Settings.Categories

model_cat = []
anno_cat = []
ana_cat = []
internal_cat = []

for c in categories:
	if c.CategoryType == CategoryType.Model:
		if c.SubCategories.Size > 0 or c.CanAddSubcategory:
			model_cat.append(Revit.Elements.Category.ById(c.Id.IntegerValue))
		else:
			continue
	elif c.CategoryType == CategoryType.Annotation:
		anno_cat.append(Revit.Elements.Category.ById(c.Id.IntegerValue))
	elif c.CategoryType == CategoryType.AnalyticalModel:
		ana_cat.append(Revit.Elements.Category.ById(c.Id.IntegerValue))
	elif c.CategoryType == CategoryType.Internal:
		internal_cat.append(Revit.Elements.Category.ById(c.Id.IntegerValue))
		

OUT = model_cat, anno_cat, ana_cat, internal_cat
# ----------------------------------------
ReFresh = Input(ReFresh : bool = true)
code_block = CodeBlock(python_script, ReFresh)
# ---------- code_block.designscript (11 lines) ----------
list;
come;

[Imperative]

{
 if (come ==true)
  return = list;
 else
  return = list;
};
# ----------------------------------------
string_from_object = FromObject()  # unwired: arg0
sortByFunction = SortByFunction(arg1=string_from_object)  # unwired: arg0
map = List.Map(list=code_block.out2, f_x=sortByFunction)
code_block_2 = CodeBlock(x=map) { x[0]; }
code_block_3 = CodeBlock { ".dwg"; }
object_string_contains_basic = Custom[Object➜String.Contains_Basic](List_In=code_block_2, Search_For=code_block_3)  # filters a list of objects for input string values
Model_categories = Output(object_string_contains_basic.Others)
code_block_4 = CodeBlock(x=map) { x[1]; }
code_block_5 = CodeBlock { "tags"; }
object_string_contains_basic_2 = Custom[Object➜String.Contains_Basic](List_In=code_block_4, Search_For=code_block_5)
Annotation_categories = Output(object_string_contains_basic_2.Others)
Annotation_Tags = Output(object_string_contains_basic_2.Match)
code_block_6 = CodeBlock(x=map) { x[2]; }
Analytical_categories = Output(code_block_6)
code_block_7 = CodeBlock(x=map) { x[3]; }
Internal_categories = Output(code_block_7)
Dwg_File_Names = Output(object_string_contains_basic.Match)
