# Dynamo custom node Collect_ElementTypes_All.dyf (Dynamo 1.3.2.2480)
# category: ArupBimSF.^TestingGrounds
# collect all element types in document

Refresh = Input(Refresh : bool = false)
RunMe = Input(RunMe : bool = false)
element_types = ElementTypes("ElementType")
runme = Python(IN[0]=RunMe, IN[1]=element_types)
# ---------- runme.python (6 lines) ----------
bool=IN[0]

if bool == True:
	OUT=IN[1]
else:
	OUT=0
# ----------------------------------------
action_ReFresh = Custom[Action_ReFresh](Refresh=Refresh, list=runme)  # add to the front of a workflow to allow it to be refreshed with a boolean node
all_elements_of_type = ElementsOfType(action_ReFresh)

# group: Filter unknown elements
type = Object.Type(all_elements_of_type)
code_block = CodeBlock { "Revit.Elements.UnknownElement"; }
eq = _ == code_block  # unwired: arg0
map = List.Map(list=type, f_x=eq)
filterByBoolMask = List.FilterByBoolMask(list=all_elements_of_type, mask=map)

# group: KnownTypes_grouped by object type
type_2 = Object.Type(filterByBoolMask.out)
code_block_2 = CodeBlock { "Revit.Elements."; }
split = String.Split(type_2, code_block_2)
flatten = Flatten(split)
groupByKey = List.GroupByKey(list=filterByBoolMask.out, keys=flatten)

firstPass_Keys_ByObjectType = Object.Identity(groupByKey.unique_keys)

# group: Filter "ElementType" Elements
string_from_object = FromObject(filterByBoolMask.in)
code_block_3 = CodeBlock { "ElementType"; }
eq_2 = string_from_object == code_block_3
filterByBoolMask_2 = List.FilterByBoolMask(list=filterByBoolMask.in, mask=eq_2)

# group: Elements That Have Types
string_from_object_2 = FromObject(filterByBoolMask_2.out)
groupByKey_2 = List.GroupByKey(list=filterByBoolMask_2.out, keys=string_from_object_2)

code_block_4 = CodeBlock { {"DwgElementTypes","ImageElementTypes"}; }

# group: Filter Elements With No Category
getCategory = Element.GetCategory(filterByBoolMask_2.in)
string_from_object_3 = FromObject(getCategory)
code_block_5 = CodeBlock { ""; }
eq_3 = string_from_object_3 == code_block_5
filterByBoolMask_3 = List.FilterByBoolMask(list=filterByBoolMask_2.in, mask=eq_3)
filterByBoolMask_4 = List.FilterByBoolMask(list=string_from_object_3, mask=eq_3)

# group: FILTER DWGS
code_block_6 = CodeBlock { ".dwg"; }
contains = String.Contains(str=filterByBoolMask_4.out, searchFor=code_block_6)
filterByBoolMask_5 = List.FilterByBoolMask(list=filterByBoolMask_3.out, mask=contains)

get_workset_name = Custom[Get_Workset Name+](element=filterByBoolMask_5.out)  # get the workset for input elements

# group: NO CATEGORY_SO WE WILL GROUP BY "FAMILY NAME"
code_block_7 = CodeBlock { "Family Name"; }
getParameterValueByName = Element.GetParameterValueByName(element=filterByBoolMask_3.in, parameterName=code_block_7)
code_block_8 = CodeBlock { "Decal"; }
contains_2 = String.Contains(str=getParameterValueByName, searchFor=code_block_8)
filterByBoolMask_6 = List.FilterByBoolMask(list=filterByBoolMask_3.in, mask=contains_2)
filterByBoolMask_7 = List.FilterByBoolMask(list=getParameterValueByName, mask=contains_2)
groupByKey_3 = List.GroupByKey(list=filterByBoolMask_6.out, keys=filterByBoolMask_7.out)
images = Object.Identity(filterByBoolMask_6.in)

# group: By Workset Name
groupByKey_4 = List.GroupByKey(list=filterByBoolMask_5.out, keys=get_workset_name.WorksetName)
dwgs = Object.Identity(filterByBoolMask_5.in)
create = List.Create(dwgs, images)
thirdPass_Groups_ByCategory = Object.Identity(groupByKey_4.groups)

thirdPass_Keys_ByCategory = Object.Identity(groupByKey_4.unique_keys)
join = List.Join(firstPass_Keys_ByObjectType, groupByKey_2.unique_keys, code_block_4, thirdPass_Keys_ByCategory, groupByKey_3.unique_keys)
sortByKey = List.SortByKey(list=join, keys=join)
Types = Output(sortByKey.sorted_list)
firstPass_Groups_ByObjectType = Object.Identity(groupByKey.groups)
join_2 = List.Join(firstPass_Groups_ByObjectType, groupByKey_2.groups, create, thirdPass_Groups_ByCategory, groupByKey_3.groups)
sortByKey_2 = List.SortByKey(list=join_2, keys=join)
All_Elements = Output(sortByKey_2.sorted_list)
code_block_9 = CodeBlock {  }
