# Dynamo custom node Collect_ModelGroup Types.dyf (Dynamo 1.3.2.2480)
# category: ArupBimSF.Revit.Element_Collectors
# collect all model groups in current project

python_script = Python()
# ---------- python_script.python (33 lines) ----------
import clr
clr.AddReference('ProtoGeometry')
from Autodesk.DesignScript.Geometry import *

# Import DocumentManager
clr.AddReference('RevitServices')
import RevitServices
from RevitServices.Persistence import DocumentManager

# Import Revit API
clr.AddReference('RevitAPI')
import Autodesk.Revit.DB
from Autodesk.Revit.DB import *

# Import ToDSType(bool) extension method
clr.AddReference('RevitNodes')
import Revit
clr.ImportExtensions(Revit.Elements)

def GetModelGroupTypes(doc):
  return list(
      modelGroupType.ToDSType(True) for modelGroupType in
      FilteredElementCollector(doc)
      .OfCategory(BuiltInCategory.OST_IOSModelGroups)
      .OfClass(GroupType)
    )

doc = DocumentManager.Instance.CurrentDBDocument

modelGroupTypes = GetModelGroupTypes(doc)

#Assign your output to the OUT variable.
OUT = modelGroupTypes
# ----------------------------------------
ModelGroupTypes = Output(python_script)
