# Dynamo custom node Collect_ViewFilters_FromDoc.dyf (Dynamo 1.3.2.2480)
# category: ArupBimSF.Revit.Document
# Gets all the view filters in the active document

python_script = Python()
# ---------- python_script.python (32 lines) ----------
import clr
clr.AddReference('ProtoGeometry')
from Autodesk.DesignScript.Geometry import *

# Import DocumentManager and TransactionManager
clr.AddReference("RevitServices")
import RevitServices
from RevitServices.Persistence import DocumentManager
from RevitServices.Transactions import TransactionManager

# Import RevitAPI
clr.AddReference("RevitAPI")
import Autodesk
from Autodesk.Revit.DB import *

doc = DocumentManager.Instance.CurrentDBDocument

from System.Collections.Generic import *

# Import ToDSType(bool) extension method
clr.AddReference("RevitNodes")
import Revit
clr.ImportExtensions(Revit.Elements)

#collect all views in the model
collector = FilteredElementCollector(doc)
views = collector.OfClass(FilterElement).ToElements()

view = []
for i in views:
	view.append(i.ToDSType(True))
OUT = view
# ----------------------------------------
Element = Output(python_script)
get_element_id = Custom[Get_Element Id+](Elements=python_script)  # Gets Revit element Id and GUID for input elements
flatten = Flatten(get_element_id.Id_As_Integer)
Id = Output(flatten)
name = Element.Name(python_script)
Name = Output(name)
