# Dynamo custom node Compare_Set Difference.dyf (Dynamo 1.3.2.2480)
# category: ArupBimSF.^TestingGrounds
# compares two input sets of elements and checks for differences

list1 = Input(list1:var[])
list2 = Input(list2:var[])
code_block = CodeBlock(list1, list2)
# ---------- code_block.designscript (15 lines) ----------
def NullSetDiff(newl:var[], oldl:var[])
{
return = [Imperative]
{
if (oldl != null)
{
return = SetDifference(newl,oldl);
}
else
{
return = newl;
}
}
};
NullSetDiff(l1, l2);
# ----------------------------------------
list = Output(code_block)
