# Dynamo custom node Convert_YYMMDD to WrittenDate.dyf (Dynamo 1.3.2.2480)
# category: ArupBimSF.Time
# converts input date  in yymmdd format to a written date

DateIn_YYMMDD = Input(DateIn_YYMMDD:var = "")  # enter the date as an integer or string in yymmdd format
code_block = CodeBlock { ""; }
eq = DateIn_YYMMDD == code_block
code_block_2 = CodeBlock { 2000; }
code_block_3 = CodeBlock { DSCore.DateTime.Now; }
if_ = If(test=eq, true=code_block_3, false=DateIn_YYMMDD)
action_runme_if = Custom[Action_RunMe If](List_In=if_, Run_If_Not=DateIn_YYMMDD)  # uses a run_me node if input does note eqaul ""#Action
string_from_object = FromObject(action_runme_if)
code_block_4 = CodeBlock(t4=string_from_object) { t3 = String.Length(t4); n = t3; t1 = (0..n - 1); t5 = String.Substring(t4, t1, 1); }
code_block_5 = CodeBlock { 2; }
chop = List.Chop(list=code_block_4.t5, lengths=code_block_5)
code_block_6 = CodeBlock { ""; }
list_MergeSublists = Custom[List_MergeSublists](List=chop, Seperator=code_block_6)  # Merges sublists into strings with seperator_!!List.Functions
flatten = Flatten(list_MergeSublists)
toNumber = String.ToNumber(flatten, lacing=Longest)
code_block_7 = CodeBlock(x=toNumber) { x[0]; x[1]; x[2]; }
code_block_8 = CodeBlock(z=code_block_2, b=code_block_7.out0) { z+b; }
byDate = DateTime.ByDate(code_block_8, code_block_7.out1, code_block_7.out2)
graph_SeqPassthru = Custom[Graph_SeqPassthru](passThrough=eq, waitFor=byDate)  # forces an operation to run in sequence.
if_2 = If(test=graph_SeqPassthru, true=if_, false=byDate)
DateOut = Output(if_2)
