# Dynamo custom node Copy_ElementToLocation.dyf "Copy_Element➜Location" (Dynamo 1.3.2.2480)
# category: ArupBimSF.Revit.Element_Location
# copies elements to input locations and updates the host level of the elements

Element = Input()
Location = Input()
python_script = Python(IN[0]=Element, IN[1]=Location)
# ---------- python_script.python (54 lines) ----------
import clr

clr.AddReference("RevitServices")
import RevitServices
from RevitServices.Persistence import DocumentManager
from RevitServices.Transactions import TransactionManager
doc = DocumentManager.Instance.CurrentDBDocument

clr.AddReference("RevitAPI")
import Autodesk
from Autodesk.Revit.DB import *

clr.AddReference("RevitNodes")
import Revit
clr.ImportExtensions(Revit.Elements)
clr.ImportExtensions(Revit.GeometryConversion)

from System.Collections.Generic import List
#The inputs to this node will be stored as a list in the IN variables.
if isinstance(IN[0],list):
	elements = UnwrapElement(IN[0])
else:
	elements = [UnwrapElement(IN[0])]
if isinstance(IN[1], list):
	newlocations = [x.ToXyz() for x in IN[1]]
else:
	newlocations = [IN[1].ToXyz()]

newelements = []

options = CopyPasteOptions()
elementlist = List[ElementId]()
	
TransactionManager.Instance.EnsureInTransaction(doc)
for element,loc in zip(elements,newlocations):
	try:
		oldloc = element.Location.Point
		
		elementlist.Add(element.Id)
		OffsetZ = (oldloc.Z - loc.Z)*-1
		OffsetX = (oldloc.X - loc.X)*-1
		OffsetY = (oldloc.Y - loc.Y)*-1
		direction = XYZ(OffsetX,OffsetY,OffsetZ)
		trans = Transform.CreateTranslation(direction)
		newelementId = ElementTransformUtils.CopyElements(doc,elementlist,doc,trans,options)
		elementlist.Clear()
		newelement = doc.GetElement(newelementId[0])
		newelements.append(newelement.ToDSType(False))
	except:
		newelements.append(None)

TransactionManager.Instance.TransactionTaskDone()
#Assign your output to the OUT variable.
OUT = newelements
# ----------------------------------------
New_Element = Output(python_script)
