# Dynamo custom node Copy_LegendViews_ToSheets.dyf (Dynamo 1.3.2.2480)
# category: ArupBimSF.^TestingGrounds
# Copy_LegendView_ToSheets

Legend_to_Copy = Input()
Sheets_to_Copy_To = Input()
Location = Input()
python_script = Python(IN[0]=Legend_to_Copy, IN[1]=Sheets_to_Copy_To, IN[2]=Location)
# ---------- python_script.python (38 lines) ----------
import clr
# import Document Manager
clr.AddReference("RevitServices")
import RevitServices 
from RevitServices.Persistence import DocumentManager
from RevitServices.Transactions import TransactionManager
doc = DocumentManager.Instance.CurrentDBDocument
uidoc = DocumentManager.Instance.CurrentUIDocument
clr.AddReference("RevitNodes")
import Revit
clr.ImportExtensions(Revit.Elements)
clr.ImportExtensions(Revit.GeometryConversion)
clr.AddReference("RevitAPI")
from Autodesk.Revit.DB import *

dataEnteringNode = IN

legend = UnwrapElement(IN[0])
sheets = IN[1]
loc = XYZ(IN[2].X, IN[2].Y, IN[2].Z)
viewports = []
failed = []

for vs in sheets:
	sheet = UnwrapElement(vs)
	canAddToSht = Viewport.CanAddViewToSheet(doc, sheet.Id, legend.Id)
	if canAddToSht:
		try:		
			TransactionManager.Instance.EnsureInTransaction(doc)	
			viewport = Viewport.Create(doc, sheet.Id, legend.Id, loc)	
			TransactionManager.Instance.TransactionTaskDone()
			viewports.Add([viewport,sheet])
		except:
			failed.Add(["Failed",sheet])
	else:
		failed.Add(["Failed",sheet])
		
OUT = [viewports, failed]
# ----------------------------------------
succeded = CodeBlock(a=python_script) { a[0]; }
Output = Output(succeded)  # ""
failed = CodeBlock(a=python_script) { a[1]; }
Output_2 = Output(failed)  # ""
