# Dynamo custom node Create_CeilingPlan_ByViewTemplate.dyf (Dynamo 1.3.2.2480)
# category: ArupBimSF.Revit.Views & Sheets
# Creates a Floorplan view and applies a View Template.  Also Gererates the ViewName based on the View Template Name#View#VT

Levels = Input()
list_assurance = Python(IN[0]=Levels)
# ---------- list_assurance.python (13 lines) ----------
import clr
clr.AddReference('ProtoGeometry')
from Autodesk.DesignScript.Geometry import *
#The inputs to this node will be stored as a list in the IN variables.
input = IN[0]

if isinstance(input,list) == False:
	elements = [input]
else:
	elements = input

#Assign your output to the OUT variable.
OUT = elements
# ----------------------------------------
flatten = Flatten(list_assurance)
TempNames = Input()
list_assurance_2 = Python(IN[0]=TempNames)  # same code as list_assurance
flatten_2 = Flatten(list_assurance_2)
count = Count(flatten_2)
ofRepeatedItem = List.OfRepeatedItem(amount=count)  # unwired: item
map = List.Map(list=flatten, f_x=ofRepeatedItem)
byLevel = CeilingPlanView.ByLevel(map)
code_block = CodeBlock { "View Name"; }
code_block_2 = CodeBlock { "Name"; }
getParameterValueByName = Element.GetParameterValueByName(element=map, parameterName=code_block_2)
count_2 = Count(flatten)
cycle = List.Cycle(list=flatten_2, amount=count_2)
chop = List.Chop(list=cycle, lengths=count)
code_block_3 = CodeBlock(a=getParameterValueByName, b=chop) { a+"_"+b; }
setParameterByName = Element.SetParameterByName(element=byLevel, parameterName=code_block, value=code_block_3)
flatten_3 = Flatten(setParameterByName)
flatten_4 = Flatten(chop)
python_script = Python(IN[0]=flatten_3, IN[1]=flatten_4)
# ---------- python_script.python (39 lines) ----------
import clr
clr.AddReference('ProtoGeometry')
from Autodesk.DesignScript.Geometry import *

# Import DocumentManager and TransactionManager
clr.AddReference("RevitServices")
import RevitServices
from RevitServices.Persistence import DocumentManager
from RevitServices.Transactions import TransactionManager

# Import RevitAPI
clr.AddReference("RevitAPI")
import Autodesk
from Autodesk.Revit.DB import *

doc = DocumentManager.Instance.CurrentDBDocument

#The inputs to this node will be stored as a list in the IN variable.
views = UnwrapElement(IN[0])
viewTempName = IN[1]
templateList = []

collector = FilteredElementCollector(doc).OfClass(View)
for j in viewTempName:
	for i in collector:
		if i.IsTemplate == True and i.Name == j:
			templateList.append(i)

TransactionManager.Instance.EnsureInTransaction(doc)
h = 0
for i in views:
	TempTemplate = templateList[h]
	i.ViewTemplateId = TempTemplate.Id
	h=h+1

TransactionManager.Instance.TransactionTaskDone()

#Assign your output to the OUT variable
OUT = views
# ----------------------------------------
Views = Output(python_script)
get_NumbersFromString = Custom[Get_NumbersFromString](str=getParameterValueByName)
code_block_4 = CodeBlock { "L0"; }
code_block_5 = CodeBlock { 1; }
obj_string_matchlength = Custom[Obj➜String_MatchLength](List_In=get_NumbersFromString.string, Pad_With=code_block_4, ExtraPad=code_block_5)  # converts input object to flat list of strings and matches the length of all strings to that of the longest item in list
