# Dynamo custom node Create_FamilyType_FE.dyf (Dynamo 1.3.2.2480)
# category: ArupBimSF.Revit.FamilyEditor
# Creates a new family type inside of family editor._!!FE

NewTypeName = Input(NewTypeName : string)
create_new_types = Python(IN[0]=NewTypeName)
# ---------- create_new_types.python (29 lines) ----------
import clr

clr.AddReference("RevitServices")
import RevitServices
from RevitServices.Persistence import DocumentManager
from RevitServices.Transactions import TransactionManager
doc = DocumentManager.Instance.CurrentDBDocument

clr.AddReference("RevitAPI")
import Autodesk
from Autodesk.Revit.DB import *

clr.AddReference("RevitNodes")
import Revit
clr.ImportExtensions(Revit.Elements)
clr.ImportExtensions(Revit.GeometryConversion)

types = IN[0]


FamilyMan = doc.FamilyManager
TransactionManager.Instance.EnsureInTransaction(doc)
try:
	newtype = FamilyMan.NewType(types)
except:
	newtype = "could not create new type"
TransactionManager.Instance.TransactionTaskDone()

OUT = newtype
# ----------------------------------------
NewType = Output(create_new_types)
