# Dynamo custom node Create_RevitPipeElements.dyf (Dynamo 1.3.2.2480)
# category: ArupBimSF.Revit.Mep
# Create Revit Pipe Elements by input points

System_Type = Input()  # "System.Type"
id = Element.Id(System_Type)
Pipe_Type = Input()  # "Pipe.Type"
id_2 = Element.Id(Pipe_Type)
Level = Input()
id_3 = Element.Id(Level)
Start_Point = Input()  # "Start.Point"
points_dynamo_revit = Custom[Points_Dynamo➜Revit](DynamoPt=Start_Point)
End_Point = Input()  # "End.Point"
points_dynamo_revit_2 = Custom[Points_Dynamo➜Revit](DynamoPt=End_Point)
python_script = Python(IN[0]=id, IN[1]=id_2, IN[2]=id_3, IN[3]=points_dynamo_revit, IN[4]=points_dynamo_revit_2)
# ---------- python_script.python (43 lines) ----------
import clr
# Import RevitAPI
clr.AddReference("RevitAPI")
import Autodesk

clr.AddReference("RevitNodes")
import Revit

# Import DocumentManager and TransactionManager
clr.AddReference("RevitServices")
import RevitServices
from RevitServices.Persistence import DocumentManager
from RevitServices.Transactions import TransactionManager

# Import geometry conversion extension methods
clr.ImportExtensions(Revit.GeometryConversion)

# Import Element wrapper extension methods
clr.ImportExtensions(Revit.Elements)
doc = DocumentManager.Instance.CurrentDBDocument

systemTypeId =IN[0]
pipeTypeId = IN[1]
levelId = IN[2]
startPoint = IN[3]
endPoint = IN[4]

list = len(startPoint)
count = 0
pipelist = []

TransactionManager.Instance.EnsureInTransaction(doc)
while (count < list):
	try:
		result = Autodesk.Revit.DB.Plumbing.Pipe.Create(doc,systemTypeId[0],pipeTypeId[0],levelId[0],startPoint[count],endPoint[count])
		count = count + 1
		pipelist.append(result)
	except:
		count = count +1
		
TransactionManager.Instance.TransactionTaskDone()

OUT = pipelist
# ----------------------------------------
Result = Output(python_script)
