# Dynamo custom node Create_SectionView_ByElements.dyf (Dynamo 1.3.2.2480)
# category: ArupBimSF.Revit.Views
# Create a section view around an element and set the view limits and offsets

# group: DESCRIPTION
# note: DYNAMO VERSION
# 1.3.0.875
# note: WORKING REVIT VERSION(S)
# 2017, 2018
# note: DYNAMO FILE NAME
# Create Element View.dyf
# note: ASSOCIATED REVIT FILE(S)
# /
# note: DESCRIPTION
# This node makes it possible to automatically create aligned section views on selected elements.
# Necessary inputs are:
# Revit Elements: this to detect the solid.centroid. The views are oriented to that point.
# X-vectors and Y-vectors to get the direction of the section plane. Traditionally these vectors are taken from the location lines of linear objects or facing directions of generic elements (i.e. doors). You might replace this with the vector of a selected edge for instance.

# group: INPUT VALUES
CSPoint = Input(CSPoint:Point[])  # Indicate the section center point This point should lie within the solid geometry of the selected element
Xvector = Input(Xvector:Vector[])  # This vector defines the length direction of the section view
Yvector = Input(Yvector:Vector[])  # This vector defines the width direction of the section view
RevitElements = Input(RevitElements:Element[])  # Select the Revit elements
CropRegionOffset = Input(CropRegionOffset:double)  # Distance between object countours and section crop region
ViewDepth = Input(ViewDepth:double)  # Defines the depth of the section view
Viewname = Input(Viewname:string[])  # The name of the section view

# group: ELEMENT GEOMETRY SIMPLIFICATION
geometry = Element.Geometry(RevitElements)
# note: Filter solids from the element.geometry output
type = Object.Type(geometry)
code_block = CodeBlock { "Autodesk.DesignScript.Geometry.Solid"; }
eq = type == code_block
filterByBoolMask = List.FilterByBoolMask(list=geometry, mask=eq)
byUnion = Solid.ByUnion(filterByBoolMask.in@L2)
flatten = Flatten(byUnion)
# note: Union solids in case the object consists of multiple, and get the bounding box of it, to create rectangular boundaries representing the view planes.
byGeometry = BoundingBox.ByGeometry(flatten, lacing=Longest)
toCuboid = BoundingBox.ToCuboid(byGeometry)

# group: APPLY CS AND WORKPLANE
# note: Defines the coordinate system for the direction of the section view.
# This is taken in the centroid of the solid geometry to be able to define negative and positive values for the min/max point
# Top view:
# X=length axis element
# Y=normal at length axis
# Front view:
# X=length axis element
# Y=Global Z axis
# Cross section view:
# X=normal axis element
# Y=Global Z axis
byOriginVectors = CoordinateSystem.ByOriginVectors(origin=CSPoint, xAxis=Xvector, yAxis=Yvector, lacing=Longest)
centroid = Solid.Centroid(flatten)
# note: Generate a plane at the solid center which is orientated to the view cs. This plane is used to detect the boundaries of the section view.
byOriginXAxisYAxis = Plane.ByOriginXAxisYAxis(centroid, Xvector, Yvector, lacing=Longest)

# group: DETECT SECTION BOUNDARY CURVES AND WORKPOINTS
intersect = Geometry.Intersect(geometry=toCuboid, other=byOriginXAxisYAxis, lacing=Longest)
# note: Detect the perimeter curves of the cutting surface at the solid centroid
flatten_2 = Flatten(intersect)
perimeterCurves = Surface.PerimeterCurves(flatten_2)
byJoinedCurves = PolyCurve.ByJoinedCurves(perimeterCurves)
code_block_2 = CodeBlock(x=CropRegionOffset) { {x,-x}; }
# note: Apply the offset on the cutting surface perimeter curves.
offset = Curve.Offset(curve=byJoinedCurves, distance=code_block_2, lacing=CrossProduct)
# note: If the offset value exceeds the half-width of the surface, then it generates a "null" value for the generated polycurve.
# This might return an error in the Curve.Offset node. To filter out the "null" values, the List.FilterByBoolMask is used.
isNull = Object.IsNull(offset)
filterByBoolMask_2 = List.FilterByBoolMask(list=offset, mask=isNull)
length = Curve.Length()  # unwired: arg0
# note: Get the external polycurve of the offsetted polycurves.
maximumItemByKey = MaximumItemByKey(filterByBoolMask_2.out@L2, length)
# note: Get the single curves and their starting point to define the min and max boundary values
explode = Geometry.Explode(maximumItemByKey)
startPoint = Curve.StartPoint(explode)

# group: TRANSLATE TO WCS FOR minPoint / maxPoint Calc
identity = CoordinateSystem.Identity()
transform = Geometry.Transform(contextCoordinateSystem=identity)  # unwired: geometry, fromCoordinateSystem
# note: As Point.X and Point.Y only work according to global WCS, the curves are transformed from the solid.centroid to the WCS in order to define the MinPoint and MaxPoint of the cut surface (offset values already included)
combine = List.Combine(transform, startPoint, byOriginVectors)
X = Point.X(combine)
minimumItem = List.MinimumItem(X)
Y = Point.Y(combine)
minimumItem_2 = List.MinimumItem(Y)
maximumItem = List.MaximumItem(X)
maximumItem_2 = List.MaximumItem(Y)

# group: CREATE SECTION VIEW ACCORDING BOUNDING BOX
code_block_3 = CodeBlock(CropRegionOffset=CropRegionOffset, ViewDepth=ViewDepth)
# ---------- code_block_3.designscript (7 lines) ----------
//Z value calculation
//in accordance with the
//Centroid point
//Startingpoint of sectionview
-CropRegionOffset;
//Relative depth of sectionview
ViewDepth-CropRegionOffset;
# ----------------------------------------
# note: The section view is created according the CS, defined by the centroid and the given section view direction.
# The minPoint / maxPoint is defined by the local oriented bounding box + offset of the element.
byCoordinates = Point.ByCoordinates(x=minimumItem, y=minimumItem_2, z=code_block_3.out0)
byCoordinates_2 = Point.ByCoordinates(x=maximumItem, y=maximumItem_2, z=code_block_3.out1)
byCoordinateSystemMinPointMaxPoint = SectionView.ByCoordinateSystemMinPointMaxPoint(byOriginVectors, byCoordinates, byCoordinates_2)
code_block_4 = CodeBlock { "View Name"; }
setParameterByName = Element.SetParameterByName(element=byCoordinateSystemMinPointMaxPoint, parameterName=code_block_4, value=Viewname)
SectionView = Output(setParameterByName)
