# Dynamo custom node Curve.Offset_byPointOrMaxDistance.dyf "Curve.Offset➜PointOrMaxDistance" (Dynamo 1.3.2.2480)
# category: ArupBimSF.Geometry
# Offsets Curves by set distance or by maximum point

CurveIn = Input(CurveIn:var)
MaxDistance = Input(MaxDistance:var)
Point = Input(Point:var)
distanceTo = Geometry.DistanceTo(other=Point)  # unwired: geometry
code_block = CodeBlock(c=CurveIn, dist=MaxDistance, fn1=distanceTo) { offset1(c,dist,fn1); }
curve = Output(code_block)
code_block_2 = CodeBlock()
# ---------- code_block_2.designscript (5 lines) ----------
def offset1(c:Curve, dist:double,fn1){
d1 = {- dist, dist};
cl1 = c.Offset(d1<1>);
return = MinimumItemByKey(cl1, fn1);
};
# ----------------------------------------
