# Dynamo custom node Curve_ArrayBetweenTwoEnds.dyf (Dynamo 1.3.2.2480)
# category: ArupBimSF.Geometry
# arrays a desired number of curves between two input end curves

degree = Input()
curve_1 = Input()
curve_2 = Input()
Number_of_curves = Input()
code_block = CodeBlock(degree=degree, c1=curve_1, c2=curve_2, nbcv=Number_of_curves)
# ---------- code_block.designscript (10 lines) ----------
range = 0..1..0.1*degree;
p1 = Flatten(c1.PointAtParameter(range<1>));
p2 = Flatten(c2.PointAtParameter(range<1>));
l = Line.ByStartPointEndPoint(p1,p2);
range2 = 0..1..1/(nbcv+1);
c = List.Count(range2);
range3 = List.RemoveItemAtIndex(range2,{0,c-1});
pts = l<1>.PointAtParameter(range3<2>);
ctrlpts = List.Transpose(pts);
crvs = NurbsCurve.ByPoints(ctrlpts);
# ----------------------------------------
Curves = Output(code_block.crvs)
