# Dynamo custom node Db_Categories_Analytical.dyf (Dynamo 1.3.2.2480)
# category: ArupBimSF.Revit_Db.Categories
# all  Analytical categories

analytical_categories = StringInput("""Analytical Beams
Analytical Braces
Analytical Columns
Analytical Floors
Analytical Foundation Slabs
Analytical Isolated Foundations
Analytical Links
Analytical Nodes
Analytical Spaces
Analytical Surfaces
OST_GbXMLFaces
Analytical Wall Foundations
Analytical Walls
Analysis Display Style
Analysis Results
Boundary Conditions
Structural Internal Loads
Structural Load Cases
Structural Loads""")
multilinestring_list = Custom[MultilineString➜List](String_In=analytical_categories)  # converts a string with line breaks in to a list of strings
byName = Category.ByName(multilinestring_list)
AnalysisCategories = Output(byName)
