# Dynamo custom node Db_Categories_Anno.Tags.dyf (Dynamo 1.3.2.2480)
# category: ArupBimSF.Revit_Db.Categories
# Get all annotation Categories

anno_tag_categories = StringInput("""Air Terminal Tags
Analytical Beam Tags
Analytical Brace Tags
Analytical Column Tags
Analytical Floor Tags
Analytical Isolated Foundation Tags
Analytical Link Tags
Analytical Node Tags
Analytical Slab Foundation Tags
Analytical Wall Foundation Tags
Analytical Wall Tags
Area Load Tags
Area Tags
Assembly Tags
Cable Tray Fitting Tags
Cable Tray Tags
Casework Tags
Ceiling Tags
Communication Device Tags
Conduit Fitting Tags
Conduit Tags
Curtain Panel Tags
Curtain System Tags
Data Device Tags
Detail Item Tags
Door Tags
Duct Accessory Tags
Duct Fitting Tags
Duct Insulation Tags
Duct Lining Tags
Duct Tags
Electrical Equipment Tags
Electrical Fixture Tags
Fire Alarm Device Tags
Flex Duct Tags
Flex Pipe Tags
Floor Tags
Furniture System Tags
Furniture Tags
Generic Model Tags
Internal Area Load Tags
Internal Line Load Tags
Internal Point Load Tags
Keynote Tags
Lighting Device Tags
Lighting Fixture Tags
Line Load Tags
Mass Floor Tags
Mass Tags
Material Tags
Mechanical Equipment Tags
MEP Fabrication Containment Tags
Mechanical Equipment Tags
MEP Fabrication Containment Tags
MEP Fabrication Ductwork Tags
MEP Fabrication Hanger Tags
MEP Fabrication Pipework Tags
Nurse Call Device Tags
Parking Tags
Part Tags
Pipe Accessory Tags
Pipe Fitting Tags
Pipe Insulation Tags
Pipe Tags
Planting Tags
Plumbing Fixture Tags
Point Load Tags
Property Line Segment Tags
Property Tags
Railing Tags
Revision Cloud Tags
Roof Tags
Room Tags
Security Device Tags
Site Tags
Space Tags
Specialty Equipment Tags
Sprinkler Tags
Stair Landing Tags
Stair Run Tags
Stair Support Tags
Stair Tags
Structural Area Reinforcement Tags
Structural Beam System Tags
Structural Column Tags
Structural Connection Tags
Structural Fabric Reinforcement Tags
Structural Foundation Tags
Structural Framing Tags
Structural Path Reinforcement Tags
Structural Rebar Coupler Tags
Structural Rebar Tags
Structural Stiffener Tags
Structural Truss Tags
Telephone Device Tags
Wall Tags
Window Tags
Wire Tags
Zone Tags""")
multiline_text_to_list = Custom[Multiline Text_To List](String_In=anno_tag_categories)  # converts a string with line breaks in to a list of strings
byName = Category.ByName(multiline_text_to_list)
TagCategories = Output(byName)
