# Dynamo custom node Db_Categories_Arch and Site.dyf (Dynamo 1.3.2.2480)
# category: ArupBimSF.Revit_Db.Categories
# Architechture and site categories

struct = StringInput("""Casework
Ceilings
Columns
Doors
Floors
Furniture
Furniture Systems
Roofs
Roofs - Gutters
Roofs - Roof Soffits
Roofs - Fascias
Shaft Openings
Specialty Equipment
Walls
Windows""")  # "Categories_Arch.Struct"
curtainSystems = StringInput("""Curtain Panels
Curtain Systems
Curtain Wall Mullions
Curtain Grids""")
rampsStairsOpenings = StringInput("""Railings
Railings - Supports
Railings - Terminations
Railings - Top Rails
Railings - Balusters
Railings - Handrails
Ramps
Stairs
Stairs - Runs
Stairs - Supports
Stairs - Landings""")
site_and_exterior = StringInput("""Site
Roads
Site - Pads
Parking
Planting
Entourage
Topography""")
create = List.Create(struct, curtainSystems, rampsStairsOpenings, site_and_exterior)
multiline_text_to_list = Custom[Multiline Text_To List](String_In=create@@L1)  # converts a string with line breaks in to a list of strings
sort = List.Sort()  # unwired: arg0
map = List.Map(list=multiline_text_to_list, f_x=sort)
byName = Category.ByName(map@@L2)
code_block = CodeBlock(x=byName) { x[0]; x[1]; x[2]; x[3]; }
Arch_Common = Output(code_block.out0)
CurtainSystems = Output(code_block.out1)
Ramps_Stairs_Railings = Output(code_block.out2)
Site_and_Exterior = Output(code_block.out3)
