# Dynamo custom node Db_Categories_Structural.dyf (Dynamo 1.3.2.2480)
# category: ArupBimSF.Revit_Db.Categories
# Lists out all structural specific Revit categories

categories_Structural = StringInput("""Structural Area Reinforcement
Structural Beam Systems
Structural Columns
Structural Connections
Structural Fabric Areas
Structural Fabric Reinforcement
Structural Foundations
Structural Framing
Structural Path Reinforcement
Structural Rebar
Structural Rebar Couplers
Structural Stiffeners
Structural Trusses""")
anno_structural_symbols = StringInput("""Brace in Plan View Symbols
Connection Symbols
Foundation Span Direction Symbol
Span Direction Symbol
Structural Annotations
Structural Area Reinforcement Symbols
Structural Fabric Reinforcement Symbols
Structural Path Reinforcement Symbols""")
reinforcing = StringInput("""Rebar Cover References
Rebar Set Toggle
Rebar Shape
Multi-Rebar Annotations""")
create = List.Create(categories_Structural, anno_structural_symbols, reinforcing)
multiline_text_to_list = Custom[Multiline Text_To List](String_In=create@@L1)  # converts a string with line breaks in to a list of strings
sort = List.Sort()  # unwired: arg0
map = List.Map(list=multiline_text_to_list, f_x=sort)
byName = Category.ByName(map@@L2)
code_block = CodeBlock(x=byName) { x[0]; x[1]; x[2]; }
Structural = Output(code_block.out0)
StructuralSymbols = Output(code_block.out1)
Rebar_Reinf = Output(code_block.out2)
