# Dynamo custom node Db_Categories_View And Common.dyf (Dynamo 1.3.2.2480)
# category: ArupBimSF.Revit_Db.Categories
# Get all view type and boundary categories

categories_Views = StringInput("""Sheets
Views
Elevations
Sections
Viewports
Title Blocks
View Reference
View Titles
Callouts""")
symbols = StringInput("""Callout Heads
Elevation Marks
Grid Heads
Level Heads
Section Line
Section Marks
Annotation Crop Boundary
Callout Boundary
Callout Boundary - Callout Leader Line
Spot Elevation Symbols""")  # "Categories_View.Symbols"
string = StringInput("""Dimensions
Text Notes
Revision Clouds
Spot Coordinates
Spot Elevations
Spot Slopes
Contour Labels
Generic Annotations""")
common = StringInput("""Masking Region
Detail Items
Filled region
Generic Models
Lines
Mass
Parts
Assemblies""")  # "Categories_Model.Common"
categories_References = StringInput("""Grids
Levels
Matchline
Reference Lines
Reference Planes
Reference Points
Adaptive Points
Crop Boundaries
Render Regions
Cameras
Scope Boxes
Section Boxes
Plan Region
Areas""")
categories_links_imports = StringInput("""Imports in Families
Point Clouds
Raster Images
RVT Links
Materials
Project Information""")
anno_common = StringInput("""Duct Color Fill
Duct Color Fill Legends
Pipe Color Fill
Pipe Color Fill Legends
Guide Grid
Color Fill Legends
Displacement Path
Schedule Graphics
Panel Schedule Graphics
Stair Paths
Stair Tread/Riser Numbers""")
create = List.Create(categories_Views, symbols, string, common, categories_References, categories_links_imports, anno_common)
multilinestring_list = Custom[MultilineString➜List](String_In=create@@L1)  # converts a string with line breaks in to a list of strings
sort = List.Sort()  # unwired: arg0
map = List.Map(list=multilinestring_list, f_x=sort)
byName = Category.ByName(map@@L2)
code_block = CodeBlock(x=byName) { x[0]; x[1]; x[2]; x[3]; x[4]; x[5]; x[6]; }
n00_ViewCategories = Output(code_block.out0)  # "00_ViewCategories"
n01_ViewSymbol = Output(code_block.out1)  # "01_ViewSymbol"
n02_Annotations = Output(code_block.out2)  # "02_Annotations"
n03_Model_Common = Output(code_block.out3)  # "03_Model_Common"
n04_Reference_Area = Output(code_block.out4)  # "04_Reference&Area"
n05_Project_Links = Output(code_block.out5)  # "05_Project&Links"
n06_Uncommon = Output(code_block.out6)  # "06_Uncommon"
flatten = Flatten(byName)
string_from_object = FromObject()  # unwired: arg0
sortByFunction = SortByFunction(flatten, string_from_object)
n07_All = Output(sortByFunction)  # "07_All"
