# Dynamo custom node Db_Categories_ViewType & Boundary.dyf (Dynamo 1.3.2.2480)
# category: ArupBimSF.Revit_Db.Categories
# Get all view type and boundary categories

internal = StringInput("""Crop Boundaries
Render Regions
Cameras
Sheets
Viewports
Views
Scope Boxes
Section Boxes
Plan Region
View Reference
View Titles
Matchline
Callouts
Elevations
Sections
Title Blocks""")  # "Categories_View.Internal"
multilinestring_list = Custom[MultilineString➜List](String_In=internal)  # converts a string with line breaks in to a list of strings
byName = Category.ByName(multilinestring_list)
ViewCategories = Output(byName)
sort = List.Sort(multilinestring_list)
