# Dynamo custom node Db_ElementTypes_Get All.dyf (Dynamo 1.3.2.2480)
# category: ArupBimSF.Revit_Db
# get all element type classes

python_script = Python()
# ---------- python_script.python (13 lines) ----------
import clr
clr.AddReference('RevitAPI')
from Autodesk.Revit.DB import *
import Autodesk
clr.AddReference('RevitNodes')
import Revit
clr.ImportExtensions(Revit.Elements)
import System.Reflection
import System.AppDomain

rAssembly = [x for x in System.AppDomain.CurrentDomain.GetAssemblies() if x.GetName().Name == 'RevitAPI'][0]
rElement = [x for x in rAssembly.GetTypes() if x.Name == 'Element' and x.Namespace == 'Autodesk.Revit.DB'][0]
OUT = [x for x in rAssembly.GetTypes() if x.IsClass and x.Namespace == 'Autodesk.Revit.DB' and x.IsSubclassOf(rElement)]
# ----------------------------------------
python_script_2 = Python(IN[0]=python_script)
# ---------- python_script_2.python (21 lines) ----------
import clr
clr.AddReference('RevitAPI')
from Autodesk.Revit.DB import *

faminsts = IN[0]
elementlist = list()
for item in faminsts:
	try:
		n = UnwrapElement(item).Name
	except:
		# Use a built-in property of (wrapped) Dynamo elements for family symbols instead
		try:
			n = item.Name
		except:
			# maybe it's a parameter name
			try:
				n = item.Definition.Name
			except:
				n = []
	elementlist.append(n)
OUT = elementlist
# ----------------------------------------
sortByKey = List.SortByKey(list=python_script, keys=python_script_2)
elementTypes = Output(sortByKey.sorted_list)
TypeNames = Output(sortByKey.sorted_keys)
