# Dynamo custom node Db_Subcategories by Category.dyf (Dynamo 1.3.2.2480)
# category: ArupBimSF.Revit_Db.Categories
# gets the sub categories assiciated with the input categories

category = Input()
code_block = CodeBlock(item=category) { Flatten({item}); }
python_script = Python(IN[0]=code_block)
# ---------- python_script.python (20 lines) ----------
import clr
clr.AddReference('RevitAPI')
from Autodesk.Revit.DB import *

clr.AddReference("RevitNodes")
import Revit
clr.ImportExtensions(Revit.Elements)

cats = UnwrapElement(IN[0])
elementlist = list()

for cat in cats:
	try:
		sublist = []
		for subcat in cat.SubCategories:
			sublist.append(Revit.Elements.Category.ById(subcat.Id.IntegerValue))
		elementlist.append(sublist)
	except:
		elementlist.append(list())
OUT = elementlist
# ----------------------------------------
list_return_list_or_single_value = Custom[List_Return List or Single Value](unknownItem=category, List_In=python_script)
subcategories = Output(list_return_list_or_single_value)
