# Dynamo custom node Db_View Disciplines_Built-In.dyf (Dynamo 1.3.2.2480)
# category: ArupBimSF.Revit_Db
# Enumerate the Different View Disciplines in Revit DB

python_script = Python()  # unwired: IN[0]
# ---------- python_script.python (29 lines) ----------
import clr
clr.AddReference('ProtoGeometry')
from Autodesk.DesignScript.Geometry import *

# Import DocumentManager and TransactionManager
clr.AddReference("RevitServices")
import RevitServices
from RevitServices.Persistence import DocumentManager
from RevitServices.Transactions import TransactionManager

# Import RevitAPI
clr.AddReference("RevitAPI")
import Autodesk
from Autodesk.Revit.DB import *
import System

#Assign your output to the OUT variable
names = System.Enum.GetValues(ViewDiscipline)
typelist = list()
idlist = list()
for z in names:
	typelist.append(z.GetType())

for x in typelist:
	idlist.append(x.Name)
codelist = list()
for z in names:
	codelist.append(z.GetHashCode())
OUT = names, typelist, idlist, codelist
# ----------------------------------------
code_block = CodeBlock { 0; }
getItemAtIndex = List.GetItemAtIndex(list=python_script, index=code_block)
ViewDiscipline = Output(getItemAtIndex)
code_block_2 = CodeBlock { 1; }
getItemAtIndex_2 = List.GetItemAtIndex(list=python_script, index=code_block_2)
RuntimeTypes = Output(getItemAtIndex_2)
code_block_3 = CodeBlock { 2; }
getItemAtIndex_3 = List.GetItemAtIndex(list=python_script, index=code_block_3)
RuntimeTypeNames = Output(getItemAtIndex_3)
code_block_4 = CodeBlock { 3; }
getItemAtIndex_4 = List.GetItemAtIndex(list=python_script, index=code_block_4)
HashCodes = Output(getItemAtIndex_4)
