# Dynamo custom node Delete_BackUpFiles_Rfa.dyf (Dynamo 1.3.2.2480)
# category: ArupBimSF.^TestingGrounds
# Deletes back-up family files from input directory

refresh = Input(refresh:bool=true)
DirPath = Input(DirPath:string)  # Example C:\Users\Lingkon\Desktop\SampleFolder
fromPath = DirectoryObject(DirPath)  # "Directory.FromPath"
string = StringInput("*.rfa")
contents = Directory.Contents(fromPath, string)
flatten = Flatten(contents)
boolean = BoolSelector(false)
fileName = FilePath.FileName(flatten, boolean)
code_block = CodeBlock { "."; }
lastIndexOf = String.LastIndexOf(fileName, code_block)
code_block_2 = CodeBlock(a=lastIndexOf) { 0; a+1; }
remove = String.Remove(str=fileName, startIndex=code_block_2.out0, count=code_block_2.out1)
length = String.Length(remove)
code_block_3 = CodeBlock(li=length) { li==4; }
filterByBoolMask = List.FilterByBoolMask(list=flatten, mask=code_block_3)
filterByBoolMask_2 = List.FilterByBoolMask(list=remove, mask=code_block_3)
toNumber = String.ToNumber(filterByBoolMask_2.in)
isNull = Object.IsNull(toNumber)
filterByBoolMask_3 = List.FilterByBoolMask(list=filterByBoolMask.in, mask=isNull)
watch = Watch(filterByBoolMask_3.out)
filterByBoolMask_4 = List.FilterByBoolMask(list=toNumber, mask=isNull)
watch_2 = Watch(filterByBoolMask_4.out)
code_block_4 = CodeBlock { 1000; }
lt = watch_2 < code_block_4
filterByBoolMask_5 = List.FilterByBoolMask(list=watch, mask=lt)
watch_3 = Watch(filterByBoolMask_5.in)
python_script = Python(IN[0]=watch_3)
# ---------- python_script.python (8 lines) ----------
li = IN[0]
li2 = []

for x in li:
	li2.append(x)
	
#Assign your output to the OUT variable.
OUT = li2
# ----------------------------------------
BackupPath = Output(python_script)  # BackupFilePath
python_script_2 = Python(IN[0]=watch_3)
# ---------- python_script_2.python (14 lines) ----------
import sys
sys.path.append(r'C:\Program Files (x86)\IronPython 2.7\Lib')
import os
####################################
filePaths = IN[0]
fileSize = [os.path.getsize(eachIteam) for eachIteam in filePaths]

####################################
finalFileSize = []#empty list
for eachIteam in fileSize:#converting to MB
	finalFileSize.append(float(eachIteam)/pow(1024,2))
	
####################################
OUT = finalFileSize, "Total = "+str(round(sum(finalFileSize),2))+" MB", "Total = "+str(round(sum(finalFileSize)/1024,3))+" GB"
# ----------------------------------------
code_block_5 = CodeBlock(o=python_script_2) { o[1]; }
FileSizeInMB = Output(code_block_5)
RunMe = Input(RunMe:bool=false)  # Set True for execute command
action_RunMe = Custom[Action_RunMe](Should_I=RunMe, ThingToDo=watch_3)  # Uses A boolean to determine whether to run a function or sequence.
delete = File.Delete(action_RunMe)
Success = Output(delete)  # "Success?"
