# Dynamo custom node Delete_DuplicateLines.dyf (Dynamo 1.3.2.2480)
# category: ArupBimSF.Revit.Lines,Text & Styles
# deletes duplicate lines Similiar to Kill/Overkill in Autocad

empty = List.Empty()
categories = Categories("Lines")
ReFresh = Input(ReFresh:bool=false)
code_block = CodeBlock(categories, ReFresh)
# ---------- code_block.designscript (11 lines) ----------
list;
come;

[Imperative]

{
 if (come ==true)
  return = list;
 else
  return = list;
};
# ----------------------------------------
all_elements_of_category = ElementsOfCategory(code_block.out2)
curves = Element.Curves(all_elements_of_category)
code_block_2 = CodeBlock { 0.5; }
pointAtParameter = Curve.PointAtParameter(curve=curves, param=code_block_2)
flatten = Flatten(pointAtParameter)
python_script = Python(IN[0]=flatten)
# ---------- python_script.python (23 lines) ----------
#Copyright(c) 2015, Konrad Sobon
# @arch_laboratory, http://archi-lab.net

import clr
clr.AddReference('ProtoGeometry')
from Autodesk.DesignScript.Geometry import *
#The inputs to this node will be stored as a list in the IN variable.
dataEnteringNode = IN

mylist = IN[0]

a, seen, result, unique = mylist, set(), [], []
for idx, item in enumerate(a):
    if item not in seen:
    	seen.add(item)
    	unique.append(idx)        
    	# First time seeing the element
    else:
    	result.append(idx)
    	# Already seen, add the index to the result

#Assign your output to the OUT variable
OUT = unique, result
# ----------------------------------------
number = DoubleInput(0)
getItemAtIndex = List.GetItemAtIndex(list=python_script, index=number)
removeItemAtIndex = List.RemoveItemAtIndex(list=all_elements_of_category, indices=getItemAtIndex)
create = List.Create(empty, removeItemAtIndex)
flatten_2 = Flatten(create)
code_block_3 = CodeBlock(t3=flatten_2) { t2 = t3.GetParameterValueByName("Line Style"); t4 = t2.Name; }
Review_Them = Output(code_block_3.t4)
Delete_Them = Input(Delete_Them : bool = false)
python_script_2 = Python(IN[0]=flatten_2, IN[1]=Delete_Them)
# ---------- python_script_2.python (49 lines) ----------
#Copyright(c) 2015, Konrad Sobon
# @arch_laboratory, http://archi-lab.net

import clr
clr.AddReference('ProtoGeometry')
from Autodesk.DesignScript.Geometry import *

# Import DocumentManager and TransactionManager
clr.AddReference("RevitServices")
import RevitServices
from RevitServices.Persistence import DocumentManager
from RevitServices.Transactions import TransactionManager

# Import RevitAPI
clr.AddReference("RevitAPI")
import Autodesk
from Autodesk.Revit.DB import *

doc = DocumentManager.Instance.CurrentDBDocument
uiapp = DocumentManager.Instance.CurrentUIApplication
app = uiapp.Application

from System.Collections.Generic import *

#The inputs to this node will be stored as a list in the IN variable.
dataEnteringNode = IN
deleteBoolean = IN[1]
#unwrap all elements to use with API
elements = []
for i in IN[0]:
	elements.append(UnwrapElement(i))

idsToDelete = List[Autodesk.Revit.DB.ElementId]()
for i in elements:
	idsToDelete.Add(i.Id)

# "Start" the transaction
TransactionManager.Instance.EnsureInTransaction(doc)

if deleteBoolean:
	doc.Delete(idsToDelete)
	message = "You have successfully deleted \n " + str(idsToDelete.Count) + " elements from Revit model."
else:
	message = "Delete set to false."

# "End" the transaction
TransactionManager.Instance.TransactionTaskDone()

OUT = '\n'.join('{:^35}'.format(s) for s in message.split('\n'))
# ----------------------------------------
Process_Report = Output(python_script_2)
