# Dynamo custom node Delete_Elements.dyf (Dynamo 1.3.2.2480)
# category: ArupBimSF.Revit.PurgeTools
# Attempts to delete elements from Revit

element = Input(element:var[])
confirm = Input(confirm:bool)
python_script = Python(IN[0]=element, IN[1]=confirm)
# ---------- python_script.python (28 lines) ----------
import clr

clr.AddReference("RevitServices")
import RevitServices
from RevitServices.Persistence import DocumentManager
from RevitServices.Transactions import TransactionManager
doc = DocumentManager.Instance.CurrentDBDocument

def tolist(obj1):
	if hasattr(obj1,"__iter__"): return obj1
	else: return [obj1]

ids = [e.Id for e in UnwrapElement(tolist(IN[0]) )]

if IN[1]:
	deleted, failed = [], []
	TransactionManager.Instance.EnsureInTransaction(doc)
	for id in ids:
		try:
			del_id = doc.Delete(id)
			deleted.extend([d.ToString() for d in del_id])
		except : failed.append(id.ToString() )
	TransactionManager.Instance.TransactionTaskDone()
	s = set(deleted)
	failed1 = [x for x in failed if x not in s]
	OUT = len(deleted), ';'.join(deleted), ';'.join(failed1)
else:
	OUT = "Set confirm to True", "", ""
# ----------------------------------------
code_block = CodeBlock(d=python_script) { d[0]; d[1]; d[2]; }
count = Output(code_block.out0)
deleted_Ids = Output(code_block.out1)
failed_Ids = Output(code_block.out2)
