# Dynamo custom node Deliminated String_ToList.dyf "Deliminated String ➜ List" (Dynamo 1.3.2.2480)
# category: ArupBimSF.List Functions
# Splits a comma deliminated String to a list of strings_!!List DeliminatedStringToList

Strings_In = Input()
Seperator = Input(Seperator : string = ",")
split = String.Split(Strings_In, Seperator)
flatten = Flatten(split)
strings = Output(flatten)
