# Dynamo custom node DetachAndSaveNewCentral_ByFilePath.dyf (Dynamo 1.3.2.2480)
# category: ArupBimSF.Revit.Directory
# detaches and saves a central model from an input file path

file_path = Input()
python_script = Python(IN[0]=file_path)
# ---------- python_script.python (41 lines) ----------
import clr
clr.AddReference('ProtoGeometry')
from Autodesk.DesignScript.Geometry import *
# Import DocumentManager and TransactionManager
clr.AddReference("RevitServices")
import RevitServices
from RevitServices.Persistence import DocumentManager

doc = DocumentManager.Instance.CurrentDBDocument
uiapp = DocumentManager.Instance.CurrentUIApplication
app = uiapp.Application

# Import RevitAPI
clr.AddReference("RevitAPI")
import Autodesk
from Autodesk.Revit.DB import *

if isinstance(IN[0], list):
	files = IN[0]
else:
	files = [IN[0]]

version = "v" + app.VersionNumber

options = OpenOptions()
options.DetachFromCentralOption = DetachFromCentralOption.DetachAndPreserveWorksets

worksharingOptions = WorksharingSaveAsOptions()
worksharingOptions.SaveAsCentral = True

SaveOptions = SaveAsOptions()
SaveOptions.SetWorksharingOptions(worksharingOptions)

for file in files:
	modelpath = FilePath(file)
	newdoc = app.OpenDocumentFile(modelpath,options)
	newfile = file[:-4] + version + ".rvt"
	newdoc.SaveAs(newfile,SaveOptions)
	newdoc.Close(False)

OUT = 0
# ----------------------------------------
