# Dynamo custom node DetailLine_FromCurve+.dyf (Dynamo 1.3.2.2480)
# category: ArupBimSF.Revit.Curves
# Craetes a detail line from an input curve and view.  Allows you to create curves in Family editor also which the ootb version does not.

curve = Input(curve : Autodesk.Curve)
turnIntoSingleList = Custom[List_TurnIntoSingleList](unknownItem=curve)  # Converts a collection or items and lists into a single one dimensional List_!!Li
view = Input()
python_script = Python(IN[0]=turnIntoSingleList, IN[1]=view)
# ---------- python_script.python (28 lines) ----------
import clr
clr.AddReference('RevitAPI')
from Autodesk.Revit.DB import *

clr.AddReference("RevitNodes")
import Revit
clr.ImportExtensions(Revit.GeometryConversion)

clr.AddReference("RevitServices")
import RevitServices
from RevitServices.Persistence import DocumentManager
from RevitServices.Transactions import TransactionManager

doc = DocumentManager.Instance.CurrentDBDocument
curves = UnwrapElement(IN[0])
view = UnwrapElement(IN[1])
elementlist = []

TransactionManager.Instance.EnsureInTransaction(doc)
if doc.IsFamilyDocument: 
	doc_create = doc.FamilyCreate
else: 
	doc_create = doc.Create
for curve in curves:
	detcurve = doc_create.NewDetailCurve(view, curve.ToRevitType())
	elementlist.append(detcurve)
TransactionManager.Instance.TransactionTaskDone()
OUT = elementlist
# ----------------------------------------
detailLine = Output(python_script)
