# Dynamo custom node Doc_LoadFamily_FromPath.dyf (Dynamo 1.3.2.2480)
# category: ArupBimSF.Revit.Document
# Loads families from input paths into active document._!Doc

path = Input(path : string)  # The path to the family to be loaded
turnIntoSingleList = Custom[TurnIntoSingleList](unknownItem=path)  # Converts a collection or items and lists into a single one dimensional List_!!Li
directoryName = FilePath.DirectoryName(turnIntoSingleList)
code_block = CodeBlock(path=directoryName) { path + "\\"; ""; ".rfa"; }
replace = String.Replace(str=turnIntoSingleList, searchFor=code_block.out0, replaceWith=code_block.out1)
replace_2 = String.Replace(str=replace, searchFor=code_block.out2, replaceWith=code_block.out1)
python_script = Python(IN[0]=turnIntoSingleList, IN[1]=replace_2)
# ---------- python_script.python (36 lines) ----------
import clr
clr.AddReference('RevitAPI')
from Autodesk.Revit.DB import *

clr.AddReference("RevitNodes")
import Revit
clr.ImportExtensions(Revit.Elements)

clr.AddReference("RevitServices")
import RevitServices
from RevitServices.Persistence import DocumentManager
from RevitServices.Transactions import TransactionManager

doc = DocumentManager.Instance.CurrentDBDocument
fampaths = IN[0]
famnames = IN[1]
elementlist = []
booleans = []

TransactionManager.Instance.EnsureInTransaction(doc)
for fampath in fampaths:
	try: 
		doc.LoadFamily(fampath)
		booleans.append(True)
	except: booleans.append(False)
TransactionManager.Instance.TransactionTaskDone()

collector = FilteredElementCollector(doc)
collector.OfClass(Family)
for item in collector.ToElements():
	if item.Name in famnames:
		typelist = list()
		for famtypeid in item.GetFamilySymbolIds():
			typelist.append(doc.GetElement(famtypeid).ToDSType(True))
		elementlist.append(typelist)
OUT = (elementlist,booleans)
# ----------------------------------------
firstItem = List.FirstItem(python_script)
return_ListOrSingleValue = Custom[Return_ListOrSingleValue](unknownItem=path, List_In=firstItem)  # See Forum Post Regarding this node_RevitForum I think?_!LI
familyTypes = Output(return_ListOrSingleValue)
lastItem = List.LastItem(python_script)
return_ListOrSingleValue_2 = Custom[Return_ListOrSingleValue](unknownItem=path, List_In=lastItem)
success = Output(return_ListOrSingleValue_2)
