# Dynamo custom node Duplicate_SheetsWithViews_Options+.dyf (Dynamo 1.3.2.2480)
# category: ArupBimSF.Revit.Views & Sheets
# Duplicate Input Sheets with or Without Views

Sheets_In = Input(Sheets_In:Sheet[])  # Enter the Revit sheets to duplicate
RunMe = Input(RunMe:bool)  # Set to True to dupicate the input sheets
duplicateViews = Input(duplicateViews:bool = true)  # Set to True to duplicate views on the sheets
duplicateOption = Input(duplicateOption:int=0)  # Enter DuplicateOption: 0 = Duplicate. 1 = WithDetailing. 2 = AsDependent
suffix = Input(suffix:string="")  # Add the suffix to add to duplicated sheet number and view names
Prefix = Input(Prefix:string="")  # Enter an optional prefix at the start of the duplicated sheet number and view names
python_script = Python(IN[0]=Sheets_In, IN[1]=RunMe, IN[2]=duplicateViews, IN[3]=duplicateOption, IN[4]=suffix, IN[5]=Prefix)
# ---------- python_script.python (123 lines) ----------
import System
import itertools

import clr

# Import ToDSType(bool) extension method
clr.AddReference("RevitNodes")
import Revit
clr.ImportExtensions(Revit.Elements)

# Import DocumentManager and TransactionManager
clr.AddReference("RevitServices")
import RevitServices
from RevitServices.Persistence import DocumentManager
from RevitServices.Transactions import TransactionManager
from System.Collections.Generic import *

# Import RevitAPI
clr.AddReference("RevitAPI")
import Autodesk
from Autodesk.Revit.DB import *
from Autodesk.Revit.Exceptions import *

doc = DocumentManager.Instance.CurrentDBDocument
uiapp = DocumentManager.Instance.CurrentUIApplication
app = uiapp.Application

sheets = IN[0]
run = IN[1]
duplicateWithViews = IN[2]
duplicateOption = (ViewDuplicateOption.Duplicate, ViewDuplicateOption.WithDetailing, ViewDuplicateOption.AsDependent)[ IN[3] ]
affix = IN[4]
prefix = IN[5]

if run:
	if isinstance(sheets, list):
		sheetsList = sheets
	else:
		sheetsList = [sheets]
		
	TransactionManager.Instance.EnsureInTransaction(doc)
	
	allSheets = FilteredElementCollector(doc).OfCategory(BuiltInCategory.OST_Sheets)
	allSheetNumbers = []
	for i in allSheets:
		allSheetNumbers.Add( i.SheetNumber )
	
	allViews = FilteredElementCollector(doc).OfCategory(BuiltInCategory.OST_Views)
	allViewNamesAndTypes = []
	for i in allViews:
		if doc.GetElement(i.GetTypeId()) != None:
			allViewNamesAndTypes.Add( [i.ViewName, i.ViewType] )

	report = []
	newSheetList = []
	sheetViews = []
	for i in sheetsList:
		doc.Regenerate() 
		unwrapSheet = UnwrapElement(i)
		sheetSuccessfullyDuplicated = False
		
		titleBlock = FilteredElementCollector(doc, ElementId(i.Id)).OfCategory(BuiltInCategory.OST_TitleBlocks).ToElements()
		titleBlockSymbol = titleBlock[0].Symbol
		
		currentSheetNumber = i.SheetNumber
		currentSheetName = unwrapSheet.get_Parameter( BuiltInParameter.SHEET_NAME ).AsString()
			
		newSheetNumberString = prefix + currentSheetNumber + affix
		if newSheetNumberString in allSheetNumbers:
			report.Add("Sheet " + newSheetNumberString + " exists in the document and cannot be duplicated" )
		else:
			newSheet = ViewSheet.Create(doc, ElementId(titleBlockSymbol.ToDSType(True).Id) )
			sheetSuccessfullyDuplicated = True
			
			sheetNumberParam = newSheet.get_Parameter( BuiltInParameter.SHEET_NUMBER )
			sheetNumberParam.Set( newSheetNumberString )
			allSheetNumbers.Add( newSheetNumberString )
		
			sheetName = newSheet.get_Parameter( BuiltInParameter.SHEET_NAME )
			sheetName.Set(currentSheetName)
			
			newSheetList.Add( doc.GetElement(newSheet.Id) )
			
			doc.Regenerate()
			if duplicateWithViews and sheetSuccessfullyDuplicated:
				viewPorts = FilteredElementCollector(doc, ElementId(i.Id)).OfCategory(BuiltInCategory.OST_Viewports).ToElements()

				ptXYZ = [] 
				for j in viewPorts:
					currentViewport = j
					ptXYZ = currentViewport.GetBoxCenter()
					
					getView = doc.GetElement(currentViewport.ViewId)
					viewType = getView.ViewType
					newViewName = prefix + getView.ViewName + affix
					
					invalidDuplicateDependancyTypes = [ViewType.ThreeD, ViewType.DraftingView, ViewType.Rendering]
					
					viewExists = False
					for i in range(len(allViewNamesAndTypes)):
						if newViewName == allViewNamesAndTypes[i][0] and viewType == allViewNamesAndTypes[i][1]:
							viewExists = True
							break
						
					if viewExists:
						report.Add("View Type " + str(viewType) + newViewName + " exists in the document and cannot be duplicated" )
					elif viewType == ViewType.Legend:
						addView = Viewport.Create(doc, ElementId(newSheet.ToDSType(True).Id), getView.Id, ptXYZ)
					else:
						overrideDuplicateOption = ViewDuplicateOption.WithDetailing if (viewType in invalidDuplicateDependancyTypes and duplicateOption == ViewDuplicateOption.AsDependent) else duplicateOption
						
						newView = getView.Duplicate(overrideDuplicateOption)
						newViewNameParam = doc.GetElement(newView).get_Parameter( BuiltInParameter.VIEW_NAME )
						newViewNameParam.Set(newViewName)
						
						addView = Viewport.Create(doc, ElementId(newSheet.ToDSType(True).Id), newView, ptXYZ)
						allViewNamesAndTypes.Add( [newViewName, viewType] )

	TransactionManager.Instance.TransactionTaskDone()
	if report == []:
		OUT = "Duplication process successful", newSheetList
	else:	
		OUT = report, newSheetList
# ----------------------------------------
firstItem = List.FirstItem(python_script)
report = Output(firstItem)
lastItem = List.LastItem(python_script)
Sheets = Output(lastItem)
