# Dynamo graph CompareMonitoredFixtures.dyn (Dynamo 1.3.2.2480)

get_forcedparametervalue_atindex = Custom[!Get_ForcedParameterValue_AtIndex+]()  # ^Test; unwired: elements
get_ForcedParameterValue_AtIndex = Custom[Get_ForcedParameterValue_AtIndex+]()  # ^Test; unwired: Elements_In
code_block = CodeBlock { "Lighting Fixtures"; }
code_block_2 = CodeBlock { 9; }
get_familytype_at_index = Custom[Get_FamilyType_At Index+](Category_In=code_block, Index_Or_SearchString=code_block_2)  # get all loaded family types of a category
watch = Watch(get_familytype_at_index.3_Type_Names)
graph_SeqPassthru = Custom[Graph_SeqPassthru]()  # forces an operation to run in sequence.; unwired: passThrough, waitFor
create = List.Create()  # unwired: arg0, arg1
code_block_3 = CodeBlock { 1; }
get_ModelCategories_Doc = Custom[Get_ModelCategories_Doc+](Refresh=code_block_3)  # Collects all modeled/Placed elements in the active document. I have removed the Detail Items and Lines as they are included in the Annotation elements Node instead
code_block_4 = CodeBlock { 2; }
get_LinkedRevitDoc = Custom[Get_LinkedRevitDoc++](Index_Or_SearchString=code_block_4)  # Get Link instance, Doc, Name & Path. Use With Get Docs or Get Loaded RVT Links To get a link from a list of links. Use the all link names output to review the linked file names and chose the one you want by entering the index number of the desired link_#Lnk
get_ModelCategories_Doc_2 = Custom[Get_ModelCategories_Doc+](LinkedDoc=get_LinkedRevitDoc.Document)
list_compare_match = Custom[List_Compare&Match+](a_TakeFromList=get_ModelCategories_Doc_2.Categories_Doc, b_ItemsToTake=get_ModelCategories_Doc.Categories_Doc)  # Removes Matching Items and reports back all Match,&No Match from Both Lists_!!List_Compare&Match+
list_remove_matching = Custom[List_Remove Matching](a_TakeFromList=get_ModelCategories_Doc.Categories_Doc, b_ItemsToTake=list_compare_match.c_In_Both_Lists)  # Removes Matching Items and reports back all Match,&No Match from Both Lists
code_block_5 = CodeBlock(x=list_remove_matching.a_Reduced_List, p=get_ModelCategories_Doc.All_Elements) { x; p; }
code_block_6 = CodeBlock { 8; }
quantifyAndSelect_ItemAtIndex = Custom[QuantifyAndSelect_ItemAtIndex+](List_In=code_block_5.p, Keys_In=code_block_5.x, Get_Index=code_block_6)
get_IdenityData = Custom[Get_IdenityData+](Elements=quantifyAndSelect_ItemAtIndex.Chosen_Index)  # Gets Revit element Id and GUID for input elements
deconstruct = List.Deconstruct(list=get_IdenityData.6_ListOut, lacing=Longest)
code_block_7 = CodeBlock(x=get_ModelCategories_Doc_2.All_Elements, o=list_compare_match.a_Index_of_Match) { x[o]; }
code_block_8 = CodeBlock(x=get_ModelCategories_Doc_2.Categories_Doc, o=list_compare_match.a_Index_of_Match) { x[o]; }
code_block_9 = CodeBlock { 5; }
quantifyAndSelect_ItemAtIndex_2 = Custom[QuantifyAndSelect_ItemAtIndex+](List_In=code_block_7, Keys_In=code_block_8, Get_Index=code_block_9)
get_IdenityData_2 = Custom[Get_IdenityData+](Elements=quantifyAndSelect_ItemAtIndex_2.Chosen_Index)
deconstruct_2 = List.Deconstruct(list=get_IdenityData_2.6_ListOut, lacing=Longest)
combine = List.Combine(create, deconstruct.rest, deconstruct_2.rest)
code_block_10 = CodeBlock { 4; }
quantifyAndSelect_ItemAtIndex_3 = Custom[QuantifyAndSelect_ItemAtIndex+](List_In=combine, Keys_In=deconstruct.first, Get_Index=code_block_10)
code_block_11 = CodeBlock(x=quantifyAndSelect_ItemAtIndex_3.Chosen_Index) { x[1]; }
get_ModelCategories_Doc_3 = Custom[Get_ModelCategories_Doc+]()
set_FamilyType = Custom[Set_FamilyType]()  # set the type of input family instances; unwired: familyInstance, familyType
byPoint = FamilyInstance.ByPoint()  # unwired: familyType, point
