# Dynamo custom node Get_Closest Levels.DYF (Dynamo 1.3.2.2480)
# category: ArupBimSF.Revit.Element_Location
# get the closest levels to input elements.  will get the level elements of the closest level above and below input elements.

categories = Categories("Levels")
all_elements_of_category = ElementsOfCategory(categories)
code_block = CodeBlock { "Elevation"; }
getParameterValueByName = Element.GetParameterValueByName(element=all_elements_of_category, parameterName=code_block)
Elements = Input()
getLocation = Element.GetLocation(Elements)
Z = Point.Z(getLocation)
code_block_2 = CodeBlock { 0; }
gt = Z > code_block_2
filterByBoolMask = List.FilterByBoolMask(list=Z, mask=gt)
watch = Watch(filterByBoolMask.in)
gt_2 = getParameterValueByName > watch  # lacing=CrossProduct
transpose = List.Transpose(gt_2)
code_block_3 = CodeBlock { true; }
firstIndexOf = List.FirstIndexOf(list=transpose, item=code_block_3, lacing=Longest)
getItemAtIndex = List.GetItemAtIndex(list=all_elements_of_category, index=firstIndexOf)
code_block_4 = CodeBlock { "---"; }
list_CleanOutput = Custom[List_CleanOutput](List_In=getItemAtIndex, Replace_With=code_block_4)  # Removes and Replaces Nulls and Empty Lists from input lists. *only works with flat or 2 dimentional lists_Need to fix it to go deeper or use list.map_!!List
LevelAbove = Output(list_CleanOutput.Cleaned)
name = Element.Name(list_CleanOutput.Cleaned)
LevelAbove_Name = Output(name)
code_block_5 = CodeBlock { false; }
allIndicesOf = List.AllIndicesOf(list=transpose, item=code_block_5, lacing=Longest)
maximumItem = List.MaximumItem(allIndicesOf, lacing=Longest)
getItemAtIndex_2 = List.GetItemAtIndex(list=all_elements_of_category, index=maximumItem)
code_block_6 = CodeBlock { "---"; }
list_CleanOutput_2 = Custom[List_CleanOutput](List_In=getItemAtIndex_2, Replace_With=code_block_6)
LevelBelow = Output(list_CleanOutput_2.Cleaned)
name_2 = Element.Name(list_CleanOutput_2.Cleaned)
LevelBelow_Name = Output(name_2)
endpoint = Input()
startpoint = Input()
