# Dynamo custom node Get_ClosestLevels_AndIntersections.dyf (Dynamo 1.3.2.2480)
# category: ArupBimSF.Revit.Element_Location
# get the closest levels to input elements.  will get the level elements of the closest level above and below input elements.

categories = Categories("Levels")
all_elements_of_category = ElementsOfCategory(categories)
code_block = CodeBlock { "Elevation"; }
getParameterValueByName = Element.GetParameterValueByName(element=all_elements_of_category, parameterName=code_block)
Elements = Input()
getLocation = Element.GetLocation(Elements)
Z = Point.Z(getLocation)
code_block_2 = CodeBlock { 0; }
gt = Z > code_block_2
filterByBoolMask = List.FilterByBoolMask(list=Z, mask=gt)
watch = Watch(filterByBoolMask.in)
gt_2 = getParameterValueByName > watch  # lacing=CrossProduct
transpose = List.Transpose(gt_2)
code_block_3 = CodeBlock { false; }
allIndicesOf = List.AllIndicesOf(list=transpose, item=code_block_3, lacing=Longest)
maximumItem = List.MaximumItem(allIndicesOf, lacing=Longest)
getItemAtIndex = List.GetItemAtIndex(list=all_elements_of_category, index=maximumItem)
code_block_4 = CodeBlock { "---"; }
list_CleanOutput = Custom[List_CleanOutput](List_In=getItemAtIndex, Replace_With=code_block_4)  # Removes and Replaces Nulls and Empty Lists from input lists. *only works with flat or 2 dimentional lists_Need to fix it to go deeper or use list.map_!!List
LevelBelow = Output(list_CleanOutput.Cleaned)
code_block_5 = CodeBlock { true; }
firstIndexOf = List.FirstIndexOf(list=transpose, item=code_block_5, lacing=Longest)
getItemAtIndex_2 = List.GetItemAtIndex(list=all_elements_of_category, index=firstIndexOf)
code_block_6 = CodeBlock { "---"; }
list_CleanOutput_2 = Custom[List_CleanOutput](List_In=getItemAtIndex_2, Replace_With=code_block_6)
LevelAbove = Output(list_CleanOutput_2.Cleaned)
categories_2 = Categories("Levels")
all_elements_of_category_2 = ElementsOfCategory(categories_2)
code_block_7 = CodeBlock { "Elevation"; }
getParameterValueByName_2 = Element.GetParameterValueByName(element=all_elements_of_category_2, parameterName=code_block_7)
gt_3 = getParameterValueByName_2 > watch  # lacing=CrossProduct
transpose_2 = List.Transpose(gt_3)
code_block_8 = CodeBlock { true; }
firstIndexOf_2 = List.FirstIndexOf(list=transpose_2, item=code_block_8, lacing=Longest)
getItemAtIndex_3 = List.GetItemAtIndex(list=all_elements_of_category_2, index=firstIndexOf_2)
code_block_9 = CodeBlock { "---"; }
list_CleanOutput_3 = Custom[List_CleanOutput](List_In=getItemAtIndex_3, Replace_With=code_block_9)
LevelAbove_2 = Output(list_CleanOutput_3.Cleaned)  # "LevelAbove"
code_block_10 = CodeBlock { false; }
allIndicesOf_2 = List.AllIndicesOf(list=transpose_2, item=code_block_10, lacing=Longest)
maximumItem_2 = List.MaximumItem(allIndicesOf_2, lacing=Longest)
getItemAtIndex_4 = List.GetItemAtIndex(list=all_elements_of_category_2, index=maximumItem_2)
code_block_11 = CodeBlock { "---"; }
list_CleanOutput_4 = Custom[List_CleanOutput](List_In=getItemAtIndex_4, Replace_With=code_block_11)
LevelBelow_2 = Output(list_CleanOutput_4.Cleaned)  # "LevelBelow"
type = archilab.Revit.Elements.Elements.Type(getLocation)
