# Dynamo custom node Get_ModelElements_ByCategory.dyf (Dynamo 1.3.2.2480)
# category: Revit.Elements
# Collects all modeled/Placed elements in the active document. I have removed the Detail Items and Lines as they are included in the Annotation elements Node instead

string = StringInput("""OST_DuctTerminal
OST_Areas
OST_CableTrayFitting
OST_CableTray
OST_Casework
OST_Ceilings
OST_Columns
OST_CommunicationDevices
OST_ConduitFitting
OST_Conduit
OST_CurtainWallPanels
OST_CurtaSystem
OST_CurtainWallMullions
OST_DataDevices
OST_Doors
OST_DuctAccessory
OST_DuctFitting
OST_DuctInsulations
OST_DuctLinings
OST_PlaceHolderDucts
OST_DuctSystem
OST_DuctCurves
OST_ElectricalEquipment
OST_ElectricalFixtures
OST_Entourage
OST_FireAlarmDevices
OST_FlexDuctCurves
OST_FlexPipeCurves
OST_Floors
OST_Furniture
OST_FurnitureSystems
OST_GenericModel
OST_Grids
OST_Gutter
OST_HVAC_Zones
OST_Levels
OST_LightingDevices
OST_LightingFixtures
OST_Mass
OST_MechanicalEquipment
OST_FabricationContainment
OST_FabricationDuctwork
OST_FabricationHangers
OST_FabricationPipework
OST_NurseCallDevices
OST_BuildingPad
OST_Parking
OST_Parts
OST_PipeAccessory
OST_PipeFitting
OST_PlaceHolderPipes
OST_PipeCurves
OST_Planting
OST_PlumbingFixtures
OST_StairsRailing
OST_RailingSupport
OST_RailingTermination
OST_RailingTopRail
OST_StairsRailingBaluster
OST_RailingHandRail
OST_Ramps
OST_Roads
OST_Roofs
OST_RoofSoffit
OST_Fascia
OST_SecurityDevices
OST_ShaftOpening
OST_Site
OST_SpecialityEquipment
OST_Sprinklers
OST_Stairs
OST_StairsRuns
OST_StairsSupports
OST_StairsLandings
OST_AreaRein
OST_StructuralFramingSystem
OST_StructuralColumns
OST_StructConnections
OST_FabricAreas
OST_FabricReinforcement
OST_StructuralFoundation
OST_StructuralFraming
OST_PathRein
OST_Rebar
OST_Coupler
OST_StructuralStiffener
OST_StructuralTruss
OST_TelephoneDevices
OST_Topography
OST_Walls
OST_Windows
OST_Wire
Spaces
Rooms""")
Refresh = Input(Refresh: bool = false)
code_block = CodeBlock(string, Refresh)
# ---------- code_block.designscript (11 lines) ----------
list;
come;

[Imperative]

{
 if (come ==true)
  return = list;
 else
  return = list;
};
# ----------------------------------------
code_block_2 = CodeBlock { "\n"; }
split = String.Split(code_block.out2, code_block_2)
byName = Category.ByName(split)
list_CleanOutput = Custom[List_CleanOutput](List_In=byName)  # Removes and Replaces Nulls and Empty Lists from input lists. *only works with flat or 2 dimentional lists_Need to fix it to go deeper or use list.map
all_elements_of_category = ElementsOfCategory(list_CleanOutput.Cleaned)
isEmpty = List.IsEmpty(all_elements_of_category, lacing=Longest)
filterByBoolMask = List.FilterByBoolMask(list=list_CleanOutput.Cleaned, mask=isEmpty)
Categories = Output(filterByBoolMask.out)
boolean = BoolSelector(false)
clean = List.Clean(list=all_elements_of_category, preserveIndices=boolean)
All_Elements = Output(clean)
CategoryList = Input(CategoryList:var="---")
code_block_3 = CodeBlock { "---"; }
code_block_4 = CodeBlock(t3=CategoryList, t4=code_block_3) { t2 = t3 == t4; t5 = t2 == false; }
python_script = Python(IN[0]=code_block_4.t5, IN[1]=CategoryList)
# ---------- python_script.python (6 lines) ----------
bool=IN[0]

if bool == True:
	OUT=IN[True]
else:
	OUT=False
# ----------------------------------------
if_ = If(test=python_script, true=string, false=CategoryList)
