# Dynamo graph Home.dyn (Dynamo 1.3.2.2480)

family_types = FamilyTypes("26 51 00_LF_Interior:‍LF_Interior_Multi")
code_block = CodeBlock { 2; }
code_block_2 = CodeBlock { 1; }
get_LinkedRevitDoc = Custom[Get_LinkedRevitDoc++](Index_Or_SearchString=code_block, Refresh=code_block_2)  # Get Link instance, Doc, Name & Path. Use With Get Docs or Get Loaded RVT Links To get a link from a list of links. Use the all link names output to review the linked file names and chose the one you want by entering the index number of the desired link_#Lnk
code_block_3 = CodeBlock { 3; }
get_MepElements_ByDiscipline = Custom[Get_MepElements_ByDiscipline](Linked_Document=get_LinkedRevitDoc.Document, Index_Or_Search=code_block_3)  # Get Link instance, Doc, Name & Path. Use With Get Docs or Get Loaded RVT Links To get a link from a list of links. Use the all link names output to review the linked file names and chose the one you want by entering the index number of the desired link_#Lnk#MEP#PM!!
getLocation = Element.GetLocation(get_MepElements_ByDiscipline.3_Elements_ByCat)
Z = Point.Z(getLocation)
code_block_4 = CodeBlock { 0; }
gt = Z > code_block_4
filterByBoolMask = List.FilterByBoolMask(list=get_MepElements_ByDiscipline.3_Elements_ByCat, mask=gt)
code_block_5 = CodeBlock { 1; }
quantifyAndSelect_ItemAtIndex = Custom[QuantifyAndSelect_ItemAtIndex+](List_In=filterByBoolMask.in, Keys_In=get_MepElements_ByDiscipline.2_ChosenCategories, Get_Index=code_block_5)
flatten = Flatten(quantifyAndSelect_ItemAtIndex.Chosen_Index)
getLocation_2 = Element.GetLocation(flatten, lacing=Longest)
familyInstance_ByPointEachRun = Custom[FamilyInstance_ByPointEachRun](FamilyType=family_types, Points=getLocation_2)  # Place family instance by point each time you hit the 'Run' button without deleting previously placed ones. Don't use this node in 'Auto' mode!
get_ForcedParameterValue_AtIndex = Custom[Get_ForcedParameterValue_AtIndex+](elements=familyInstance_ByPointEachRun)  # ^Test
code_block_6 = CodeBlock { "_"; }
object_string_contains = Custom[Object➜String.Contains+](List_In=get_ForcedParameterValue_AtIndex.00_ParameterList, Extra_In=get_ForcedParameterValue_AtIndex.00_ParameterList, SearchString=code_block_6)  # Filters an input list by imput sting contains plus an extra list to run through the same filter._!!Filter
code_block_7 = CodeBlock { 2; }
removeItemAtIndex = List.RemoveItemAtIndex(list=object_string_contains.0_Match_IN, indices=code_block_7)
get_IdenityData = Custom[Get_IdenityData+](Elements=quantifyAndSelect_ItemAtIndex.Chosen_Index)  # Gets Revit element Id and GUID for input elements
code_block_8 = CodeBlock { "Location"; }
points_deliminatedstring = Custom[Points➜DeliminatedString+](points_In=getLocation_2)  # converts points to strings with an option to round off points to number of digits
addItemToFront = List.AddItemToFront(item=code_block_8, list=points_deliminatedstring)
create = List.Create(addItemToFront)
code_block_9 = CodeBlock { "Host Level"; }
code_block_10 = CodeBlock { 20; }
get_ForcedParameterValue_AtIndex_2 = Custom[Get_ForcedParameterValue_AtIndex+](elements=flatten, Index=code_block_10)
addItemToFront_2 = List.AddItemToFront(item=code_block_9, list=get_ForcedParameterValue_AtIndex_2.03_ForcedStringValue@L2)
code_block_11 = CodeBlock { "Mark_Number"; }
code_block_12 = CodeBlock { 12; }
get_ForcedParameterValue_AtIndex_3 = Custom[Get_ForcedParameterValue_AtIndex+](elements=flatten, Index=code_block_12)
code_block_13 = CodeBlock(Loc_Point=addItemToFront, Type_Name=get_IdenityData.5_TypeName, TYpe_Number=get_ForcedParameterValue_AtIndex_3.03_ForcedStringValue) { Loc_Level; Loc_Point; Type_Name; TYpe_Number; }  # unwired: Loc_Level
addItemToFront_3 = List.AddItemToFront(item=code_block_11, list=code_block_13.TYpe_Number@L2)
join = List.Join(get_IdenityData.6_ListOut, create, addItemToFront_2, addItemToFront_3)
transpose = List.Transpose(join)

# group: Send Report To PDF
string = StringInput("C:\Temp\")
get_UserName = Custom[Get_UserName]()  # Gets the Active UserName from Revit
code_block_14 = CodeBlock { "@"; }
string_SplitByCharachters = Custom[String_SplitByCharachters+](String_List=get_UserName, TrimBy=code_block_14)  # This node allows you to get the portion of a string after, before a defined charachter (or sequence of) within the string. Additionally you can get combined output of the string removing only the Charachter(s) chosen_!!String.SplitByCharachter
code_block_15 = CodeBlock { "."; }
code_block_16 = CodeBlock { ""; }
replace = String.Replace(str=string_SplitByCharachters.Portion_Prior, searchFor=code_block_15, replaceWith=code_block_16)
code_block_17 = CodeBlock { "_BimRpts"; }
code_block_18 = CodeBlock(a=string, b=replace, d=code_block_17) { a+b+d; }
get_ProjectNumber = Custom[Get_ProjectNumber]()  # gets the project number for the active Project
code_block_19 = CodeBlock { ".xlsx"; }
code_block_20 = CodeBlock(a=code_block_18, b=get_ProjectNumber, c=code_block_19) { a+b+c; }
date_Current_yymmdd = Custom[Date_Current_yymmdd]()  # get date in YYMMDD format for use in parameters and filenames
code_block_21 = CodeBlock(c=quantifyAndSelect_ItemAtIndex.Chosen_Category, v=date_Current_yymmdd.YYMMDD) { c+"_"+v; }
code_block_22 = CodeBlock { 1; }
writeToFile = Excel.WriteToFile(filePath=code_block_20, sheetName=code_block_21, startRow=code_block_22, startCol=code_block_22, data=transpose)
list_unique_items = Custom[List_Unique Items+](List_In=get_IdenityData.2_Type_Id)  # Count the number of times each individual unique element occurs in a list
fromPath = DirectoryObject(code_block_18)  # "Directory.FromPath"
get_ActiveView = Custom[Get_ActiveView]()  # captures your active view and keeps it as an input
name = Element.Name(get_ActiveView)
code_block_23 = CodeBlock { ".jpg"; }
code_block_24 = CodeBlock(a=fromPath, b=name, e=code_block_23) { a+b+e; }
code_block_25 = CodeBlock { "View Name"; }
export_viewasimage_directory = Custom[Export_ViewAsImage➜Directory](directoryPath=code_block_24, viewElement=get_ActiveView, viewParameter=code_block_25)  # Export Views As images to directory

set_linked_element_id = Custom[Set_Linked_Element Id](Local_Element=familyInstance_ByPointEachRun, Linked_Element=flatten)  # det the linked element id custom command to link two elements between models
get_Elements_BySelectInRevit = Custom[Get_Elements_BySelectInRevit](Elements_In=set_linked_element_id.ElementOut)  # Selects input elements in revit_!se

# group: get family types
categories = Categories("LightingFixtures")
get_familytype_at_index = Custom[Get_FamilyType_At Index+](Category_In=categories)  # get all loaded family types of a category
categories_2 = Categories("LightingFixtures")
code_block_26 = CodeBlock { 8; }
get_familytype_at_index_2 = Custom[Get_FamilyType_At Index+](Category_In=categories_2, Index_Or_SearchString=code_block_26)
get_all_instances_of_familytype = Custom[Get_All Instances of FamilyType](familyType=get_familytype_at_index_2.4_ChosenIndex)  # Collect all Placed Elements of imput Family Types from a document or revit link instance.

code_block_27 = CodeBlock { "_"; }
string_SplitByCharachters_2 = Custom[String_SplitByCharachters+](String_List=get_MepElements_ByDiscipline.1_ChosenGroup, TrimBy=code_block_27)
code_block_28 = CodeBlock { "CopyMonitor&Track"; }
code_block_29 = CodeBlock(a=string_SplitByCharachters_2.TrimAfter, B=code_block_28) { a+B; }
get_Instance_byNameSearch = Custom[Get_Instance_byNameSearch](Search_String=code_block_29)  # collects placed elements by input name
flatten_2 = Flatten(get_Instance_byNameSearch.exact_match)
code_block_30 = CodeBlock { {"1.1_Text_Note","1.2_Text_Note"}; }
getParameterValueByName = Element.GetParameterValueByName(element=flatten_2, parameterName=code_block_30, lacing=Longest)
code_block_31 = CodeBlock(x=getParameterValueByName) { x[0]; x[1]; }
string_2 = StringInput(" | ")
watch = Watch(quantifyAndSelect_ItemAtIndex.Chosen_Category)
code_block_32 = CodeBlock(e=string_2, a=watch, t=date_Current_yymmdd.YYMMDD, b=string_SplitByCharachters.Portion_Prior) { e+a+e+t+e+b; }
join_2 = List.Join(code_block_31.out0, code_block_32)
list_multilinestring = Custom[List➜MultilineString](List_In=join_2)  # converts a list into a single string with line breaks
code_block_33 = CodeBlock { ""; }
count = Count(familyInstance_ByPointEachRun)
string_3 = StringInput(" | ")
code_block_34 = CodeBlock { " Copied"; }
code_block_35 = CodeBlock(a=count, r=string_3, b=watch, w=code_block_34) { a+r+b+w; }
list_GroupAndReportByKey = Custom[List_GroupAndReportByKey+](List_In=get_IdenityData.3_Element_ID, Keys_In=get_IdenityData.4_Family_Name)  # groups an input list by input keys and outputs groups and unique keys_!!Select at Index+
join_3 = List.Join(code_block_31.out1, code_block_33, code_block_35, list_GroupAndReportByKey.Reports)
list_multilinestring_2 = Custom[List➜MultilineString](List_In=join_3)
create_2 = List.Create(list_multilinestring, list_multilinestring_2)
setParameterByName = Element.SetParameterByName(element=flatten_2, parameterName=code_block_30, value=create_2, lacing=Longest)
string_4 = StringInput("C:\Dropbox\__Projects_Temp\00_Project_0001\01_Project Data\259548_BimDataReports.xlsx")  # frozen
code_block_36 = CodeBlock { 1; }
readFromFile_Excel = Custom[ReadFromFile_Excel](filePath=string_4, runIt=code_block_36)  # A modified version of Konrad BB read excel node
transpose_2 = List.Transpose(readFromFile_Excel)
deconstruct = List.Deconstruct(list=transpose_2, lacing=Longest)
code_block_37 = CodeBlock { {3,4,5,6}; }
getItemAtIndex = List.GetItemAtIndex(list=deconstruct.rest, index=code_block_37)
watch_2 = Watch(deconstruct.first)
code_block_38 = CodeBlock(x=watch_2, p=code_block_37) { x[p]; }
