# Dynamo custom node Create_TimeSpan_ByNumberOfDays.dyf (Dynamo 1.3.2.2480)
# category: ArupBimSF.Time
# input amount of days and it outputs a date in yymmdd format. Greate for use in naming files and date_stamping

n0_Start_Date = Output()  # "0_Start_Date"; unwired: arg0
n1_End_Date = Output()  # "1_End_Date"; unwired: arg0
Date_In = Input(Date_In = DSCore.DateTime.Now)
date_Current_yymmdd = Custom[Date_Current_yymmdd](Date_In=Date_In)  # get date in YYMMDD format for use in parameters and filenames
n2_Start_YYMMDD = Output(date_Current_yymmdd.YYMMDD)  # "2_Start_YYMMDD"
NumberOfDays = Input(NumberOfDays: int = 0)
create = TimeSpan.Create(NumberOfDays)
addTimeSpan = DateTime.AddTimeSpan(arg1=create)  # unwired: arg0
date_Current_yymmdd_2 = Custom[Date_Current_yymmdd](Date_In=addTimeSpan)
n3_End_YYMMDD = Output(date_Current_yymmdd_2.YYMMDD)  # "3_End_YYMMDD"
totalDays = TimeSpan.TotalDays(create)
n4_Total_Days = Output(totalDays)  # "4_Total Days"
