# Dynamo custom node Date_Current_yymmdd.dyf (Dynamo 1.3.2.2480)
# category: ArupBimSF.Time
# get date in YYMMDD format for use in parameters and filenames

Date_In = Input(Date_In = DSCore.DateTime.Now)
components = DateTime.Components(Date_In)
string_from_object = FromObject(components.out0)
code_block = CodeBlock(t3=string_from_object) { t4 = String.Remove(t3, 0, 2); }
string_from_object_2 = FromObject(components.out1)
code_block_2 = CodeBlock(t2=string_from_object_2) { t1 = String.Length(t2); t4 = t1; t6 = t2; t5 = t4 > 1; t7 = String.PadLeft(t6, 2, "0"); }
if_ = If(test=code_block_2.t5, true=string_from_object_2, false=code_block_2.t7)
string_from_object_3 = FromObject(components.out2)
code_block_3 = CodeBlock(t2=string_from_object_3) { t1 = String.Length(t2); t4 = t1; t6 = t2; t5 = t4 > 1; t7 = String.PadLeft(t6, 2, "0"); }
if_2 = If(test=code_block_3.t5, true=string_from_object_3, false=code_block_3.t7)
concat = String.Concat(code_block, if_, if_2)
YYMMDD = Output(concat)
Written = Output(Date_In)
