# Dynamo custom node Filter_ByAndSetParameter_AtIndex+.dyf (Dynamo 1.3.2.2480)
# category: ArupBimSF.^TestingGrounds
# Filter a list of elements and set a parameter at index

CategoryOrElements = Input()
ReFresh = Input(ReFresh : bool = true)
code_block = CodeBlock(CategoryOrElements, ReFresh)
# ---------- code_block.designscript (11 lines) ----------
list;
come;

[Imperative]

{
 if (come ==true)
  return = list;
 else
  return = list;
};
# ----------------------------------------
type = Object.Type(code_block.out2)
code_block_2 = CodeBlock { "Revit.Elements.Category"; }
eq = type == code_block_2
list_any_false = Custom[List_Any False](List_In=eq)  # Returns false if any of the values is false
all_elements_of_category = ElementsOfCategory(code_block.out2)
action_this_or_that = Custom[Action_This Or That](Bool_Switch=list_any_false, Item1=code_block.out2, Item2=all_elements_of_category)  # toggles between two choices
list_CleanOutput = Custom[List_CleanOutput](List_In=action_this_or_that)  # Removes and Replaces Nulls and Empty Lists from input lists. *only works with flat or 2 dimentional lists_Need to fix it to go deeper or use list.map
parameters = Element.Parameters(list_CleanOutput.Cleaned)
isReadOnly = Parameter.IsReadOnly(parameters)
filterByBoolMask = List.FilterByBoolMask(list=parameters, mask=isReadOnly)
name = Parameter.Name(filterByBoolMask.out)
flatten = Flatten(name)
uniqueItems = List.UniqueItems(flatten)
sort = List.Sort(uniqueItems)
Parameter_List = Output(sort)
Index_Of_Param = Input(Index_Of_Param : var = "")
getItemAtIndex = List.GetItemAtIndex(list=sort, index=Index_Of_Param)
Chosen_Parameter = Output(getItemAtIndex)
code_block_3 = CodeBlock { ""; }
eq_2 = Index_Of_Param == code_block_3
list_any_false_2 = Custom[List_Any False](List_In=eq_2)
action_RunMe = Custom[Action_RunMe](Should_I=list_any_false_2, ThingToDo=list_CleanOutput.Cleaned)  # Uses A boolean to determine whether to run a function or sequence.
python_script = Python(IN[0]=action_RunMe)
# ---------- python_script.python (20 lines) ----------
# Default imports
import clr
clr.AddReference('ProtoGeometry')
from Autodesk.DesignScript.Geometry import *

#The input to this node will be stored in the IN[0] variable.
list = IN[0]

cleanlist = []
for i in list:
	if hasattr(i, "__iter__"):
		for ii in i:
			if not (i is None):
				cleanlist.append(i)	
	else:
		if not (i is None):
			cleanlist.append(i)	

#Assign your output to the OUT variable
OUT = cleanlist
# ----------------------------------------
Partial_Or_Exact = Input(Partial_Or_Exact : bool = true)
getItemAtIndex_2 = List.GetItemAtIndex(list=sort, index=Index_Of_Param)
getParameterValueByName = Element.GetParameterValueByName(element=python_script, parameterName=getItemAtIndex_2)
string_from_object = FromObject(getParameterValueByName)
Search_Value = Input(Search_Value: var = "")
string_from_object_2 = FromObject(Search_Value)
code_block_4 = CodeBlock { true; }
contains = String.Contains(str=string_from_object, searchFor=string_from_object_2, ignoreCase=code_block_4)
eq_3 = string_from_object_2 == string_from_object
action_this_or_that_2 = Custom[Action_This Or That](Bool_Switch=Partial_Or_Exact, Item1=contains, Item2=eq_3)
filterByBoolMask_2 = List.FilterByBoolMask(list=python_script, mask=action_this_or_that_2)
Element_In = Output(filterByBoolMask_2.in)
Element_Out = Output(filterByBoolMask_2.out)
filterByBoolMask_3 = List.FilterByBoolMask(list=getParameterValueByName, mask=action_this_or_that_2)
ParameterValue_In = Output(filterByBoolMask_3.in)
ParameterValue_Out = Output(filterByBoolMask_3.out)
SetParam_Index = Input(SetParam_Index: var = "")
eq_4 = SetParam_Index == code_block_3
list_any_false_3 = Custom[List_Any False](List_In=eq_4)
SetParam_Vlaue = Input(SetParam_Vlaue: var = "")
join = List.Join(SetParam_Index, SetParam_Vlaue)
action_RunMe_2 = Custom[Action_RunMe](Should_I=list_any_false_3, ThingToDo=join)
code_block_5 = CodeBlock(x=action_RunMe_2) { x[0]; x[1]; }
getItemAtIndex_3 = List.GetItemAtIndex(list=sort, index=code_block_5.out0)
setParameterByName = Element.SetParameterByName(parameterName=getItemAtIndex_3, value=code_block_5.out1)  # unwired: element
map = List.Map(list=filterByBoolMask_2.in, f_x=setParameterByName)
Element_SetParam = Output(map)
