# Dynamo custom node Get_DynamoElements_By Revit Selection.dyf (Dynamo 1.3.2.2480)
# category: ArupBimSF.Revit.Element_Selectors
# get a list of elements selected in revit

empty = List.Empty()
Refresh = Input(Refresh:bool = true)
python_script = Python(IN[0]=empty, IN[1]=Refresh)
# ---------- python_script.python (42 lines) ----------
#python nodes in dynamo 1.0
#proposed by Julien Benoit @jbenoit44 
#http://aecuandme.wordpress.com/
import clr
clr.AddReference('ProtoGeometry')
from Autodesk.DesignScript.Geometry import *
# Import ToDSType(bool) extension method
clr.AddReference("RevitNodes")
import Revit
clr.ImportExtensions(Revit.Elements)
# Import geometry conversion extension methods
clr.ImportExtensions(Revit.GeometryConversion)
# Import DocumentManager and TransactionManager
clr.AddReference("RevitServices")
import RevitServices
from RevitServices.Persistence import DocumentManager
from RevitServices.Transactions import TransactionManager
from System.Collections.Generic import *
# Import RevitAPI
clr.AddReference("RevitAPI")
import Autodesk
from Autodesk.Revit.DB import *

doc = DocumentManager.Instance.CurrentDBDocument
uiapp = DocumentManager.Instance.CurrentUIApplication
app = uiapp.Application
uidoc=DocumentManager.Instance.CurrentUIApplication.ActiveUIDocument

sel=[]
elt=[]
# Start Transaction
TransactionManager.Instance.EnsureInTransaction(doc)

sel=uidoc.Selection.GetElementIds()

for i in sel:
	elt.append(doc.GetElement(i).ToDSType(True))
		
# End Transaction
TransactionManager.Instance.TransactionTaskDone()

OUT=elt
# ----------------------------------------
Element = Output(python_script)
