# Dynamo custom node Get_MepElements_ByDiscipline.dyf (Dynamo 1.3.2.2480)
# category: ArupBimSF.Revit.Links & Imports
# Get Link instance, Doc, Name & Path. Use With Get Docs or Get Loaded RVT Links To get a link from a list of links.  Use the all link names output to review the linked file names and chose the one you want by entering the index number of the desired link_#Lnk#MEP#PM!!

string = StringInput("01_SpacesRooms&Zones,22_Plumbing,23_Mechanical,26_Electrical,27_ComDevices")
deliminated_string_list = Custom[Deliminated String ➜ List](Strings_In=string)  # Splits a comma deliminated String to a list of strings_!!List DeliminatedStringToList
n0_CategoryGroups = Output(deliminated_string_list)  # "0_CategoryGroups"
deliminated_string_list_2 = Custom[Deliminated String ➜ List](Strings_In=string)
Index_Or_Search = Input(Index_Or_Search:var="---")
code_block = CodeBlock { "---"; }
eq = Index_Or_Search == code_block
type = Object.Type(Index_Or_Search)
code_block_2 = CodeBlock { "System.Int"; }
contains = String.Contains(str=type, searchFor=code_block_2)
join = List.Join(eq, contains)
list_any_true = Custom[List_Any True](List_In=join)  # #Depricated use list contains item and put true or false in a code block
string_from_object = FromObject(Index_Or_Search)
code_block_3 = CodeBlock { 1; }
contains_2 = String.Contains(str=deliminated_string_list_2, searchFor=string_from_object, ignoreCase=code_block_3)
code_block_4 = CodeBlock { true; }
indexOf = IndexOf(arg1=code_block_4, lacing=Longest)  # unwired: arg0
map = List.Map(list=contains_2, f_x=indexOf)
uniqueItems = List.UniqueItems(map)
if_ = If(test=contains, true=Index_Or_Search, false=uniqueItems)
if_2 = If(test=list_any_true, true=Index_Or_Search, false=if_)
getItemAtIndex = List.GetItemAtIndex(list=deliminated_string_list_2, index=if_2)
n1_ChosenGroup = Output(getItemAtIndex)  # "1_ChosenGroup"
mep_CategoriesGroups_Db = Custom[Mep_CategoriesGroups_Db]()  # A collection of MEP Categories
Refresh = Input(Refresh : bool = true)
code_block_5 = CodeBlock(mep_CategoriesGroups_Db.All_Categories, Refresh)
# ---------- code_block_5.designscript (11 lines) ----------
list;
come;

[Imperative]

{
 if (come ==true)
  return = list;
 else
  return = list;
};
# ----------------------------------------
getItemAtIndex_2 = List.GetItemAtIndex(list=code_block_5.out2, index=if_2)
flatten = Flatten(getItemAtIndex_2)
Linked_Document = Input(Linked_Document: var = "---")
string_from_object_2 = FromObject(Linked_Document)
string_2 = StringInput("Autodesk.Revit.DB.Document")
eq_2 = string_from_object_2 == string_2
flatten_2 = Flatten(getItemAtIndex_2)
get_LinkedElements_ByCategory = Custom[Get_LinkedElements_ByCategory](Category_In=flatten_2, Linked_Doc=Linked_Document, lacing=Longest)  # Gets all elements of chosen category from A linked RVT Model
list_CleanOutput = Custom[List_CleanOutput](List_In=get_LinkedElements_ByCategory)  # Removes and Replaces Nulls and Empty Lists from input lists. *only works with flat or 2 dimentional lists_Need to fix it to go deeper or use list.map_!!List
all_elements_of_category = ElementsOfCategory(flatten_2)
list_CleanOutput_2 = Custom[List_CleanOutput](List_In=all_elements_of_category)
action_this_or_that = Custom[Action_This Or That](Bool_Switch=eq_2, Item1=list_CleanOutput.Indices, Item2=list_CleanOutput_2.Indices)  # toggles between two choices
removeItemAtIndex = List.RemoveItemAtIndex(list=flatten, indices=action_this_or_that)
n2_ChosenCategories = Output(removeItemAtIndex)  # "2_ChosenCategories"
action_this_or_that_2 = Custom[Action_This Or That](Bool_Switch=eq_2, Item1=list_CleanOutput.Cleaned, Item2=list_CleanOutput_2.Cleaned)
n3_Elements_ByCat = Output(action_this_or_that_2)  # "3_Elements_ByCat"
getItemAtIndex_3 = List.GetItemAtIndex(list=flatten, index=action_this_or_that)
n4_ChosenCat_NoElem = Output(getItemAtIndex_3)  # "4_ChosenCat_NoElem"
code_block_6 = CodeBlock {  }
