# Dynamo custom node Get_ModelCategories_Doc+.dyf (Dynamo 1.3.2.2480)
# category: Revit.Elements
# Collects all modeled/Placed elements in the active document. I have removed the Detail Items and Lines as they are included in the Annotation elements Node instead

LinkedDoc = Input(LinkedDoc: var = "")  # Only Use this port if you want a linked Doc. Leave open for Active Document
string_from_object = FromObject(LinkedDoc)
string = StringInput("Autodesk.Revit.DB.Document")
eq = string_from_object == string
string_2 = StringInput("""OST_DuctTerminal
OST_Areas
OST_CableTrayFitting
OST_CableTray
OST_Casework
OST_Ceilings
OST_Columns
OST_CommunicationDevices
OST_ConduitFitting
OST_Conduit
OST_CurtainWallPanels
OST_CurtaSystem
OST_CurtainWallMullions
OST_DataDevices
OST_Doors
OST_DuctAccessory
OST_DuctFitting
OST_DuctInsulations
OST_DuctLinings
OST_PlaceHolderDucts
OST_DuctSystem
OST_DuctCurves
OST_ElectricalEquipment
OST_ElectricalFixtures
OST_Entourage
OST_FireAlarmDevices
OST_FlexDuctCurves
OST_FlexPipeCurves
OST_Floors
OST_Furniture
OST_FurnitureSystems
OST_GenericModel
OST_Grids
OST_Gutter
OST_HVAC_Zones
OST_Levels
OST_LightingDevices
OST_LightingFixtures
OST_Mass
OST_MechanicalEquipment
OST_FabricationContainment
OST_FabricationDuctwork
OST_FabricationHangers
OST_FabricationPipework
OST_NurseCallDevices
OST_BuildingPad
OST_Parking
OST_Parts
OST_PipeAccessory
OST_PipeFitting
OST_PlaceHolderPipes
OST_PipeCurves
OST_Planting
OST_PlumbingFixtures
OST_StairsRailing
OST_RailingSupport
OST_RailingTermination
OST_RailingTopRail
OST_StairsRailingBaluster
OST_RailingHandRail
OST_Ramps
OST_Roads
OST_Roofs
OST_RoofSoffit
OST_Fascia
OST_SecurityDevices
OST_ShaftOpening
OST_Site
OST_SpecialityEquipment
OST_Sprinklers
OST_Stairs
OST_StairsRuns
OST_StairsSupports
OST_StairsLandings
OST_AreaRein
OST_StructuralFramingSystem
OST_StructuralColumns
OST_StructConnections
OST_FabricAreas
OST_FabricReinforcement
OST_StructuralFoundation
OST_StructuralFraming
OST_PathRein
OST_Rebar
OST_Coupler
OST_StructuralStiffener
OST_StructuralTruss
OST_TelephoneDevices
OST_Topography
OST_Walls
OST_Windows
OST_Wire
Spaces
Rooms
Sheets
Views
Viewports""")
code_block = CodeBlock { "\n"; }
split = String.Split(string_2, code_block)
byName = Category.ByName(split)
string_from_object_2 = FromObject()  # unwired: arg0
sortByFunction = SortByFunction(byName, string_from_object_2)
Refresh = Input(Refresh: bool = false)
code_block_2 = CodeBlock(sortByFunction, Refresh)
# ---------- code_block_2.designscript (11 lines) ----------
list;
come;

[Imperative]

{
 if (come ==true)
  return = list;
 else
  return = list;
};
# ----------------------------------------
get_LinkedElements_ByCategory = Custom[Get_LinkedElements_ByCategory](Category_In=code_block_2.out2, Linked_Doc=LinkedDoc, lacing=Longest)  # Gets all elements of chosen category from A linked RVT Model
all_elements_of_category = ElementsOfCategory(code_block_2.out2)
action_this_or_that = Custom[Action_This Or That](Bool_Switch=eq, Item1=get_LinkedElements_ByCategory, Item2=all_elements_of_category)  # toggles between two choices
list_CleanOutput = Custom[List_CleanOutput](List_In=action_this_or_that)  # Removes and Replaces Nulls and Empty Lists from input lists. *only works with flat or 2 dimentional lists_Need to fix it to go deeper or use list.map
boolean = BoolSelector(false)
clean = List.Clean(list=list_CleanOutput.Cleaned, preserveIndices=boolean)
All_Elements = Output(clean)
graph_SeqPassthru = Custom[Graph_SeqPassthru](passThrough=code_block_2.out2, waitFor=action_this_or_that)  # forces an operation to run in sequence.
isEmpty = List.IsEmpty(get_LinkedElements_ByCategory, lacing=Longest)
isEmpty_2 = List.IsEmpty(all_elements_of_category, lacing=Longest)
action_this_or_that_2 = Custom[Action_This Or That](Bool_Switch=eq, Item1=isEmpty, Item2=isEmpty_2)
filterByBoolMask = List.FilterByBoolMask(list=graph_SeqPassthru, mask=action_this_or_that_2)
getItemAtIndex = List.GetItemAtIndex(list=graph_SeqPassthru, index=list_CleanOutput.Indices)
join = List.Join(filterByBoolMask.out, getItemAtIndex)
flatten = Flatten(join)
Categories_Doc = Output(flatten)
