# Dynamo custom node RoomBoundaries_InView_ToClipBoard.dyf (Dynamo 1.3.2.2480)
# category: EEC.Revit
# use this to send room boundaries from an arch file to the cipboard as a multiline string... need to use string line to dyn line node to convert

categories = Categories("Rooms")
code_block = CodeBlock { 1; }
get_ActiveView = Custom[Get_ActiveView](Refresh=code_block)  # captures your active view and keeps it as an input
byCategoryAndView = archilab.Revit.Selection.Select.ByCategoryAndView(categories, get_ActiveView)
coreCenterBoundary = Room.CoreCenterBoundary(byCategoryAndView)
count = Count(coreCenterBoundary@L2)
flatten = Flatten(coreCenterBoundary)
create = List.Create(count, flatten)
flatten_2 = Flatten(create)
list_clipboard_asmultilinestring = Custom[List➜ClipBoard_AsMultilineString](List_In=flatten_2)  # sends input list to clipboard as a single multi-line string
to_clipboard = Output(list_clipboard_asmultilinestring)
