# Dynamo custom node TimeSpan_ByNumberOfDays.dyf (Dynamo 1.3.2.2480)
# category: ArupBimSF.Time
# input amount of days and it outputs a date in yymmdd format. Greate for use in naming files and date_stamping

StartDate = Input(StartDate = DSCore.DateTime.Now)
date_Current_yymmdd = Custom[Date_Current_yymmdd](Date_In=StartDate)  # get date in YYMMDD format for use in parameters and filenames
n0_Start_Date = Output(date_Current_yymmdd.Written)  # "0_Start_Date"
NumberOfDays = Input(NumberOfDays: int = 0)
create = TimeSpan.Create(NumberOfDays)
addTimeSpan = DateTime.AddTimeSpan(date_Current_yymmdd.Written, create)
date_Current_yymmdd_2 = Custom[Date_Current_yymmdd](Date_In=addTimeSpan)
n1_End_Date = Output(date_Current_yymmdd_2.Written)  # "1_End_Date"
n2_Start_YYMMDD = Output(date_Current_yymmdd.YYMMDD)  # "2_Start_YYMMDD"
n3_End_YYMMDD = Output(date_Current_yymmdd_2.YYMMDD)  # "3_End_YYMMDD"
totalDays = TimeSpan.TotalDays(create)
n4_Total_Days = Output(totalDays)  # "4_Total Days"
code_block = CodeBlock {  }
