# Dynamo custom node TimeSpan_ByStartDate_EndDate.dyf (Dynamo 1.3.2.2480)
# category: ArupBimSF.Time
# Creates a timespan from a start and end date.  Input dates in yymmdd format

StartDate_YYMMDD = Input(StartDate_YYMMDD: var)  # enter the start date in yymmdd format or leave empty to use today as start date
date_convert_yymmdd_to_written = Custom[Convert_YYMMDD to WrittenDate](EndDate_YYMMDD=StartDate_YYMMDD)  # converts input date in yymmdd format to a written date
date_Current_yymmdd = Custom[Date_Current_yymmdd](Date_In=date_convert_yymmdd_to_written)  # get date in YYMMDD format for use in parameters and filenames
n0_Start_Date = Output(date_Current_yymmdd.Written)  # "0_Start_Date"
code_block = CodeBlock { 2000; }
EndDate_YYMMDD = Input(EndDate_YYMMDD:var)  # enter the date as an integer or string in yymmdd format
string_from_object = FromObject(EndDate_YYMMDD)
code_block_2 = CodeBlock(t4=string_from_object) { t3 = String.Length(t4); n = t3; t1 = (0..n - 1); t5 = String.Substring(t4, t1, 1); }
code_block_3 = CodeBlock { 2; }
chop = List.Chop(list=code_block_2.t5, lengths=code_block_3)
code_block_4 = CodeBlock { ""; }
list_MergeSublists = Custom[List_MergeSublists](List=chop, Seperator=code_block_4)  # Merges sublists into strings with seperator_!!List.Functions
flatten = Flatten(list_MergeSublists)
toNumber = String.ToNumber(flatten, lacing=Longest)
code_block_5 = CodeBlock(x=toNumber) { x[0]; x[1]; x[2]; }
code_block_6 = CodeBlock(z=code_block, b=code_block_5.out0) { z+b; }
byDate = DateTime.ByDate(code_block_6, code_block_5.out1, code_block_5.out2)
n1_End_Date = Output(byDate)  # "1_End_Date"
n2_Start_YYMMDD = Output(date_Current_yymmdd.YYMMDD)  # "2_Start_YYMMDD"
n3_End_YYMMDD = Output(string_from_object)  # "3_End_YYMMDD"
byDateDifference = TimeSpan.ByDateDifference(date_Current_yymmdd.Written, byDate)
n4_TotalDays = Output(byDateDifference)  # "4_TotalDays"
