# Dynamo custom node Get_RefElements_ByCategory+.dyf (Dynamo 1.3.2.2480)
# category: ArupBimSF.Revit.Reference Objects
# Gets reference elements from active doc

string = StringInput("""Grids
Levels
Matchline
Scope Boxes
Crop Boundaries
Reference Planes
Plan Region
Callout Boundary""")
Refresh = Input(Refresh: bool = true)
code_block = CodeBlock(string, Refresh)
# ---------- code_block.designscript (11 lines) ----------
list;
come;

[Imperative]

{
 if (come ==true)
  return = list;
 else
  return = list;
};
# ----------------------------------------
multilinestring_list = Custom[MultilineString➜List](String_In=code_block.out2)  # converts a string with line breaks in to a list of strings
byName = Category.ByName(multilinestring_list)
all_elements_of_category = ElementsOfCategory(byName)
list_CleanOutput = Custom[List_CleanOutput+](List_In=all_elements_of_category)  # Removes and or places nulls and empties up to 2 dimentional_!!List
removeItemAtIndex = List.RemoveItemAtIndex(list=byName, indices=list_CleanOutput.IndicesOut)
n0_CategoryList = Output(removeItemAtIndex)  # "0_CategoryList"
Get_Category = Input(Get_Category : var = "")
type = Object.Type(Get_Category)
code_block_2 = CodeBlock { "System.String"; }
eq = type == code_block_2
code_block_3 = CodeBlock { 1; }
list_FilterByStringMatch = Custom[List_FilterByStringMatch](list=removeItemAtIndex, SearchString=Get_Category, Contains_Or_Equals=code_block_3)  # Filters a list of elements by whether or not they contain a search string. I added an option to run it by string match as well._!fi!Li
code_block_4 = CodeBlock { true; }
allIndicesOf = List.AllIndicesOf(list=list_FilterByStringMatch.Other, item=code_block_4)
if_ = If(test=eq, true=allIndicesOf, false=Get_Category)
getItemAtIndex = List.GetItemAtIndex(list=list_CleanOutput.Cleaned, index=if_)
n1_Chosen_Elements = Output(getItemAtIndex)  # "1➜Chosen_Elements"
name = Custom[Get_Element.Name+](elements=getItemAtIndex, lacing=Longest)  # Get the element name from all types of elements including system families_!!Get!Element
n2_TypeNames = Output(name)  # "2➜TypeNames"
flatten = Flatten(getItemAtIndex)
Get_Type = Input(Get_Type : var = "")
type_2 = Object.Type(Get_Type)
code_block_5 = CodeBlock { "System.String"; }
eq_2 = type_2 == code_block_5
flatten_2 = Flatten(name)
code_block_6 = CodeBlock { 1; }
list_FilterByStringMatch_2 = Custom[List_FilterByStringMatch](list=flatten_2, SearchString=Get_Type, Contains_Or_Equals=code_block_6)
code_block_7 = CodeBlock { true; }
allIndicesOf_2 = List.AllIndicesOf(list=list_FilterByStringMatch_2.Other, item=code_block_7)
if_2 = If(test=eq_2, true=allIndicesOf_2, false=Get_Type)
getItemAtIndex_2 = List.GetItemAtIndex(list=flatten, index=if_2)
n3_Chosen_Type_s = Output(getItemAtIndex_2)  # "3➜➜Chosen_Type(s)"
