# Dynamo custom node zzGet_RefElements_ByCategory++.dyf (Dynamo 1.3.2.2480)
# category: ArupBimSF.Revit.Reference Objects
# Gets reference elements from active doc

string = StringInput("""Grids
Levels
Matchline
Scope Boxes
Crop Boundaries
Reference Planes
Section Boxes""")
# note: I have craeted one that works!__This one dies
Refresh = Input(Refresh: bool = true)
code_block = CodeBlock(string, Refresh)
# ---------- code_block.designscript (11 lines) ----------
list;
come;

[Imperative]

{
 if (come ==true)
  return = list;
 else
  return = list;
};
# ----------------------------------------
multilinestring_list = Custom[MultilineString➜List](String_In=code_block.out2)  # converts a string with line breaks in to a list of strings
byName = Category.ByName(multilinestring_list)
all_elements_of_category = ElementsOfCategory(byName)
list_CleanOutput = Custom[List_CleanOutput+](List_In=all_elements_of_category)  # Removes and or places nulls and empties up to 2 dimentional_!!List
removeItemAtIndex = List.RemoveItemAtIndex(list=byName, indices=list_CleanOutput.IndicesOut)
n0_Categories = Output(removeItemAtIndex)  # "0_Categories"
Get_Category = Input(Get_Category : int = 0)
getItemAtIndex = List.GetItemAtIndex(list=removeItemAtIndex, index=Get_Category)
n1_Chosen_Category = Output(getItemAtIndex)  # "1➜Chosen_Category"
string_2 = StringInput("""Plan Region
Callout Boundary
Rooms
Spaces
HVAC Zones""")  # frozen
getItemAtIndex_2 = List.GetItemAtIndex(list=list_CleanOutput.Cleaned, index=Get_Category)
n2_Chosen_Elements = Output(getItemAtIndex_2)  # "2➜Chosen_Elements"
name = Element.Name(getItemAtIndex_2)
n3_TypeNames = Output(name)  # "3➜➜TypeNames"
Get_Type = Input(Get_Type : var = "--")
type = Object.Type(Get_Type)
code_block_2 = CodeBlock { "System.String"; }
eq = type == code_block_2
object_string_contains_basic = Custom[Object➜String.Contains_Basic](List_In=multilinestring_list, Search_For=Get_Type)  # filters a list of objects for input string values
code_block_3 = CodeBlock(Match=object_string_contains_basic.Match) { {null,Match}; }
isEmpty = List.IsEmpty(object_string_contains_basic.Match)
# note: The List.Combine node cannot handle an empty list so I use the boolean mask to swap out the empty with a null.  This makes it operate smoothly.
filterByBoolMask = List.FilterByBoolMask(list=code_block_3, mask=isEmpty)
graph_SeqPassthru = Custom[Graph_SeqPassthru](passThrough=getItemAtIndex_2, waitFor=eq)  # forces an operation to run in sequence.
getItemAtIndex_3 = List.GetItemAtIndex(list=graph_SeqPassthru, index=eq)
if_ = If(test=eq, true=filterByBoolMask.in, false=getItemAtIndex_3)
n4_Chosen_Type = Output(if_)  # "4➜➜➜Chosen_Type"
Elem_All_Categories = Output(list_CleanOutput.Cleaned)  # "➜Elem_All_Categories"
