# Dynamo custom node Element_Has Area.dyf (Dynamo 1.3.2.2480)
# category: ArupBimSF.Revit.Elements
# runs areas, spaces or rooms and geterimines if area is greater than 0

Elements_In = Input(Elements_In : var[]..[])
code_block = CodeBlock(t4=Elements_In)
# ---------- code_block.designscript (5 lines) ----------
t3 = t4.GetParameterValueByName("Area");
t5 = t3 > 0;
t6 = DSCore.List.GroupByKey(t4, t5);
t7 = __TryGetValueFromNestedDictionaries(t6, "groups");
t8 = __TryGetValueFromNestedDictionaries(t6, "unique keys");
# ----------------------------------------
code_block_2 = CodeBlock(x=code_block.t7) { x[0]; x[1]; }
Has_area = Output(code_block_2.out0)
No_area = Output(code_block_2.out1)
