# Dynamo custom node Element_IsViewDependent.dyf (Dynamo 1.3.2.2480)
# category: ArupBimSF.Revit.Elements_ViewDependent
# determines if an element is view specific

familyInstances = Input()
code_block = CodeBlock(item=familyInstances) { Flatten({item}); }
python_script = Python(IN[0]=code_block)
# ---------- python_script.python (40 lines) ----------
import clr
clr.AddReference('ProtoGeometry')
from Autodesk.DesignScript.Geometry import *

# Import ToDSType(bool) extension method
clr.AddReference("RevitNodes")
import Revit
clr.ImportExtensions(Revit.Elements)

# Import DocumentManager and TransactionManager
clr.AddReference("RevitServices")
import RevitServices
from RevitServices.Persistence import DocumentManager
from RevitServices.Transactions import TransactionManager


from System.Collections.Generic import *

# Import RevitAPI
clr.AddReference("RevitAPI")
import Autodesk

doc = DocumentManager.Instance.CurrentDBDocument
uiapp = DocumentManager.Instance.CurrentUIApplication
app = uiapp.Application

#The inputs to this node will be stored as a list in the IN variable.
familyInstances = UnwrapElement(IN[0])
viewspecifics = []
#transformIsTran = []
#vectTranX = []
#vectTranY = []
#vectTranZ = []
#determinants = []
#isconformals = []
#hasreflections = []
for y in familyInstances:
	viewspecifics.append(y.ViewSpecific)
#Assign your output to the OUT variable
OUT = viewspecifics
# ----------------------------------------
code_block_2 = CodeBlock { 0; }
getItemAtIndex = List.GetItemAtIndex(list=python_script, index=code_block_2)
viewSpecific = Output(getItemAtIndex)
