# Dynamo custom node FamilyInstance_By Point In View.dyf (Dynamo 1.3.2.2480)
# category: ArupBimSF.Revit.Elements_Families
# places an annotation / view dependant family (ie; detail item, gen anno, title block...More) at a specified point in (input) view or view list.

Points_In = Input(Points_In : Autodesk.Point)
code_block = CodeBlock(item=Points_In) { Flatten({item}); }
FamilyTypes_In = Input()
Views_In = Input()
python_script = Python(IN[0]=code_block, IN[1]=FamilyTypes_In, IN[2]=Views_In)
# ---------- python_script.python (31 lines) ----------
import clr
clr.AddReference('RevitAPI')
from Autodesk.Revit.DB import *

clr.AddReference("RevitNodes")
import Revit
clr.ImportExtensions(Revit.Elements)
clr.ImportExtensions(Revit.GeometryConversion)

clr.AddReference("RevitServices")
import RevitServices
from RevitServices.Persistence import DocumentManager
from RevitServices.Transactions import TransactionManager

doc = DocumentManager.Instance.CurrentDBDocument
points = UnwrapElement(IN[0])
famtype = UnwrapElement(IN[1])
lvl = UnwrapElement(IN[2])
elementlist = list()
counter = 0

TransactionManager.Instance.EnsureInTransaction(doc)
# make sure familysymbol is active
if famtype.IsActive == False:
	famtype.Activate()
	doc.Regenerate()
for point in points:
	newobj = doc.Create.NewFamilyInstance(point.ToXyz(),famtype,lvl)
	elementlist.append(newobj.ToDSType(False))
TransactionManager.Instance.TransactionTaskDone()
OUT = elementlist
# ----------------------------------------
python_script_2 = Python(IN[0]=code_block, IN[1]=python_script)
# ---------- python_script_2.python (4 lines) ----------
check = IN[0]
items = IN[1]
if isinstance(check, (list)): OUT = items
else: OUT = items[0]
# ----------------------------------------
familyInstance = Output(python_script_2)
