# Dynamo custom node FamilyInstance_By Point In View_Dependent.dyf (Dynamo 1.3.2.2480)
# category: ArupBimSF.Revit.Elements_Families
# place a view dependent family  instance at a point in view (detail component, generic anno)

Views_In = Input(Views_In: var[])
Types_In = Input(Types_In: var[])
Points_In = Input(Points_In: var[])
python_script = Python(IN[0]=Views_In, IN[1]=Types_In, IN[2]=Points_In)
# ---------- python_script.python (46 lines) ----------
import clr

clr.AddReference("RevitServices")
import RevitServices
from RevitServices.Persistence import DocumentManager
from RevitServices.Transactions import TransactionManager
doc = DocumentManager.Instance.CurrentDBDocument

clr.AddReference("RevitAPI")
import Autodesk

clr.AddReference("RevitNodes")
import Revit
clr.ImportExtensions(Revit.Elements)
clr.ImportExtensions(Revit.GeometryConversion)

def tolist(obj1):
	if hasattr(obj1,"__iter__"): return obj1
	else: return [obj1]
def output1(l1):
	if len(l1) == 1: return l1[0]
	else: return l1

view = UnwrapElement(tolist(IN[0]))
ftype = UnwrapElement(tolist(IN[1]))
fpts = UnwrapElement(tolist(IN[2]))

Rpts =[p.ToXyz(True) for p in fpts]

nfl = []
ftp_len = len(ftype) == 1
view_len = len(view) == 1

TransactionManager.Instance.EnsureInTransaction(doc)
for i in xrange(len(Rpts) ):
	j = 0 if ftp_len else i
	k = 0 if view_len else i
	try:
		if not ftype[j].IsActive : ftype[j].Activate()
		nf = doc.Create.NewFamilyInstance(Rpts[i], ftype[j], view[k])
		nfl.append(nf.ToDSType(False) )
	except:
		nfl.append(None)
TransactionManager.Instance.TransactionTaskDone()

OUT = output1(nfl)
# ----------------------------------------
FamilyInstance = Output(python_script)
