# Dynamo custom node FamilyInstance_VisualizeOrientation.dyf (Dynamo 1.3.2.2480)
# category: ArupBimSF.Revit.Elements_Families
# This little node shows selected elements' orientation with Dynamo lines. The line starts from element location point, and indicates its facing orientation. Resulting lines could then be used to place elements or set rotation angles.
# *NOTE* This node may not work with some system families.

InputElements = Input(InputElements : Element)  # Input elements (doors, windows, etc.)
location = FamilyInstance.Location(InputElements)
facingOrientation = FamilyInstance.FacingOrientation(InputElements)
number_slider = DoubleSlider(500, range=100..1000 step 100)
byStartPointDirectionLength = Line.ByStartPointDirectionLength(startPoint=location, direction=facingOrientation, length=number_slider)
Line = Output(byStartPointDirectionLength)  # Family instance facing orientation
Location = Output(location)  # Facmily instance location point
