# Dynamo custom node Feet&Inches_Double_ToFraction.dyf "Feet&Inches_Double➜Fraction" (Dynamo 1.3.2.2480)
# category: ArupBimSF.^FixMe
# Converts feet in number (decimal) format and converts it into fraction format

code_block = CodeBlock()
# ---------- code_block.designscript (23 lines) ----------
def ft2frac(x,f1){
frac = Math.Pow(2, 1..8);
ft1 = Math.Floor(x);
in1 = (x - ft1) * 12;
in2 = Math.Floor(in1);
fr1 = (in1 - in2) * frac;
fr2 = Math.Round(fr1);
v1 = Math.Abs(fr1 - fr2);
ind1 = DSCore.List.FirstIndexOf(v1, DSCore.List.MinimumItem(v1));
fr3 = __Apply(f1,fr2[ind1]) + "/" + __Apply(f1,frac[ind1]);
t0 = fr3[0] == fr3[-1];
in3 = t0 ? (in2 + 1) : in2;
ft1s = __Apply(f1,ft1) + "'";
in3s = __Apply(f1,in3);
ft1s = ft1s == "0'" ? "" : ft1s;
t1 = in3 == 0;
t2 = fr3 == "0/2";
in2s = t1 ? "" : in3s;
fr3s = t2 || t0 ? "" : fr3;
mid = t1 || t2 || t0 ? "" : " ";
end = t1 && t2 ? "" : "\"";
return = ft1s+in2s+mid+fr3s+end;
};
# ----------------------------------------
number = Input(number:var)
number_string = Custom[Number➜String]()  # Converts a number to a string; unwired: num
code_block_2 = CodeBlock(x=number, f1=number_string) { ft2frac(x,f1); }
fraction = Output(code_block_2)
