# Dynamo custom node Feet&Inches_Fraction_ToDouble.dyf "Feet&Inches_Fraction➜Double" (Dynamo 1.3.2.2480)
# category: ArupBimSF.^FixMe
# Converts input Feet and inches written out into double format

fraction = Input(fraction:var)
code_block = CodeBlock(s1=fraction) { frac2ft(s1); }
number = Output(code_block)
code_block_2 = CodeBlock()
# ---------- code_block_2.designscript (41 lines) ----------
def frac2ft(s1){
s0 = "";
s1 = String.TrimWhitespace(s1);
n1 = 0;
n2 = 0;
n3 = 0;
n4 = 0;
n5 = 0;
 return = [Imperative]
 {
  if(String.Contains(s1,"'",true))
  {
   s0 = String.Split(s1,{"'"});
   n1 = String.ToNumber(s0[0]);
   s1 = String.TrimWhitespace(s0[1]);
  }
  if(String.Contains(s1," ",true))
  {
   s0 = String.Split(s1,{" "});
   n2 = String.ToNumber(s0[0])/12;
   s1 = s0[1];
  }
  if(String.Contains(s1,"/",true))
  {
   s0 = String.Split(s1,{"/"});
   n3 = String.ToNumber(s0[0]);
   n4 = String.ToNumber(
   String.Split(s0[1],{"\""})[0]);
  }
  elseif(!String.Contains(s1,"/",true))
  {
   n2 = String.ToNumber(
   String.Split(s1,{"\""})[0])/12;
  }
  if (n3 != 0 && n4 != 0)
  {
   n5 = (n3/n4)/12;
  }
  return = n1 + n2 + n5;
 }
};
# ----------------------------------------
