# Dynamo custom node Filter.Elements_ByFamilyName.dyf (Dynamo 1.3.2.2480)
# category: ArupBimSF.Revit.Element_Filters

elementList = Input()
watch = Watch(elementList)
familyNameString = Input()
family = FamilyType.Family(watch)
eq = familyNameString == family  # lacing=Longest
filterByBoolMask = List.FilterByBoolMask(list=watch, mask=eq)
matchingElements = Output(filterByBoolMask.in)
