# Dynamo custom node Filter_By Parameter_At Index+_NEW.DYF (Dynamo 1.3.2.2480)
# category: ArupBimSF.^TestingGrounds
# ^Test

Category_or_ElementList = Input()
ReFresh = Input(ReFresh : bool = true)
code_block = CodeBlock(Category_or_ElementList, ReFresh)
# ---------- code_block.designscript (11 lines) ----------
list;
come;

[Imperative]

{
 if (come ==true)
  return = list;
 else
  return = list;
};
# ----------------------------------------
type = Object.Type(code_block.out2)
code_block_2 = CodeBlock { "Revit.Elements.Category"; }
eq = type == code_block_2
list_any_false = Custom[List_Any False](List_In=eq)  # Returns false if any of the values is false
all_elements_of_category = ElementsOfCategory(code_block.out2)
action_this_or_that = Custom[Action_This Or That](Bool_Switch=list_any_false, Item1=code_block.out2, Item2=all_elements_of_category)  # toggles between two choices
parameters = Element.Parameters(action_this_or_that, lacing=Longest)
hasValue = Parameter.HasValue(parameters)
name = Parameter.Name(parameters)
length = String.Length(name)
code_block_3 = CodeBlock(x=length) { x+6; }
code_block_4 = CodeBlock { " : ---"; }
padRight = String.PadRight(name, code_block_3, code_block_4)
list_CombineByBooleanPattern = Custom[List_CombineByBooleanPattern](Pattern=hasValue, True=parameters, False=padRight)  # ^Testing
count = Count(hasValue@L2)
chop = List.Chop(list=list_CombineByBooleanPattern, lengths=count)
name_2 = Parameter.Name(parameters)
filterByBoolMask = List.FilterByBoolMask(list=name_2, mask=hasValue)
flatten = Flatten(filterByBoolMask.in)
uniqueItems = List.UniqueItems(flatten)
sort = List.Sort(uniqueItems)
Index_Of_Param = Input(Index_Of_Param: int=0)
getItemAtIndex = List.GetItemAtIndex(list=sort, index=Index_Of_Param)
graph_SeqPassthru = Custom[Graph_SeqPassthru](passThrough=name_2, waitFor=getItemAtIndex)  # forces an operation to run in sequence.
indexOf = IndexOf(arg1=getItemAtIndex, lacing=Longest)  # unwired: arg0
map = List.Map(list=graph_SeqPassthru, f_x=indexOf)
graph_SeqPassthru_2 = Custom[Graph_SeqPassthru](passThrough=chop, waitFor=map)
getItemAtIndex_2 = List.GetItemAtIndex(list=graph_SeqPassthru_2, index=map, lacing=Longest)
list_CleanOutput = Custom[List_CleanOutput](List_In=getItemAtIndex_2)  # Removes and Replaces Nulls and Empty Lists from input lists. *only works with flat or 2 dimentional lists_Need to fix it to go deeper or use list.map_!!List
get_parametervalue_name = Custom[Get_ParameterValue&Name+](Parameter=list_CleanOutput.Cleaned)  # Gets the name and value+ of input parameters._!!Pa
uniqueItems_2 = List.UniqueItems(get_parametervalue_name.ParameterName)
n00_ChosenParam = Output(uniqueItems_2)  # "00_ChosenParam"
n01_ParameterList = Output(sort)  # "01_ParameterList"
n03_ParameterValue = Output(get_parametervalue_name.ParameterValue)  # "03_ParameterValue"
n02_ForcedStringValue = Output(get_parametervalue_name.StringValue)  # "02_ForcedStringValue"
Partial_Or_Exact = Input(Partial_Or_Exact: bool = true)
Search_Value = Input(Search_Value: string = "")
code_block_5 = CodeBlock { true; }
contains = String.Contains(str=get_parametervalue_name.StringValue, searchFor=Search_Value, ignoreCase=code_block_5)
eq_2 = get_parametervalue_name.StringValue == Search_Value
action_this_or_that_2 = Custom[Action_This Or That](Bool_Switch=Partial_Or_Exact, Item1=contains, Item2=eq_2)
filterByBoolMask_2 = List.FilterByBoolMask(list=action_this_or_that, mask=action_this_or_that_2)
n04_Element_In = Output(filterByBoolMask_2.in)  # "04_Element In"
n05_Element_Out = Output(filterByBoolMask_2.out)  # "05_Element Out"
graph_SeqPassthru_3 = Custom[Graph_SeqPassthru](passThrough=action_this_or_that, waitFor=getItemAtIndex_2)
getItemAtIndex_3 = List.GetItemAtIndex(list=graph_SeqPassthru_3, index=list_CleanOutput.Indices)
n06_Param_DoesNotExist = Output(getItemAtIndex_3)  # "06_Param_DoesNotExist"
