# Dynamo custom node Filter_ByParameterAndCondition.dyf (Dynamo 1.3.2.2480)
# category: ArupBimSF.Revit.Element_Filters
# Filter elements by parameter value and a user defined condition

CategoryNameOrElements = Input()
type = Object.Type(CategoryNameOrElements)
code_block = CodeBlock { "System.String"; }
eq = type == code_block
string_from_object = FromObject(CategoryNameOrElements)
type_2 = Object.Type(CategoryNameOrElements)
code_block_2 = CodeBlock { "Category"; }
contains = String.Contains(str=type_2, searchFor=code_block_2)
filterByBoolMask = List.FilterByBoolMask(list=string_from_object, mask=contains)
byName = Category.ByName(filterByBoolMask.in)
all_elements_of_category = ElementsOfCategory(byName)
action_this_or_that = Custom[Action_This Or That](Bool_Switch=eq, Item1=all_elements_of_category, Item2=filterByBoolMask.out)  # toggles between two choices
ParameterName = Input(ParameterName : string)
parameter_exists_in_element = Custom[Parameter_Exists In Element](ParamName=ParameterName)  # checks input elements for a parameter by name; unwired: element
filter = List.Filter(action_this_or_that, parameter_exists_in_element)
code_block_3 = CodeBlock(elem=filter.out0, param=ParameterName) { elem.GetParameterValueByName(param); }
function = Input()
map = List.Map(list=code_block_3, f_x=function)
filterByBoolMask_2 = List.FilterByBoolMask(list=filter.out0, mask=map)
in_ = Output(filterByBoolMask_2.in)  # "in"
join = List.Join(filter.out1, filterByBoolMask_2.out)
out = Output(join)
code_block_4 = CodeBlock {  }
