# Dynamo custom node Filter_ByParameterValue.dyf (Dynamo 1.3.2.2480)
# category: ArupBimSF.Revit.Element_Filters
# Filter elements by a parameter vlaue.  Node can take an Element List or a Category Name to collect elements in document to run the filter against

ElementsOrCategory = Input()
ReFresh = Input(ReFresh : bool = true)
code_block = CodeBlock(ElementsOrCategory, ReFresh)
# ---------- code_block.designscript (11 lines) ----------
list;
come;

[Imperative]

{
 if (come ==true)
  return = list;
 else
  return = list;
};
# ----------------------------------------
python_script = Python(IN[0]=code_block.out2)
# ---------- python_script.python (9 lines) ----------
import clr
clr.AddReference('ProtoGeometry')
from Autodesk.DesignScript.Geometry import *
#The inputs to this node will be stored as a list in the IN variable.
values = IN[0]


#Assign your output to the OUT variable
OUT = list(isinstance(value, str) for value in values)
# ----------------------------------------
code_block_2 = CodeBlock(seq=python_script) { !(AllFalse(seq)); }
byName = Category.ByName(code_block.out2)
all_elements_of_category = ElementsOfCategory(byName)
action_this_or_that = Custom[Action_This Or That](Bool_Switch=code_block_2, Item1=all_elements_of_category, Item2=code_block.out2)  # toggles between two choices
python_script_2 = Python(IN[0]=action_this_or_that)
# ---------- python_script_2.python (20 lines) ----------
# Default imports
import clr
clr.AddReference('ProtoGeometry')
from Autodesk.DesignScript.Geometry import *

#The input to this node will be stored in the IN[0] variable.
list = IN[0]

cleanlist = []
for i in list:
	if hasattr(i, "__iter__"):
		for ii in i:
			if not (i is None):
				cleanlist.append(i)	
	else:
		if not (i is None):
			cleanlist.append(i)	

#Assign your output to the OUT variable
OUT = cleanlist
# ----------------------------------------
Partial_Or_Exact = Input(Partial_Or_Exact : bool = true)
Parameter_Name = Input()
getParameterValueByName = Element.GetParameterValueByName(element=python_script_2, parameterName=Parameter_Name)
string_from_object = FromObject(getParameterValueByName)
Search_Value = Input()
string_from_object_2 = FromObject(Search_Value)
code_block_3 = CodeBlock { true; }
contains = String.Contains(str=string_from_object, searchFor=string_from_object_2, ignoreCase=code_block_3)
eq = string_from_object_2 == string_from_object
action_this_or_that_2 = Custom[Action_This Or That](Bool_Switch=Partial_Or_Exact, Item1=contains, Item2=eq)
filterByBoolMask = List.FilterByBoolMask(list=python_script_2, mask=action_this_or_that_2)
Element_In = Output(filterByBoolMask.in)
Element_Out = Output(filterByBoolMask.out)
filterByBoolMask_2 = List.FilterByBoolMask(list=getParameterValueByName, mask=action_this_or_that_2)
ParameterValue_In = Output(filterByBoolMask_2.in)
ParameterValue_Out = Output(filterByBoolMask_2.out)
