# Dynamo custom node Filter_ByParameter_AtIndex+.dyf (Dynamo 1.3.2.2480)
# category: ArupBimSF.^FixMe

Category_or_ElementList = Input()
ReFresh = Input(ReFresh : bool = true)
code_block = CodeBlock(Category_or_ElementList, ReFresh)
# ---------- code_block.designscript (11 lines) ----------
list;
come;

[Imperative]

{
 if (come ==true)
  return = list;
 else
  return = list;
};
# ----------------------------------------
type = Object.Type(code_block.out2)
code_block_2 = CodeBlock { "Revit.Elements.Category"; }
eq = type == code_block_2
list_any_false = Custom[List_Any False](List_In=eq)  # Returns false if any of the values is false
all_elements_of_category = ElementsOfCategory(code_block.out2)
action_this_or_that = Custom[Action_This Or That](Bool_Switch=list_any_false, Item1=code_block.out2, Item2=all_elements_of_category)  # toggles between two choices
parameters = Element.Parameters()  # unwired: arg0
map = List.Map(list=action_this_or_that, f_x=parameters)
flatten = Flatten(map)
hasValue = Parameter.HasValue(flatten)
filterByBoolMask = List.FilterByBoolMask(list=flatten, mask=hasValue)
name = Parameter.Name(filterByBoolMask.in)
uniqueItems = List.UniqueItems(name)
sort = List.Sort(uniqueItems)
n0_Parameter_List = Output(sort)  # "0_Parameter_List"
Index_Of_Param = Input(Index_Of_Param : var = "")
index_of_parameter = Object.Identity(Index_Of_Param)
code_block_3 = CodeBlock(x=sort, p2=index_of_parameter) { x[p2]; }
n1_ChosenParameter = Output(code_block_3)  # "1_ChosenParameter"
code_block_4 = CodeBlock { ""; }
eq_2 = index_of_parameter == code_block_4
list_any_false_2 = Custom[List_Any False](List_In=eq_2)
action_RunMe = Custom[Action_RunMe](Should_I=list_any_false_2, ThingToDo=action_this_or_that)  # Uses A boolean to determine whether to run a function or sequence.
python_script = Python(IN[0]=action_RunMe)
# ---------- python_script.python (20 lines) ----------
# Default imports
import clr
clr.AddReference('ProtoGeometry')
from Autodesk.DesignScript.Geometry import *

#The input to this node will be stored in the IN[0] variable.
list = IN[0]

cleanlist = []
for i in list:
	if hasattr(i, "__iter__"):
		for ii in i:
			if not (i is None):
				cleanlist.append(i)	
	else:
		if not (i is None):
			cleanlist.append(i)	

#Assign your output to the OUT variable
OUT = cleanlist
# ----------------------------------------
flatten_2 = Flatten(python_script)
Partial_Or_Exact = Input(Partial_Or_Exact : bool = true)
code_block_5 = CodeBlock { ""; }
getItemAtIndex = List.GetItemAtIndex(list=sort, index=index_of_parameter)
code_block_6 = CodeBlock { " : "; }
join = String.Join(code_block_5, getItemAtIndex, code_block_6)
graph_SeqPassthru = Custom[Graph_SeqPassthru](passThrough=map, waitFor=join)  # forces an operation to run in sequence.
action_RunMe_2 = Custom[Action_RunMe](Should_I=list_any_false_2, ThingToDo=graph_SeqPassthru)
string_from_object = FromObject(action_RunMe_2)
startsWith = String.StartsWith(str=string_from_object, searchFor=join, lacing=Longest)
filterByBoolMask_2 = List.FilterByBoolMask(list=string_from_object, mask=startsWith)
flatten_3 = Flatten(filterByBoolMask_2.in)
split = String.Split(flatten_3, join)
trimWhitespace = String.TrimWhitespace(split@L2, lacing=Longest)
flatten_4 = Flatten(trimWhitespace)
string_from_object_2 = FromObject(flatten_4)
Search_Value = Input(Search_Value: var = "")
string_from_object_3 = FromObject(Search_Value)
code_block_7 = CodeBlock { true; }
contains = String.Contains(str=string_from_object_2, searchFor=string_from_object_3, ignoreCase=code_block_7)
eq_3 = string_from_object_3 == string_from_object_2
action_this_or_that_2 = Custom[Action_This Or That](Bool_Switch=Partial_Or_Exact, Item1=contains, Item2=eq_3)
filterByBoolMask_3 = List.FilterByBoolMask(list=flatten_2, mask=action_this_or_that_2)
n2_Element_In = Output(filterByBoolMask_3.in)  # "2_Element_In"
n3_Element_Out = Output(filterByBoolMask_3.out)  # "3_Element_Out"
filterByBoolMask_4 = List.FilterByBoolMask(list=action_RunMe_2, mask=startsWith)
value = Parameter.Value(filterByBoolMask_4.in)
flatten_5 = Flatten(value)
filterByBoolMask_5 = List.FilterByBoolMask(list=flatten_5, mask=action_this_or_that_2)
n4_ParamValue_In = Output(filterByBoolMask_5.in)  # "4_ParamValue_In"
n5_ParamValue_Out = Output(filterByBoolMask_5.out)  # "5_ParamValue_Out"
filterByBoolMask_6 = List.FilterByBoolMask(list=flatten_4, mask=action_this_or_that_2)
n6_ForcedValue_In = Output(filterByBoolMask_6.in)  # "6_ForcedValue_In"
n7_ForcedValue_Out = Output(filterByBoolMask_6.out)  # "7_ForcedValue_Out"
