# Dynamo custom node Filter_ByStringContains+.dyf (Dynamo 1.3.2.2480)
# category: ArupBimSF.List Functions
# Filters an input list by imput sting contains plus an extra list to run through the same filter._!!Filter

List_In = Input()
Refresh = Input(Refresh : bool=true)
code_block = CodeBlock(List_In, Refresh)
# ---------- code_block.designscript (11 lines) ----------
list;
come;

[Imperative]

{
 if (come ==true)
  return = list;
 else
  return = list;
};
# ----------------------------------------
Partial_Or_Exact = Input(Partial_Or_Exact: bool=true)
string_from_object = FromObject(code_block.out2)
SearchString = Input(SearchString: string = "")
string_from_object_2 = FromObject(SearchString)
contains = String.Contains(str=string_from_object, searchFor=string_from_object_2)
eq = string_from_object_2 == string_from_object
action_this_or_that = Custom[Action_This Or That](Bool_Switch=Partial_Or_Exact, Item1=contains, Item2=eq)  # toggles between two choices
filterByBoolMask = List.FilterByBoolMask(list=code_block.out2, mask=action_this_or_that)
n0_Match = Output(filterByBoolMask.in)  # "0_Match"
n1_Other = Output(filterByBoolMask.out)  # "1_Other"
Extra_In = Input()
filterByBoolMask_2 = List.FilterByBoolMask(list=Extra_In, mask=action_this_or_that)
n2_Extra_In = Output(filterByBoolMask_2.in)  # "2_Extra_In"
n3_Extra_Out = Output(filterByBoolMask_2.out)  # "3_Extra_Out"
getKeys = GetKeys(Extra_In)
filterByBoolMask_3 = List.FilterByBoolMask(list=getKeys, mask=action_this_or_that)
n4_Indices_In = Output(filterByBoolMask_3.in)  # "4_Indices_In"
n5_Bool = Output(action_this_or_that)  # "5_Bool"
