# Dynamo custom node Filter_Directory_Contents.dyf (Dynamo 1.3.2.2480)
# category: ArupBimSF.Directory & OS
# searches a list of directories for a keyword

DirectoryPath = Input(DirectoryPath : var[]..[])  # Single or list of directory path Example C:\Users\Lingkon\Desktop\SampleFolder Feed string
fileName = FilePath.FileName(DirectoryPath)
SearchString = Input()  # "SearchString = " ""; You can search for Multiple items e.g.{"sample","01"} Feed string
length = String.Length(SearchString)
firstItem = List.FirstItem(length)
uniqueItems = List.UniqueItems(fileName)
reset = Input(reset:bool = true)
python_script = Python(IN[0]=firstItem, IN[1]=SearchString, IN[2]=uniqueItems, IN[3]=reset)
# ---------- python_script.python (4 lines) ----------
if IN[0] >= 1:
	OUT = IN[1]
else:
	OUT = IN[2]
# ----------------------------------------
allIndicesOf = List.AllIndicesOf(list=fileName, item=python_script)
flatten = Flatten(allIndicesOf)
getItemAtIndex = List.GetItemAtIndex(list=DirectoryPath, index=flatten)
match_path = Output(getItemAtIndex)
removeItemAtIndex = List.RemoveItemAtIndex(list=DirectoryPath, indices=flatten)
others = Output(removeItemAtIndex)
