# Dynamo custom node Filter_Sheets_ByNameOrNumber.dyf (Dynamo 1.3.2.2480)
# category: ArupBimSF.Revit.Views_Sheets
# collects all sheets in current project by partial or exact match of the sheet name or number

Search_String = Input(Search_String : string)
Name_or_Number = Input(Name_or_Number:bool = true)
python_script = Python(IN[0]=Search_String, IN[1]=Name_or_Number)
# ---------- python_script.python (52 lines) ----------
import clr

clr.AddReference("RevitServices")
import RevitServices
from RevitServices.Persistence import DocumentManager


clr.AddReference("RevitAPI")
from Autodesk.Revit.DB import *

doc = DocumentManager.Instance.CurrentDBDocument

clr.AddReference("RevitNodes")
import Revit
clr.ImportExtensions(Revit.Elements)


def tolist(obj1):
	if hasattr(obj1,"__iter__"):
		return obj1
	else:
		return [obj1]

dataEnteringNode = IN
fn = tolist(IN[0])
fn = [str(n) for n in fn]
NameNumber = IN[1]


fec = FilteredElementCollector(doc).OfClass(View).GetElementIterator()
fec.Reset()
result = []
similar = []
names = []

for i in fec:
	if i.ViewType == ViewType.DrawingSheet:
		if NameNumber:
			n1 = i.ViewName
		else:
			n1 = i.SheetNumber
		names.append(n1)
		if any(fn1 == n1 for fn1 in fn):
			result.append(i.ToDSType(True))
		elif any(fn1.lower() in n1.lower() for fn1 in fn):
			similar.append(i.ToDSType(True))
if len(result) > 0:
	OUT = result,similar
if len(result) == 0 and len(similar) > 0:
	OUT = "---",similar
if len(result) == 0 and len(similar) == 0:
	OUT = "---", names
# ----------------------------------------
code_block = CodeBlock(v=python_script) { v[0]; v[1]; }
exact_match = Output(code_block.out0)
partial_match = Output(code_block.out1)
