# Dynamo custom node Find Revit Level for Points by Elevation.dyf (Dynamo 0.8.2.2371)
# category: Bakery.Geometry
# requires exact elevation match

point = Input(point : Point)
deconstructPoint = Geometry.Points.DeconstructPoint(point)
watch = Watch(deconstructPoint.out2)
find_nearest_revit_level_for_a = Custom[Find Nearest Revit Level for a Given Z value]()
map = List.Map(list=watch, f_x=find_nearest_revit_level_for_a)
flatten = Flatten(map)
levels = Output(flatten)
