# Dynamo custom node Framing_AtReferenceLevel.DYF (Dynamo 1.3.2.2480)
# category: ArupBimSF.Revit.Structural
# collect all structural framing at input reference levels

categories = Categories("StructuralFraming")
all_elements_of_category = ElementsOfCategory(categories)
code_block = CodeBlock { "Reference Level"; }
getParameterValueByName = Element.GetParameterValueByName(element=all_elements_of_category, parameterName=code_block)
name = Element.Name(getParameterValueByName)
Level = Input()
code_block_2 = CodeBlock { true; }
contains = String.Contains(str=name, searchFor=Level, ignoreCase=code_block_2)
filterByBoolMask = List.FilterByBoolMask(list=all_elements_of_category, mask=contains)
code_block_3 = CodeBlock { "Name"; }
getParameterValueByName_2 = Element.GetParameterValueByName(element=Level, parameterName=code_block_3)
contains_2 = String.Contains(str=name, searchFor=getParameterValueByName_2, ignoreCase=code_block_2)
filterByBoolMask_2 = List.FilterByBoolMask(list=all_elements_of_category, mask=contains_2)
create = List.Create(filterByBoolMask.in, filterByBoolMask_2.in)
flatten = Flatten(create)
isNull = Object.IsNull()  # unwired: arg0
filter = List.Filter(flatten, isNull)
list_CleanOutput = Custom[List_CleanOutput](List_In=filter.out1)  # Removes and Replaces Nulls and Empty Lists from input lists. *only works with flat or 2 dimentional lists_Need to fix it to go deeper or use list.map_!!List
By_Level = Output(list_CleanOutput.Cleaned)
removeItemAtIndex = List.RemoveItemAtIndex(list=getParameterValueByName_2, indices=list_CleanOutput.Indices)
Level_Names = Output(removeItemAtIndex)
