# Dynamo custom node Framing_LocalCoordinateSys.dyf (Dynamo 1.3.2.2480)
# category: ArupBimSF.Revit.Structural
# Get the insertion point and local axes of a structural framing.

element = Input(element : Element[])
getLocation = Element.GetLocation(element)
ChooseSide = Input(ChooseSide:bool)  # Choose between the start or end of the beam True = at start False = at end
code_block = CodeBlock { 0; 1; }
if_ = If(test=ChooseSide, true=code_block.out0, false=code_block.out1)
normalAtParameter = Curve.NormalAtParameter(curve=getLocation, param=if_)
direction = Line.Direction(getLocation)
code_block_2 = CodeBlock { -90; }
rotate = Vector.Rotate(normalAtParameter, direction, code_block_2)
Xvector = Output(rotate)
Yvector = Output(normalAtParameter)
reverse = Vector.Reverse(direction)
if_2 = If(test=ChooseSide, true=direction, false=reverse)
Zvector = Output(if_2)
startPoint = Curve.StartPoint(getLocation)
endPoint = Curve.EndPoint(getLocation)
if_3 = If(test=ChooseSide, true=startPoint, false=endPoint)
InsertionPoint = Output(if_3)
