# Dynamo custom node Geo_GroupByDistance.dyf (Dynamo 1.3.2.2480)
# category: ArupBimSF.Points & Coordinates
# Groups input Points by a tollerance disctance

Geometry = Input(Geometry:var[])
Margin = Input(Margin: double = 1)
python_script = Python(IN[0]=Geometry, IN[1]=Margin)
# ---------- python_script.python (21 lines) ----------
import clr
clr.AddReference('ProtoGeometry')
from Autodesk.DesignScript.Geometry import Geometry

pts = IN[0]
margin = IN[1]
dist1 = Geometry.DistanceTo

Groups, Queue = [], []
while pts:
	group = []
	Queue.append(pts.pop() )
	while Queue:
		p1 = Queue.pop()
		group.append(p1)
		for i in xrange(len(pts)-1,-1,-1):
			if dist1(p1, pts[i]) <= margin:
				Queue.append(pts.pop(i) )
	Groups.append(group)

OUT = Groups
# ----------------------------------------
geometry = Output(python_script)  # "geometry[][]"
