# Dynamo custom node Geo_IndexByDistance.dyf (Dynamo 1.3.2.2480)
# category: ArupBimSF.Points & Coordinates
# indexes input geomtry based on its distance from a subject geometry

geometry = Input(geometry:var[])
other = Input(other:var[])
isClosest = Input(isClosest:bool = true)
python_script = Python(IN[0]=geometry, IN[1]=other, IN[2]=isClosest)
# ---------- python_script.python (27 lines) ----------
from operator import lt, gt
from sys import maxsize

def tolist(x):
	if hasattr(x,'__iter__'): return x
	else : return [x]

geom = tolist(IN[0])
other = tolist(IN[1])
isClosest = IN[2]

_fn = lt if isClosest else gt
_base = maxsize if isClosest else -maxsize
inds, dists = [], []
OUT = inds, dists

for g in geom:
	d = _base
	ind, i = 0, 0
	for o in other:
		d1 = g.DistanceTo(o)
		if _fn(d1, d):
			d = d1
			ind = i
		i += 1
	inds.append(ind)
	dists.append(d)
# ----------------------------------------
code_block = CodeBlock(r=python_script) { r[0]; r[1]; }
index = Output(code_block.out0)
distance = Output(code_block.out1)
