# Dynamo custom node Geometry_MultipleSplit.dyf (Dynamo 1.3.2.2480)
# category: ArupBimSF.Geometry
# splits input geometry multiple times

code_block = CodeBlock()
# ---------- code_block.designscript (20 lines) ----------
def preliminary(a: var[], b : var[])
{
l=Flatten(a.Split(b));
return = l;
};


def multisplit(e : var[], geom : var[] )
{

return = [Imperative]
 {
 for (g in geom)
  {
  a = preliminary(e,geom);
  e = a;
  };
 return = e;
 };
};
# ----------------------------------------
entity = Input()
geometries = Input()
code_block_2 = CodeBlock(entity=entity, geometries=geometries) { multisplit(entity,geometries); }
array = Output(code_block_2)
