# Dynamo custom node Get All_ElementTypes_ActiveDoc.dyf (Dynamo 1.3.2.2480)
# category: ArupBimSF.Revit.Element_Collectors
# get elementTypes in active document

RunMe = Input(RunMe : bool=false)
db_elementtypes_get_all = Custom[Db_ElementTypes_Get All]()  # get all element type classes
python_script = Python(IN[0]=RunMe, IN[1]=db_elementtypes_get_all.elementTypes)
# ---------- python_script.python (6 lines) ----------
bool=IN[0]

if bool == True:
	OUT=IN[1]
else:
	OUT=0
# ----------------------------------------
code_block = CodeBlock { {1,2,4,6,7,23,32,37,38,39,40,41,88,104,105,106,107,108,109,112,121,157,170}; }
removeItemAtIndex = List.RemoveItemAtIndex(list=python_script, indices=code_block)
all_elements_of_type = ElementsOfType(removeItemAtIndex)
list_CleanOutput = Custom[List_CleanOutput+](List_In=all_elements_of_type)  # Removes and or places nulls and empties up to 2 dimentional
removeItemAtIndex_2 = List.RemoveItemAtIndex(list=removeItemAtIndex, indices=list_CleanOutput.IndicesOut)
flatten = Flatten(removeItemAtIndex_2@L2)
Types = Output(flatten)
List = Output(list_CleanOutput.Cleaned)
