# Dynamo custom node Get All_SystemTypes_ActiveDoc.dyf (Dynamo 1.3.2.2480)
# category: ArupBimSF.Revit.Mep_Systems
# get all system types in active doc

reset = Input(reset:bool = true)
python_script = Python(IN[0]=reset)
# ---------- python_script.python (20 lines) ----------
#Made by Marc Tavenier @marctavenier
import clr
clr.AddReference('RevitAPI')
from Autodesk.Revit.DB import *

clr.AddReference('RevitServices')
import RevitServices
from RevitServices.Persistence import DocumentManager

#The inputs to this node will be stored as a list in the IN variable.
dataEnteringNode = IN

elementlist = []
doc = DocumentManager.Instance.CurrentDBDocument

collector = FilteredElementCollector(doc).OfClass(HostObjAttributes)
elementlist = collector.ToElements()

#Assign your output to the OUT variable
OUT = elementlist
# ----------------------------------------
OUT = Output(python_script)
