# Dynamo custom node Get Param_as Project Units.dyf (Dynamo 1.3.2.2480)
# category: ArupBimSF.^TestingGrounds
# ^^^new_Use this one to learn how to wrtie the filter_by parameter at index in python

Elements = Input()
ParameterName = Input(ParameterName : string)
python_script = Python(IN[0]=Elements, IN[1]=ParameterName)
# ---------- python_script.python (46 lines) ----------
import clr
clr.AddReference('ProtoGeometry')
from Autodesk.DesignScript.Geometry import *
clr.AddReference('RevitAPI')
from Autodesk.Revit.DB import *

clr.AddReference("RevitServices")
import RevitServices
from RevitServices.Persistence import DocumentManager
doc = DocumentManager.Instance.CurrentDBDocument
#The inputs to this node will be stored as a list in the IN variables.
if isinstance(IN[0], list):
	element = UnwrapElement(IN[0])
else:
	element = [UnwrapElement(IN[0])]
name = IN[1]
listout = []

def checkParameter(param):
	for p in param:
		internal = p.Definition
		if internal.BuiltInParameter != BuiltInParameter.INVALID:
			return p
	return param[0]

for e in element:
	param = e.GetParameters(name)
	if len(param) == 0:
		listout.append(None)
	else:
		p = checkParameter(param)
		if p.StorageType == StorageType.String:
			listout.append(p.AsString())
		elif p.StorageType == StorageType.ElementId:
			elem = doc.GetElement(p.AsElementId())
			listout.append(elem)
		elif p.StorageType == StorageType.Double:
			ProjectUnits = p.DisplayUnitType
			newval = UnitUtils.ConvertFromInternalUnits(p.AsDouble(),ProjectUnits)
			listout.append(newval)
		else:
			listout.append(p.AsInteger())
	

#Assign your output to the OUT variable.
OUT = listout
# ----------------------------------------
Values = Output(python_script)
