# Dynamo custom node GetAll_ViewsByType.dyf (Dynamo 1.3.2.2480)
# category: ArupBimSF.Revit.Element_Collectors
# get all views in a project listed individually by type of as a combined list (great to use a filter by paramter)

Refresh = Input(Refresh : bool = true)
python_script = Python()
# ---------- python_script.python (97 lines) ----------
import clr
clr.AddReference('ProtoGeometry')
from Autodesk.DesignScript.Geometry import *
 
# Import DocumentManager and TransactionManager
clr.AddReference("RevitServices")
import RevitServices
from RevitServices.Persistence import DocumentManager
from RevitServices.Transactions import TransactionManager
 
# Import RevitAPI
clr.AddReference("RevitAPI")
import Autodesk
from Autodesk.Revit.DB import *
 
doc = DocumentManager.Instance.CurrentDBDocument
uiapp = DocumentManager.Instance.CurrentUIApplication
app = uiapp.Application
 
from System.Collections.Generic import *
 
# Import ToDSType(bool) extension method
clr.AddReference("RevitNodes")
import Revit
clr.ImportExtensions(Revit.Elements)
 
#The inputs to this node will be stored as a list in the IN variable.
dataEnteringNode = IN
 
#collect all views in the model
collector = FilteredElementCollector(doc)
views = collector.OfClass(View).ToElements()
 
#sort views into separate lists based on view type
areaPlans, ceilingPlans, columnSchedules = [], [], []
costReport, details, draftingViews = [], [], []
drawingSheets, elevations, engineetingPlans = [], [], []
floorPlans, internal, legends, loadReports = [], [], [], []
panelSchedules, pressureLossReports, renderings = [], [], []
reports, schedules, sections, threeD = [], [], [], []
undefined, walkthrough = [], []
for i in views:
	if not i.IsTemplate:
		if i.ViewType == ViewType.AreaPlan:
			areaPlans.append(i.ToDSType(True))
		elif i.ViewType == ViewType.CeilingPlan:
			ceilingPlans.append(i.ToDSType(True))
		elif i.ViewType == ViewType.ColumnSchedule:
			columnSchedules.append(i.ToDSType(True))
		elif i.ViewType == ViewType.CostReport:
			costReport.append(i.ToDSType(True))
		elif i.ViewType == ViewType.Detail:
			details.append(i.ToDSType(True))
		elif i.ViewType == ViewType.DraftingView:
			draftingViews.append(i.ToDSType(True))
		elif i.ViewType == ViewType.DrawingSheet:
			drawingSheets.append(i.ToDSType(True))
		elif i.ViewType == ViewType.Elevation:
			elevations.append(i.ToDSType(True))
		elif i.ViewType == ViewType.EngineeringPlan:
			engineetingPlans.append(i.ToDSType(True))
		elif i.ViewType == ViewType.FloorPlan:
			floorPlans.append(i.ToDSType(True))
		elif i.ViewType == ViewType.Internal:
			internal.append(i.ToDSType(True))
		elif i.ViewType == ViewType.Legend:
			legends.append(i.ToDSType(True))
		elif i.ViewType == ViewType.LoadsReport:
			loadReports.append(i.ToDSType(True))
		elif i.ViewType == ViewType.PanelSchedule:
			panelSchedules.append(i.ToDSType(True))
		elif i.ViewType == ViewType.PresureLossReport:
			pressureLossReports.append(i.ToDSType(True))
		elif i.ViewType == ViewType.Rendering:
			renderings.append(i.ToDSType(True))
		elif i.ViewType == ViewType.Report:
			reports.append(i.ToDSType(True))
		elif i.ViewType == ViewType.Schedule:
			schedules.append(i.ToDSType(True))
		elif i.ViewType == ViewType.Section:
			sections.append(i.ToDSType(True))
		elif i.ViewType == ViewType.ThreeD:
			threeD.append(i.ToDSType(True))
		elif i.ViewType == ViewType.Undefined:
			undefined.append(i.ToDSType(True))
		elif i.ViewType == ViewType.Walkthrough:
			walkthrough.append(i.ToDSType(True))
		else:
			continue
 
#Assign your output to the OUT variable
OUT = areaPlans, ceilingPlans, columnSchedules, costReport, \
	details, draftingViews, drawingSheets, elevations, \
	engineetingPlans, floorPlans, internal, legends, \
	loadReports, panelSchedules, pressureLossReports, \
	renderings, reports, schedules, sections, threeD, \
	undefined, walkthrough
# ----------------------------------------
action_ReFresh = Custom[Action_ReFresh](Refresh=Refresh, list=python_script)  # add to the front of a workflow to allow it to be refreshed with a boolean node
code_block = CodeBlock(list=action_ReFresh)
# ---------- code_block.designscript (4 lines) ----------
Internal = List.GetItemAtIndex(list, 10);
Views_Renderings = List.GetItemAtIndex(list, 15);
Undefined = List.GetItemAtIndex(list, 20);
Walkthrough = List.GetItemAtIndex(list, 21);
# ----------------------------------------
x_Walkthrough = Output(code_block.Walkthrough)
x_Renderings = Output(code_block.Views_Renderings)
z_Internal = Output(code_block.Internal)
z_Undefined = Output(code_block.Undefined)
code_block_2 = CodeBlock(a=code_block.Views_Renderings, b=code_block.Walkthrough, c=code_block.Internal, d=code_block.Walkthrough) { t1=Flatten({a,b,c,d}); }
All_XZ_RarelyUsed = Output(code_block_2)  # "__All_XZ_RarelyUsed__"
code_block_3 = CodeBlock(list=action_ReFresh)
# ---------- code_block_3.designscript (7 lines) ----------
Rpt_Cost = List.GetItemAtIndex(list, 3);
Rpt_Loads = List.GetItemAtIndex(list, 12);
Rpt_PressureLoss = List.GetItemAtIndex(list, 14);
Rpt_Reports = List.GetItemAtIndex(list, 16);
Sched_Columns = List.GetItemAtIndex(list, 2);
Sched_Panels = List.GetItemAtIndex(list, 13);
Sched_Schedules = List.GetItemAtIndex(list, 17);
# ----------------------------------------
Rpt_Cost = Output(code_block_3.Rpt_Cost)
Rpt_Loads = Output(code_block_3.Rpt_Loads)
Rpt_PressureLoss = Output(code_block_3.Rpt_PressureLoss)
Rpt_Reports = Output(code_block_3.Rpt_Reports)
Sched_Columns = Output(code_block_3.Sched_Columns)
Sched_Panels = Output(code_block_3.Sched_Panels)
Sched_Schedules = Output(code_block_3.Sched_Schedules)
code_block_4 = CodeBlock(a=code_block_3.Rpt_Cost, b=code_block_3.Rpt_Loads, c=code_block_3.Rpt_PressureLoss, d=code_block_3.Rpt_Reports, e=code_block_3.Sched_Columns, f=code_block_3.Sched_Panels, g=code_block_3.Sched_Schedules) { t1=Flatten({a,b,c,d,e,f,g}); }
All_Reports___Schedules = Output(code_block_4)  # "__All_Reports_&_Schedules__"
code_block_5 = CodeBlock(list=action_ReFresh)
# ---------- code_block_5.designscript (11 lines) ----------
Plans_Area = List.GetItemAtIndex(list, 0);
Plans_Ceiling = List.GetItemAtIndex(list, 1);
Plans_Eng = List.GetItemAtIndex(list, 8);
Plans_Flr = List.GetItemAtIndex(list, 9);
Views_Detail = List.GetItemAtIndex(list, 4);
Views_Drafting = List.GetItemAtIndex(list, 5);
Views_Elev = List.GetItemAtIndex(list, 7);
Views_Legends = List.GetItemAtIndex(list, 11);
Views_Sections = List.GetItemAtIndex(list, 18);
Views_threeD = List.GetItemAtIndex(list, 19);
Sheets = List.GetItemAtIndex(list, 6);
# ----------------------------------------
Plans_Floor = Output(code_block_5.Plans_Flr)
Plans_Ceiling = Output(code_block_5.Plans_Ceiling)
Plans_Area = Output(code_block_5.Plans_Area)
Plans_Eng = Output(code_block_5.Plans_Eng)
Views_Elev = Output(code_block_5.Views_Elev)
Views_Drafting = Output(code_block_5.Views_Drafting)
Views_Detail = Output(code_block_5.Views_Detail)
Views_Sections = Output(code_block_5.Views_Sections)
Views_Legends = Output(code_block_5.Views_Legends)
Views_ThreeD = Output(code_block_5.Views_threeD)
code_block_6 = CodeBlock(a=code_block_5.Plans_Area, b=code_block_5.Plans_Ceiling, c=code_block_5.Plans_Eng, d=code_block_5.Plans_Flr, e=code_block_5.Views_Detail, f=code_block_5.Views_Drafting, g=code_block_5.Views_Elev, h=code_block_5.Views_Legends, i=code_block_5.Views_Sections, j=code_block_5.Views_threeD) { t1 = Flatten({a,b,c,d,e,f,g,h,i,j}); }
All_Plans___Views = Output(code_block_6)  # "__All_Plans_&_Views__"
Sheets = Output(code_block_5.Sheets)
