# Dynamo custom node Get_All Elements_View&SheetCat.dyf (Dynamo 1.3.2.2480)
# category: ArupBimSF.Revit.Categories
# Get elements from 2d/annotation families at index

categories_Views = StringInput("""Sheets
Views
Elevations
Sections
Viewports
Title Blocks
View Reference
View Titles
Callouts""")
Refresh = Input(Refresh: bool = true)
code_block = CodeBlock(categories_Views, Refresh)
# ---------- code_block.designscript (11 lines) ----------
list;
come;

[Imperative]

{
 if (come ==true)
  return = list;
 else
  return = list;
};
# ----------------------------------------
multilinestring_list = Custom[MultilineString➜List](String_In=code_block.out2)  # converts a string with line breaks in to a list of strings
byName = Category.ByName(multilinestring_list)
all_elements_of_category = ElementsOfCategory(byName)
list_CleanOutput = Custom[List_CleanOutput+](List_In=all_elements_of_category)  # Removes and or places nulls and empties up to 2 dimentional_!!List
removeItemAtIndex = List.RemoveItemAtIndex(list=byName, indices=list_CleanOutput.IndicesOut)
n00_Categories = Output(removeItemAtIndex)  # "00_Categories"
n01_Elements = Output(list_CleanOutput.Cleaned)  # "01_Elements"
getItemAtIndex = List.GetItemAtIndex(list=byName, index=list_CleanOutput.IndicesOut)
n02_Categories_NoneElem = Output(getItemAtIndex)  # "02_Categories_NoneElem"
