# Dynamo custom node Get_All Instances of FamilyType.dyf (Dynamo 1.3.2.2480)
# category: ArupBimSF.^TestingGrounds
# Collect all Placed Elements of imput Family Types from a document or revit link instance.

familyType = Input()
turnIntoSingleList = Custom[TurnIntoSingleList](unknownItem=familyType)  # Converts a collection or items and lists into a single one dimensional List_!!Li
Refresh = Input(Refresh : bool = true)
docOrRevitLinkInstance = Input(docOrRevitLinkInstance : var = null)  # Use only if you want to query a linked model
python_script = Python(IN[0]=turnIntoSingleList, IN[1]=Refresh, IN[2]=docOrRevitLinkInstance)
# ---------- python_script.python (26 lines) ----------
import System
import clr
clr.AddReference('RevitAPI')
from Autodesk.Revit.DB import *

clr.AddReference("RevitServices")
import RevitServices
from RevitServices.Persistence import DocumentManager

famtypes = UnwrapElement(IN[0])
inputdoc = UnwrapElement(IN[2])
if inputdoc == None:
	doc = DocumentManager.Instance.CurrentDBDocument
elif inputdoc.GetType().ToString() == "Autodesk.Revit.DB.RevitLinkInstance":
	doc = inputdoc.GetLinkDocument()
elif inputdoc.GetType().ToString() == "Autodesk.Revit.DB.Document":
	doc = inputdoc
else: doc = None

elementlist = list()
for ft in famtypes:
	collector = FilteredElementCollector(doc)
	bic = System.Enum.ToObject(BuiltInCategory, ft.Category.Id.IntegerValue)
	collector.OfCategory(bic)
	elementlist.append([x for x in collector.ToElements() if x.GetTypeId().IntegerValue == ft.Id.IntegerValue])
OUT = elementlist
# ----------------------------------------
return_ListOrSingleValue = Custom[Return_ListOrSingleValue](unknownItem=familyType, List_In=python_script)  # See Forum Post Regarding this node_RevitForum I think?_!LI
elements = Output(return_ListOrSingleValue)
code_block = CodeBlock {  }
