# Dynamo custom node Get_All_DepElementInstances_InViews.dyf (Dynamo 1.3.2.2480)
# category: ArupBimSF.Revit.Elements_ViewDependent
# gets all instances of a View dependent element from input views_!Dep

element = Input()
turnIntoSingleList = Custom[TurnIntoSingleList](unknownItem=element)  # Converts a collection or items and lists into a single one dimensional List_!!Li
view = Input()
turnIntoSingleList_2 = Custom[TurnIntoSingleList](unknownItem=view)
python_script = Python(IN[0]=turnIntoSingleList, IN[1]=turnIntoSingleList_2)
# ---------- python_script.python (28 lines) ----------
import System
import clr
clr.AddReference('RevitAPI')
from Autodesk.Revit.DB import *

clr.AddReference("RevitServices")
import RevitServices
from RevitServices.Persistence import DocumentManager

doc = DocumentManager.Instance.CurrentDBDocument
elements = UnwrapElement(IN[0])
views = UnwrapElement(IN[1])

elementlist = list()
# This could be more elegant if only I knew how to implement a Multicategory filter in Python....
for e in elements:
	elist = list()
	for view in views:
		vlist = list()
		collector = FilteredElementCollector(doc)
		filter = ElementOwnerViewFilter(view.Id)
		bic = System.Enum.ToObject(BuiltInCategory, e.Category.Id.IntegerValue)
		for item in collector.WherePasses(filter).OfCategory(bic).ToElements():
			if item.GetTypeId().IntegerValue == e.GetTypeId().IntegerValue:
				vlist.append(item)
		elist.append(vlist)
	elementlist.append(elist)
OUT = elementlist
# ----------------------------------------
return_ListOrSingleValue = Custom[Return_ListOrSingleValue](unknownItem=element, List_In=python_script)  # See Forum Post Regarding this node_RevitForum I think?_!LI
elements = Output(return_ListOrSingleValue)
