# Dynamo custom node Get_BuiltInCategory_ByNameSearch.dyf (Dynamo 1.3.2.2480)
# category: ArupBimSF.Revit.Document
# gets RevitDb Categories by name search

builtIn_Db = Custom[GetCategories.BuiltIn_Db]()  # collects all builtin Categories in revit database
string_from_object = FromObject(builtIn_Db.BuiltInCategories)
searchFor = Input(searchFor : string)
ignoreCase = Input(ignoreCase : bool = true)
contains = String.Contains(str=string_from_object, searchFor=searchFor, ignoreCase=ignoreCase)
filterByBoolMask = List.FilterByBoolMask(list=builtIn_Db.BuiltInCategories, mask=contains)
BuiltInCategories = Output(filterByBoolMask.in)
filterByBoolMask_2 = List.FilterByBoolMask(list=builtIn_Db.ElementIDs, mask=contains)
ElementIDs = Output(filterByBoolMask_2.in)
filterByBoolMask_3 = List.FilterByBoolMask(list=builtIn_Db.Categories, mask=contains)
Categories = Output(filterByBoolMask_3.in)
