# Dynamo custom node Get_Categories.Built-In_RevitDb.dyf (Dynamo 1.3.2.2480)
# category: ArupBimSF.Revit_Db.Categories
# list all BuiltIn Categories from the Revit API

python_script = Python()
# ---------- python_script.python (22 lines) ----------
import clr
import System
clr.AddReference('RevitAPI')
clr.AddReference('RevitAPIUI')
from Autodesk.Revit.DB import *
import Autodesk
clr.AddReference("RevitNodes")
import Revit

clr.AddReference("RevitServices")
import RevitServices
from RevitServices.Persistence import DocumentManager
doc = DocumentManager.Instance.CurrentDBDocument

bics = System.Enum.GetValues(BuiltInCategory)
cdata = list()
for bic in bics:
	try:
		cdata.append((bic,ElementId(bic),Revit.Elements.Category.ById(ElementId(bic).IntegerValue)))
	except:
		pass
OUT = cdata
# ----------------------------------------
Refresh = Input(Refresh: bool = true)
code_block = CodeBlock(python_script, Refresh)
# ---------- code_block.designscript (11 lines) ----------
list;
come;

[Imperative]

{
 if (come ==true)
  return = list;
 else
  return = list;
};
# ----------------------------------------
code_block_2 = CodeBlock { 0; }
list_get_one_index_from_sublists = Custom[List_Get One Index From Sublists](list=code_block.out2, desired_index=code_block_2)  # gets all from one sublist
string_from_object = FromObject(list_get_one_index_from_sublists)
sortByKey = List.SortByKey(list=code_block.out2, keys=string_from_object)
transpose = List.Transpose(sortByKey.sorted_list)
code_block_3 = CodeBlock(seq=transpose) { seq[0]; seq[1]; seq[2]; }
BuiltInCategories = Output(code_block_3.out0)
ElementIDs = Output(code_block_3.out1)
Categories = Output(code_block_3.out2)
