# Dynamo custom node Get_CentralFilePath.dyf (Dynamo 1.3.2.2480)
# category: ArupBimSF.Revit.Document
# Get the path of the central file of current document

string = StringInput("J:")
ReFresh = Input(ReFresh:bool = true)
centralPath = Python(IN[0]=ReFresh)  # "Doc.CentralPath"
# ---------- centralPath.python (13 lines) ----------
import clr

clr.AddReference('RevitServices')
from RevitServices.Persistence import DocumentManager
doc = DocumentManager.Instance.CurrentDBDocument

clr.AddReference('RevitAPI')
from Autodesk.Revit.DB import *

OUT = None
if doc.IsWorkshared:
	cp = doc.GetWorksharingCentralModelPath()
	OUT = ModelPathUtils.ConvertModelPathToUserVisiblePath(cp)
# ----------------------------------------
string_2 = StringInput("jobs")
string_SplitByCharachters = Custom[String_SplitByCharachters+](String_List=centralPath, TrimBy=string_2)  # This node allows you to get the portion of a string after, before a defined charachter (or sequence of) within the string. Additionally you can get combined output of the string removing only the Charachter(s) chosen_!!String.SplitByCharachter
concat = String.Concat(string, string_SplitByCharachters.Portion_Post)
firstItem = List.FirstItem(centralPath)
FilePath = Output(firstItem)
fileName = FilePath.FileName(centralPath)
FileName = Output(fileName)
string_SplitByCharachters_2 = Custom[String_SplitByCharachters+](String_List=centralPath, TrimBy=fileName)
DirectoryPath = Output(string_SplitByCharachters_2.Portion_Prior)
