# Dynamo custom node Get_CharachterAtIndex.dyf (Dynamo 1.3.2.2480)
# category: ArupBimSF.String Functions
# get charachters from strings at index. Powerful tool to use along with a key group or as headers, sheet and view names.

Strings_In = Input()
Index = Input()
code_block = CodeBlock(Strings_In, Index)
# ---------- code_block.designscript (5 lines) ----------
def CharacterAtIndex (x,y)
{
return=x[y];
};
CharacterAtIndex(x,y);
# ----------------------------------------
Character = Output(code_block)
