# Dynamo custom node Get_DesignOptions.dyf (Dynamo 1.3.2.2480)
# category: ArupBimSF.Revit.Document
# Collects all of the design options currently in the project, and outputs their names and elements or the options

python_script = Python()  # unwired: IN[0]
# ---------- python_script.python (36 lines) ----------
import clr
clr.AddReference('ProtoGeometry')
from Autodesk.DesignScript.Geometry import *

# Import ToDSType(bool) extension method
clr.AddReference("RevitNodes")
import Revit
clr.ImportExtensions(Revit.Elements)

# Import DocumentManager and TransactionManager
clr.AddReference("RevitServices")
import RevitServices
from RevitServices.Persistence import DocumentManager
from RevitServices.Transactions import TransactionManager

from System.Collections.Generic import *

# Import RevitAPI
clr.AddReference("RevitAPI")
import Autodesk
from Autodesk.Revit.DB import *

doc = DocumentManager.Instance.CurrentDBDocument
uiapp = DocumentManager.Instance.CurrentUIApplication
app = uiapp.Application

#The inputs to this node will be stored as a list in the IN variable.
dataEnteringNode = IN

#get all design options in the model
designOp = FilteredElementCollector(doc).OfClass(DesignOption).ToElements()
designOpNames = []
for i in designOp:
	designOpNames.append(i.Name.ToString())
#Assign your output to the OUT variable
OUT = designOp, designOpNames
# ----------------------------------------
number = DoubleInput(0)
getItemAtIndex = List.GetItemAtIndex(list=python_script, index=number)
Design_Options = Output(getItemAtIndex)
number_2 = DoubleInput(1)
getItemAtIndex_2 = List.GetItemAtIndex(list=python_script, index=number_2)
Names = Output(getItemAtIndex_2)
