# Dynamo custom node Get_DirectoryContents+.dyf (Dynamo 1.3.2.2480)
# category: ArupBimSF.Directory & OS
# Gets the files and subfolders of a directory from an input path, plus multiple filtering options

code_block = CodeBlock()
# ---------- code_block.designscript (3 lines) ----------
//All file = *
//For example just type pptx for MS powerpoint
searchFileType : string = "*";
# ----------------------------------------
code_block_2 = CodeBlock { directoryPath:string; }  # unwired: directoryPath
code_block_3 = CodeBlock()
# ---------- code_block_3.designscript (3 lines) ----------
//All Directory = " "
//Type Directory name
searchDirectory : string = "";
# ----------------------------------------
code_block_4 = CodeBlock { Refresh:bool = true; }
directoryPath = Input(directoryPath:string)
Refresh = Input(Refresh:bool = true)
python_script = Python(IN[0]=directoryPath, IN[1]=Refresh)
# ---------- python_script.python (10 lines) ----------
import sys
sys.path.append(r'C:\Program Files (x86)\IronPython 2.7\Lib')
import os
###############################
dataEnteringNode = IN
dic = IN[0]
dics = os.walk(dic)

###############################
OUT = [a[0] for a in dics]
# ----------------------------------------
fromPath = DirectoryObject(python_script)  # "Directory.FromPath"
string = StringInput("*.")
searchFileType = Input(searchFileType : string = "*")  # All file = * For example just type pptx for MS powerpoint
concat = String.Concat(string, searchFileType)
contents = Directory.Contents(fromPath, concat)
flatten = Flatten(contents)
string_from_object = FromObject(flatten)
contents_2 = Directory.Contents(fromPath)
flatten_2 = Flatten(contents_2.out0)
string_from_object_2 = FromObject(flatten_2)
flatten_3 = Flatten(contents_2.out1)
create = List.Create(string_from_object, string_from_object_2, flatten_3)
code_block_5 = CodeBlock { {"backup","temp",".dat",".rws","log","$"}; }
contains = String.Contains(str=create@L2, searchFor=code_block_5, lacing=CrossProduct)
transpose = List.Transpose()  # unwired: arg0
map = List.Map(list=contains, f_x=transpose)
list_any_true = Custom[List_Any True](List_In=map)  # Returns true if any items in a list are true
filterByBoolMask = List.FilterByBoolMask(list=create, mask=list_any_true)
code_block_6 = CodeBlock(x=filterByBoolMask.out) { x[0]; x[1]; x[2]; }
fileName = FilePath.FileName(code_block_6.out0)
fileNames = Output(fileName)
files = Output(code_block_6.out0)
searchDirectory = Input(searchDirectory : string = "")  # All Directory = " " Type Directory name
object_string_contains = Custom[Object➜String.Contains+](List_In=code_block_6.out2, Extra_In=code_block_6.out2, SearchString=searchDirectory)  # Filters an input list by imput sting contains plus an extra list to run through the same filter.
dir_Match = Output(object_string_contains.0_Match_IN)
object_string_contains_2 = Custom[Object➜String.Contains+](List_In=code_block_6.out1, Extra_In=code_block_6.out1, SearchString=searchDirectory)
File_Match = Output(object_string_contains_2.0_Match_IN)
