# Dynamo custom node Get_Distance_ToObjects.dyf "Get_Distance➜Objects" (Dynamo 1.3.2.2480)
# category: ArupBimSF.Points & Coordinates
# finds the closest geometry to input geometry.  Returns closest object and point

geometry = Input(geometry : Autodesk.Geometry[])
others = Input(others : Autodesk.Geometry)
code_block = CodeBlock(seq1=geometry, p=others) { seq2 = seq1.DistanceTo(p); mind = List.MinimumItem(seq2); }
formula = Formula("a=b", code_block.seq2, code_block.mind)
code_block_2 = CodeBlock(geom=geometry, mask=formula, other=others) { filtered = List.FilterByBoolMask(geom, mask)["in"]; Flatten(filtered); Flatten(filtered.ClosestPointTo(other)); }
Closest_Object = Output(code_block_2.out1)
Closest_Point = Output(code_block_2.out2)
Distance_To_Closest = Output(code_block.mind)
Distance_To_All = Output(code_block.seq2)
