# Dynamo custom node Get_DocumentWarnings.dyf (Dynamo 1.3.2.2480)
# category: ArupBimSF.Revit.Document
# get warnings from active document.  This only works with revit 2018 and higher

python_script = Python()  # unwired: IN[0]
# ---------- python_script.python (21 lines) ----------
#Works only with Revit 2018+ and Dynamo 1.3.0+
import clr
#Import Revit Services
clr.AddReference("RevitServices")
import RevitServices
from RevitServices.Persistence import DocumentManager

doc = DocumentManager.Instance.CurrentDBDocument
wlist = doc.GetWarnings()

if isinstance(wlist, list):
	wtext = wlist.GetDescriptionText()
	welt = wlist.GetFailingElements()
	wsev = wlist.GetSeverity()
else:
	wtext, welt, wsev = [], [], []
	for i in wlist:
		wtext.append(i.GetDescriptionText())
		welt.append(i.GetFailingElements())
		wsev.append(i.GetSeverity())
OUT = wtext, welt, wsev
# ----------------------------------------
code_block = CodeBlock(seq=python_script) { seq[0]; seq[1]; seq[2]; }
WarningText = Output(code_block.out0)  # Failure message (string)
FailingElementIds = Output(code_block.out1)  # Ids of the failing elements
FailureType = Output(code_block.out2)  # Failure severity
