# Dynamo custom node Get_Dwg_LayerNames.dyf (Dynamo 1.3.2.2480)
# category: ArupBimSF.Revit.Links & Imports
# get the layer from from input dwg link or import

Dwg_Instance = Input()  # Input the ImportInstance to extract the layers
python_script = Python(IN[0]=Dwg_Instance)
# ---------- python_script.python (18 lines) ----------
import clr

# Import RevitAPI
clr.AddReference("RevitAPI")
import Autodesk
from Autodesk.Revit.DB import *

dwgImport = UnwrapElement(IN[0])

catSub = dwgImport.Category.SubCategories
enum = catSub.GetEnumerator()

nameList = []
while enum.MoveNext():
	layerName = enum.Current.Name
	nameList.Add( layerName )
	
OUT  = nameList
# ----------------------------------------
layerNames = Output(python_script)
