# Dynamo custom node Get_Dwg_LinksAndImports.dyf (Dynamo 1.3.2.2480)
# category: ArupBimSF.Revit.Links & Imports
# collect all dwg links and imports in active documents

Refresh = Input(Refresh : bool = true)
python_script = Python(IN[0]=Refresh)
# ---------- python_script.python (21 lines) ----------
import clr
clr.AddReference('RevitAPI')
from Autodesk.Revit.DB import *
import Autodesk

clr.AddReference("RevitServices")
import RevitServices
from RevitServices.Persistence import DocumentManager

doc = DocumentManager.Instance.CurrentDBDocument
# need to learn how to implement LINQ here...
collector = FilteredElementCollector(doc)
impinst = collector.OfClass(ImportInstance).ToElements()
linkedlist = list()
importlist = list()
for item in impinst:
	if item.IsLinked:
		linkedlist.append(item)
	else:
		importlist.append(item)
OUT = (linkedlist,importlist)
# ----------------------------------------
code_block = CodeBlock(seq=python_script) { seq[0]; seq[1]; }
Links = Output(code_block.out0)
Imports = Output(code_block.out1)
