# Dynamo custom node Get_ElectricalElements_ByCategory.dyf (Dynamo 1.3.2.2480)
# category: ArupBimSF.Revit.Mep_Electrical
# Gets all of the electrical categories in Document

categories = Categories("CableTray")
categories_2 = Categories("CableTrayFitting")
categories_3 = Categories("CommunicationDevices")
categories_4 = Categories("Conduit")
categories_5 = Categories("ConduitFitting")
categories_6 = Categories("DataDevices")
categories_7 = Categories("ElectricalEquipment")
categories_8 = Categories("ElectricalFixtures")
categories_9 = Categories("FireAlarmDevices")
categories_10 = Categories("LightingDevices")
categories_11 = Categories("LightingFixtures")
categories_12 = Categories("NurseCallDevices")
categories_13 = Categories("SecurityDevices")
categories_14 = Categories("TelephoneDevices")
create = List.Create(categories, categories_2, categories_3, categories_4, categories_5, categories_6, categories_7, categories_8, categories_9, categories_10, categories_11, categories_12, categories_13, categories_14)
all_elements_of_category = ElementsOfCategory(categories)
all_elements_of_category_2 = ElementsOfCategory(categories_2)
all_elements_of_category_3 = ElementsOfCategory(categories_3)
all_elements_of_category_4 = ElementsOfCategory(categories_4)
all_elements_of_category_5 = ElementsOfCategory(categories_5)
all_elements_of_category_6 = ElementsOfCategory(categories_6)
all_elements_of_category_7 = ElementsOfCategory(categories_7)
all_elements_of_category_8 = ElementsOfCategory(categories_8)
all_elements_of_category_9 = ElementsOfCategory(categories_9)
all_elements_of_category_10 = ElementsOfCategory(categories_10)
all_elements_of_category_11 = ElementsOfCategory(categories_11)
all_elements_of_category_12 = ElementsOfCategory(categories_12)
all_elements_of_category_13 = ElementsOfCategory(categories_13)
all_elements_of_category_14 = ElementsOfCategory(categories_14)
create_2 = List.Create(all_elements_of_category, all_elements_of_category_2, all_elements_of_category_3, all_elements_of_category_4, all_elements_of_category_5, all_elements_of_category_6, all_elements_of_category_7, all_elements_of_category_8, all_elements_of_category_9, all_elements_of_category_10, all_elements_of_category_11, all_elements_of_category_12, all_elements_of_category_13, all_elements_of_category_14)
list_CleanOutput = Custom[List_CleanOutput](List_In=create_2)  # Removes and Replaces Nulls and Empty Lists from input lists. *only works with flat or 2 dimentional lists_Need to fix it to go deeper or use list.map
removeItemAtIndex = List.RemoveItemAtIndex(list=create, indices=list_CleanOutput.Indices)
Elec_Categories = Output(removeItemAtIndex)
Elements = Output(list_CleanOutput.Cleaned)
