# Dynamo custom node Get_Element Id+.dyf (Dynamo 1.3.2.2480)
# category: ArupBimSF.Revit.Elements
# Gets Revit element Id and GUID for input elements

Elements = Input()
identity = Object.Identity(Elements)
id = Element.Id(identity)
code_block = CodeBlock(item=id) { Flatten({item}); }
python_script = Python(IN[0]=code_block, IN[1]=identity)
# ---------- python_script.python (39 lines) ----------
import clr

# Import RevitAPI
clr.AddReference("RevitAPI")
import Autodesk

clr.AddReference("RevitNodes")
import Revit

# Import DocumentManager and TransactionManager
clr.AddReference("RevitServices")
import RevitServices
from RevitServices.Persistence import DocumentManager
from RevitServices.Transactions import TransactionManager

# Import geometry conversion extension methods
clr.ImportExtensions(Revit.GeometryConversion)

# Import Element wrapper extension methods
clr.ImportExtensions(Revit.Elements)

# Unwrap the Point, yielding a Revit XYZ in Revit unit system

def toRvtId(_id):
	if isinstance(_id, int) or isinstance(_id, str):
		id = Autodesk.Revit.DB.ElementId(int(_id))
		return id
	elif isinstance(_id, Autodesk.Revit.DB.ElementId):
		return _id
element = UnwrapElement(IN[1])
ID = []
GUID = []
for i in element:
	GUID.append(i.UniqueId)
for i in IN[0]:
	a = toRvtId(i)
	ID.append(a)

OUT = ID,GUID
# ----------------------------------------
code_block_2 = CodeBlock(x=python_script) { x[0]; x[1]; }
Id_As_Integer = Output(code_block_2.out0)
string_from_object = FromObject(code_block_2.out0)
Id_As_String = Output(string_from_object)
GUID = Output(code_block_2.out1)
