# Dynamo custom node Get_Element Name.dyf (Dynamo 1.3.2.2480)
# category: ArupBimSF.Revit.Elements
# Get the element name from all types of elements including system families

Input = Input(Input: var)
code_block = CodeBlock(item=Input) { Flatten({item}); }
python_script = Python(IN[0]=code_block)
# ---------- python_script.python (21 lines) ----------
import clr
clr.AddReference('RevitAPI')
from Autodesk.Revit.DB import *

faminsts = IN[0]
elementlist = list()
for item in faminsts:
	try:
		n = UnwrapElement(item).Name
	except:
		# Use a built-in property of (wrapped) Dynamo elements for family symbols instead
		try:
			n = item.Name
		except:
			# maybe it's a parameter name
			try:
				n = item.Definition.Name
			except:
				n = []
	elementlist.append(n)
OUT = elementlist
# ----------------------------------------
return_list_or_single_value = Python(IN[0]=Input, IN[1]=python_script)
# ---------- return_list_or_single_value.python (4 lines) ----------
check = IN[0]
items = IN[1]
if isinstance(check, (list)): OUT = items
else: OUT = items[0]
# ----------------------------------------
Names_Out = Output(return_list_or_single_value)
