# Dynamo custom node Get_Element.Name+.dyf (Dynamo 1.3.2.2480)
# category: ArupBimSF.Revit.Elements
# Get the element name from all types of elements including system families_!!Get!Element

elements = Input()
reset = Input(reset:bool=true)
python_script = Python(IN[0]=elements, IN[1]=reset)
# ---------- python_script.python (21 lines) ----------
import clr
clr.AddReference('RevitAPI')
from Autodesk.Revit.DB import *

faminsts = IN[0]
elementlist = list()
for item in faminsts:
	try:
		n = UnwrapElement(item).Name
	except:
		# Use a built-in property of (wrapped) Dynamo elements for family symbols instead
		try:
			n = item.Name
		except:
			# maybe it's a parameter name
			try:
				n = item.Definition.Name
			except:
				n = []
	elementlist.append(n)
OUT = elementlist
# ----------------------------------------
Name = Output(python_script)
