# Dynamo custom node Get_Element.Parameters+.dyf (Dynamo 1.3.2.2480)
# category: ArupBimSF.Revit.Parameters
# Get all parameters availible for an element or list of elements.  This Node Also only shows unique values and sorts parameters A-Z_!!Pa!Elem

elements = Input()
ReFresh = Input(ReFresh : bool = false)
code_block = CodeBlock(elements, ReFresh)
# ---------- code_block.designscript (11 lines) ----------
list;
come;

[Imperative]

{
 if (come ==true)
  return = list;
 else
  return = list;
};
# ----------------------------------------
parameters = Element.Parameters(code_block.out2)
string_from_object = FromObject(parameters)
python_script = Python(IN[0]=string_from_object)
# ---------- python_script.python (20 lines) ----------
import clr
clr.AddReference('ProtoGeometry')
from Autodesk.DesignScript.Geometry import *
#The inputs to this node will be stored as a list in the IN variable.
dataEnteringNode = IN

mylist = IN[0]

a, seen, result, unique = mylist, set(), [], []
for idx, item in enumerate(a):
    if item not in seen:
    	seen.add(item)
    	unique.append(idx)        
    	# First time seeing the element
    else:
    	result.append(idx)
    	# Already seen, add the index to the result

#Assign your output to the OUT variable
OUT = unique, result
# ----------------------------------------
code_block_2 = CodeBlock(x=python_script) { x[0]; x[1]; }
getItemAtIndex = List.GetItemAtIndex(list=parameters, index=code_block_2.out0)
name = Parameter.Name(getItemAtIndex)
sortByKey = List.SortByKey(list=getItemAtIndex, keys=name)
Parameter = Output(sortByKey.sorted_list)
Names = Output(sortByKey.sorted_keys)
value = Parameter.Value(sortByKey.sorted_list)
Values = Output(value)
code_block_3 = CodeBlock { " : "; }
string_SplitByCharachters = Custom[String_SplitByCharachters+](String_List=sortByKey.sorted_list, TrimBy=code_block_3)  # This node allows you to get the portion of a string after, before a defined charachter (or sequence of) within the string. Additionally you can get combined output of the string removing only the Charachter(s) chosen_!!String.SplitByCharachter
StringValues = Output(string_SplitByCharachters.Portion_Post)
