# Dynamo custom node Get_ElementElevation_Points.dyf (Dynamo 1.3.2.2480)
# category: ArupBimSF.Revit.Mep
# get the elevation points from curve elements

Imperial_Or_Metric = Input(Imperial_Or_Metric:bool=true)
elements = Input()
referenceLevel = Input(referenceLevel: Level)
refresh = Input(refresh: bool = true)
imperial = Python(IN[0]=elements, IN[1]=referenceLevel, IN[2]=refresh)
# ---------- imperial.python (57 lines) ----------
import clr
clr.AddReference('ProtoGeometry')
from Autodesk.DesignScript.Geometry import *

clr.AddReference("RevitNodes")
import Revit
clr.ImportExtensions(Revit.Elements)

clr.AddReference("RevitAPI")
import Autodesk
from Autodesk.Revit.DB import *

clr.AddReference("RevitServices")
import RevitServices
from RevitServices.Persistence import DocumentManager
from RevitServices.Transactions import TransactionManager

doc = DocumentManager.Instance.CurrentDBDocument

elements = UnwrapElement(IN[0])
refLevel = UnwrapElement(IN[1])

levelZ = refLevel.Elevation

pCoord = []
zMinCoord = []
zMaxCoord = []
zMidCoord = []

for element in elements:
	try:
		pCoord.append(element.Location.Point.Z - levelZ)
		bb = element.get_BoundingBox(None)
		zMinCoord.append(bb.Min.Z - levelZ)
		zMaxCoord.append(bb.Max.Z -levelZ)
		zMidCoord.append((bb.Max.Z + bb.Min.Z)/2 -levelZ )
	except:
		pCoord.append(0)
		zMinCoord.append(0)
		zMaxCoord.append(0)
		zMidCoord.append(0)
		
outlist =[]	

outlist.append(elements)
outlist.append(pCoord)
outlist.append(zMinCoord)
outlist.append(zMaxCoord)
outlist.append(zMidCoord)

OUT = outlist

	
	
	
	
	
# ----------------------------------------
metric = Python(IN[0]=elements, IN[1]=referenceLevel, IN[2]=refresh)
# ---------- metric.python (57 lines) ----------
import clr
clr.AddReference('ProtoGeometry')
from Autodesk.DesignScript.Geometry import *

clr.AddReference("RevitNodes")
import Revit
clr.ImportExtensions(Revit.Elements)

clr.AddReference("RevitAPI")
import Autodesk
from Autodesk.Revit.DB import *

clr.AddReference("RevitServices")
import RevitServices
from RevitServices.Persistence import DocumentManager
from RevitServices.Transactions import TransactionManager

doc = DocumentManager.Instance.CurrentDBDocument

elements = UnwrapElement(IN[0])
refLevel = UnwrapElement(IN[1])

levelZ = 0.3048*refLevel.Elevation

pCoord = []
zMinCoord = []
zMaxCoord = []
zMidCoord = []

for element in elements:
	try:
		pCoord.append(0.3048*element.Location.Point.Z - levelZ)
		bb = element.get_BoundingBox(None)
		zMinCoord.append(0.3048*bb.Min.Z - levelZ)
		zMaxCoord.append(0.3048*bb.Max.Z -levelZ)
		zMidCoord.append(0.3048*(bb.Max.Z + bb.Min.Z)/2 -levelZ )
	except:
		pCoord.append(0)
		zMinCoord.append(0)
		zMaxCoord.append(0)
		zMidCoord.append(0)
		
outlist =[]	

outlist.append(elements)
outlist.append(pCoord)
outlist.append(zMinCoord)
outlist.append(zMaxCoord)
outlist.append(zMidCoord)

OUT = outlist

	
	
	
	
	
# ----------------------------------------
if_ = If(test=Imperial_Or_Metric, true=imperial, false=metric)
code_block = CodeBlock(A=if_) { A[0]; A[1]; A[2]; A[3]; A[4]; }
elements_2 = Output(code_block.out0)  # "elements"
Zpoint = Output(code_block.out1)
Zmin = Output(code_block.out2)
Zmax = Output(code_block.out3)
Zmiddle = Output(code_block.out4)
