# Dynamo custom node Get_Element_All Instances of.dyf (Dynamo 1.3.2.2480)
# category: ArupBimSF.Revit.Element_Selectors
# Gets all placed model instances of input elements

Element_In = Input()
code_block = CodeBlock(Element_In)  # unwired: arg1
# ---------- code_block.designscript (11 lines) ----------
list;
come;

[Imperative]

{
 if (come ==true)
  return = list;
 else
  return = list;
};
# ----------------------------------------
id = Element.Id(code_block.out2)
uniqueItems = List.UniqueItems(id)
firstIndexOf = List.FirstIndexOf(list=id, item=uniqueItems)
getItemAtIndex = List.GetItemAtIndex(list=code_block.out2, index=firstIndexOf)
code_block_2 = CodeBlock(item=getItemAtIndex) { Flatten({item}); }
python_script = Python(IN[0]=code_block_2)
# ---------- python_script.python (26 lines) ----------
import System
import clr
clr.AddReference('RevitAPI')
from Autodesk.Revit.DB import *

clr.AddReference("RevitServices")
import RevitServices
from RevitServices.Persistence import DocumentManager

doc = DocumentManager.Instance.CurrentDBDocument
elements = UnwrapElement(IN[0])

elementlist = list()
for e in elements:
	collector = FilteredElementCollector(doc)
	bic = System.Enum.ToObject(BuiltInCategory, e.Category.Id.IntegerValue)
	collector.OfCategory(bic)
	# This is a workaround
	# because I was to lazy to learn
	# how to implement LINQ in Python
	elist =  list()
	for item in collector.ToElements():
		if item.GetTypeId().IntegerValue == e.GetTypeId().IntegerValue:
			elist.append(item)
	elementlist.append(elist)
OUT = elementlist
# ----------------------------------------
python_script_2 = Python(IN[0]=code_block_2, IN[1]=python_script)
# ---------- python_script_2.python (4 lines) ----------
check = IN[0]
items = IN[1]
if isinstance(check, (list)): OUT = items
else: OUT = items[0]
# ----------------------------------------
elements = Output(python_script_2)
