# Dynamo custom node Get_Element_Associated Level.dyf (Dynamo 1.3.2.2480)
# category: ArupBimSF.Revit.Element_Location
# get the level associated with input elements

element = Input()
code_block = CodeBlock(item=element) { Flatten({item}); }
python_script = Python(IN[0]=code_block)
# ---------- python_script.python (25 lines) ----------
import clr
clr.AddReference('RevitAPI')
from Autodesk.Revit.DB import *

clr.AddReference("RevitNodes")
import Revit
clr.ImportExtensions(Revit.Elements)

faminsts = UnwrapElement(IN[0])
elementlist = list()
for item in faminsts:
	try:	
		elementlist.append(item.Document.GetElement(item.LevelId).ToDSType(True))
	except:
		try:
			elementlist.append(item.Level.ToDSType(True))
		except:
			try:
				elementlist.append(item.GenLevel.ToDSType(True))
			except:
				try:
					elementlist.append(item.Document.GetElement(item.get_Parameter(BuiltInParameter.INSTANCE_REFERENCE_LEVEL_PARAM).AsElementId()).ToDSType(True))
				except:
					elementlist.append(list())
OUT = elementlist
# ----------------------------------------
return_ListOrSingleValue = Custom[Return_ListOrSingleValue](unknownItem=element, List_In=python_script)  # See Forum Post Regarding this node_RevitForum I think?
level = Output(return_ListOrSingleValue)
