# Dynamo custom node Get_Element_ById+.dyf (Dynamo 1.3.2.2480)
# category: EEC.Revit.Element Selection
# get elements by their id number in active or linked documents

Id_List = Input(Id_List: var[]..[])
list_TurnIntoSingleList = Custom[List_TurnIntoSingleList](unknownItem=Id_List)  # Converts a collection or items and lists into a single one dimensional List_!!Li
DocOrLinkInstance = Input(DocOrLinkInstance : var = null)  # Use only if you want to query a linked model
python_script = Python(IN[0]=list_TurnIntoSingleList, IN[1]=DocOrLinkInstance)
# ---------- python_script.python (32 lines) ----------
import clr
clr.AddReference('RevitAPI')
from Autodesk.Revit.DB import *

clr.AddReference("RevitNodes")
import Revit
clr.ImportExtensions(Revit.Elements)

clr.AddReference("RevitServices")
import RevitServices
from RevitServices.Persistence import DocumentManager

items = UnwrapElement(IN[0])
inputdoc = UnwrapElement(IN[1])
if inputdoc == None:
	doc = DocumentManager.Instance.CurrentDBDocument
elif inputdoc.GetType().ToString() == "Autodesk.Revit.DB.RevitLinkInstance":
	doc = inputdoc.GetLinkDocument()
elif inputdoc.GetType().ToString() == "Autodesk.Revit.DB.Document":
	doc = inputdoc
else: doc = None

elementlist = list()
for item in items:
	try: 
		elementlist.append(doc.GetElement(item).ToDSType(True))
	except:
		try:
			elementlist.append(doc.GetElement(ElementId(item)).ToDSType(True))
		except:
			elementlist.append(None)
OUT = elementlist
# ----------------------------------------
return_ListOrSingleValue = Custom[Return_ListOrSingleValue](unknownItem=Id_List, List_In=python_script)  # See Forum Post Regarding this node_RevitForum I think?_!LI
code_block = CodeBlock { "---"; }
list_CleanOutput = Custom[List_CleanOutput](List_In=return_ListOrSingleValue, Replace_With=code_block)  # Removes and Replaces Nulls and Empty Lists from input lists. *only works with flat or 2 dimentional lists_Need to fix it to go deeper or use list.map_!!List
Element_Out = Output(list_CleanOutput.Cleaned)
List_Out = Output(list_CleanOutput.REPlaced)
ElemMissing_Index = Output(list_CleanOutput.Indices)
