# Dynamo custom node Get_Element_Category+.dyf (Dynamo 1.3.2.2480)
# category: ArupBimSF.Revit.Elements
# gets the category and category name of input elements. Gets categories from types, and other elements such as worksets which the OOTB cannot.

ElementsIn = Input()
python_script = Python(IN[0]=ElementsIn)
# ---------- python_script.python (25 lines) ----------
import clr
clr.AddReference('RevitAPI')
from Autodesk.Revit.DB import *

clr.AddReference("RevitNodes")
import Revit
clr.ImportExtensions(Revit.Elements)

items = UnwrapElement(IN[0])
elementlist = list()
for item in items:
	objtype = item.GetType().ToString()
	try:
		if objtype == "Autodesk.Revit.DB.ViewSchedule":
			elementlist.append(Revit.Elements.Category.ById(item.Definition.CategoryId.IntegerValue))
		elif objtype == "Autodesk.Revit.DB.Family":
			elementlist.append(Revit.Elements.Category.ById(item.FamilyCategoryId.IntegerValue))
		elif objtype == "Autodesk.Revit.DB.GraphicsStyle":
			elementlist.append(Revit.Elements.Category.ById(item.GraphicsStyleCategory.Id.IntegerValue))
		else:
			elementlist.append(Revit.Elements.Category.ById(item.Category.Id.IntegerValue))
	except:
		elementlist.append(None)

OUT = elementlist
# ----------------------------------------
Category = Output(python_script)
string_from_object = FromObject(python_script)
AsString = Output(string_from_object)
