# Dynamo custom node Get_Element_Location++.dyf (Dynamo 1.3.2.2480)
# category: ArupBimSF.Data Transfer
# Get the location of input elements. Outputs locations as geometry and as a string value for exporting.

Element_List = Input(Element_List : Element)
getLocation = Element.GetLocation(Element_List)
type = Object.Type(getLocation)
code_block = CodeBlock { "Geometry.Line"; }
contains = String.Contains(str=type, searchFor=code_block)
getKeys = GetKeys(contains)
join = List.Join()  # unwired: arg0, arg1
endPoints = Geometry.Curves.EndPoints(getLocation)
combine = List.Combine(join, endPoints.out0, endPoints.out1)
code_block_2 = CodeBlock { 3; }
points_deliminatedstring = Custom[Points➜DeliminatedString+](points_In=combine@L2, Round_Digits=code_block_2)  # converts points to strings with an option to round off points to number of digits
code_block_3 = CodeBlock { "|"; }
list_MergeSublists = Custom[List_MergeSublists](List=points_deliminatedstring, Seperator=code_block_3)  # Merges sublists into strings with seperator_!!List.Functions
flatten = Flatten(list_MergeSublists)
points_deliminatedstring_2 = Custom[Points➜DeliminatedString+](points_In=getLocation, Round_Digits=code_block_2)
if_ = If(test=contains, true=flatten, false=points_deliminatedstring_2)
Loc_As_String = Output(if_)
Loc_Geometry = Output(getLocation)
