# Dynamo custom node Get_Element_OwnerView.dyf (Dynamo 1.3.2.2480)
# category: ArupBimSF.Revit.Elements_ViewDependent
# lists the owner view for view dependant elements (tags, generic anno, others)

In = Input()
code_block = CodeBlock(item=In) { Flatten({item}); }
python_script = Python(IN[0]=code_block)
# ---------- python_script.python (16 lines) ----------
import clr
clr.AddReference('RevitAPI')
from Autodesk.Revit.DB import *

clr.AddReference("RevitNodes")
import Revit
clr.ImportExtensions(Revit.Elements)

items = UnwrapElement(IN[0])
elementlist = list()
for item in items:
	try:
		elementlist.append(item.Document.GetElement(item.OwnerViewId).ToDSType(True))
	except:
		elementlist.append(list())
OUT = elementlist
# ----------------------------------------
return_ListOrSingleValue = Custom[Return_ListOrSingleValue](unknownItem=In, List_In=python_script)  # See Forum Post Regarding this node_RevitForum I think?
OwnerView = Output(return_ListOrSingleValue)
