# Dynamo custom node Get_Element_Rotation.Relative.dyf (Dynamo 1.3.2.2480)
# category: ArupBimSF.Revit.Element_Location
# get the rotation of an element based on an input vector

Rotate90 = Input(Rotate90:bool=false)
# note: This could be a family instance orientation vector, or line direction vector
InputVector = Input(InputVector:Vector)
YAxis = Vector.YAxis()
ZAxis = Vector.ZAxis()
angleAboutAxis = Vector.AngleAboutAxis(InputVector, YAxis, ZAxis)
code_block = CodeBlock(angle=angleAboutAxis) { angle+90; }
if_ = If(test=Rotate90, true=code_block, false=angleAboutAxis)
code_block_2 = CodeBlock(degree=if_) { degree > 180 ? degree-360 : degree; }
Degree = Output(code_block_2)
