# Dynamo custom node Get_Element_Rotation.dyf (Dynamo 1.3.2.2480)
# category: ArupBimSF.Revit.Element_Location
# get the rotation angle of elements

element = Input(element:Element)
code_block = CodeBlock(lst=element) { Flatten({lst}); }
rotationAngle = Python(IN[0]=code_block)  # "Element.RotationAngle"
# ---------- rotationAngle.python (33 lines) ----------
#This script looks for the rotation angle of Revit elements if available.
#If location is a LocationPoint then the Rotation value is available.
#In case of a slanted column, the Location is a LocationCurve, which doesn't have a rotation value.

import clr
import math

clr.AddReference('ProtoGeometry')
from Autodesk.DesignScript.Geometry import *

#Import RevitAPI
clr.AddReference('RevitAPI')
import Autodesk
#The inputs to this node will be stored as a list in the IN variables.
resRotation = []
strCol= IN[0]

#make unwrapped list of elements
elements=[]
for i in strCol:
	elements.append(UnwrapElement(i))
	
#get location and then rotation of element, if not not existing, then set rotation to null.
for item in elements:
	try:
		loc=item.Location
		resRotation.append(math.degrees(loc.Rotation))
	except:
		resRotation.append(None)
	

#Assign your output to the OUT variable.
OUT=resRotation
# ----------------------------------------
Angle = Output(rotationAngle)
