# Dynamo custom node Get_Elements_By Level At Index+.dyf (Dynamo 1.3.2.2480)
# category: ArupBimSF.Revit.Element_Selectors
# gets all elements at an input level

categories = Categories("Levels")
all_elements_of_category = ElementsOfCategory(categories)
code_block = CodeBlock { "Elevation"; }
getParameterValueByName = Element.GetParameterValueByName(parameterName=code_block)  # unwired: element
sortByFunction = SortByFunction(all_elements_of_category, getParameterValueByName)
name = Element.Name(sortByFunction)
Level_Names = Output(name)
Index = Input(Index:var="")
code_block_2 = CodeBlock(t1=Index) { t2 = !""; t3 = t1 == t2; }
python_script = Python(IN[0]=code_block_2.t3, IN[1]=sortByFunction)
# ---------- python_script.python (6 lines) ----------
bool=IN[0]

if bool == True:
	OUT=IN[1]
else:
	OUT=0
# ----------------------------------------
getItemAtIndex = List.GetItemAtIndex(list=python_script, index=Index)
python_script_2 = Python(IN[0]=getItemAtIndex)
# ---------- python_script_2.python (36 lines) ----------
import clr

clr.AddReference("RevitServices")
import RevitServices
from RevitServices.Persistence import DocumentManager
from RevitServices.Transactions import TransactionManager
doc = DocumentManager.Instance.CurrentDBDocument

clr.AddReference("RevitAPI")
import Autodesk
from Autodesk.Revit.DB import *

clr.AddReference("RevitNodes")
import Revit
clr.ImportExtensions(Revit.Elements)
clr.ImportExtensions(Revit.GeometryConversion)

level = UnwrapElement(IN[0])
levelId = level.Id

LevelFilter = ElementLevelFilter(levelId)
collector = FilteredElementCollector(doc)
collector.OfClass(FamilyInstance).WherePasses(LevelFilter)

bip = BuiltInParameter.RBS_START_LEVEL_PARAM
provider = ParameterValueProvider(ElementId(bip))
evaluator = FilterNumericEquals()
rule = FilterElementIdRule(provider,evaluator,levelId)
filter = ElementParameterFilter(rule)

collector2 = FilteredElementCollector(doc)
collector2.OfClass(HostObject).WherePasses(filter)
collector2.UnionWith(collector)

elements = collector2.ToElements()
OUT = elements
# ----------------------------------------
elements = Output(python_script_2)
