# Dynamo custom node Get_Elements_BySelectInRevitByCategory.dyf (Dynamo 1.3.2.2480)
# category: ArupBimSF.Revit.Element_Selectors
# Get Elements by select in revit by category. This isoloates you selection so you can only select the category chosen._!se

Category = Input()
Toggle = Input(Toggle : bool = false)
python_script = Python(IN[0]=Category, IN[1]=Toggle)
# ---------- python_script.python (40 lines) ----------
#Copyright (c) mostafa el ayoubi ,  2017
#Data-Shapes www.data-shapes.net , elayoubi.mostafa@gmail.com
#This work was inspired by @DanielHurtubise

import clr
clr.AddReference('RevitAPI')
from Autodesk.Revit.DB import *
clr.AddReference('RevitAPIUI')
from Autodesk.Revit.UI import*
from Autodesk.Revit.UI.Selection import ObjectType , ISelectionFilter
clr.AddReference('RevitServices')
from RevitServices.Persistence import DocumentManager

doc = DocumentManager.Instance.CurrentDBDocument
uidoc = uidoc = DocumentManager.Instance.CurrentUIApplication.ActiveUIDocument

class selectionfilter(ISelectionFilter):
	def __init__(self,categories):
		self.categories = categories
	def AllowElement(self,element):
		if element.Category.Name in [c.Name for c in self.categories] :
			return True
		else:
			return False
	def AllowReference(reference,point):
		return False

if isinstance(IN[0],list):
	categories = UnwrapElement(IN[0])
else:
	categories = [UnwrapElement(IN[0])]
	
selfilt = selectionfilter(categories)
catnames = ', '.join([c.Name for c in categories])
if IN[1]:
	sel = uidoc.Selection.PickObjects(Selection.ObjectType.Element,selfilt,'Select %s' %(catnames))
	selelem = [doc.GetElement(s.ElementId) for s in sel]
	OUT = selelem
else:
	OUT = 'Set toggle to true!'
# ----------------------------------------
OUT = Output(python_script)
