# Dynamo custom node Get_Elements_InViews+.dyf (Dynamo 1.3.2.2480)
# category: ArupBimSF.Revit.Elements
# Gets all visible elements from input views.  This node gets more info that the OOTb node does not pick-up like RAster Images, textnotes and more. Get elements in active view by default and setting RunMe To true otherwise input a list of views

ViewsIn = Input(ViewsIn: var="")
action_runme_if = Custom[Action_RunMe If](List_In=ViewsIn)  # uses a run_me node if input does note eqaul ""#Action
RunMe = Input(RunMe : bool = false)  # set runme to true to run the Current Active view
python_script = Python()  # unwired: IN[0]
# ---------- python_script.python (25 lines) ----------
import clr
clr.AddReference('ProtoGeometry')
from Autodesk.DesignScript.Geometry import *

# Import RevitNodes
clr.AddReference("RevitNodes")
import Revit

# Import Revit elements
from Revit.Elements import *

# Import DocumentManager
clr.AddReference("RevitServices")
import RevitServices
from RevitServices.Persistence import DocumentManager

import System

doc = DocumentManager.Instance.CurrentDBDocument
uiapp = DocumentManager.Instance.CurrentUIApplication
uidoc = uiapp.ActiveUIDocument
app = uiapp.Application
view = uidoc.ActiveView 

OUT = view
# ----------------------------------------
action_RunMe = Custom[Action_RunMe](Should_I=RunMe, ThingToDo=python_script)  # Uses A boolean to determine whether to run a function or sequence.
if_ = If(test=action_runme_if, true=ViewsIn, false=action_RunMe)
Refresh = Input(Refresh : bool = false)
code_block = CodeBlock(if_, Refresh)
# ---------- code_block.designscript (11 lines) ----------
list;
come;

[Imperative]

{
 if (come ==true)
  return = list;
 else
  return = list;
};
# ----------------------------------------
python_script_2 = Python(IN[0]=code_block.out2)
# ---------- python_script_2.python (14 lines) ----------
import clr
clr.AddReference('RevitAPI')
from Autodesk.Revit.DB import*
clr.AddReference('RevitServices')
from RevitServices.Persistence import DocumentManager

doc = DocumentManager.Instance.CurrentDBDocument

if isinstance(IN[0],list):
	views = UnwrapElement(IN[0])
else:
	views = [UnwrapElement(IN[0])]

OUT = [FilteredElementCollector(doc,v.Id).ToElements() for v in views]
# ----------------------------------------
ElementOut = Output(python_script_2)
