# Dynamo custom node Get_Elements_InViewsByCategories+.dyf (Dynamo 1.3.2.2480)
# category: Arup - Bay Area.Revit.Elements
# Reads list of views and categories and returns list of elements of specified categories by view.

# note: THROUGHPUT:  No direct user interaction needed.

# group: DESCRIPTION
# note: DYNAMO FILE NAME
# Get_Elements_InViewsByCategories+.dyn
# note: ASSOCIATED REVIT FILE(S)
# N/A
# note: AUTHOR(S)
# Bryan McCaffrey (Bay Area)
# note: DESCRIPTION
# Reads list of views and categories and returns list of elements of specified categories by view.
# note: DYNAMO VERSION
# 1.3
# note: WORKING REVIT VERSION(S)
# 2017
# note: N/A

# group: INPUTS
# note: INPUT:  Requires interaction / verification.
view = Input(view:var[])
# note: OUTPUT:  Suggests interaction / verification / review.
refresh = Input(refresh:bool = true)
# note: OUTPUT:  Requires interaction / verification/review.
# note: OUTPUT:  Final data for use / further manipulation.
categoryName = Input(categoryName:var[])

# group: READ VIEWS + CATEGORIES AND SELECT ELEMENTS OF CATEGORIES IN VIEWS
python_script = Python(IN[0]=view, IN[1]=refresh)
# ---------- python_script.python (35 lines) ----------
#Copyright(c) 2016, Dimitar Venkov
# @5devene, dimitar.ven@gmail.com

import clr

clr.AddReference("RevitServices")
import RevitServices
from RevitServices.Persistence import DocumentManager
doc = DocumentManager.Instance.CurrentDBDocument

clr.AddReference("RevitAPI")
from Autodesk.Revit.DB import FilteredElementCollector

clr.AddReference("RevitNodes")
import Revit
clr.ImportExtensions(Revit.Elements)

def tolist(obj1):
	if hasattr(obj1,"__iter__"): return obj1
	else: return [obj1]
def output1(l1):
	if len(l1) == 1: return l1[0]
	else: return l1

views = UnwrapElement(tolist(IN[0]))
elements = []

for i in xrange(len(views)):
	fec = FilteredElementCollector(doc, views[i].Id).WhereElementIsNotElementType().GetElementIterator()
	fec.Reset()
	view_el = []
	while fec.MoveNext():
		view_el.append(fec.Current.ToDSType(True))
	elements.append(view_el)
OUT = output1(elements)
# ----------------------------------------
string_from_object = FromObject(categoryName)
python_script_2 = Python(IN[0]=python_script, IN[1]=string_from_object)
# ---------- python_script_2.python (24 lines) ----------
#Copyright(c) 2016, Dimitar Venkov
# @5devene, dimitar.ven@gmail.com

import clr

clr.AddReference("RevitNodes")
import Revit
clr.ImportExtensions(Revit.Elements)

def tolist(obj1):
	if hasattr(obj1,"__iter__"): return obj1
	else: return [obj1]

elements = UnwrapElement(tolist(IN[0]))
filter = tolist(IN[1])
in1, out1 = [], []

for i in xrange(len(elements)):
	try: n1 = elements[i].Category.Name.lower()
	except: n1 = ""
	if any(filter[j].lower() in n1 for j in xrange(len(filter))):
		in1.append(elements[i])
	else: out1.append(elements[i])
OUT = in1, out1
# ----------------------------------------
code_block = CodeBlock(f=python_script_2) { f[0]; f[1]; }

# group: OUTPUTS
in_ = Output(code_block.out0)  # "in"
