# Dynamo custom node Get_Elements_InViewsByCategory.dyf (Dynamo 1.3.2.2480)
# category: ArupBimSF.Revit.Elements
# Gets elements in views or sheets by category_!!GetElementsInViews_ByCategory

Categories = Input()
string_from_object = FromObject(Categories)
byName = Category.ByName(string_from_object)
code_block = CodeBlock(item=byName) { Flatten({item}); }
Views_In = Input()
code_block_2 = CodeBlock(item=Views_In) { Flatten({item}); }
python_script = Python(IN[0]=code_block, IN[1]=code_block_2)
# ---------- python_script.python (25 lines) ----------
import System
import clr
clr.AddReference('RevitAPI')
from Autodesk.Revit.DB import *

clr.AddReference("RevitServices")
import RevitServices
from RevitServices.Persistence import DocumentManager


cats = IN[0]
views = UnwrapElement(IN[1])
doc = DocumentManager.Instance.CurrentDBDocument

elementlist = list()
# This could be more elegant if only I knew how to implement a Multicategory filter in Python....
for cat in cats:
	catlist = list()
	for view in views:
		collector = FilteredElementCollector(doc)
		filter = ElementOwnerViewFilter(view.Id)
		bic = System.Enum.ToObject(BuiltInCategory, cat.Id)
		catlist.append(collector.WherePasses(filter).OfCategory(bic).ToElements())
	elementlist.append(catlist)
OUT = elementlist
# ----------------------------------------
flatten = Flatten(python_script@L1)
Elements = Output(flatten)
