# Dynamo custom node Get_Elements_RoomLocation.dyf (Dynamo 1.3.2.2480)
# category: ArupBimSF.Revit.Element_Location
# Gets the room location of elements

elements = Input()
document = Input()
refresh = Input(refresh: bool = true)
python_script = Python(IN[0]=elements, IN[1]=document, IN[2]=refresh)
# ---------- python_script.python (43 lines) ----------
import clr
import sys
clr.AddReference('ProtoGeometry')
from Autodesk.DesignScript.Geometry import *

# Import RevitAPI
clr.AddReference("RevitAPI")
import Autodesk
from Autodesk.Revit.DB import *

# Import ToDSType(bool) extension method
clr.AddReference("RevitNodes")
import Revit
clr.ImportExtensions(Revit.Elements)

# inputs
elements = UnwrapElement(IN[0])
doc = UnwrapElement(IN[1])
refresh = UnwrapElement(IN[2])
		
# Get rooms		
collector = FilteredElementCollector(doc)
filter = ElementCategoryFilter(BuiltInCategory.OST_Rooms)
rooms = collector.WherePasses(filter).WhereElementIsNotElementType().ToElements()

elementroom = []
elementswithroom = []

for element in elements:	
	for room in rooms:
		epoint = element.Location.Point
		if room.IsPointInRoom(epoint):
			elementroom.append(room)
			elementswithroom.append(element)			
			break			
	


outlist = []
outlist.append(elementswithroom)
outlist.append(elementroom)

OUT = outlist
# ----------------------------------------
code_block = CodeBlock(OUT=python_script) { OUT[0]; OUT[1]; }
elements_2 = Output(code_block.out0)  # "elements"
rooms = Output(code_block.out1)
