# Dynamo custom node Get_FamilyDoc_FromFamily.dyf (Dynamo 1.3.2.2480)
# category: ArupBimSF.Revit.Directory
# gets the family document from input family

Family = Input()
uniqueItems = List.UniqueItems(Family)
python_script = Python(IN[0]=uniqueItems)
# ---------- python_script.python (21 lines) ----------
import clr
clr.AddReference('ProtoGeometry')
from Autodesk.DesignScript.Geometry import *

clr.AddReference("RevitAPI")
import Autodesk
from Autodesk.Revit.DB import *

clr.AddReference("RevitServices")
import RevitServices
from RevitServices.Persistence import DocumentManager

doc = DocumentManager.Instance.CurrentDBDocument
element = UnwrapElement(IN[0])
family = []
fdoc = []
for i in element:
	family = Document.EditFamily(doc,i)
	fdoc.append(family)

OUT = fdoc
# ----------------------------------------
Family_Doc = Output(python_script)  # "Family.Doc"
