# Dynamo custom node Get_FamilyInstances_ByCategory.dyf (Dynamo 1.3.2.2480)
# category: ArupBimSF.^TestingGrounds
# get all loaded family types of a category

Category_In = Input(Category_In: var)
string_from_object = FromObject(Category_In)
byName = Category.ByName(string_from_object)
code_block = CodeBlock(item=byName) { Flatten({item}); }
ReFresh = Input(ReFresh : bool = true)
python_script = Python(IN[0]=code_block, IN[1]=ReFresh)
# ---------- python_script.python (21 lines) ----------
import System
import clr
clr.AddReference('RevitAPI')
from Autodesk.Revit.DB import *

clr.AddReference("RevitServices")
import RevitServices
from RevitServices.Persistence import DocumentManager

doc = DocumentManager.Instance.CurrentDBDocument
cats = IN[0]

elementlist = list()
# This could be more elegant if only I knew how to implement a Multicategory filter in Python....
for item in cats:
	collector = FilteredElementCollector(doc)
	collector.OfClass(FamilySymbol)
	bic = System.Enum.ToObject(BuiltInCategory, item.Id)
	collector.OfCategory(bic)
	elementlist.append(collector.ToElements())
OUT = elementlist
# ----------------------------------------
python_script_2 = Python(IN[0]=byName, IN[1]=python_script)
# ---------- python_script_2.python (4 lines) ----------
check = IN[0]
items = IN[1]
if isinstance(check, (list)): OUT = items
else: OUT = items[0]
# ----------------------------------------
family = FamilyType.Family(python_script_2)
Parent_Family = Output(family)
Family_Types = Output(python_script_2)
get_element_name = Custom[Get_Element.Name+](Input=python_script_2)  # Get the element name from all types of elements including system families
Type_Names = Output(get_element_name)
