# Dynamo custom node Get_FamilyParameters_FE.dyf (Dynamo 1.3.2.2480)
# category: ArupBimSF.Revit.FamilyEditor
# Gets all family parameters in a family (inside the family editor)._!!FE

Refresh = Input(Refresh : bool = true)
python_script = Python(IN[0]=Refresh)
# ---------- python_script.python (14 lines) ----------
import clr
clr.AddReference('RevitAPI')
from Autodesk.Revit.DB import *

clr.AddReference("RevitServices")
import RevitServices
from RevitServices.Persistence import DocumentManager

doc = DocumentManager.Instance.CurrentDBDocument
elementlist = list()
if doc.IsFamilyDocument:
	for param in doc.FamilyManager.Parameters:
		elementlist.append(param)
OUT = elementlist
# ----------------------------------------
familyParameters = Output(python_script)
