# Dynamo custom node Get_FamilyType_At Index+.dyf (Dynamo 1.3.2.2480)
# category: ArupBimSF.Revit.Elements_Families
# get all loaded family types of a category

Category_In = Input(Category_In: var)
string_from_object = FromObject(Category_In)
byName = Category.ByName(string_from_object)
code_block = CodeBlock(item=byName) { Flatten({item}); }
ReFresh = Input(ReFresh : bool = true)
python_script = Python(IN[0]=code_block, IN[1]=ReFresh)
# ---------- python_script.python (21 lines) ----------
import System
import clr
clr.AddReference('RevitAPI')
from Autodesk.Revit.DB import *

clr.AddReference("RevitServices")
import RevitServices
from RevitServices.Persistence import DocumentManager

doc = DocumentManager.Instance.CurrentDBDocument
cats = IN[0]

elementlist = list()
# This could be more elegant if only I knew how to implement a Multicategory filter in Python....
for item in cats:
	collector = FilteredElementCollector(doc)
	collector.OfClass(FamilySymbol)
	bic = System.Enum.ToObject(BuiltInCategory, item.Id)
	collector.OfCategory(bic)
	elementlist.append(collector.ToElements())
OUT = elementlist
# ----------------------------------------
python_script_2 = Python(IN[0]=byName, IN[1]=python_script)
# ---------- python_script_2.python (4 lines) ----------
check = IN[0]
items = IN[1]
if isinstance(check, (list)): OUT = items
else: OUT = items[0]
# ----------------------------------------
family = FamilyType.Family(python_script_2)
n1_Parent_Family = Output(family)  # "1_Parent Family"
name = Element.Name(family)
n0_Family_Names = Output(name)  # "0_Family Names"
n2_Family_Types = Output(python_script_2)  # "2_Family Types"
name_2 = Element.Name(python_script_2)
n3_Type_Names = Output(name_2)  # "3_Type Names"
Index_Or_SearchString = Input(Index_Or_SearchString : var = 0)
type = Object.Type(Index_Or_SearchString)
code_block_2 = CodeBlock { "System.String"; }
eq = type == code_block_2
code_block_3 = CodeBlock { 1; }
list_FilterByStringMatch = Custom[List_FilterByStringMatch](list=name, SearchString=Index_Or_SearchString, Contains_Or_Equals=code_block_3)  # Filters a list of elements by whether or not they contain a search string. I added an option to run it by string match as well._!fi!Li
code_block_4 = CodeBlock { true; }
indexOf = IndexOf(list_FilterByStringMatch.Bool, code_block_4)
if_ = If(test=eq, true=indexOf, false=Index_Or_SearchString)
graph_SeqPassthru = Custom[Graph_SeqPassthru](passThrough=python_script_2, waitFor=if_)  # forces an operation to run in sequence.
code_block_5 = CodeBlock(x=graph_SeqPassthru, p=if_) { x[p]; }
n4_ChosenIndex = Output(code_block_5)  # "4_ChosenIndex"
