# Dynamo custom node Get_FamilyTypes Of Parent Family.dyf (Dynamo 1.3.2.2480)
# category: ArupBimSF.Revit.Elements_Families
# get all family types of an input parent family

Family = Input()
python_script = Python(IN[0]=Family)
# ---------- python_script.python (33 lines) ----------
import clr
clr.AddReference('ProtoGeometry')
from Autodesk.DesignScript.Geometry import *

# Import DocumentManager and TransactionManager
clr.AddReference("RevitServices")
import RevitServices
from RevitServices.Persistence import DocumentManager

doc = DocumentManager.Instance.CurrentDBDocument

#The inputs to this node will be stored as a list in the IN variables.
if isinstance(IN[0], list):
	toggle = 0
	family = UnwrapElement(IN[0])
else:
	toggle = 1
	family = [UnwrapElement(IN[0])]

listout = []
for fam in family:
	ids = fam.GetFamilySymbolIds()
	types = []
	for i in ids:
		type = doc.GetElement(i)
		types.append(type)
	listout.append(types)

#Assign your output to the OUT variable.
if toggle == 0:
	OUT = listout
else:
	OUT = types
# ----------------------------------------
FamilyTypes = Output(python_script)
