# Dynamo custom node Get_FamilyTypes_FE.dyf (Dynamo 1.3.2.2480)
# category: ArupBimSF.Revit.FamilyEditor
# Outputs all family types of  the active Family doc in the family editor.  Also outputs the Active Famliy Type._!!FE

Refresh = Input(Refresh : bool = true)
python_script = Python(IN[0]=Refresh)
# ---------- python_script.python (14 lines) ----------
import clr
clr.AddReference('RevitAPI')
from Autodesk.Revit.DB import *

clr.AddReference("RevitServices")
import RevitServices
from RevitServices.Persistence import DocumentManager

doc = DocumentManager.Instance.CurrentDBDocument
elementlist = list()
if doc.IsFamilyDocument:
	for ftype in doc.FamilyManager.Types:
		elementlist.append(ftype)
OUT = elementlist
# ----------------------------------------
familyTypes = Output(python_script)
python_script_2 = Python(IN[0]=Refresh)
# ---------- python_script_2.python (12 lines) ----------
import clr
clr.AddReference('RevitAPI')
from Autodesk.Revit.DB import *

clr.AddReference("RevitServices")
import RevitServices
from RevitServices.Persistence import DocumentManager

doc = DocumentManager.Instance.CurrentDBDocument
if doc.IsFamilyDocument:
	OUT = doc.FamilyManager.CurrentType
else: OUT = None
# ----------------------------------------
ActiveType = Output(python_script_2)
