# Dynamo custom node Get_Filled Regions.dyf (Dynamo 1.3.2.2480)
# category: ArupBimSF.Revit.Annotations
# gets all filled regions in document

Refresh = Input(Refresh: bool = true)
python_script = Python()
# ---------- python_script.python (32 lines) ----------
import clr
clr.AddReference('ProtoGeometry')
from Autodesk.DesignScript.Geometry import *

# Import RevitAPI
clr.AddReference("RevitAPI")
import Autodesk
from Autodesk.Revit.DB import *
from Autodesk.Revit.DB.Analysis import *

# Import DocumentManager and TransactionManager
clr.AddReference("RevitServices")
import RevitServices
from RevitServices.Persistence import DocumentManager
from RevitServices.Transactions import TransactionManager

doc = DocumentManager.Instance.CurrentDBDocument

# Import ToDSType(bool) extension method
clr.AddReference("RevitNodes")
import Revit
clr.ImportExtensions(Revit.Elements)
clr.ImportExtensions(Revit.GeometryConversion)

#The inputs to this node will be stored as a list in the IN variable.
dataEnteringNode = IN

inView = FilteredElementCollector(doc, doc.ActiveView.Id).OfClass(FilledRegion)
inProject = FilteredElementCollector(doc).OfClass(FilledRegion)

#Assign your output to the OUT variable
OUT = [i.ToDSType(True) for i in inView],[j.ToDSType(True) for j in inProject]
# ----------------------------------------
action_ReFresh = Custom[Action_ReFresh](Refresh=Refresh, list=python_script)  # add to the front of a workflow to allow it to be refreshed with a boolean node
code_block = CodeBlock(OUT=action_ReFresh) { OUT[0]; OUT[1]; }
Active_View_Filled_Regions = Output(code_block.out0)
All_Filled_Regions = Output(code_block.out1)
