# Dynamo custom node Get_ForcedParameterValue_AtIndex+.dyf (Dynamo 1.3.2.2480)
# category: ArupBimSF.^TestingGrounds
# ^Test

Elements_In = Input()
ReFresh = Input(ReFresh : bool = false)
code_block = CodeBlock(Elements_In, ReFresh)
# ---------- code_block.designscript (11 lines) ----------
list;
come;

[Imperative]

{
 if (come ==true)
  return = list;
 else
  return = list;
};
# ----------------------------------------
parameters = Element.Parameters(code_block.out2, lacing=Longest)
name = Parameter.Name(parameters)
hasValue = Parameter.HasValue(parameters)
filterByBoolMask = List.FilterByBoolMask(list=name, mask=hasValue)
flatten = Flatten(filterByBoolMask.in)
sort = List.Sort(flatten)
uniqueItems = List.UniqueItems(sort)
n00_ParameterList = Output(uniqueItems)  # "00_ParameterList"
name_2 = Parameter.Name(parameters)
length = String.Length(name_2)
code_block_2 = CodeBlock(x=length) { x+6; }
code_block_3 = CodeBlock { " : ---"; }
padRight = String.PadRight(name_2, code_block_2, code_block_3)
list_CombineByBooleanPattern = Custom[List_CombineByBooleanPattern](Pattern=hasValue, True=parameters, False=padRight)  # ^Testing
count = Count(hasValue@L2)
chop = List.Chop(list=list_CombineByBooleanPattern, lengths=count)
Index_Or_Search = Input(Index_Or_Search : var = "---")
code_block_4 = CodeBlock { "---"; }
eq = Index_Or_Search == code_block_4
type = Object.Type(Index_Or_Search)
code_block_5 = CodeBlock { "System.Int"; }
contains = String.Contains(str=type, searchFor=code_block_5)
join = List.Join(eq, contains)
list_any_true = Custom[List_Any True](List_In=join)  # #Depricated use list contains item and put true or false in a code block
getItemAtIndex = List.GetItemAtIndex(index=Index_Or_Search)  # unwired: list
map = List.Map(list=uniqueItems, f_x=getItemAtIndex)
ContainsOrEquals = Input(ContainsOrEquals: bool=true)
list_FilterByStringMatch = Custom[List_FilterByStringMatch](list=uniqueItems, SearchString=Index_Or_Search, Contains_Or_Equals=ContainsOrEquals, lacing=Longest)  # Filters a list of elements by whether or not they contain a search string. I added an option to run it by string match as well._!fi!Li
if_ = If(test=list_any_true, true=map, false=list_FilterByStringMatch.Match)
graph_SeqPassthru = Custom[Graph_SeqPassthru](passThrough=name, waitFor=if_)  # forces an operation to run in sequence.
indexOf = IndexOf(arg1=if_, lacing=Longest)  # unwired: arg0
map_2 = List.Map(list=graph_SeqPassthru, f_x=indexOf)
getItemAtIndex_2 = List.GetItemAtIndex(list=chop, index=map_2, lacing=Longest)
list_CleanOutput = Custom[List_CleanOutput](List_In=getItemAtIndex_2)  # Removes and Replaces Nulls and Empty Lists from input lists. *only works with flat or 2 dimentional lists_Need to fix it to go deeper or use list.map_!!List
get_parametervalue_name = Custom[Get_ParameterValue&Name+](Parameter=list_CleanOutput.Cleaned)  # Gets the name and value+ of input parameters._!!Pa
uniqueItems_2 = List.UniqueItems(get_parametervalue_name.ParameterName)
n01_ChosenParam = Output(uniqueItems_2)  # "01_ChosenParam"
n02_ParameterValue = Output(get_parametervalue_name.ParameterValue)  # "02_ParameterValue"
n03_ForcedStringValue = Output(get_parametervalue_name.StringValue)  # "03_ForcedStringValue"
graph_SeqPassthru_2 = Custom[Graph_SeqPassthru](passThrough=code_block.out2, waitFor=getItemAtIndex_2)
getItemAtIndex_3 = List.GetItemAtIndex(list=graph_SeqPassthru_2, index=list_CleanOutput.Indices)
n04_Param_DoesNotExist = Output(getItemAtIndex_3)  # "04_Param_DoesNotExist"
