# Dynamo custom node Get_FromClipBoard.dyf "➜GetFromClipBoard" (Dynamo 1.3.2.2480)
# category: ArupBimSF.Data Transfer
# gets text strings copied to clipboard

toggle = Input(toggle : bool = true)
python_script = Python(IN[0]=toggle)
# ---------- python_script.python (21 lines) ----------
import clr
import System
from System.Threading import Thread, ThreadStart
clr.AddReference("System.Windows.Forms")

clipboardcontents = '###'

def GetText():
    def thread_proc():
        global clipboardcontents
        clipboardcontents = System.Windows.Forms.Clipboard.GetText()
    t = Thread(ThreadStart(thread_proc))
    t.ApartmentState = System.Threading.ApartmentState.STA
    t.Start()
    t.Join()

try:
	GetText()
	OUT = clipboardcontents
except:
	OUT = 'Data could not be copied to clipboard'
# ----------------------------------------
str = Output(python_script)
