# Dynamo custom node Get_GlobalParameters_Doc.dyf (Dynamo 1.3.2.2480)
# category: ArupBimSF.Revit.Parameters
# Get all the global parameters from active doc along with their properties.  Sort Properties and select a parameter at index._#Pa#Gp#doc

# group: DESCRIPTION
# note: N/A
# note: AUTHOR(S)
# Emmett Cruey_ArupSF
# note: ASSOCIATED REVIT FILE(S)
# N/A
# note: DYNAMO FILE NAME
# Get_GlobalParameters_Doc.dyf
# note: DESCRIPTION
# Reads all global parameters in active document and their properties, sorts properties, and returns parameter at specified index.
# #pa #gp #doc
# note: WORKING REVIT VERSION(S)
# 2017
# note: DYNAMO VERSION
# 1.3

element_types = ElementTypes("GlobalParameter")

# group: INPUTS
Refresh = Input(Refresh : bool=true)
Index_Or_StringMatch = Input(Index_Or_StringMatch: var = 0)

code_block = CodeBlock(element_types, Refresh)
# ---------- code_block.designscript (11 lines) ----------
list;
come;

[Imperative]

{
 if (come ==true)
  return = list;
 else
  return = list;
};
# ----------------------------------------
all_elements_of_type = ElementsOfType(code_block.out2)
name = GlobalParameter.Name(all_elements_of_type)
code_block_2 = CodeBlock { 1; }
list_FilterByStringMatch = Custom[List_FilterByStringMatch](list=name, SearchString=Index_Or_StringMatch, Contains_Or_Equals=code_block_2)  # Filters a list of elements by whether or not they contain a search string. I added an option to run it by string match as well._!fi!Li
code_block_3 = CodeBlock { true; }
indexOf = IndexOf(list_FilterByStringMatch.Bool, code_block_3)
value = GlobalParameter.Value(all_elements_of_type)
parameterType = GlobalParameter.ParameterType(all_elements_of_type)
parameterGroup = GlobalParameter.ParameterGroup(all_elements_of_type)
type = Object.Type(Index_Or_StringMatch)
code_block_4 = CodeBlock { "System.String"; }
eq = type == code_block_4
allIndicesOf = List.AllIndicesOf(list=list_FilterByStringMatch.Bool, item=code_block_3)
if_ = If(test=eq, true=allIndicesOf, false=Index_Or_StringMatch)
code_block_5 = CodeBlock(x=name, p=if_) { x[p]; }
code_block_6 = CodeBlock(x=all_elements_of_type, p=if_) { x[p]; }

# group: OUTPUT
n0_ParameterNames = Output(name)  # "0_ParameterNames"
n1_All_GlobalParams = Output(all_elements_of_type)  # "1_All_GlobalParams"
n2_ParameterValue = Output(value)  # "2_ParameterValue"
n3_ParameterUnitType = Output(parameterType)  # "3_ParameterUnitType"
n4_ParameterGroup = Output(parameterGroup)  # "4_ParameterGroup"
Chosen_Param_Name = Output(code_block_5)  # "➜Chosen_Param_Name"
Chosen_Param = Output(code_block_6)  # "➜Chosen_Param"

# note: INPUT:  Requires interaction / verification.
# note: OUTPUT:  Requires interaction / verification/review.
# note: OUTPUT:  Suggests interaction / verification / review.
# note: OUTPUT:  Final data for use / further manipulation.
# note: THROUGHPUT:  No direct user interaction needed.
code_block_7 = CodeBlock {  }
