# Dynamo custom node Get_IdenityData+.dyf (Dynamo 1.3.2.2480)
# category: ArupBimSF.Revit.Elements
# Gets Revit element Id and GUID for input elements

Elements = Input()
Refresh = Input(Refresh : bool = false)
code_block = CodeBlock(Elements, Refresh)
# ---------- code_block.designscript (11 lines) ----------
list;
come;

[Imperative]

{
 if (come ==true)
  return = list;
 else
  return = list;
};
# ----------------------------------------
identity = Object.Identity(code_block.out2)
getCategory = Element.GetCategory(identity)
n0_CategoryName = Output(getCategory)  # "0_CategoryName"
getType = FamilyInstance.GetType(identity)
family = FamilyType.Family(getType)
id = Element.Id(family)
n1_Family_Id = Output(id)  # "1_Family Id"
id_2 = Element.Id(getType)
n2_Type_Id = Output(id_2)  # "2_Type Id"
id_3 = Element.Id(identity)
n3_Element_ID = Output(id_3)  # "3_Element ID"
name = Element.Name(family)
n4_Family_Name = Output(name)  # "4_Family_Name"
name_2 = Custom[Get_Element.Name+](elements=code_block.out2)  # Get the element name from all types of elements including system families_!!Get!Element
n5_TypeName = Output(name_2)  # "5_TypeName"
getLocation = Element.GetLocation(code_block.out2)
n6_Location = Output(getLocation)  # "6_Location"
join = List.Join(lacing=Longest)  # unwired: arg0, arg1
string = StringInput("Category Name,Family Id,Type Id,Instance Id,Family Name,Element Name,Location")
deliminated_string_list = Custom[Deliminated String ➜ List](Strings_In=string)  # Splits a comma deliminated String to a list of strings_!!List DeliminatedStringToList
string_from_object = FromObject(id)
string_from_object_2 = FromObject(id_3)
create = List.Create(getCategory, string_from_object, id_2, string_from_object_2, name, name_2, getLocation)
combine = List.Combine(join, deliminated_string_list, create)
n7_ListOut = Output(combine)  # "7_ListOut"
