# Dynamo custom node Get_Instance_byNameSearch.dyf (Dynamo 1.3.2.2480)
# category: ArupBimSF.Revit.Elements_Families
# collects placed elements by input name

Search_String = Input(Search_String:string)
ReFresh = Input(ReFresh:bool = true)
python_script = Python(IN[0]=Search_String, IN[1]=ReFresh)
# ---------- python_script.python (36 lines) ----------
import clr

clr.AddReference("RevitServices")
import RevitServices
from RevitServices.Persistence import DocumentManager
doc = DocumentManager.Instance.CurrentDBDocument

clr.AddReference("RevitAPI")
from Autodesk.Revit.DB import *

clr.AddReference("RevitNodes")
import Revit
clr.ImportExtensions(Revit.Elements)

def tolist(obj1):
	if hasattr(obj1,"__iter__"): return obj1
	else: return [obj1]

fn = map(str,tolist(IN[0]) )
result, similar, names = [], [], []

fec = FilteredElementCollector(doc).OfClass(FamilyInstance)
for i in fec:
	n1 = i.Name
	names.append(n1)
	if any(fn1 == n1 for fn1 in fn):
		result.append(i.ToDSType(True))
	elif any(fn1.lower() in n1.lower() for fn1 in fn):
		similar.append(i.ToDSType(True))

if len(result) > 0:
	OUT = result,similar
if len(result) == 0 and len(similar) > 0:
	OUT = "No exact match found. Check partial below:",similar
if len(result) == 0 and len(similar) == 0:
	OUT = "No match found! Check names below:", names
# ----------------------------------------
code_block = CodeBlock(o=python_script) { o[0]; o[1]; }
exact_match = Output(code_block.out0)
partial_match = Output(code_block.out1)
