# Dynamo custom node Get_Intersection.dyf (Dynamo 1.3.2.2480)
# category: ArupBimSF.Geometry
# get the intersecting solid of two input geometries

Base_Geo = Input()
Intersection_Geo = Input()
python_script = Python(IN[0]=Base_Geo, IN[1]=Intersection_Geo)
# ---------- python_script.python (29 lines) ----------
import clr
clr.AddReference('RevitAPI')
clr.AddReference("RevitNodes")

import Revit
import Autodesk
from Autodesk.Revit.DB import *

clr.AddReference("RevitServices")
import RevitServices
from RevitServices.Persistence import DocumentManager
from RevitServices.Transactions import TransactionManager
doc = DocumentManager.Instance.CurrentDBDocument

baseGeometry = IN[0]
intersectionGeometry = IN[1]
interferences = []


for i in intersectionGeometry:
	for j in baseGeometry:
		interference = i.DoesIntersect(j)
		if interference == True:
			interferences.append(j.Intersect(i))

			
			
OUT = interferences
			
# ----------------------------------------
flatten = Flatten(python_script)
Elements = Output(flatten)
