# Dynamo custom node Get_IntersectionByLevel.dyf (Dynamo 1.3.2.2480)
# category: ArupBimSF.Geometry
# get the insection geometry of input geometries by level

Base_Geo = Input()
Intersection_Geo = Input()
Level = Input()
python_script = Python(IN[0]=Base_Geo, IN[1]=Intersection_Geo, IN[2]=Level)
# ---------- python_script.python (37 lines) ----------
import clr
clr.AddReference('RevitAPI')
clr.AddReference("RevitNodes")

import Revit
import Autodesk
from Autodesk.Revit.DB import *

clr.AddReference("RevitServices")
import RevitServices
from RevitServices.Persistence import DocumentManager
from RevitServices.Transactions import TransactionManager
doc = DocumentManager.Instance.CurrentDBDocument

baseGeometry = IN[0]
intersectionGeometry = IN[1]
lev = IN[2]
interferences = []
levels = []
output = []


for i in intersectionGeometry:
	k = 0
	for j in baseGeometry:
		interference = i.DoesIntersect(j)
		if interference == True:
			interferences.append(j.Intersect(i))
			levels.append(lev[k])
		k += 1
			

output.append(interferences)
output.append(levels)
			
OUT = output
			
# ----------------------------------------
code_block = CodeBlock(lst=python_script) { lst[0]; lst[1]; }
flatten = Flatten(code_block.out0)
Elements = Output(flatten)
flatten_2 = Flatten(code_block.out1)
Levels = Output(flatten_2)
