# Dynamo custom node Get_Level_AssociatedViews.dyf (Dynamo 1.3.2.2480)
# category: ArupBimSF.Revit.Location_References
# input levels and get all views associated to them

toggleToRefresh = Input(toggleToRefresh : bool = true)
python_script = Python(IN[0]=toggleToRefresh)
# ---------- python_script.python (20 lines) ----------
import clr
clr.AddReference('RevitAPI')
from Autodesk.Revit.DB import *
import Autodesk

clr.AddReference("RevitServices")
import RevitServices
from RevitServices.Persistence import DocumentManager

doc = DocumentManager.Instance.CurrentDBDocument
collector = FilteredElementCollector(doc)
views = collector.OfClass(View).ToElements()
viewlist = list()
for view in views:
	if view.ViewType == ViewType.ThreeD:
		if not(view.IsTemplate):
			viewlist.append(view)
	else:
		viewlist.append(view)
OUT = viewlist
# ----------------------------------------
element_Level = Custom[Element_Level](element=python_script)  # get the level associated with input elements
isEmpty = List.IsEmpty()  # unwired: arg0
map = List.Map(list=element_Level, f_x=isEmpty)
filterByBoolMask = List.FilterByBoolMask(list=python_script, mask=map)
filterByBoolMask_2 = List.FilterByBoolMask(list=element_Level, mask=map)
uniqueId = Element.UniqueId(filterByBoolMask_2.out)
level = Input(level : Level)
uniqueId_2 = Element.UniqueId(level)
eq = uniqueId == uniqueId_2
filterByBoolMask_3 = List.FilterByBoolMask(list=filterByBoolMask.out, mask=eq)
firstItem = List.FirstItem(filterByBoolMask_3.in)
firstView = Output(firstItem)
allViews = Output(filterByBoolMask_3.in)
