# Dynamo custom node Get_Level_Plane.dyf (Dynamo 1.3.2.2480)
# category: ArupBimSF.Revit.Location_References
# Gets the xy plane at the base of input levels #Levels

code_block = CodeBlock { 0; }
levels = Input(levels : var[]..[])  # Revit levels
projectElevation = Level.ProjectElevation(levels)
byCoordinates = Point.ByCoordinates(x=code_block, y=code_block, z=projectElevation)
ZAxis = Vector.ZAxis()
byOriginNormal = Plane.ByOriginNormal(origin=byCoordinates, normal=ZAxis)
plane = Output(byOriginNormal)
