# Dynamo custom node Get_Levels_FromDocument+.dyf (Dynamo 1.3.2.2480)
# category: ArupBimSF.Revit.Element_Collectors
# Get Level Info from input Linked Documents _!!Levels at Index+

LinkedDoc = Input(LinkedDoc: var = "")  # Only Use this port if you want a linked Doc. Leave open for Active Document
string_from_object = FromObject(LinkedDoc)
string = StringInput("Autodesk.Revit.DB.Document")
eq = string_from_object == string
Refresh = Input(Refresh: bool=false)
categories = Categories("Levels")
action_ReFresh = Custom[Action_ReFresh](Refresh=Refresh, list=categories)  # add to the front of a workflow to allow it to be refreshed with a boolean node
get_LinkedElements_ByCategory = Custom[Get_LinkedElements_ByCategory](Category_In=action_ReFresh, Linked_Doc=LinkedDoc)  # Gets all elements of chosen category from A linked RVT Model
all_elements_of_category = ElementsOfCategory(action_ReFresh)
action_this_or_that = Custom[Action_This Or That](Bool_Switch=eq, Item1=get_LinkedElements_ByCategory, Item2=all_elements_of_category)  # toggles between two choices
code_block = CodeBlock(t2=action_this_or_that) { t3 = t2.GetParameterValueByName("Elevation"); }
sortByKey = List.SortByKey(list=action_this_or_that, keys=code_block)
flatten = Flatten(sortByKey.sorted_list)
id = Element.Id(flatten)
name = Element.Name(flatten)
flatten_2 = Flatten(sortByKey.sorted_keys)
create = List.Create(flatten, id, name, flatten_2)
code_block_2 = CodeBlock(x=create) { x[0]; x[1]; x[2]; x[3]; }
n00_NameList = Output(code_block_2.out2)  # "00_NameList"
n01_Elevation = Output(code_block_2.out3)  # "01_Elevation"
n02_Element_Id = Output(code_block_2.out1)  # "02_Element Id"
n03_Elements = Output(code_block_2.out0)  # "03_Elements"
Index_Or_SearchString = Input(Index_Or_SearchString: var = "")
type = Object.Type(Index_Or_SearchString)
code_block_3 = CodeBlock { "System.String"; }
eq_2 = type == code_block_3
list_FilterByStringMatch = Custom[List_FilterByStringMatch](list=code_block_2.out2, SearchString=Index_Or_SearchString)  # Filters a list of elements by whether or not they contain a search string. I added an option to run it by string match as well._!fi!Li
code_block_4 = CodeBlock { true; }
allIndicesOf = List.AllIndicesOf(list=list_FilterByStringMatch.Bool, item=code_block_4)
if_ = If(test=eq_2, true=allIndicesOf, false=Index_Or_SearchString)
getItemAtIndex = List.GetItemAtIndex(list=code_block_2.out0, index=if_)
ChosenElements = Output(getItemAtIndex)  # "➜ChosenElements"
getItemAtIndex_2 = List.GetItemAtIndex(list=code_block_2.out2, index=if_)
ChosenNames = Output(getItemAtIndex_2)  # "➜ChosenNames"
