# Dynamo custom node Get_Library_Unicode+.dyf (Dynamo 1.3.2.2480)
# category: ArupBimSF.Libraries
# Reads selected index from library and returns character to clipboard and output.#Unicode

# note: OUTPUT:  Final data for use / further manipulation.
# note: OUTPUT:  Requires interaction / verification/review.
# note: INPUT:  Requires interaction / verification.

# group: DESCRIPTION
# note: WORKING REVIT VERSION(S)
# 2017
# note: DYNAMO VERSION
# 1.3
# note: DESCRIPTION
# Reads selected index from library and returns character to clipboard and output.
# note: N/A
# note: AUTHOR(S)
# Emmett Cruey (Arup S-F)
# note: ASSOCIATED REVIT FILE(S)
# N/A
# note: DYNAMO FILE NAME
# Get_Library_Unicode+.dyf

# group: I removed the send to clipboard automatic...I think it was causing Dynamo to crash. I will just use one outside of the node
# note: OUTPUT:  Suggests interaction / verification / review.

LRE = Custom[Unicode.LRE]()  # frozen; Start of left-to-right embedding Unicode Character
LRM = Custom[Unicode.LRM]()  # frozen; Left-to-right mark unicode character
RLE = Custom[Unicode.RLE]()  # frozen; Start of right-to-left embedding Unicode Character
RLM = Custom[Unicode.RLM]()  # frozen; Right-to-left mark Unicode character
ZWJ = Custom[Unicode.ZWJ]()  # frozen; Zero width joiner Unicode Character
ZWNJ = Custom[Unicode.ZWNJ]()  # frozen; Zero width non-joiner Unicode Character
string = StringInput("""|
➜
●
✓
⚫
➤
✔
⬛
⬜
◉
○
🔼
🔽
✚
⌀
𐩑
∠
॥
⏊
◼
⟘
⟙
⟝
⟞
⟟
⟵
⟶
⟷
⟸
⟹
⟺
⟻
⟼
⦾
⦿
⧉
⬀
⬁
⬂
⬃
⭙
⭦
⭧
⭨
⭩
⮀
⮁
⮂
⮃
⮄
⮅
⮆
⮇
⮘
⮙
⮚
⮛
⮜
⮝
⮞
⮟
⮿
©
®
◐
◑
◒
◓
◔
◕
◖
◗
⚐
⚑
⚠
⚡
☚
☛
✖
✀
✅
∥
❌
❎
⛝
✘
✚
✪
✱
✸
✹
⛤
⛧
♺
♻
♼
🏴
⚿
➊
➋
➌
➍
➎
➏
➐
➑
➒
➓
📌
🔌
🔐
🔑
🔒
🔓
🔧
🔨
☝
👊
👍
👎
👽
💀
💊
💣
💰
🔪
🔫
🕱
🕶
🕷
🚫
🚹
🚺
🚻
🚾
🛠
☀
☁
☂
★
☆
☒
☕
🌡
🍸
🍹
🍺
🍻
""")
string_2 = StringInput("\n")
split = String.Split(string, string_2)
trimWhitespace = String.TrimWhitespace(split, lacing=Longest)
StdCharacterList = Output(trimWhitespace)
python_script = Python()  # frozen
# ---------- python_script.python (9 lines) ----------
#This script generates the Right-to-left mark unicode character
import clr
clr.AddReference('ProtoGeometry')
from Autodesk.DesignScript.Geometry import *
#The inputs to this node will be stored as a list in the IN variable.
dataEnteringNode = IN

#Assign your output to the OUT variable
OUT = u"\u200F"
# ----------------------------------------
python_script_2 = Python()  # frozen
# ---------- python_script_2.python (9 lines) ----------
#This script generates the Start of right-to-left embedding unicode character
import clr
clr.AddReference('ProtoGeometry')
from Autodesk.DesignScript.Geometry import *
#The inputs to this node will be stored as a list in the IN variable.
dataEnteringNode = IN

#Assign your output to the OUT variable
OUT = u"\u202A"
# ----------------------------------------
python_script_3 = Python()  # frozen
# ---------- python_script_3.python (9 lines) ----------
#This script generates the Left-to-right mark unicode character
import clr
clr.AddReference('ProtoGeometry')
from Autodesk.DesignScript.Geometry import *
#The inputs to this node will be stored as a list in the IN variable.
dataEnteringNode = IN

#Assign your output to the OUT variable
OUT = u"\u200E"
# ----------------------------------------
python_script_4 = Python()  # frozen
# ---------- python_script_4.python (9 lines) ----------
#This script generates the Start of left-to-right embedding unicode character
import clr
clr.AddReference('ProtoGeometry')
from Autodesk.DesignScript.Geometry import *
#The inputs to this node will be stored as a list in the IN variable.
dataEnteringNode = IN

#Assign your output to the OUT variable
OUT = u"\u202B"
# ----------------------------------------
python_script_5 = Python()  # frozen
# ---------- python_script_5.python (9 lines) ----------
#This script generates the Zero width joiner mark unicode character
import clr
clr.AddReference('ProtoGeometry')
from Autodesk.DesignScript.Geometry import *
#The inputs to this node will be stored as a list in the IN variable.
dataEnteringNode = IN

#Assign your output to the OUT variable
OUT = u"\u200D"
# ----------------------------------------
python_script_6 = Python()  # frozen
# ---------- python_script_6.python (9 lines) ----------
#This script generates the Zero width non joiner mark unicode character
import clr
clr.AddReference('ProtoGeometry')
from Autodesk.DesignScript.Geometry import *
#The inputs to this node will be stored as a list in the IN variable.
dataEnteringNode = IN

#Assign your output to the OUT variable
OUT = u"\u200C"
# ----------------------------------------
string_3 = StringInput("""‫
‎
‪
‏
‍
‌""")
string_4 = StringInput("\n")
split_2 = String.Split(string_3, string_4)
trimWhitespace_2 = String.TrimWhitespace(split_2, lacing=Longest)
ReFresh = Input(ReFresh: bool = false)

# group: INPUTS
Get_Index = Input(Get_Index : int = 0)
Standard_Or_Special = Input(Standard_Or_Special : bool = true)

# note: THROUGHPUT:  No direct user interaction needed.
action_ReFresh = Custom[Action_ReFresh](Refresh=ReFresh, list=Get_Index)  # add to the front of a workflow to allow it to be refreshed with a boolean node
getItemAtIndex = List.GetItemAtIndex(list=trimWhitespace_2, index=action_ReFresh)
string_5 = StringInput("""LRE
LRM
RLE
RLM
ZWJ
ZWNJ""")
split_3 = String.Split(string_5, string_4)
trimWhitespace_3 = String.TrimWhitespace(split_3, lacing=Longest)

# group: OUTPUT
SpecialCharacterList = Output(trimWhitespace_3)

getItemAtIndex_2 = List.GetItemAtIndex(list=trimWhitespace, index=action_ReFresh)
string_6 = StringInput("""LRE
LRM
RLE
RLM
ZWJ
ZWNJ""")
multilinestring_list = Custom[MultilineString➜List](String_In=string_6)  # converts a string with line breaks in to a list of strings
getItemAtIndex_3 = List.GetItemAtIndex(list=multilinestring_list, index=action_ReFresh)
if_ = If(test=Standard_Or_Special, true=getItemAtIndex_2, false=getItemAtIndex_3)
Character_ClipBoard = Output(if_)  # "Character➜ClipBoard"
code_block = CodeBlock {  }
sendtoclipboard = Custom[➜SendToClipBoard](str=if_)  # copies the input item to clipboard
