# Dynamo custom node Get_LineStyle.Info_FromLines.dyf (Dynamo 1.3.2.2480)
# category: ArupBimSF.Revit.Lines,Text & Styles
# Gives LineStyle name and element of Lines

Lines_In = Input(Lines_In : var[])
python_script = Python(IN[0]=Lines_In)
# ---------- python_script.python (27 lines) ----------
import clr
clr.AddReference('RevitServices')
import RevitServices
from RevitServices.Persistence import DocumentManager
clr.AddReference('RevitAPI')
from Autodesk.Revit.DB import *
clr.AddReference('RevitNodes')
import Revit
clr.ImportExtensions(Revit.Elements)


doc = DocumentManager.Instance.CurrentDBDocument

if isinstance(IN[0],list):
	lines = UnwrapElement(IN[0])
else:
	lines = [UnwrapElement(IN[0])]
	
linestyles = []
linestyleids = []

for l in lines:
	linestyles.append(l.LineStyle.Name)
	linestyleids.append(l.LineStyle)


OUT = [linestyles,linestyleids]
# ----------------------------------------
code_block = CodeBlock(out=python_script) { out[0]; out[1]; }
Style_Name = Output(code_block.out0)
GraphicStyle = Output(code_block.out1)
id = Element.Id(code_block.out1)
Type_Id = Output(id)
