# Dynamo custom node Get_LineStyle_At Index+.dyf (Dynamo 1.3.2.2480)
# category: ArupBimSF.Revit.Lines,Text & Styles
# get linstyle attributes for all styles in project

python_script = Python()
# ---------- python_script.python (34 lines) ----------
import clr

# Import DocumentManager and TransactionManager
clr.AddReference("RevitServices")
import RevitServices
from RevitServices.Persistence import DocumentManager

# Import RevitAPI
clr.AddReference("RevitAPI")
import Autodesk
from Autodesk.Revit.DB import *

doc = DocumentManager.Instance.CurrentDBDocument

lineStyle = doc.Settings.Categories.get_Item( BuiltInCategory.OST_Lines )
lineStyleSubTypes = lineStyle.SubCategories

listNames = []
listRGB = []
lineWeight = []
graphicStyles = []
for i in lineStyleSubTypes:
	rgb = [i.LineColor.Red, i.LineColor.Green, i.LineColor.Blue]
	weight = i.GetLineWeight(GraphicsStyleType.Projection)
	
	listNames.append(i.Name)
	listRGB.append(rgb)
	lineWeight.append(weight)
	graphicStyles.Add( i.GetGraphicsStyle(GraphicsStyleType.Projection) )


syncSort = sorted( zip(listNames, lineWeight, listRGB, graphicStyles), key=lambda name: name[0] )

OUT = syncSort
# ----------------------------------------
transpose = List.Transpose(python_script)
code_block = CodeBlock(lineStyles=transpose)
# ---------- code_block.designscript (4 lines) ----------
lineStyleNames = lineStyles[0];
lineStyleWeights = lineStyles[1];
lineStyleColour = lineStyles[2];
revitLineStyles = lineStyles[3];
# ----------------------------------------
ListAll_Names = Output(code_block.lineStyleNames)
id = Element.Id(code_block.revitLineStyles)
create = List.Create(code_block.lineStyleNames, code_block.lineStyleWeights, code_block.lineStyleColour, code_block.revitLineStyles, id)
ChooseIndex = Input(ChooseIndex : int = 0)
getItemAtIndex = List.GetItemAtIndex(index=ChooseIndex)  # unwired: list
map = List.Map(list=create, f_x=getItemAtIndex)
code_block_2 = CodeBlock(x=map) { x[0]; x[1]; x[2]; x[3]; x[4]; }
LineStyle_Name = Output(code_block_2.out0)
LineStyle_Weight = Output(code_block_2.out1)
code_block_3 = CodeBlock { ","; }
string_from_object = FromObject(code_block_2.out2)
join = String.Join(code_block_3, string_from_object)
LineStyle_Color = Output(join)
GraphicStyle = Output(code_block_2.out3)
GraphicStyle_Id = Output(code_block_2.out4)
ReFresh = Input(ReFresh:bool=true)  # To refresh, input a bool and switch its current state
