# Dynamo custom node Get_LineStyles_byNameSearch.dyf (Dynamo 1.3.2.2480)
# category: ArupBimSF.Revit.Lines,Text & Styles
# gets revit linestyles by name contains

empty = List.Empty()
python_script = Python(IN[0]=empty)
# ---------- python_script.python (40 lines) ----------
import clr
clr.AddReference('ProtoGeometry')
from Autodesk.DesignScript.Geometry import *
# Import ToDSType(bool) extension method
clr.AddReference("RevitNodes")
import Revit
clr.ImportExtensions(Revit.Elements)
# Import geometry conversion extension methods
clr.ImportExtensions(Revit.GeometryConversion)
# Import DocumentManager and TransactionManager
clr.AddReference("RevitServices")
import RevitServices
from RevitServices.Persistence import DocumentManager
from RevitServices.Transactions import TransactionManager
from System.Collections.Generic import *
# Import RevitAPI
clr.AddReference("RevitAPI")
import Autodesk
from Autodesk.Revit.DB import *

doc = DocumentManager.Instance.CurrentDBDocument
uiapp = DocumentManager.Instance.CurrentUIApplication
app = uiapp.Application
uidoc=DocumentManager.Instance.CurrentUIApplication.ActiveUIDocument
TransactionManager.Instance.EnsureInTransaction(doc)

elt = []
list=[]
a=UnwrapElement(IN[0])
a=doc.Settings.Categories.get_Item(BuiltInCategory.OST_Lines)
b=a.SubCategories

for i in b:
	c=i.Name.ToString()
	list.append(c)
	
# End Transaction
TransactionManager.Instance.TransactionTaskDone()

OUT = b,list
# ----------------------------------------
code_block = CodeBlock(list=python_script) { list[0]; list[1]; }
All_LineStyles = Output(code_block.out0)
sort = List.Sort(code_block.out1)
All_LS_Names = Output(sort)
Search_String = Input()
IgnoreCase = Input(IgnoreCase : bool = true)
contains = String.Contains(str=code_block.out1, searchFor=Search_String, ignoreCase=IgnoreCase)
filterByBoolMask = List.FilterByBoolMask(list=code_block.out0, mask=contains)
Match_Internal = Output(filterByBoolMask.in)
filterByBoolMask_2 = List.FilterByBoolMask(list=code_block.out1, mask=contains)
Matching_Name = Output(filterByBoolMask_2.in)
