# Dynamo custom node Get_LinkedElements_ByCategory.dyf (Dynamo 1.3.2.2480)
# category: ArupBimSF.Revit.Links & Imports
# Gets all elements of chosen category from A linked RVT Model

Linked_Doc = Input()
Category_In = Input(Category_In: var)  # This input accepts category either as a string input or category element
string_from_object = FromObject(Category_In)
byName = Category.ByName(string_from_object)
python_script = Python(IN[0]=Linked_Doc, IN[1]=byName)
# ---------- python_script.python (35 lines) ----------
import clr
clr.AddReference('ProtoGeometry')
from Autodesk.DesignScript.Geometry import *

# Import RevitAPI
clr.AddReference("RevitAPI")
import Autodesk
from Autodesk.Revit.DB import *

import System

import sys
pyt_path = r'C:\Program Files (x86)\IronPython 2.7\Lib'
sys.path.append(pyt_path)

#The inputs to this node will be stored as a list in the IN variable.
dataEnteringNode = IN

_linkDoc = IN[0]
_category = IN[1]

try:
	errorReport = None
	filter = ElementCategoryFilter(System.Enum.ToObject(BuiltInCategory, _category.Id))
	result = FilteredElementCollector(_linkDoc).WherePasses(filter).WhereElementIsNotElementType().ToElements()
except:
	# if error accurs anywhere in the process catch it
	import traceback
	errorReport = traceback.format_exc()

#Assign your output to the OUT variable
if errorReport == None:
	OUT = result
else:
	OUT = errorReport
# ----------------------------------------
Elements = Output(python_script)
