# Dynamo custom node Get_LocalCoordinateSystem.dyf (Dynamo 1.3.2.2480)
# category: ArupBimSF.^FixMe
# Get the insertion point and local axes of an element.

element = Input(element : Element[])

# group: Get insertion point
getLocation = Element.GetLocation(element)
# note: In case of a slanted column, the location returns a line. In that case we need the startpoint of this line.
type = Object.Type(getLocation)
code_block = CodeBlock { "Autodesk.DesignScript.Geometry.Line"; }
eq = type == code_block
filterByBoolMask = List.FilterByBoolMask(list=getLocation, mask=eq)
boolean = BoolSelector(true)
startPoint = Curve.StartPoint(filterByBoolMask.in)
replace_items_at_condition = Python(IN[0]=eq, IN[1]=boolean, IN[2]=startPoint, IN[3]=getLocation)
# ---------- replace_items_at_condition.python (23 lines) ----------
import clr
clr.AddReference('ProtoGeometry')
from Autodesk.DesignScript.Geometry import *
#The inputs to this node will be stored as a list in the IN variables.
Test=IN[0]
Condition=IN[1]
ValCondition=IN[2]
OriginalValue=IN[3]
Results=[]
i=0
j=0

for t in Test:
	if t == Condition:
		Results.append(ValCondition[i])
		i=i+1
	else:
		Results.append(OriginalValue[j])
	j=j+1


#Assign your output to the OUT variable.
OUT = Results
# ----------------------------------------

# group: Get location line vector
boolean_2 = BoolSelector(true)
direction = Line.Direction(filterByBoolMask.in)
ZAxis = Vector.ZAxis()
count = List.Count(getLocation)
cycle = List.Cycle(list=ZAxis, amount=count)
replace_items_at_condition_2 = Python(IN[0]=eq, IN[1]=boolean_2, IN[2]=direction, IN[3]=cycle)  # same code as replace_items_at_condition
reverse = Vector.Reverse(replace_items_at_condition_2)

# group: Define vectors
handOrientation = Custom[Element.HandOrientation](element=element, lacing=Longest)  # Gets the orientation of the family instance hand
invalid = Watch(handOrientation.InvalidElements)
# note: X-vector
flatten = Flatten(handOrientation.Orientation)
# note: Y-vector
cross = Vector.Cross(vector=flatten, cross=reverse)
# note: Z-vector
cross_2 = Vector.Cross(vector=flatten, cross=cross)

Xvector = Output(flatten)
Yvector = Output(cross)
Zvector = Output(cross_2)
InsertionPoint = Output(replace_items_at_condition)
Invalid_Elements = Output(handOrientation.InvalidElements)
