# Dynamo custom node Get_MechanicalElements_ByCategory.dyf (Dynamo 1.3.2.2480)
# category: ArupBimSF.Revit.Mep_Mechanical
# Get all mechanical elements in active document

categories = Categories("DuctTerminal")
categories_2 = Categories("DuctAccessory")
element_types = ElementTypes("Duct")
categories_3 = Categories("DuctFitting")
element_types_2 = ElementTypes("FlexDuct")
element_types_3 = ElementTypes("FlexPipe")
categories_4 = Categories("MechanicalEquipment")
categories_5 = Categories("PipeAccessory")
all_elements_of_category = ElementsOfCategory(categories_5)
element_types_4 = ElementTypes("Pipe")
all_elements_of_type = ElementsOfType(element_types_4)
categories_6 = Categories("PipeFitting")
all_elements_of_category_2 = ElementsOfCategory(categories_6)
create = List.Create(categories, categories_2, element_types, categories_3, element_types_2, element_types_3, categories_4, all_elements_of_category, all_elements_of_type, all_elements_of_category_2)
all_elements_of_category_3 = ElementsOfCategory(categories)
all_elements_of_category_4 = ElementsOfCategory(categories_2)
all_elements_of_type_2 = ElementsOfType(element_types)
all_elements_of_category_5 = ElementsOfCategory(categories_3)
all_elements_of_type_3 = ElementsOfType(element_types_2)
all_elements_of_type_4 = ElementsOfType(element_types_3)
all_elements_of_category_6 = ElementsOfCategory(categories_4)
create_2 = List.Create(all_elements_of_category_3, all_elements_of_category_4, all_elements_of_type_2, all_elements_of_category_5, all_elements_of_type_3, all_elements_of_type_4, all_elements_of_category_6, all_elements_of_category, all_elements_of_type, all_elements_of_category_2)
list_CleanOutput = Custom[List_CleanOutput](List_In=create_2)  # Removes and Replaces Nulls and Empty Lists from input lists. *only works with flat or 2 dimentional lists_Need to fix it to go deeper or use list.map
removeItemAtIndex = List.RemoveItemAtIndex(list=create, indices=list_CleanOutput.Indices)
Mech_Categories = Output(removeItemAtIndex)
Elements = Output(list_CleanOutput.Cleaned)
