# Dynamo custom node Get_MepElementType_At Index+.DYF (Dynamo 1.3.2.2480)
# category: ArupBimSF.Revit.Mep
# Allows you to select an MEP ElementType by index from list of type names in document

element_types = ElementTypes("PipeType")
all_elements_of_type = ElementsOfType(element_types)
name = Element.Name(all_elements_of_type)
PipeType_Names = Output(name)
element_types_2 = ElementTypes("DuctType")
all_elements_of_type_2 = ElementsOfType(element_types_2)
name_2 = Element.Name(all_elements_of_type_2)
DuctType_Names = Output(name_2)
element_types_3 = ElementTypes("ConduitType")
all_elements_of_type_3 = ElementsOfType(element_types_3)
name_3 = Element.Name(all_elements_of_type_3)
ConduitType_Names = Output(name_3)
PipeType_AtIndex = Input(PipeType_AtIndex : int = 0)
code_block = CodeBlock(x=all_elements_of_type, p=PipeType_AtIndex) { x[p]; }
PipeType = Output(code_block)
DuctType_AtIndex = Input(DuctType_AtIndex : int = 0)
code_block_2 = CodeBlock(x=all_elements_of_type_2, p=DuctType_AtIndex) { x[p]; }
DuctType = Output(code_block_2)
ConduitType_AtIndex = Input(ConduitType_AtIndex : int = 0)
code_block_3 = CodeBlock(x=all_elements_of_type_3, p=ConduitType_AtIndex) { x[p]; }
ConduitType = Output(code_block_3)
