# Dynamo custom node Get_MepSystem_AtIndex+.dyf (Dynamo 1.3.2.2480)
# category: ArupBimSF.Revit.Mep
# Allows you to select an MEP System by index from list of all the systems in document

element_types = ElementTypes("PipingSystemType")
all_elements_of_type = ElementsOfType(element_types)
name = Custom[Get_Element.Name+](elements=all_elements_of_type)  # Get the element name from all types of elements including system families
PipingSystem_Names = Output(name)
element_types_2 = ElementTypes("MechanicalSystemType")
all_elements_of_type_2 = ElementsOfType(element_types_2)
name_2 = Custom[Get_Element.Name+](elements=all_elements_of_type_2)
MechSystem_Names = Output(name_2)
PipingSytemType_AtIndex = Input(PipingSytemType_AtIndex : int = 0)
code_block = CodeBlock(x=all_elements_of_type, p=PipingSytemType_AtIndex) { x[p]; }
PipeSystem = Output(code_block)
MechSystemType_AtIndex = Input(MechSystemType_AtIndex : int = 0)
code_block_2 = CodeBlock(x=all_elements_of_type_2, p=MechSystemType_AtIndex) { x[p]; }
MechSystem = Output(code_block_2)
