# Dynamo custom node Get_ModelElements_ByCategory+.dyf (Dynamo 1.3.2.2480)
# category: Revit.Elements
# Collects all modeled/Placed elements in the active document. I have removed the Detail Items and Lines as they are included in the Annotation elements Node instead#Index+

string = StringInput(" | ")
join = String.Join(string)  # unwired: arg1, arg2
string_2 = StringInput("""OST_DuctTerminal
OST_Areas
OST_CableTrayFitting
OST_CableTray
OST_Casework
OST_Ceilings
OST_Columns
OST_CommunicationDevices
OST_ConduitFitting
OST_Conduit
OST_CurtainWallPanels
OST_CurtaSystem
OST_CurtainWallMullions
OST_DataDevices
OST_Doors
OST_DuctAccessory
OST_DuctFitting
OST_DuctInsulations
OST_DuctLinings
OST_PlaceHolderDucts
OST_DuctSystem
OST_DuctCurves
OST_ElectricalEquipment
OST_ElectricalFixtures
OST_Entourage
OST_FireAlarmDevices
OST_FlexDuctCurves
OST_FlexPipeCurves
OST_Floors
OST_Furniture
OST_FurnitureSystems
OST_GenericModel
OST_Grids
OST_Gutter
OST_HVAC_Zones
OST_Levels
OST_LightingDevices
OST_LightingFixtures
OST_Mass
OST_MechanicalEquipment
OST_FabricationContainment
OST_FabricationDuctwork
OST_FabricationHangers
OST_FabricationPipework
OST_NurseCallDevices
OST_BuildingPad
OST_Parking
OST_Parts
OST_PipeAccessory
OST_PipeFitting
OST_PlaceHolderPipes
OST_PipeCurves
OST_Planting
OST_PlumbingFixtures
OST_StairsRailing
OST_RailingSupport
OST_RailingTermination
OST_RailingTopRail
OST_StairsRailingBaluster
OST_RailingHandRail
OST_Ramps
OST_Roads
OST_Roofs
OST_RoofSoffit
OST_Fascia
OST_SecurityDevices
OST_ShaftOpening
OST_Site
OST_SpecialityEquipment
OST_Sprinklers
OST_Stairs
OST_StairsRuns
OST_StairsSupports
OST_StairsLandings
OST_AreaRein
OST_StructuralFramingSystem
OST_StructuralColumns
OST_StructConnections
OST_FabricAreas
OST_FabricReinforcement
OST_StructuralFoundation
OST_StructuralFraming
OST_PathRein
OST_Rebar
OST_Coupler
OST_StructuralStiffener
OST_StructuralTruss
OST_TelephoneDevices
OST_Topography
OST_Walls
OST_Windows
OST_Wire
Spaces
Rooms""")
Refresh = Input(Refresh: bool = false)
code_block = CodeBlock(string_2, Refresh)
# ---------- code_block.designscript (11 lines) ----------
list;
come;

[Imperative]

{
 if (come ==true)
  return = list;
 else
  return = list;
};
# ----------------------------------------
code_block_2 = CodeBlock { "\n"; }
split = String.Split(code_block.out2, code_block_2)
byName = Category.ByName(split)
list_CleanOutput = Custom[List_CleanOutput](List_In=byName)  # Removes and Replaces Nulls and Empty Lists from input lists. *only works with flat or 2 dimentional lists_Need to fix it to go deeper or use list.map
all_elements_of_category = ElementsOfCategory(list_CleanOutput.Cleaned)
isEmpty = List.IsEmpty(all_elements_of_category, lacing=Longest)
filterByBoolMask = List.FilterByBoolMask(list=list_CleanOutput.Cleaned, mask=isEmpty)
string_from_object = FromObject(filterByBoolMask.out)
length = String.Length(string_from_object)
maximumItem = List.MaximumItem(length)
code_block_3 = CodeBlock(x=maximumItem) { x; }
padRight = String.PadRight(string_from_object, code_block_3)
boolean = BoolSelector(false)
clean = List.Clean(list=all_elements_of_category, preserveIndices=boolean)
count = List.Count(clean, lacing=Longest)
string_from_object_2 = FromObject(count)
code_block_4 = CodeBlock { 4; }
code_block_5 = CodeBlock { "0"; }
padLeft = String.PadLeft(string_from_object_2, code_block_4, code_block_5)
combine = List.Combine(join, padRight, padLeft)
Category_ItemCount = Output(combine)
Get_Index = Input(Get_Index: int = 0)
getItemAtIndex = List.GetItemAtIndex(list=filterByBoolMask.out, index=Get_Index)
Chosen_Category = Output(getItemAtIndex)
getItemAtIndex_2 = List.GetItemAtIndex(list=clean, index=Get_Index)
Chosen_Index = Output(getItemAtIndex_2)
All_Categories = Output(filterByBoolMask.out)
list_CleanOutput_2 = Custom[List_CleanOutput+](List_In=byName)  # frozen; Removes and or places nulls and empties up to 2 dimentional
All_Elements = Output(clean)
