# Dynamo custom node Get_NumbersFromString.dyf (Dynamo 1.3.2.2480)
# category: ArupBimSF.String Functions

str = Input(str : string)
python_script = Python(IN[0]=str)
# ---------- python_script.python (69 lines) ----------
# Extract a list of numbers from a string
# Colin McCrone 
# July 2017

import clr


# True if character is a number, false otherwise
def IsNum(char):
    try:
        int(char)
        return True
    except ValueError:
        return False


# Join a single list of characters into a string
def JoinChars(chars):
	if not chars:
		return None
	elif len(chars) == 1:
		return chars[0]
	else:
		return "".join(chars)


# Return a list of contiguous numbers from a string
def StringToNumbers(str):
	# Extract lists of contiguous number characters
	nums = []
	lastWasNum = False
	ls = []
	for i in range(len(str)):
		if IsNum(str[i]):
			ls.append(str[i])
			lastWasNum = True
		elif str[i] == "." and lastWasNum:
			ls.append(str[i])
		elif lastWasNum:
			nums.append(ls)
			ls = []
			lastWasNum = False
		
		if i == len(str)-1 and ls:
			nums.append(ls)

	# Cast character strings to numbers
	if not nums:
		return [None,None]
	elif len(nums) == 1:
		asStr = JoinChars(nums[0])
		return [asStr,float(asStr)]
	else:
		asStr = []
		asNum = []
		for i in range(len(nums)):
			oneStr = JoinChars(nums[i])
			asStr.append(oneStr)
			asNum.append(float(oneStr))
		return [asStr,asNum]


str = IN[0]
OUT = StringToNumbers(str)




	
# ----------------------------------------
code_block = CodeBlock(OUT=python_script) { OUT[0]; OUT[1]; }
string = Output(code_block.out0)
number = Output(code_block.out1)
