# Dynamo custom node Get_ObjectExtents.dyf (Dynamo 1.3.2.2480)
# category: ArupBimSF.Geometry
# Gets the geometrical extents from input elements

geometry = Input(geometry:var)
code_block = CodeBlock(geometry)
# ---------- code_block.designscript (11 lines) ----------
def size1(g){
bb = BoundingBox.ByGeometry(g);
min = bb.MinPoint;
max = bb.MaxPoint;
w = Math.Abs(min.X - max.X);
l = Math.Abs(min.Y - max.Y);
h = Math.Abs(min.Z - max.Z);
return = {w, l, h};
};

size1(obj);
# ----------------------------------------
code_block_2 = CodeBlock(r=code_block) { r[0]; r[1]; r[2]; }
width = Output(code_block_2.out0)
length = Output(code_block_2.out1)
height = Output(code_block_2.out2)
