# Dynamo custom node Get_ParameterValue&Name+.dyf (Dynamo 1.3.2.2480)
# category: ArupBimSF.Revit.Parameters
# Gets the name and value+ of input parameters._!!Pa

Parameter = Input()
code_block = CodeBlock { " : "; }
Refresh = Input(Refresh:bool = true)
string_SplitByCharachters = Custom[String_SplitByCharachters+](String_List=Parameter, TrimBy=code_block, reset=Refresh)  # This node allows you to get the portion of a string after, before a defined charachter (or sequence of) within the string. Additionally you can get combined output of the string removing only the Charachter(s) chosen_!!String.SplitByCharachter
ParameterName = Output(string_SplitByCharachters.Portion_Prior)
value = Parameter.Value(Parameter)
ParameterValue = Output(value)
StringValue = Output(string_SplitByCharachters.Portion_Post)
