# Dynamo custom node Get_ParameterValueByForce_AtIndex+.dyf (Dynamo 1.3.2.2480)
# category: ArupBimSF.Revit.Parameters
# Gets parameters from elements using element.parameters and converting them to Strings and extracting the values. Allowing you to pull values from built-in categories and created params_!!Pa!++!El

elements = Input()
ReFresh = Input(ReFresh : bool = false)
code_block = CodeBlock(elements, ReFresh)
# ---------- code_block.designscript (11 lines) ----------
list;
come;

[Imperative]

{
 if (come ==true)
  return = list;
 else
  return = list;
};
# ----------------------------------------
parameters = Element.Parameters(code_block.out2, lacing=Longest)
name = Parameter.Name(parameters)
flatten = Flatten(name)
list_unique_items = Custom[List_Unique Items+](List_In=flatten)  # Count the number of times each individual unique element occurs in a list
sort = List.Sort(list_unique_items.Unique_Items)
Index = Input(Index: int=0)
getItemAtIndex = List.GetItemAtIndex(list=sort, index=Index)
indexOf = IndexOf(arg1=getItemAtIndex, lacing=Longest)  # unwired: arg0
map = List.Map(list=name, f_x=indexOf)
getItemAtIndex_2 = List.GetItemAtIndex(list=parameters, index=map, lacing=Longest)
get_parametervalue_name = Custom[Get_ParameterValue&Name+](Parameter=getItemAtIndex_2)  # Gets the name and value+ of input parameters._!!Pa
uniqueItems = List.UniqueItems(get_parametervalue_name.ParameterName)
ChosenParameter = Output(uniqueItems)
ParameterList = Output(sort)
Value = Output(get_parametervalue_name.ParameterValue)
ForcedStringValue = Output(get_parametervalue_name.StringValue)
