# Dynamo custom node Get_ParameterValueByName.dyf (Dynamo 1.3.2.2480)
# category: ArupBimSF.Revit.Parameters
# ootb Get parameter value by name copied with easier access by name_!PA!el

Element_In = Input()
Name = Input()
string_from_object = FromObject(Name)
code_block = CodeBlock(t1=Element_In, t2=string_from_object) { t3 = t1.GetParameterValueByName(t2); }
var = Output(code_block)  # "var[]..[]"
