# Dynamo custom node Get_ProjectInformation.dyf (Dynamo 1.3.2.2480)
# category: ArupBimSF.Revit.Document
# Get project information parameters

Refresh = Input(Refresh : bool = true)
python_script = Python(IN[0]=Refresh)
# ---------- python_script.python (23 lines) ----------
import clr
clr.AddReference("RevitServices")
import RevitServices
from RevitServices.Persistence import DocumentManager

doc = DocumentManager.Instance.CurrentDBDocument
elementlist = list()
projinfo = doc.ProjectInformation
elementlist.append(projinfo.OrganizationName)
elementlist.append(projinfo.OrganizationDescription)
elementlist.append(projinfo.BuildingName)
# this property seems to be missing in some files - weird...
try:
	elementlist.append(projinfo.Author)
except:
	elementlist.append(list())
elementlist.append(projinfo.IssueDate)
elementlist.append(projinfo.Status)
elementlist.append(projinfo.ClientName)
elementlist.append(projinfo.Address)
elementlist.append(projinfo.Name)
elementlist.append(projinfo.Number)
OUT = elementlist
# ----------------------------------------
code_block = CodeBlock(seq=python_script) { seq[0]; seq[1]; seq[2]; seq[3]; seq[4]; seq[5]; seq[6]; seq[7]; seq[8]; seq[9]; }
OrganizationName = Output(code_block.out0)
Org_Description = Output(code_block.out1)
BuildingName = Output(code_block.out2)
Author = Output(code_block.out3)
IssueDate = Output(code_block.out4)
ProjectStatus = Output(code_block.out5)
ClientName = Output(code_block.out6)
Address = Output(code_block.out7)
ProjectName = Output(code_block.out8)
ProjectNumber = Output(code_block.out9)
