# Dynamo custom node Get_ProjectNumber.dyf (Dynamo 1.3.2.2480)
# category: ArupBimSF.Revit.Document
# gets the project number for the active Project

project_number = Python()  # unwired: IN[0]
# ---------- project_number.python (11 lines) ----------
import clr
clr.AddReference("RevitServices")
import RevitServices
from RevitServices.Persistence import DocumentManager

doc = DocumentManager.Instance.CurrentDBDocument
elementlist = list()
projinfo = doc.ProjectInformation
elementlist.append(projinfo.Number)
# this property seems to be missing in some files - weird...
OUT = elementlist
# ----------------------------------------
OUT = Output(project_number)
