# Dynamo custom node Get_ProjectParam_byCategory.dyf (Dynamo 1.3.2.2480)
# category: ArupBimSF.Revit.Parameters
# Gets project parameters from active doc by input category

category = Input()
string_from_object = FromObject(category)
byName = Category.ByName(string_from_object)
code_block = CodeBlock(item=byName) { Flatten({item}); }
toggle = Input(toggle : bool = true)
python_get_the_parameters = Python(IN[0]=code_block, IN[1]=toggle)
# ---------- python_get_the_parameters.python (25 lines) ----------
import clr
clr.AddReference('RevitAPI')
from Autodesk.Revit.DB import *
import Autodesk

clr.AddReference("RevitServices")
import RevitServices
from RevitServices.Persistence import DocumentManager

search_cats = UnwrapElement(IN[0])
search_ids = []
cats = []
for search_cat in search_cats:
	search_ids.append(search_cat.Id.IntegerValue)
	cats.append(list())
doc = DocumentManager.Instance.CurrentDBDocument
iterator = doc.ParameterBindings.ForwardIterator()
while iterator.MoveNext():
	for cat in iterator.Current.Categories:
		i = 0
		for search_id in search_ids:
			if cat.Id.IntegerValue == search_id:
				cats[i].append(iterator.Key.Name)
			i += 1
OUT = cats
# ----------------------------------------
return_list_or_single_value = Python(IN[0]=byName, IN[1]=python_get_the_parameters)
# ---------- return_list_or_single_value.python (4 lines) ----------
check = IN[0]
items = IN[1]
if isinstance(check, (list)): OUT = items
else: OUT = items[0]
# ----------------------------------------
paramName = Output(return_list_or_single_value)
