# Dynamo custom node Get_RGB Color_ByIndexOrSearch_2.dyf (Dynamo 1.3.2.2480)
# category: ArupBimSF.Revit.Links & Imports
# Get Link instance, Doc, Name & Path. Use With Get Docs or Get Loaded RVT Links To get a link from a list of links.  Use the all link names output to review the linked file names and chose the one you want by entering the index number of the desired link_#Lnk

color_palette_excel_file = StringInput("C:\Dropbox\02_Standards_Std\00_Color Palette_180118.xlsx")
code_block = CodeBlock { 1; }
readFromFile_Excel = Custom[ReadFromFile_Excel](filePath=color_palette_excel_file, runIt=code_block)  # A modified version of Konrad BB read excel node
transpose = List.Transpose(readFromFile_Excel)
deconstruct = List.Deconstruct(list=transpose@L2)
number = DoubleInput(0)
getItemAtIndex = List.GetItemAtIndex(list=deconstruct.rest, index=number)
ColorNames = Output(getItemAtIndex)
Open_Excel_DB = Input(Open_Excel_DB: bool = false)  # set boolean to true to open excel color pallete DB
action_RunMe = Custom[Action_RunMe](Should_I=Open_Excel_DB, ThingToDo=color_palette_excel_file)  # Uses A boolean to determine whether to run a function or sequence.
openFile_FromPath_OS = Custom[OpenFile_FromPath_OS](FilePath_String=action_RunMe)  # Open a file or folder from a designated path In its native program
number_2 = DoubleInput(2)
getItemAtIndex_2 = List.GetItemAtIndex(list=deconstruct.rest, index=number_2)
number_3 = DoubleInput(3)
getItemAtIndex_3 = List.GetItemAtIndex(list=deconstruct.rest, index=number_3)
number_4 = DoubleInput(4)
getItemAtIndex_4 = List.GetItemAtIndex(list=deconstruct.rest, index=number_4)
number_5 = DoubleInput(5)
getItemAtIndex_5 = List.GetItemAtIndex(list=deconstruct.rest, index=number_5)
create = List.Create(getItemAtIndex, getItemAtIndex_2, getItemAtIndex_3, getItemAtIndex_4, getItemAtIndex_5)
Index_Or_SearchString = Input(Index_Or_SearchString : var = 0)
type = Object.Type(Index_Or_SearchString)
code_block_2 = CodeBlock { "System.String"; }
eq = type == code_block_2
code_block_3 = CodeBlock { 1; }
list_FilterByStringMatch = Custom[List_FilterByStringMatch](list=getItemAtIndex, String=Index_Or_SearchString, Contains_Or_Equals=code_block_3)  # Filters a list of elements by whether or not they contain a search string. I added an option to run it by string match as well._!fi!Li
code_block_4 = CodeBlock { true; }
indexOf = IndexOf(list_FilterByStringMatch.Bool, code_block_4)
if_ = If(test=eq, true=indexOf, false=Index_Or_SearchString)
list_GetIndexFromSublists = Custom[List_GetIndexFromSublists](list=create, desired_index=if_)  # GEt item at index mapped_!!List
code_block_5 = CodeBlock { 0; 2; 3; 4; 5; }
getItemAtIndex_6 = List.GetItemAtIndex(list=list_GetIndexFromSublists, index=code_block_5.out0)
ColorName = Output(getItemAtIndex_6)
getItemAtIndex_7 = List.GetItemAtIndex(list=list_GetIndexFromSublists, index=code_block_5.out1)
RGB_Combined = Output(getItemAtIndex_7)
getItemAtIndex_8 = List.GetItemAtIndex(list=list_GetIndexFromSublists, index=code_block_5.out2)
R = Output(getItemAtIndex_8)
getItemAtIndex_9 = List.GetItemAtIndex(list=list_GetIndexFromSublists, index=code_block_5.out3)
G = Output(getItemAtIndex_9)
getItemAtIndex_10 = List.GetItemAtIndex(list=list_GetIndexFromSublists, index=code_block_5.out4)
B = Output(getItemAtIndex_10)
RGB_ListOut = Output(getItemAtIndex_2)
