# Dynamo custom node Get_Revision_At Index+.dyf (Dynamo 1.3.2.2480)
# category: ArupBimSF.Revit.Document
# Add Revisions to Sheets

ReFresh = Input(ReFresh : bool = true)
code_block = CodeBlock { true; }
code_block_2 = CodeBlock(ReFresh, code_block)
# ---------- code_block_2.designscript (11 lines) ----------
list;
come;

[Imperative]

{
 if (come ==true)
  return = list;
 else
  return = list;
};
# ----------------------------------------
python_script = Python(IN[0]=code_block_2.out2)
# ---------- python_script.python (42 lines) ----------
import clr
# Import Element wrapper extension methods
clr.AddReference("RevitNodes")
import Revit
clr.ImportExtensions(Revit.Elements)

# Import DocumentManager and TransactionManager
clr.AddReference("RevitServices")
import RevitServices
from RevitServices.Persistence import DocumentManager
doc = DocumentManager.Instance.CurrentDBDocument

# Import RevitAPI
clr.AddReference("RevitAPI")
import Autodesk
from Autodesk.Revit.DB import *

import sys
pyt_path = r'C:\Program Files (x86)\IronPython 2.7\Lib'
sys.path.append(pyt_path)

#The inputs to this node will be stored as a list in the IN variable.
dataEnteringNode = IN
RunIt = IN[0]

if RunIt:
	try:
		errorReport = None
		revisions = FilteredElementCollector(doc).OfCategory(BuiltInCategory.OST_Revisions).WhereElementIsNotElementType().ToElements()
	except:
		# if error accurs anywhere in the process catch it
		import traceback
		errorReport = traceback.format_exc()
else:
	errorReport = "RunIt set to False."


#Assign your output to the OUT variable
if errorReport == None:
	OUT = revisions
else:
	OUT = errorReport
# ----------------------------------------
GetRev_AtIndex = Input(GetRev_AtIndex : int = 0)
getItemAtIndex = List.GetItemAtIndex(list=python_script, index=GetRev_AtIndex)
RevisionOut = Output(getItemAtIndex)
All_Revisions = Output(python_script)
python_script_2 = Python(IN[0]=python_script)
# ---------- python_script_2.python (65 lines) ----------
import clr
# Import Element wrapper extension methods
clr.AddReference("RevitNodes")
import Revit
clr.ImportExtensions(Revit.Elements)

# Import DocumentManager and TransactionManager
clr.AddReference("RevitServices")
import RevitServices
from RevitServices.Persistence import DocumentManager
doc = DocumentManager.Instance.CurrentDBDocument

# Import RevitAPI
clr.AddReference("RevitAPI")
import Autodesk
from Autodesk.Revit.DB import *

import sys
pyt_path = r'C:\Program Files (x86)\IronPython 2.7\Lib'
sys.path.append(pyt_path)

#The inputs to this node will be stored as a list in the IN variable.
dataEnteringNode = IN

def ProcessList(_func, _list):
    return map( lambda x: ProcessList(_func, x) if type(x)==list else _func(x), _list )

def UnwrapNestedList(e):
	return UnwrapElement(e)
def GetSequence(e):
	return e.SequenceNumber
def GetDate(e):
	return e.RevisionDate
def GetIssuedTo(e):
	return e.IssuedTo
def GetIssuedBy(e):
	return e.IssuedBy
def GetIssued(e):
	return e.Issued
def GetDescription(e):
	return e.Description

if isinstance(IN[0], list):
	revs = ProcessList(UnwrapNestedList, IN[0])
else:
	revs = [UnwrapElement(IN[0])]

try:
	errorReport = None
	sequence = ProcessList(GetSequence, revs)
	date = ProcessList(GetDate, revs)
	description = ProcessList(GetDescription, revs)
	issued = ProcessList(GetIssued, revs)
	issuedTo = ProcessList(GetIssuedTo, revs)
	issuedBy = ProcessList(GetIssuedBy, revs)
except:
	# if error accurs anywhere in the process catch it
	import traceback
	errorReport = traceback.format_exc()

#Assign your output to the OUT variable
if errorReport == None:
	OUT = [sequence, date, description, issued, issuedTo, issuedBy]
else:
	OUT = errorReport
# ----------------------------------------
code_block_3 = CodeBlock(IN=python_script_2) { sequence = IN[0]; date = IN[1]; description = IN[2]; issued = IN[3]; issuedTo = IN[4]; issuedBy = IN[5]; }
Sequence = Output(code_block_3.sequence)
Date = Output(code_block_3.date)
Description = Output(code_block_3.description)
Issued = Output(code_block_3.issued)
issuedTo = Output(code_block_3.issuedTo)
issuedBy = Output(code_block_3.issuedBy)
transpose = List.Transpose(python_script_2)
flatten = Flatten(transpose@@L2)
DataOut = Output(flatten)
