# Dynamo custom node Get_Scopebox Geometry.dyf (Dynamo 1.3.2.2480)
# category: ArupBimSF.Revit.Location_References
# get the geometry of input scopebox elements

scopeBox = Input(scopeBox:var)
code_block = CodeBlock(scopeBox)
# ---------- code_block.designscript (12 lines) ----------
def scopeGeo(s){
c1 = s.Geometry();
msk = Vector.ZAxis().Dot(c1.Direction) == 0;
c2 = DSCore.List.FilterByBoolMask(c1, msk)["in"];
c3 = DSCore.List.SortByKey(c2, c2.EndPoint.Z)["sorted list"];
pc1 = PolyCurve.ByJoinedCurves(c3[0..3]);
s1 = pc1.ExtrudeAsSolid(c3[4].EndPoint.Z - c3[0].EndPoint.Z);
return = {pc1, s1};
};
r = scopeGeo(x);
r[0];
r[1];
# ----------------------------------------
polyCurve = Output(code_block.out1)
solid = Output(code_block.out2)
