# Dynamo custom node Get_SharedParameterDefinition.dyf (Dynamo 1.3.2.2480)
# category: ArupBimSF.Revit.Parameters
# Gets the names, groups, and definitions for shared parameters from the Shared Parameter txt file linked to the active revit document_!Pa!Shp!Ext!Db_^FixMe allow this one to take in a txt file from path also. Have it run as-is by default

python_script = Python()
# ---------- python_script.python (39 lines) ----------
import clr
clr.AddReference('ProtoGeometry')
from Autodesk.DesignScript.Geometry import *

clr.AddReference("RevitAPI")
import Autodesk
from Autodesk.Revit.DB import *

clr.AddReference("RevitServices")
import RevitServices
from RevitServices.Persistence import DocumentManager
from RevitServices.Transactions import TransactionManager
from System.Collections.Generic import *

clr.AddReference("RevitNodes")
import Revit
clr.ImportExtensions(Revit.Elements)

import System

doc = DocumentManager.Instance.CurrentDBDocument
uiapp = DocumentManager.Instance.CurrentUIApplication
app = uiapp.Application

gitem = []
itemg = []
itemd = []
items = []
file = app.OpenSharedParameterFile()
group = file.Groups
for i in group:
	gitem.append(i.Name)
	itemg.append(i)
for j in itemg:
	itemd.append(j.Definitions)
for i in itemd:
	for j in i:
		items.append(j.Name)
OUT = gitem,itemg,itemd,items
# ----------------------------------------
code_block = CodeBlock(x=python_script) { x[0]; x[1]; }
Group_Def = Output(code_block.out1)  # "Group.Def"
Group_Name = Output(code_block.out0)  # "Group.Name"
code_block_2 = CodeBlock(x=python_script) { x[2]; x[3]; }
Parameter_Def = Output(code_block_2.out0)  # "Parameter.Def"
count = Count(code_block_2.out0, lacing=Longest)
chop = List.Chop(list=code_block_2.out1, lengths=count)
Parameter_Name = Output(chop)  # "Parameter.Name"
