# Dynamo custom node Get_SheetViewsContent&Info+.dyf (Dynamo 1.3.2.2480)
# category: ArupBimSF.Revit.Views_Sheets
# collects views on sheets and elements in the views, as well as an element list of objects on the sheets itself (title block, viewports, annotations)_!!GetSheetContents

Sheets_In = Input(Sheets_In: var = "")  # To run all sheets set runme to true or input list of sheets here and it will AutoRun
code_block = CodeBlock { ""; }
eq = Sheets_In == code_block
RunMe = Input(RunMe : bool = false)
categories = Categories("Sheets")
all_elements_of_category = ElementsOfCategory(categories)
python_script = Python(IN[0]=RunMe, IN[1]=all_elements_of_category)
# ---------- python_script.python (6 lines) ----------
bool=IN[0]

if bool == True:
	OUT=IN[1]
else:
	OUT="Set RunMe to true to run all sheets or input a sheets list"
# ----------------------------------------
if_ = If(test=eq, true=python_script, false=Sheets_In)
flatten = Flatten(if_)
ReFresh = Input(ReFresh : bool = true)
code_block_2 = CodeBlock(flatten, ReFresh)
# ---------- code_block_2.designscript (17 lines) ----------
list = t4;
come = t5;
t3 = [Imperative]
{
if(come == True)
{
return = list;

}
else
{
return = list;

}

}
t6 = t3.Id;
# ----------------------------------------
SheetElements = Output(code_block_2.out2)
Element_Id = Output(code_block_2.out3)
sheetNumber = Sheet.SheetNumber(code_block_2.out2)
Sheet_Nubmer = Output(sheetNumber)
sheetName = Sheet.SheetName(code_block_2.out2)
Sheet_Name = Output(sheetName)
flatten_2 = Flatten(code_block_2.out2)
python_script_2 = Python(IN[0]=flatten_2)
# ---------- python_script_2.python (45 lines) ----------
#Copyright(c) 2016, Dimitar Venkov
# @5devene, dimitar.ven@gmail.com

import clr

clr.AddReference("RevitServices")
from RevitServices.Persistence import DocumentManager
doc = DocumentManager.Instance.CurrentDBDocument

clr.AddReference("RevitNodes")
import Revit
clr.ImportExtensions(Revit.Elements)

clr.AddReference("RevitAPI")
from Autodesk.Revit.DB import *

def tolist(obj1):
	if hasattr(obj1,"__iter__"): return obj1
	else: return [obj1]

def output1(l1):
	if len(l1) == 1: return l1[0]
	else: return l1

sheets = UnwrapElement(tolist(IN[0]))
sheet_views, sheets_scheds = [], []
rev_str = "<Revision Schedule>"
sched_dict = dict()
fec1 = FilteredElementCollector(doc).OfClass(ScheduleSheetInstance)
for s in fec1:
	if rev_str not in s.Name:
		key = s.OwnerViewId.IntegerValue
		if key not in sched_dict:
			sched_dict[key] = [s]
		else:
			sched_dict[key].append(s)

for i in xrange(len(sheets) ):
	viewsid = sheets[i].GetAllPlacedViews()
	views = [doc.GetElement(v).ToDSType(True) for v in viewsid]
	sheet_views.append(views)
	s_id = sheets[i].Id.IntegerValue
	scheds = sched_dict[s_id] if s_id in sched_dict else []
	sheets_scheds.append(scheds)
OUT = output1(sheet_views), output1(sheets_scheds)
# ----------------------------------------
code_block_3 = CodeBlock(o=python_script_2) { o[0]; o[1]; }
count = Count(code_block_2.out3, lacing=Longest)
chop = List.Chop(list=code_block_3.out0, lengths=count)
Sheet_Views = Output(chop)
python_script_3 = Python(IN[0]=flatten_2)
# ---------- python_script_3.python (46 lines) ----------
import clr
clr.AddReference('ProtoGeometry')
from Autodesk.DesignScript.Geometry import *
# Import ToDSType(bool) extension method
clr.AddReference("RevitNodes")
import Revit
clr.ImportExtensions(Revit.Elements)
# Import geometry conversion extension methods
clr.ImportExtensions(Revit.GeometryConversion)
# Import DocumentManager and TransactionManager
clr.AddReference("RevitServices")
import RevitServices
from RevitServices.Persistence import DocumentManager
from RevitServices.Transactions import TransactionManager
from System.Collections.Generic import *
# Import RevitAPI
clr.AddReference("RevitAPI")
import Autodesk
from Autodesk.Revit.DB import *

doc = DocumentManager.Instance.CurrentDBDocument
uiapp = DocumentManager.Instance.CurrentUIApplication
app = uiapp.Application
uidoc=DocumentManager.Instance.CurrentUIApplication.ActiveUIDocument

sheets = []
for i in IN[0]:
	sheets.append(UnwrapElement(i))

# Start Transaction
TransactionManager.Instance.EnsureInTransaction(doc)

vplist=[]
for v in sheets:
	vp=[]
	a=v.GetAllViewports()
	for i in a:
		b=doc.GetElement(i)
		vp.append(b)
	vplist.append(vp)
			

# End Transaction
TransactionManager.Instance.TransactionTaskDone()

OUT=vplist
# ----------------------------------------
chop_2 = List.Chop(list=python_script_3, lengths=count)
Sheet_ViewPorts = Output(chop_2)
chop_3 = List.Chop(list=code_block_3.out1, lengths=count)
Sheet_Sched = Output(chop_3)
code_block_4 = CodeBlock { "Title Blocks"; }
# note: Combine all of these into one python script
get_Elements_InViewsByCategory = Custom[Get_Elements_InViewsByCategory](Views_In=flatten_2, Categories=code_block_4)  # Gets elements in views or sheets by category_!!GetElementsInViews_ByCategory
chop_4 = List.Chop(list=get_Elements_InViewsByCategory, lengths=count)
TitleBlocks = Output(chop_4)
code_block_5 = CodeBlock {  }
