# Dynamo custom node Get_TitleBlock_At Index+.dyf (Dynamo 1.3.2.2480)
# category: ArupBimSF.Revit.Elements_Families
# get all loaded family types of a category

categories = Categories("TitleBlocks")
string_from_object = FromObject(categories)
byName = Category.ByName(string_from_object)
code_block = CodeBlock(item=byName) { Flatten({item}); }
ReFresh = Input(ReFresh : bool = true)
python_script = Python(IN[0]=code_block, IN[1]=ReFresh)
# ---------- python_script.python (21 lines) ----------
import System
import clr
clr.AddReference('RevitAPI')
from Autodesk.Revit.DB import *

clr.AddReference("RevitServices")
import RevitServices
from RevitServices.Persistence import DocumentManager

doc = DocumentManager.Instance.CurrentDBDocument
cats = IN[0]

elementlist = list()
# This could be more elegant if only I knew how to implement a Multicategory filter in Python....
for item in cats:
	collector = FilteredElementCollector(doc)
	collector.OfClass(FamilySymbol)
	bic = System.Enum.ToObject(BuiltInCategory, item.Id)
	collector.OfCategory(bic)
	elementlist.append(collector.ToElements())
OUT = elementlist
# ----------------------------------------
python_script_2 = Python(IN[0]=byName, IN[1]=python_script)
# ---------- python_script_2.python (4 lines) ----------
check = IN[0]
items = IN[1]
if isinstance(check, (list)): OUT = items
else: OUT = items[0]
# ----------------------------------------
name = Element.Name(python_script_2)
n00_Tb_Names = Output(name)  # "00_Tb_Names"
family = FamilyType.Family(python_script_2)
n01_ParentFamily = Output(family)  # "01_ParentFamily"
n02_FamilyTypes = Output(python_script_2)  # "02_FamilyTypes"
getIndex = Input(getIndex: int = 0)
code_block_2 = CodeBlock(x=python_script_2, p=getIndex) { x[p]; }
ChosenType = Output(code_block_2)  # "➜ChosenType"
