# Dynamo custom node Get_UnicodeChar_AtIndex+.dyf (Dynamo 1.3.2.2480)
# category: ArupBimSF.String Functions
# Select a unicode Charachter at index.  Chosen Charachter get sent to clipboard and is availible in an output as well

string = StringInput("""‖
⍿
|
：
⌀
○
●
⚠
⚡
✔
✖
✗
✘
❌
➜
⟘
⟙
⧉
⭦
⭧
⭨
⭩
⮀
⮁
⮂
⮃
⮄
⮅
⮆
⮇
⮘
⮙
⮚
⮛
⮜
⮝
⮞
⮟
⮿
🗲
🗸
©
®
॥
𐩑
🌍
🌎
🌏
🌡
🍄
🍕
🍷
🍸
🍹
🍺
🍻
🏴
👊
👍
👎
💀
💊
💣
💰
📌
🔌
🔑
🔒
🔓
🔧
🔨
🔪
🔫
🕱
🕶
🕷
🚫
🚹
🚺
🚻
🚾
🛠
∠
∥
⏊
◉
◐
◑
◒
◓
◔
◕
◖
◗
☀
☁
☂
★
☆
☕
☚
☛
☝
☢
☣
☮
☯
♔
♕
♖
♗
♘
♙
♚
♛
♜
♝
♞
♟
♠
♡
♢
♣
♤
♥
♦
♧
♺
♻
♼
⚐
⚑
⚒
⚓
⚔
⚾
⚿
⛝
⛤
⛧
✀
✈
✌
✍
✏
✚
✪
✱
✶
✷
✸
✹
❎
❽
➑
➤
⟝
⟞
⟟
⟵
⟶
⟷
⟸
⟹
⟺
⟻
⟼
⦾
⦿
⬀
⬁
⬂
⬃
⬛
⬜
⭙
：""")
string_2 = StringInput("\n")
split = String.Split(string, string_2)
trimWhitespace = String.TrimWhitespace(split, lacing=Longest)
Get_Index = Input(Get_Index : int = 0)
getItemAtIndex = List.GetItemAtIndex(list=trimWhitespace, index=Get_Index)
sendtoclipboard = Custom[➜SendToClipBoard](str=getItemAtIndex)  # copies the input item to clipboard
SentToClipBoard = Output(sendtoclipboard)
CharacterList = Output(trimWhitespace)
