# Dynamo custom node Get_UnusedTypes_ByCategory.dyf (Dynamo 1.3.2.2480)
# category: ArupBimSF.Revit.Document.Loaded Content
# Collect unused family types in document.#Types#Doc#Families

ReFresh = Input(ReFresh: bool = false)
Category = Input()
action_ReFresh = Custom[Action_ReFresh](Refresh=ReFresh, list=Category)  # add to the front of a workflow to allow it to be refreshed with a boolean node
code_block = CodeBlock(a=action_ReFresh) { Flatten({a}); }
python_script = Python(IN[0]=code_block)
# ---------- python_script.python (23 lines) ----------
#python nodes in dynamo 1.0
#proposed by Julien Benoit @jbenoit44 
#http://aecuandme.wordpress.com/
import System
import clr
clr.AddReference('RevitAPI')
from Autodesk.Revit.DB import *

clr.AddReference("RevitServices")
import RevitServices
from RevitServices.Persistence import DocumentManager

doc = DocumentManager.Instance.CurrentDBDocument
cats = IN[0]

elementlist = []
for item in cats:
	collector = FilteredElementCollector(doc)
	collector.OfClass(FamilySymbol)
	bic = System.Enum.ToObject(BuiltInCategory, item.Id)
	collector.OfCategory(bic)
	elementlist.append(collector.ToElements())
OUT =collector.ToElements()
# ----------------------------------------
all_elements_of_category = ElementsOfCategory(action_ReFresh)
type = FamilyInstance.Type(all_elements_of_category)
uniqueItems = List.UniqueItems(type)
setDifference = SetDifference(python_script, uniqueItems)
n0_UnUsed_Types = Output(setDifference)  # "0_UnUsed_Types"
name = Custom[Get_Element.Name+](elements=setDifference)  # Get the element name from all types of elements including system families_!!Get!Element
n1_Family_Names = Output(name)  # "1_Family_Names"
id = Element.Id(setDifference)
n2_Element_Ids = Output(id)  # "2_Element_Ids"
