# Dynamo custom node Get_ViewDependents_InViewsByCategory.dyf (Dynamo 1.3.2.2480)
# category: ArupBimSF.Revit.Elements_ViewDependent
# Gets All View Dependent Elements In Input Views

category = Input(category : Category)
code_block = CodeBlock(item=category) { Flatten({item}); }
ViewList_In = Input()
code_block_2 = CodeBlock(item=ViewList_In) { Flatten({item}); }
Refresh = Input(Refresh : bool = true)
python_script = Python(IN[0]=code_block, IN[1]=code_block_2, IN[2]=Refresh)
# ---------- python_script.python (24 lines) ----------
import System
import clr
clr.AddReference('RevitAPI')
from Autodesk.Revit.DB import *

clr.AddReference("RevitServices")
import RevitServices
from RevitServices.Persistence import DocumentManager

doc = DocumentManager.Instance.CurrentDBDocument
cats = IN[0]
views = UnwrapElement(IN[1])

elementlist = list()
# This could be more elegant if only I knew how to implement a Multicategory filter in Python....
for cat in cats:
	catlist = list()
	for view in views:
		collector = FilteredElementCollector(doc)
		filter = ElementOwnerViewFilter(view.Id)
		bic = System.Enum.ToObject(BuiltInCategory, cat.Id)
		catlist.append(collector.WherePasses(filter).OfCategory(bic).ToElements())
	elementlist.append(catlist)
OUT = elementlist
# ----------------------------------------
python_script_2 = Python(IN[0]=category, IN[1]=python_script)
# ---------- python_script_2.python (4 lines) ----------
check = IN[0]
items = IN[1]
if isinstance(check, (list)): OUT = items
else: OUT = items[0]
# ----------------------------------------
list_CleanOutput = Custom[List_CleanOutput](List_In=python_script_2)  # Removes and Replaces Nulls and Empty Lists from input lists. *only works with flat or 2 dimentional lists_Need to fix it to go deeper or use list.map
Elements = Output(list_CleanOutput.Cleaned)
isEmpty = List.IsEmpty(python_script_2, lacing=Longest)
filterByBoolMask = List.FilterByBoolMask(list=code_block_2, mask=isEmpty)
Parent_Views = Output(filterByBoolMask.out)
None_In_View = Output(filterByBoolMask.in)
