# Dynamo custom node Get_ViewDisicpline_ByCodeName.dyf (Dynamo 1.3.2.2480)
# category: ArupBimSF.^FixMe
# Gets the View Discipline text from View Discipline Codenames

db_view_disciplines_built_in = Custom[Db_View Disciplines_Built-In]()  # Enumerate the Different View Disciplines in Revit DB
ViewDisc = Input()
code_block = CodeBlock(item=ViewDisc) { Flatten({item}); }
string_flat_list_to_list_of = Custom[String_Flat LIst to List of Strings](Original_List=db_view_disciplines_built_in.ViewDiscipline)  # converts a flat list into a list of strings
indexOf = IndexOf(string_flat_list_to_list_of)  # unwired: arg1
map = List.Map(list=code_block, f_x=indexOf)
getItemAtIndex = List.GetItemAtIndex(list=db_view_disciplines_built_in.HashCodes, index=map)
firstItem = List.FirstItem(getItemAtIndex)
item = Output(firstItem)
