# Dynamo custom node Get_ViewElementsByCategory_At Index+.dyf (Dynamo 1.3.2.2480)
# category: ArupBimSF.Revit.Views

code_block = CodeBlock { ""; }
join = List.Join()  # unwired: arg0, arg1
categories_Views = StringInput("""Sheets
Views
Elevations
Sections
Viewports
Title Blocks
View Reference
View Titles
Callouts""")
multilinestring_list = Custom[MultilineString➜List](String_In=categories_Views)  # converts a string with line breaks in to a list of strings
byName = Category.ByName(multilinestring_list)
all_elements_of_category = ElementsOfCategory(byName)
list_CleanOutput = Custom[List_CleanOutput](List_In=all_elements_of_category)  # Removes and Replaces Nulls and Empty Lists from input lists. *only works with flat or 2 dimentional lists_Need to fix it to go deeper or use list.map
removeItemAtIndex = List.RemoveItemAtIndex(list=byName, indices=list_CleanOutput.Indices)
code_block_2 = CodeBlock { "."; }
code_block_3 = CodeBlock { 3; }
obj_string_matchlength = Custom[Obj➜String_MatchLength](List_In=removeItemAtIndex, Pad_With=code_block_2, ExtraPad=code_block_3)  # converts input object to flat list of strings and matches the length of all strings to that of the longest item in list
code_block_4 = CodeBlock { 0; }
clean = List.Clean(list=all_elements_of_category, preserveIndices=code_block_4)
count = Count(clean, lacing=Longest)
code_block_5 = CodeBlock { "0"; }
code_block_6 = CodeBlock { 1; }
obj_string_matchlength_2 = Custom[Obj➜String_MatchLength](List_In=count, Pad_With=code_block_5, ExtraPad=code_block_6)
combine = List.Combine(join, obj_string_matchlength.PadRight, obj_string_matchlength_2.PadLeft)
join_2 = String.Join(code_block, combine, lacing=Longest)
Category_ItemCount = Output(join_2)  # "Category|ItemCount"
Get_Index = Input(Get_Index: var = "")
getItemAtIndex = List.GetItemAtIndex(list=removeItemAtIndex, index=Get_Index)
ChosenCategory = Output(getItemAtIndex)
getItemAtIndex_2 = List.GetItemAtIndex(list=clean, index=Get_Index)
ChosenElements = Output(getItemAtIndex_2)
