# Dynamo custom node Get_ViewLocation_OnSheet.dyf (Dynamo 1.3.2.2480)
# category: ArupBimSF.Revit.Views
# Finds the sheet from input views.  Seperates views on sheets from views not on sheets

Views_In = Input(Views_In: var="")
code_block = CodeBlock { ""; }
eq = Views_In == code_block
RunMe = Input(RunMe : bool = false)  # Set runme to true to run all views or input a list of views to run them
categories = Categories("Views")
action_RunMe = Custom[Action_RunMe](Should_I=RunMe, ThingToDo=categories)  # Uses A boolean to determine whether to run a function or sequence.
all_elements_of_category = ElementsOfCategory(action_RunMe)
if_ = If(test=eq, true=all_elements_of_category, false=Views_In)
code_block_2 = CodeBlock { "Sheet Number"; }
getParameterValueByName = Element.GetParameterValueByName(element=if_, parameterName=code_block_2)
code_block_3 = CodeBlock { false; }
filter_Sheets_ByNameOrNumber = Custom[Filter_Sheets_ByNameOrNumber](Name_or_Number=code_block_3)  # collects all sheets in current project by partial or exact match of the sheet name or number; unwired: Search_String
map = List.Map(list=getParameterValueByName, f_x=filter_Sheets_ByNameOrNumber.exact_match)
flatten = Flatten(map)
n0_ListOut_UnFiltered = Output(flatten)  # "0_ListOut_UnFiltered"
string = StringInput("---")
eq_2 = map == string
filterByBoolMask = List.FilterByBoolMask(list=if_, mask=eq_2)
n1_Not_On_Sheets = Output(filterByBoolMask.in)  # "1_Not On Sheets"
n2_On_Sheets = Output(filterByBoolMask.out)  # "2_On Sheets"
filterByBoolMask_2 = List.FilterByBoolMask(list=flatten, mask=eq_2)
n3_Sheet_Elements = Output(filterByBoolMask_2.out)  # "3_Sheet_Elements"
