# Dynamo custom node Get_ViewPlane.dyf (Dynamo 1.3.2.2480)
# category: ArupBimSF.Revit.Views & Sheets
# get the view plane from input views

View_In = Input()
code_block = CodeBlock(item=View_In) { Flatten({item}); }
python_script = Python(IN[0]=code_block)
# ---------- python_script.python (20 lines) ----------
import clr
clr.AddReference('RevitAPI')
from Autodesk.Revit.DB import *

clr.AddReference("RevitNodes")
import Revit
clr.ImportExtensions(Revit.GeometryConversion)

items = UnwrapElement(IN[0])
elementlist = list()
olist = list()
dlist = list()

for item in items:
	try:
		olist.append(item.Origin.ToPoint())
		dlist.append(item.ViewDirection.ToVector())
	except:
		elementlist.append(list())
OUT = (olist,dlist)
# ----------------------------------------
code_block_2 = CodeBlock(seq=python_script) { Plane.ByOriginNormal(seq[0],seq[1]); }
return_ListOrSingleValue = Custom[Return_ListOrSingleValue](unknownItem=View_In, List_In=code_block_2)
plane = Output(return_ListOrSingleValue)
