# Dynamo custom node Get_ViewTemplate.dyf (Dynamo 1.3.2.2480)
# category: ArupBimSF.Revit.View Templates, Filters, and Overrides
# Gets view templates from input views

Views = Input()
code_block = CodeBlock(item=Views) { Flatten({item}); }
python_script = Python(IN[0]=code_block)
# ---------- python_script.python (18 lines) ----------
import clr
clr.AddReference('RevitAPI')
from Autodesk.Revit.DB import *

clr.AddReference("RevitServices")
import RevitServices
from RevitServices.Persistence import DocumentManager

doc = DocumentManager.Instance.CurrentDBDocument
views = UnwrapElement(IN[0])
elementlist = list()

for view in views:
	if view.ViewTemplateId.IntegerValue == -1:
		elementlist.append(list())
	else:
		elementlist.append(doc.GetElement(view.ViewTemplateId))
OUT = elementlist
# ----------------------------------------
Templates = Output(python_script)
