# Dynamo custom node Get_ViewTemplate_At Index+.dyf (Dynamo 1.3.2.2480)
# category: ArupBimSF.Revit.View Templates, Filters, and Overrides
# Collect the name and element info for all view templates in active Revit Model

# note: DYNAMO VERSION
# 1.3
# note: INPUT:  Requires interaction / verification.

# group: DESCRIPTION
# note: WORKING REVIT VERSION(S)
# 2017
# note: N/A
# note: ASSOCIATED REVIT FILE(S)
# N/A
# note: AUTHOR(S)
# Emmett Cruey (Arup S-F)
# note: DESCRIPTION
# Reads selected index from library and returns character to clipboard and output.

# note: DYNAMO FILE NAME
# Get_Library_Unicode+.dyf
categories = Categories("Views")
ReFresh = Input(ReFresh : bool = true)
# note: OUTPUT:  Suggests interaction / verification / review.
code_block = CodeBlock(categories, ReFresh)
# ---------- code_block.designscript (11 lines) ----------
list;
come;

[Imperative]

{
 if (come ==true)
  return = list;
 else
  return = list;
};
# ----------------------------------------
# note: OUTPUT:  Requires interaction / verification/review.
# note: OUTPUT:  Final data for use / further manipulation.
# note: THROUGHPUT:  No direct user interaction needed.
all_elements_of_category = ElementsOfCategory(code_block.out2)
list_CleanOutput = Custom[List_CleanOutput](List_In=all_elements_of_category)  # Removes and Replaces Nulls and Empty Lists from input lists. *only works with flat or 2 dimentional lists_Need to fix it to go deeper or use list.map_!!List
get_ViewType = Custom[Get_ViewType](View=list_CleanOutput.Cleaned)  # Returns the View Type Of Input Views
code_block_2 = CodeBlock { "Legend"; }
eq = get_ViewType == code_block_2
filterByBoolMask = List.FilterByBoolMask(list=list_CleanOutput.Cleaned, mask=eq)
isViewTemplate = View.IsViewTemplate(filterByBoolMask.out)
list_CleanOutput_2 = Custom[List_CleanOutput](List_In=isViewTemplate)
removeItemAtIndex = List.RemoveItemAtIndex(list=filterByBoolMask.out, indices=list_CleanOutput_2.Indices)
filterByBoolMask_2 = List.FilterByBoolMask(list=removeItemAtIndex, mask=list_CleanOutput_2.Cleaned)
name = Element.Name()  # unwired: arg0
sortByFunction = SortByFunction(filterByBoolMask_2.in, name)
name_2 = Element.Name(sortByFunction)
NameList = Output(name_2)
ChooseIndex = Input(ChooseIndex : int = 0)
getItemAtIndex = List.GetItemAtIndex(list=sortByFunction, index=ChooseIndex)
ChosenElement = Output(getItemAtIndex)
getItemAtIndex_2 = List.GetItemAtIndex(list=name_2, index=ChooseIndex)
ElementName = Output(getItemAtIndex_2)
All_ViewTemplates = Output(sortByFunction)
code_block_3 = CodeBlock {  }
