# Dynamo custom node Get_ViewTemplates.DYF (Dynamo 1.3.2.2480)
# category: EEC.Revit.ViewTemplates, Filters
# get all view templates not including schedules at this time

categories = Categories("Views")
ReFresh = Input(ReFresh : bool = true)
# note: Select Templates_By Type, Discpline, Use....more?
code_block = CodeBlock(categories, ReFresh)
# ---------- code_block.designscript (11 lines) ----------
list;
come;

[Imperative]

{
 if (come ==true)
  return = list;
 else
  return = list;
};
# ----------------------------------------
all_elements_of_category = ElementsOfCategory(code_block.out2)
list_CleanOutput = Custom[List_CleanOutput+](List_In=all_elements_of_category)  # Removes and or places nulls and empties up to 2 dimentional_!!List
flatten = Flatten(list_CleanOutput.Cleaned)
get_workset_name = Custom[Get_Workset Name+](element=flatten)  # get the workset for input elements
code_block_2 = CodeBlock { "Template"; }
contains = String.Contains(str=get_workset_name.WorksetName, searchFor=code_block_2)
filterByBoolMask = List.FilterByBoolMask(list=flatten, mask=contains)
ViewTemplates = Output(filterByBoolMask.in)
