# Dynamo custom node Get_ViewTemplates_ByFilter+.dyf (Dynamo 1.3.2.2480)
# category: ArupBimSF.Revit.Views & Sheets
# get all views in a project listed individually by type of as a combined list (great to use a filter by paramter)_#Views#GetAll#Sheets

code_block = CodeBlock { " | "; }
get_ViewTemplates = Custom[Get_ViewTemplates]()  # get all view templates not including schedules at this time
get_ViewType = Custom[Get_ViewType](View=get_ViewTemplates)  # Returns the View Type Of Input Views
list_GroupAndSortByKey = Custom[List_GroupAndSortByKey+](List_In=get_ViewTemplates, Keys_In=get_ViewType)  # groups an input list by input keys and outputs groups and unique keys
length = String.Length(list_GroupAndSortByKey.Unique_keys)
maximumItem = List.MaximumItem(length)
code_block_2 = CodeBlock { " "; }
padRight = String.PadRight(list_GroupAndSortByKey.Unique_keys, maximumItem, code_block_2)
count = List.Count(list_GroupAndSortByKey.groups, lacing=Longest)
string_from_object = FromObject(count)
code_block_3 = CodeBlock { 3; }
code_block_4 = CodeBlock { "0"; }
padLeft = String.PadLeft(string_from_object, code_block_3, code_block_4)
join_WithSeperator = Custom[Join_WithSeperator](separator=code_block, stringA=padRight, stringB=padLeft, lacing=Longest)  # Joins two strings into one with a seperator
Object_List_Count = Output(join_WithSeperator)  # "Object_List&Count"
ChoseBy_Type = Input(ChoseBy_Type : int = 0)
getItemAtIndex = List.GetItemAtIndex(list=list_GroupAndSortByKey.groups, index=ChoseBy_Type)
n1_ChosenGroup = Output(getItemAtIndex)  # "1☛ChosenGroup"
name = Custom[Get_Element.Name+](elements=getItemAtIndex)  # Get the element name from all types of elements including system families_!!Get!Element
n2_FilterValue = Output(name)  # "2☛FilterValue"
# note: Change this node to allow you to choose a filter Name, CSI MF, View Use,Other?
GetVT = Input(GetVT : int = 0)
removeItemAtIndex = List.RemoveItemAtIndex(list=getItemAtIndex, indices=GetVT)
n3_Chosen_Templates = Output(removeItemAtIndex)  # "3☛☛Chosen_Templates"
element_Name = Custom[Element_Name+](Input=get_ViewTemplates)  # gets the element name for all elements
code_block_5 = CodeBlock { {"Dicipline_Name","CSI_Masterformat","View_Use"}; }
getParameterValueByName = Element.GetParameterValueByName(element=get_ViewTemplates, parameterName=code_block_5, lacing=Longest)
