# Dynamo custom node Get_ViewType.dyf (Dynamo 1.3.2.2480)
# category: ArupBimSF.Revit.Views & Sheets
# Returns the View Type Of Input Views

View = Input()
code_block = CodeBlock(item=View) { Flatten({item}); }
python_script = Python(IN[0]=code_block)
# ---------- python_script.python (10 lines) ----------
import clr
clr.AddReference('RevitAPI')
from Autodesk.Revit.DB import *

views = UnwrapElement(IN[0])
elementlist = list()

for view in views:
	elementlist.append(str(view.ViewType))
OUT = elementlist
# ----------------------------------------
python_script_2 = Python(IN[0]=View, IN[1]=python_script)
# ---------- python_script_2.python (4 lines) ----------
check = IN[0]
items = IN[1]
if isinstance(check, (list)): OUT = items
else: OUT = items[0]
# ----------------------------------------
type = Output(python_script_2)
