# Dynamo custom node Get_Workset Name+.dyf (Dynamo 1.3.2.2480)
# category: ArupBimSF.Revit.Elements
# get the workset for input elements

element = Input()
flatten = Flatten(element)
python_script = Python(IN[0]=flatten)
# ---------- python_script.python (17 lines) ----------
import clr
clr.AddReference('RevitAPI')
from Autodesk.Revit.DB import *

clr.AddReference("RevitServices")
import RevitServices
from RevitServices.Persistence import DocumentManager

doc = DocumentManager.Instance.CurrentDBDocument
faminsts = UnwrapElement(IN[0])
elementlist = list()
for item in faminsts:
	try:
		elementlist.append(doc.GetWorksetTable().GetWorkset(item.WorksetId))
	except:
		elementlist.append(list())
OUT = elementlist
# ----------------------------------------
return_ListOrSingleValue = Custom[Return_ListOrSingleValue](unknownItem=element, List_In=python_script)
Internal = Output(return_ListOrSingleValue)
python_script_2 = Python(IN[0]=return_ListOrSingleValue)
# ---------- python_script_2.python (21 lines) ----------
import clr
clr.AddReference('RevitAPI')
from Autodesk.Revit.DB import *

faminsts = IN[0]
elementlist = list()
for item in faminsts:
	try:
		n = UnwrapElement(item).Name
	except:
		# Use a built-in property of (wrapped) Dynamo elements for family symbols instead
		try:
			n = item.Name
		except:
			# maybe it's a parameter name
			try:
				n = item.Definition.Name
			except:
				n = []
	elementlist.append(n)
OUT = elementlist
# ----------------------------------------
return_list_or_single_value = Python(IN[0]=return_ListOrSingleValue, IN[1]=python_script_2)
# ---------- return_list_or_single_value.python (4 lines) ----------
check = IN[0]
items = IN[1]
if isinstance(check, (list)): OUT = items
else: OUT = items[0]
# ----------------------------------------
WorksetName = Output(return_list_or_single_value)
