# Dynamo custom node Graph_Pause.dyf (Dynamo 1.3.2.2480)
# category: ArupBimSF.Core
# Pause an Entire Graph

second = Input(second:int)
reset = Input(reset:bool = true)
python_script = Python(IN[0]=second, IN[1]=reset)
# ---------- python_script.python (4 lines) ----------
s = IN[0]
import time
time.sleep(s) 
OUT = 0
# ----------------------------------------
wait = Output(python_script)
