# Dynamo custom node Graph_SeqPassthru.dyf (Dynamo 1.3.2.2480)
# category: ArupBimSF.Core
# forces an operation to run in sequence.

passThrough = Input()
waitFor = Input()
code_block = CodeBlock(passthrough=passThrough, waitfor=waitFor) { {passthrough,waitfor}[0]; }
passThrough_2 = Output(code_block)  # "passThrough"
