# Dynamo custom node Group_Elements_ByBoundingBoxContainer.dyf (Dynamo 1.3.2.2480)
# category: ArupBimSF.Revit.Element_Location
# groups elements by bounding container (solid)

objects = Input(objects : var[])
Loc_Pts = Input(Loc_Pts : Autodesk.Point[])
containers = Input(containers : var[])
code_block = CodeBlock(objects=objects, points=Loc_Pts, bins=containers) { objects; points; bins; }
python_script = Python(IN[0]=code_block.objects, IN[1]=code_block.points, IN[2]=code_block.bins)
# ---------- python_script.python (46 lines) ----------
# Group a set of objects and their representative location points by their inclusion in a set of given list of "bins."  Bins can be solids or closed polygons or polycurves.  Objects and their corresponding location points are returned, per the first bin that contains them in the order in which they were received.  A list of objects and representative location points not found to included in any bin is also given.

import clr
clr.AddReference('ProtoGeometry')
from Autodesk.DesignScript.Geometry import *

objects = IN[0]
pts = IN[1]
bins = IN[2]

objPerBin = []	# Objects per solid
ptPerBin = []		# Points per solid
objNotTaken = []	# Objects not in a solid
ptNotTaken = []		# Points not in a solid

for bin in bins:
	objPerBin.append([])
	ptPerBin.append([])

for j in range(len(pts)):
	taken = False
	for k in range(len(bins)):
		# For bins as solids
		if type(bins[k]) is Solid:
			if pts[j].DoesIntersect(bins[k]):
				ptPerBin[k].append(pts[j])
				objPerBin[k].append(objects[j])
				taken = True
				break
		# For bins as polygons/polycurves
		if type(bins[k]) is PolyCurve or type(bins[k]) is Polygon or type(bins[k]) is Rectangle:		
			if bins[k].ContainmentTest(pts[j]):
				ptPerBin[k].append(pts[j])
				objPerBin[k].append(objects[j])
				taken = True
				break
	# Note objects/points not in any bin
	if not taken:
		ptNotTaken.append(pts[j])
		objNotTaken.append(objects[j])

OUT = []
OUT.append(objPerBin)
OUT.append(ptPerBin)
OUT.append(objNotTaken)
OUT.append(ptNotTaken)
# ----------------------------------------
code_block_2 = CodeBlock(OUT=python_script) { OUT[0]; OUT[1]; OUT[2]; OUT[3]; }
objects_ByContainer = Output(code_block_2.out0)
LocPts_ByContainer = Output(code_block_2.out1)
objects_Excluded = Output(code_block_2.out2)
LocPts_Excluded = Output(code_block_2.out3)
