# Dynamo custom node Group_Elements_ByParameterValue.dyf (Dynamo 1.3.2.2480)
# category: ArupBimSF.Revit.Element_Filters
# Groups input elements by input Parameter

code_block = CodeBlock()
# ---------- code_block.designscript (8 lines) ----------
def getparam(e,name)
{

//Gettig parameter values
pv = e.GetParameterValueByName(name);
pvst = ToString(pv);
return = pvst;
};
# ----------------------------------------
elements = Input()
parameter_name = Input()
code_block_2 = CodeBlock(e=elements, n=parameter_name) { List.GroupByKey(e,getparam(e,n))["groups"]; }
list = Output(code_block_2)
