# Dynamo custom node Imports_Check for Imported Object Styles.dyf (Dynamo 1.3.2.2480)
# category: ArupBimSF.^TestingGrounds
# checks your active document for imported oject styles.  Runs against project and loaded families.

integer_slider = IntegerSlider(0, range=0..100 step 1)
string = StringInput("Imports in Families")
boolean = BoolSelector(true)
get_imported_object_styles = Custom[Get Imported Object Styles](Search_for=string, False_for_catch_more=boolean)  # original code by Konrad
watch = Watch(get_imported_object_styles)
count = List.Count(watch)
lt = integer_slider < count
watch_2 = Watch(lt)
Are_there_Imports_in_Families_styles = Output(watch_2)  # "Are there Imports in Families styles?"
integer_slider_2 = IntegerSlider(0, range=0..100 step 1)
string_2 = StringInput("dwg")
boolean_2 = BoolSelector(false)
get_imported_object_styles_2 = Custom[Get Imported Object Styles](Search_for=string_2, False_for_catch_more=boolean_2)
watch_3 = Watch(get_imported_object_styles_2)
count_2 = List.Count(watch_3)
lt_2 = integer_slider_2 < count_2
watch_4 = Watch(lt_2)
Are_there_DWG_styles = Output(watch_4)  # "Are there DWG styles?"
List_of_DWG_styles = Output(watch_3)
List_of_Imports_in_Families_styles = Output(watch)
