# Dynamo custom node LineStyle_Create Location LS.dyf (Dynamo 1.3.2.2480)
# category: ArupBimSF.Revit.Lines,Text & Styles
# Creates Loc.Point LineStyle.

code_block = CodeBlock { "!Location_Point"; }
code_block_2 = CodeBlock { 5; {255,125,0}; 1; }
lineStyle_CreateNew = Custom[LineStyle_CreateNew](LS_Name=code_block, LS_Weight=code_block_2.out0, LS_Color=code_block_2.out1, RunMe=code_block_2.out2)  # Create new linestyles by color, weight and name
LineStyles = Output(lineStyle_CreateNew)
