# Dynamo custom node List_Any False.dyf (Dynamo 1.3.2.2480)
# category: ArupBimSF.^Depricated
# #Depricated use list contains item and put true or false in a code block

List_In = Input(List_In : bool[])
code_block = CodeBlock(seq=List_In) { !(AllTrue(seq)); }
bool = Output(code_block)
