# Dynamo custom node List_Clean+.dyf (Dynamo 1.3.2.2480)
# category: ArupBimSF.List Functions
# Returns true if list item is null or empty_!Li

List_In = Input(List_In : var[]..[])
isEmpty = List.IsEmpty(List_In, lacing=Longest)
code_block = CodeBlock { true; }
python_script = Python(IN[0]=isEmpty, IN[1]=code_block)
# ---------- python_script.python (8 lines) ----------
items = IN[0]
rep = IN[1]
elementlist = list()
for item in items:
	if item is None: 
		item = rep
	elementlist.append(item)
OUT = elementlist
# ----------------------------------------
filterByBoolMask = List.FilterByBoolMask(list=List_In, mask=python_script)
CleanList = Output(filterByBoolMask.in)
Boolean = Output(python_script)
