# Dynamo custom node List_CleanEmpties.dyf (Dynamo 1.3.2.2480)
# category: NightCrawler.List
# remove empty indices from input lists

List_In = Input()
ReFresh = Input(ReFresh : bool = true)
code_block = CodeBlock(List_In, ReFresh)
# ---------- code_block.designscript (11 lines) ----------
list;
come;

[Imperative]

{
 if (come ==true)
  return = list;
 else
  return = list;
};
# ----------------------------------------
isEmpty = List.IsEmpty()  # unwired: arg0
map = List.Map(list=code_block.out2, f_x=isEmpty)
code_block_2 = CodeBlock(t2=code_block.out2, t3=map)
# ---------- code_block_2.designscript (4 lines) ----------
t4 = DSCore.List.FilterByBoolMask(t2, t3);
t5 = __TryGetValueFromNestedDictionaries(t4, "in");
t6 = __TryGetValueFromNestedDictionaries(t4, "out");
t7 = DSCore.List.AllIndicesOf(t3, true);
# ----------------------------------------
Cleaned_List = Output(code_block_2.t6)
Indices_Removed = Output(code_block_2.t7)
Replacement = Input(Replacement: var="---")
replaceByCondition = Replace(code_block.out2, Replacement, isEmpty)
EmptiesReplaced = Output(replaceByCondition)
