# Dynamo custom node List_CleanOutput+.dyf (Dynamo 1.3.2.2480)
# category: ArupBimSF.List Functions
# Removes and or places nulls and empties up to 2 dimentional_!!List

List_In = Input(List_In : var[]..[])
code_block = CodeBlock { null; }
list_CleanOutput = Custom[List_CleanOutput](List_In=List_In, Replace_With=code_block)  # Removes and Replaces Nulls and Empty Lists from input lists. *only works with flat or 2 dimentional lists_Need to fix it to go deeper or use list.map
flatten = Flatten(list_CleanOutput.REPlaced)
ReplaceWith = Input(ReplaceWith : var="")
python_script = Python(IN[0]=flatten, IN[1]=ReplaceWith)
# ---------- python_script.python (8 lines) ----------
items = IN[0]
rep = IN[1]
elementlist = list()
for item in items:
	if item is None: 
		item = rep
	elementlist.append(item)
OUT = elementlist
# ----------------------------------------
isNull = Object.IsNull()  # unwired: arg0
map = List.Map(list=list_CleanOutput.REPlaced, f_x=isNull)
flatten_2 = Flatten(map)
filterByBoolMask = List.FilterByBoolMask(list=python_script, mask=flatten_2)
ofRepeatedItem = List.OfRepeatedItem()  # unwired: item, amount
getKeys = GetKeys(map)
count = List.Count(map, lacing=Longest)
combine = List.Combine(ofRepeatedItem, getKeys, count)
flatten_3 = Flatten(combine)
filterByBoolMask_2 = List.FilterByBoolMask(list=flatten_3, mask=flatten_2)
groupByKey = List.GroupByKey(list=filterByBoolMask.out, keys=filterByBoolMask_2.out)
Cleaned = Output(groupByKey.groups)
groupByKey_2 = List.GroupByKey(list=python_script, keys=flatten_3)
Replaced = Output(groupByKey_2.groups)
IndicesOut = Output(list_CleanOutput.Indices)
