# Dynamo custom node List_CleanOutput.2+.dyf (Dynamo 1.3.2.2480)
# category: ArupBimSF.List Functions
# cleans a list of all null and empty lists.  the "cleaned" output removes them, the replaced allows you to replace them (by default with an empty string but you can set anything as the replacement). The third out put is the empty or bull indices so you can remove them from other lists without losing you order.

list = Input()
ReplaceWith = Input(ReplaceWith: var = "")
list_CleanOutput = Custom[List_CleanOutput](Replace_With=ReplaceWith)  # Removes and Replaces Nulls and Empty Lists from input lists. *only works with flat or 2 dimentional lists_Need to fix it to go deeper or use list.map_!!List; unwired: List_In
map = List.Map(list=list, f_x=list_CleanOutput.Cleaned)
Cleaned = Output(map)
map_2 = List.Map(list=list, f_x=list_CleanOutput.REPlaced)
Replaced = Output(map_2)
map_3 = List.Map(list=list, f_x=list_CleanOutput.Indices)
Indices = Output(map_3)
