# Dynamo custom node List_CleanOutput.dyf (Dynamo 1.3.2.2480)
# category: ArupBimSF.List Functions
# Removes and Replaces Nulls and Empty Lists from input lists.  *only works with flat or 2 dimentional lists_Need to fix it to go deeper or use list.map_!!List

List_In = Input(List_In : var[]..[])
isEmpty = List.IsEmpty(List_In, lacing=Longest)
code_block = CodeBlock { true; }
python_script = Python(IN[0]=isEmpty, IN[1]=code_block)
# ---------- python_script.python (8 lines) ----------
items = IN[0]
rep = IN[1]
elementlist = list()
for item in items:
	if item is None: 
		item = rep
	elementlist.append(item)
OUT = elementlist
# ----------------------------------------
code_block_2 = CodeBlock { true; }
allIndicesOf = List.AllIndicesOf(list=python_script, item=code_block_2)
removeItemAtIndex = List.RemoveItemAtIndex(list=List_In, indices=allIndicesOf)
Cleaned = Output(removeItemAtIndex)
Replace_With = Input(Replace_With : var = "")
list_replace_item_at_index = Custom[List_Replace Item At Index+](List_In=List_In, index=allIndicesOf, replacement=Replace_With)  # Replaces the item at a given index (or list of indices) of a list by another item (From Clockwork)
REPlaced = Output(list_replace_item_at_index)
Indices = Output(allIndicesOf)
