# Dynamo custom node List_Clean_Nulls.dyf "List_Remove or Replace Nulls" (Dynamo 1.3.1.1736)
# category: Revit
# clears input list of null, empty and reports the removed indices

Input = Input(Input : var[])
python_script = Python(IN[0]=Input)
# ---------- python_script.python (23 lines) ----------
#Copyright(c) 2015, Konrad K Sobon
# @arch_laboratory, http://archi-lab.net

import clr
clr.AddReference('ProtoGeometry')
from Autodesk.DesignScript.Geometry import *
#The inputs to this node will be stored as a list in the IN variable.
dataEnteringNode = IN

def ClearList(_list):
    out = []
    for _list1 in _list:
        if _list1 is None:
            continue
        if isinstance(_list1, list):
             _list1 = ClearList(_list1)
             if not _list1:
                 continue
        out.append(_list1)
    return out

#Assign your output to the OUT variable
OUT = ClearList(IN[0])
# ----------------------------------------
Remove = Output(python_script)
string_from_object = FromObject(Input)
code_block = CodeBlock(t2=string_from_object) { t3 = DSCore.List.AllIndicesOf(t2, "null"); }
code_block_2 = CodeBlock { ""; }
replaceItemAtIndex = List.ReplaceItemAtIndex(list=string_from_object, index=code_block, item=code_block_2)
Replace = Output(replaceItemAtIndex)
IndexOF = Output(code_block)
