# Dynamo custom node List_Compare & Match+.dyf (Dynamo 1.3.2.2480)
# category: ArupBimSF.List Functions
# Compares 2 lists and reports matching items, and  unmatched from both lists_!!List_CompareandMatch+

a_TakeFromList = Input()
string_from_object = FromObject(a_TakeFromList)
b_ItemsToTake = Input()
string_from_object_2 = FromObject(b_ItemsToTake)
list_remove_matching = Custom[List_Remove Matching](a_TakeFromList=string_from_object, b_ItemsToTake=string_from_object_2)  # Removes Matching Items and reports back all Match,&No Match from Both Lists
a_Reduced_List = Output(list_remove_matching.a_Reduced_List)
b_Unmatched_Items = Output(list_remove_matching.b_Unmatched_Items)
python_script = Python(IN[0]=list_remove_matching.b_Unmatched_Items, IN[1]=string_from_object_2)
# ---------- python_script.python (13 lines) ----------
listA = IN[0]
listB = IN[1]
unmatched = []

#listC = [x for x in listA if x not in listB]
for x in range(len(listA)):
#	s = set(listA)
	if listA[x] in listB:
		listB.remove(listA[x])
	else:
		unmatched.append(listA[x])

OUT = [listB, unmatched]
# ----------------------------------------
code_block = CodeBlock(xc=python_script) { xc[0]; }
c_In_Both_Lists = Output(code_block)
firstIndexOf = List.FirstIndexOf(list=string_from_object, item=code_block)
a_Index_of_Match = Output(firstIndexOf)
