# Dynamo custom node List_FilterByStringMatch.dyf (Dynamo 1.3.2.2480)
# category: ArupBimSF.List Functions
# Filters a list of elements by whether or not they contain a search string. I added an option to run it by string match as well._!fi!Li

list = Input()
code_block = CodeBlock(item=list) { Flatten({item}); }
string_from_object = FromObject()  # unwired: arg0
Contains_Or_Equals = Input(Contains_Or_Equals: bool = true)
SearchString = Input()
boolean = BoolSelector(true)
contains = String.Contains(searchFor=SearchString, ignoreCase=boolean)  # unwired: str
eq = _ == SearchString  # unwired: arg0
if_ = If(test=Contains_Or_Equals, true=contains, false=eq)
compose = ComposeFunctions(string_from_object, if_)  # "Function.Compose"
filter = List.Filter(code_block, compose)
Match = Output(filter.out0)
map = List.Map(list=code_block, f_x=compose)
Bool = Output(map)
Other = Output(filter.out1)
code_block_2 = CodeBlock {  }
code_block_3 = CodeBlock {  }
