# Dynamo custom node List_FilterBySublistLengths.dyf (Dynamo 1.3.2.2480)
# category: ArupBimSF.List Functions
# filters out sublist that are not specified length_!!List

List_In = Input()
count = List.Count()  # unwired: arg0
map = List.Map(list=List_In, f_x=count)
length = Input(length: int = 1)
code_block = CodeBlock(n=map, x=length, seq=List_In) { mask = n <= x; filter = List.FilterByBoolMask(seq,mask); filter["in"]; filter["out"]; }
in_ = Output(code_block.out2)  # "in"
out = Output(code_block.out3)
