# Dynamo custom node List_FlatList_To_ListOfStrings.dyf "List_FlatList➜ListOfStrings" (Dynamo 1.3.2.2480)
# category: ArupBimSF.List Functions
# Converts a flatlist into a list of strings_!!List

ListIn = Input()
python_script = Python(IN[0]=ListIn)
# ---------- python_script.python (15 lines) ----------
import clr
clr.AddReference('ProtoGeometry')
from Autodesk.DesignScript.Geometry import *
#The inputs to this node will be stored as a list in the IN variable.
dataEnteringNode = IN

stringList = []
for x in dataEnteringNode[0]:
	try:
		tempString = str(x)
	except:
		tempString = "stringConversionFailed"
	stringList.append(tempString)
#Assign your output to the OUT variable
OUT = stringList
# ----------------------------------------
List_of_Strings = Output(python_script)
