# Dynamo custom node List_GetAllIndicesOfItem.dyf (Dynamo 1.3.2.2480)
# category: ArupBimSF.List Functions
# Get all the occurences of an item in a list.Works For Strings and numbers_!!List

List = Input()
code_block = CodeBlock(item=List) { Flatten({item}); }
Item = Input()
python_script = Python(IN[0]=code_block, IN[1]=Item)
# ---------- python_script.python (2 lines) ----------
indices = [i for i, x in enumerate(IN[0]) if x == IN[1]]
OUT = indices
# ----------------------------------------
Indices = Output(python_script)
