# Dynamo custom node List_GetFirstAndLast+.dyf (Dynamo 1.3.2.2480)
# category: ArupBimSF.List Functions
# get the first and last item from list_!!List_GetFirstAndLast+

list = Input(list : var[]..[])
code_block = CodeBlock(l1=list) { DSCore.List.DropItems(DSCore.List.DropItems(l1,1),-1); l1[{0,-1}]; }
code_block_2 = CodeBlock(x=code_block.out1) { x[0]; x[1]; }
First = Output(code_block_2.out0)
Last = Output(code_block_2.out1)
ListOut = Output(code_block.out0)
