# Dynamo custom node List_GetIndexFromSublists.dyf (Dynamo 1.3.2.2480)
# category: ArupBimSF.List Functions
# GEt item at index mapped_!!List

list = Input()
desired_index = Input()
getItemAtIndex = List.GetItemAtIndex(index=desired_index)  # unwired: list
map = List.Map(list=list, f_x=getItemAtIndex)
mapped = Output(map)
