# Dynamo custom node List_GetSublistLengths.dyf (Dynamo 1.3.2.2480)
# category: ArupBimSF.List Functions
# Get the length of sublists from input lists_!!List.Functions

List_In = Input()
count = List.Count()  # unwired: arg0
map = List.Map(list=List_In, f_x=count)
lengths = Output(map)
