# Dynamo custom node List_GroupAndReportByKey+.dyf (Dynamo 1.3.2.2480)
# category: ArupBimSF.List_Selection Tools
# groups an input list by input keys and outputs groups and unique keys_!!Select at Index+

concat = String.Concat()  # unwired: arg0, arg1
List_In = Input(List_In : var[]..[])
Keys_In = Input(Keys_In : var[])
string_from_object = FromObject(Keys_In)
groupByKey = List.GroupByKey(list=List_In, keys=string_from_object)
sortByKey = List.SortByKey(list=groupByKey.groups, keys=groupByKey.unique_keys)
code_block = CodeBlock { "_"; }
code_block_2 = CodeBlock { 2; }
obj_string_matchlength = Custom[Obj➜String_MatchLength](List_In=sortByKey.sorted_keys, Pad_With=code_block, ExtraPad=code_block_2)  # converts input object to flat list of strings and matches the length of all strings to that of the longest item in list
count = Count(sortByKey.sorted_list@L2, lacing=Longest)
string_from_object_2 = FromObject(count)
code_block_3 = CodeBlock { "0"; }
obj_string_matchlength_2 = Custom[Obj➜String_MatchLength](List_In=string_from_object_2, Pad_With=code_block_3)
combine = List.Combine(concat, obj_string_matchlength.PadRight, obj_string_matchlength_2.PadLeft)
Reports = Output(combine)
Get_Index = Input(Get_Index: var="---")
getItemAtIndex = List.GetItemAtIndex(list=sortByKey.sorted_keys, index=Get_Index)
ChosenKey = Output(getItemAtIndex)
getItemAtIndex_2 = List.GetItemAtIndex(list=sortByKey.sorted_list, index=Get_Index)
ChosenIndex = Output(getItemAtIndex_2)
All_Groups = Output(sortByKey.sorted_list)
