# Dynamo custom node List_GroupAndSortByKey+.dyf (Dynamo 1.3.2.2480)
# category: ArupBimSF.List Functions
# groups an input list by input keys and outputs groups and unique keys

List_In = Input(List_In : var[]..[])
Keys_In = Input(Keys_In : var[])
SortKeys = Input(SortKeys : bool = true)
python_script = Python(IN[0]=List_In, IN[1]=Keys_In, IN[2]=SortKeys)
# ---------- python_script.python (40 lines) ----------
# Sort data into bins according to a matching a set of criteria

import clr

# Get input
data = IN[0]		# Data (list of same length as criteria) to be binned
criteria = IN[1]	# List of criteria related to the data
toSort = IN[2]		# Whether to sort keys

# Find a unique set of values for the criteria, a list of all the bins
# to sort data into
bins = []
bins.append(criteria[0])
sorted = []
sorted.append([])

for i in range(1,len(criteria)):
	if criteria[i] in bins:
		continue
	else:
		bins.append(criteria[i])
		sorted.append([]) # initialize an empty list

# Sort bins if requested
if toSort:
	bins.sort()

# Sort data into bins
for i in range(len(criteria)):
	for j in range(len(bins)):
		if criteria[i] == bins[j]:
			temp = sorted[j]
			temp.append(data[i])
			sorted[j] = temp
			continue

# Assign your output to the OUT variable
OUT = []
OUT.append(sorted)
OUT.append(bins)
# ----------------------------------------
code_block = CodeBlock(OUT=python_script) { OUT[0]; OUT[1]; }
groups = Output(code_block.out0)
Unique_keys = Output(code_block.out1)
