# Dynamo custom node List_GroupSubpairs.dyf (Dynamo 1.3.2.2480)
# category: ArupBimSF.List Functions
# groups a list into subpairs matching each item with the item in front of and behind it_!!List.Functions

list = Input(list:var[]..[])
code_block = CodeBlock(l1=list)
# ---------- code_block.designscript (2 lines) ----------
DSCore.List.DropItems(DSCore.
List.Sublists(l1,0..1,1),-1);
# ----------------------------------------
lists = Output(code_block)
