# Dynamo custom node List_InsertMultiple+.dyf (Dynamo 1.3.2.2480)
# category: ArupBimSF.List Functions
# insert multiple elements at multiple indices_!!List

code_block = CodeBlock()
# ---------- code_block.designscript (23 lines) ----------
def primary( items : var[], indices : var[] )
{
i=SortIndexByValue(indices);
sortindices=List.GetItemAtIndex(indices,i);
sortitems=List.GetItemAtIndex(items,i);
a = List.Transpose({sortindices,sortitems});
return = a;
};


def insertmultiple(array : var[] ,items :var[], indices :var[])
{l={};
a = primary(items,indices);
return = [Imperative]
 {
 for (i in a)
  {l = Insert(array,i[1],i[0]);
  array = l;
  };
 return = array;
 };

};
# ----------------------------------------
array = Input()
items = Input()
index = Input()
code_block_2 = CodeBlock(array=array, items=items, index=index) { list = insertmultiple(array,items,index); }
array_2 = Output(code_block_2)  # "array"
