# Dynamo custom node List_IsEmpty.dyf (Dynamo 1.3.2.2480)
# category: ArupBimSF.List Functions
# Same as the Built-In Node except this one handles Nulls_!!List.Functions

List_In = Input()
code_block = CodeBlock(List_In=List_In) { DSCore.List.IsEmpty(List_In); }
bool = Output(code_block)
