# Dynamo custom node List_MergeSublists.dyf (Dynamo 1.3.2.2480)
# category: ArupBimSF.List Functions
# Merges sublists into strings with seperator_!!List.Functions

Seperator = Input(Seperator : string = " ")
List = Input()
string_from_object = FromObject(List)
join = String.Join(Seperator, string_from_object)
Out = Output(join)
