# Dynamo custom node List_Remove Matching.dyf (Dynamo 1.3.2.2480)
# category: ArupBimSF.^FixMe
# Removes Matching Items and reports back all Match,&No Match from Both Lists

b_ItemsToTake = Input()
a_TakeFromList = Input()
python_script = Python(IN[0]=b_ItemsToTake, IN[1]=a_TakeFromList)
# ---------- python_script.python (13 lines) ----------
listA = IN[0]
listB = IN[1]
unmatched = []

#listC = [x for x in listA if x not in listB]
for x in range(len(listA)):
#	s = set(listA)
	if listA[x] in listB:
		listB.remove(listA[x])
	else:
		unmatched.append(listA[x])

OUT = [listB, unmatched]
# ----------------------------------------
code_block = CodeBlock { 0; }
getItemAtIndex = List.GetItemAtIndex(list=python_script, index=code_block)
a_Reduced_List = Output(getItemAtIndex)
code_block_2 = CodeBlock { 1; }
getItemAtIndex_2 = List.GetItemAtIndex(list=python_script, index=code_block_2)
b_Unmatched_Items = Output(getItemAtIndex_2)
