# Dynamo custom node List_Replace Item At Index+.DYF (Dynamo 1.3.2.2480)
# category: ArupBimSF.List Functions
# Replaces the item at a given index (or list of indices) of a list by another item (From Clockwork)_!LI

List_In = Input()
replacement = Input()
code_block = CodeBlock(item=replacement) { Flatten({item}); }
index = Input()
code_block_2 = CodeBlock(item=index) { Flatten({item}); }
python_script = Python(IN[0]=List_In, IN[1]=code_block, IN[2]=code_block_2)
# ---------- python_script.python (8 lines) ----------
_list = IN[0]
rValues = IN[1]
iValues = IN[2]
if len(iValues) > 1 and len(rValues) == 1:
	rValues = [rValues[0]] * len(iValues)
for (index, value) in zip(iValues, rValues):
	_list[index] = value
OUT = _list
# ----------------------------------------
List_Out = Output(python_script)
