# Dynamo custom node List_SplitOddAndEven.dyf (Dynamo 1.3.2.2480)
# category: ArupBimSF.List Functions
# Splits a list by even and odd_!!List

list = Input(list:var[]..[])
code_block = CodeBlock(l1=list) { DSCore.List.TakeEveryNthItem(l1,2,0); DSCore.List.DropEveryNthItem(l1,2,0); }
odd = Output(code_block.out0)
even = Output(code_block.out1)
