# Dynamo custom node List_ToClipBoard_AsMultilineString.dyf "List➜ClipBoard_AsMultilineString" (Dynamo 1.3.2.2480)
# category: ArupBimSF.Data Transfer
# sends input list to clipboard as a single multi-line string

List_In = Input()
list_multilinestring = Custom[List➜MultilineString](List_In=List_In)  # converts a list into a single string with line breaks
python_script = Python(IN[0]=list_multilinestring)
# ---------- python_script.python (8 lines) ----------
import clr
clr.AddReference('System.Windows.Forms')
from System.Windows.Forms import Clipboard
try:
	Clipboard.SetText(IN[0])
	OUT = IN[0]
except:
	OUT = 'Data could not be copied to clipboard'
# ----------------------------------------
to_clipboard = Output(python_script)
