# Dynamo custom node List_ToDesignScriptString.dyf "List➜DesignScriptString" (Dynamo 1.3.2.2480)
# category: ArupBimSF.List Functions
# coverts a list into a Design Script String

list = Input(list : string[])
python_script = Python(IN[0]=list)
# ---------- python_script.python (18 lines) ----------
import clr
clr.AddReference('ProtoGeometry')

strs = IN[0]

ds = "{"

for i in range(len(strs)):
	ds = ds + "\"" + strs[i]

	if i == len(strs)-1:
		ds = ds + "\""
	else:
		ds = ds + "\",\n"

ds = ds + "};"

OUT = ds
# ----------------------------------------
string = Output(python_script)
