# Dynamo custom node List_ToListOfStrings.dyf "List➜ListOfStrings" (Dynamo 1.3.2.2480)
# category: ArupBimSF.List Functions
# using python methods

List_In = Input()
python_script = Python(IN[0]=List_In)
# ---------- python_script.python (15 lines) ----------
import clr
clr.AddReference('ProtoGeometry')
from Autodesk.DesignScript.Geometry import *
#The inputs to this node will be stored as a list in the IN variable.
dataEnteringNode = IN

stringList = []
for x in dataEnteringNode[0]:
	try:
		tempString = str(x)
	except:
		tempString = "stringConversionFailed"
	stringList.append(tempString)
#Assign your output to the OUT variable
OUT = stringList
# ----------------------------------------
StringsOut = Output(python_script)
