# Dynamo custom node List_ToMultilineString.dyf "List➜MultilineString" (Dynamo 1.3.2.2480)
# category: ArupBimSF.String Functions
# converts a list into a single string with line breaks

List_In = Input()
string_from_object = FromObject(List_In)
python_script = Python(IN[0]=string_from_object)
# ---------- python_script.python (3 lines) ----------
lst = IN[0]
jnd = str('\n'.join(lst))
OUT = jnd
# ----------------------------------------
StringOut = Output(python_script)
