# Dynamo custom node List_ToString_WithSeperator.dyf "List➜String_WithSeperator" (Dynamo 1.3.2.2480)
# category: ArupBimSF.String Functions
# converts a list into a single string with a seperator

List_In = Input()
Suffix = Input()
Seperator = Input()
python_script = Python(IN[0]=List_In, IN[1]=Suffix, IN[2]=Seperator)
# ---------- python_script.python (14 lines) ----------
import clr
clr.AddReference('ProtoGeometry')
from Autodesk.DesignScript.Geometry import *
#The inputs to this node will be stored as a list in the IN variable.
dataEnteringNode = IN
fileExtension = IN[1]
underscore = IN[2]

newString = []
for i in IN[0]:
	newString.append(underscore.join(i) + fileExtension)
	
#Assign your output to the OUT variable
OUT = newString
# ----------------------------------------
OUT = Output(python_script)
