# Dynamo custom node List_TurnIntoSingleList.dyf (Dynamo 1.3.2.2480)
# category: ArupBimSF.List Functions
# Converts a collection or items and lists into a single one dimensional List_!!Li

unknownItem = Input()
create = List.Create(unknownItem)
flatten = Flatten(create)
List = Output(flatten)
