# Dynamo custom node List_UniqueItems+.dyf (Dynamo 1.3.2.2480)
# category: ArupBimSF.List Functions
# Count the number of times each individual unique element occurs in a list_!li_!fi

List_In = Input()
ReFresh = Input(ReFresh : bool = true)
code_block = CodeBlock(List_In, ReFresh)
# ---------- code_block.designscript (11 lines) ----------
list;
come;

[Imperative]

{
 if (come ==true)
  return = list;
 else
  return = list;
};
# ----------------------------------------
code_block_2 = CodeBlock(item=code_block.out2) { Flatten({item}); }
identity = Object.Identity(code_block_2)
groupByKey = List.GroupByKey(list=code_block_2, keys=identity)
Unique_Items = Output(groupByKey.unique_keys)
firstIndexOf = List.FirstIndexOf(list=code_block_2, item=groupByKey.unique_keys)
First_Index_of = Output(firstIndexOf)
count = List.Count(groupByKey.groups, lacing=Longest)
Unique_Item_Count = Output(count)
allIndicesOf = List.AllIndicesOf(list=code_block_2, item=groupByKey.unique_keys)
All_Indices_Of_Each = Output(allIndicesOf)
