# Dynamo custom node Load_Fabrication_Services.dyf (Dynamo 1.3.2.2480)
# category: ArupBimSF.Revit.Fabrication
# Loads fabrication services to active doc

Service_IDs = Input()
fabrication_load_service_s = Python(IN[0]=Service_IDs)
# ---------- fabrication_load_service_s.python (23 lines) ----------
import clr
clr.AddReference("RevitAPI")
import Autodesk
from Autodesk.Revit.DB import FabricationConfiguration
clr.AddReference("RevitServices")
import RevitServices
from RevitServices.Persistence import DocumentManager
from RevitServices.Transactions import TransactionManager

Inpt = UnwrapElement(IN[0])
ItmList = list(

Doc = DocumentManager.Instance.CurrentDBDocument
TransactionManager.Instance.EnsureInTransaction(Doc)

Config = FabricationConfiguration.GetFabricationConfiguration(Doc)
Config.ReloadConfiguration()
LServices = Config.LoadServices(Inpt)
ItmList.append(LServices)

TransactionManager.Instance.TransactionTaskDone()

OUT = ItmList
# ----------------------------------------
Services_Loaded = Output(fabrication_load_service_s)
