# Dynamo custom node Locate_OriginOrPointInView.dyf (Dynamo 1.3.2.2480)
# category: ArupBimSF.Revit.Location_References
# Locate the Origin Point of a view or family with a circle at 0,0,0

Points_In = Input(Points_In : Autodesk.Point = Autodesk.Point.Origin())
ReFresh = Input(ReFresh : bool = false)
code_block = CodeBlock(Points_In, ReFresh)
# ---------- code_block.designscript (11 lines) ----------
list;
come;

[Imperative]

{
 if (come ==true)
  return = list;
 else
  return = list;
};
# ----------------------------------------
get_ActiveView = Custom[Get_ActiveView](Refresh=code_block.out2)  # captures your active view and keeps it as an input
get_ViewType = Custom[Get_ViewType](View=get_ActiveView)  # Returns the View Type Of Input Views
code_block_2 = CodeBlock { "DraftingView"; }
eq = get_ViewType == code_block_2
Radius = Input(Radius : double = 1)
byCenterPointRadius = Circle.ByCenterPointRadius(centerPoint=code_block.out2, radius=Radius)
code_block_3 = CodeBlock(item=byCenterPointRadius) { Flatten({item}); }
byCurve = DetailCurve.ByCurve(get_ActiveView, code_block_3)
byCurve_2 = ModelCurve.ByCurve(code_block_3)
if_ = If(test=eq, true=byCurve, false=byCurve_2)
code_block_4 = CodeBlock { "Center Mark Visible"; }
code_block_5 = CodeBlock { 1; }
setParameterByName = Element.SetParameterByName(element=if_, parameterName=code_block_4, value=code_block_5)
