# Dynamo custom node MEP_CSI_DisciplineCodes.dyf (Dynamo 1.3.2.2480)
# category: ArupSF.Project_Info

string = StringInput("""GN
ZZ
ST
FP
PL
ME
MP
MD
EL
EP
LT
TC
AV
SS
zBL""")
# note: You can manually modify these lists.  Or you can also copy and paste from excel
string_2 = StringInput("""00 00 00
01 00 00
05 00 00
21 00 00
22 00 00
23 00 00
23 20 00
23 30 00
26 00 00
26 10 00
26 50 00
27 00 00
27 40 00
28 40 00
99 99 99""")
discipline = StringInput("""Project Info
MEP
Structural
Fire Protection
Plumbing
Mechanical
Mechanical
Mechanical
Electrical
Electrical
Electrical
Telecom
Audio-Visual
Safety&Security
zProject Set-up""")
string_3 = StringInput("""---
---
---
---
---
---
Pipe
Duct
---
Power
Lighting
---
---
---
---""")
string_4 = StringInput("""GNRL
MEPFC
STRC
FPRO
PLMB
MECH
M Pipe
M Duct
ELEC
E PWR
E LTG
TCOM
AUVI
ESSY
zPrS""")
string_5 = StringInput("""200
200
200
200
200
300
200
200
200
300
200
300
300
100
999""")
string_6 = StringInput("""G
ZZ
S
F
P
M
M
M
E
E
E
T
AV
TZ
zBL""")
join = List.Join(string_2, discipline, string_3, string_4, string_5, string_6)
multilinestring_list = Custom[MultilineString➜List]()  # converts a string with line breaks in to a list of strings; unwired: String_In
map = List.Map(list=join, f_x=multilinestring_list)
Get_Index = Input(Get_Index: int = 0)
getItemAtIndex = List.GetItemAtIndex(list=map, index=Get_Index, lacing=Longest)
code_block = CodeBlock(x=getItemAtIndex) { x[0]; x[1]; x[2]; x[3]; x[4]; x[5]; }
n00_CSI_MasterFormat = Output(code_block.out0)  # "00_CSI MasterFormat"
n01_Discipline_Name = Output(code_block.out1)  # "01_Discipline_Name"
n02_Abbreviation = Output(code_block.out2)  # "02_Abbreviation"
n03_Sheet_Prefix = Output(code_block.out3)  # "03_Sheet_Prefix"
n04_View_Sheet_Series = Output(code_block.out4)  # "04_View/Sheet Series"
n05_SheetPrefix = Output(code_block.out5)  # "05_SheetPrefix"
n06_ListOut = Output(map)  # "06_ListOut"
n07_List_Multiline = Output(join)  # "07_List_Multiline"
