# Dynamo custom node Math_Round Floor.dyf (Dynamo 1.3.2.2480)
# category: ArupBimSF.Math
# Rounds number to user input precision

DoubleIn = Input(DoubleIn : double)
precision = Input(precision : double = 1)
code_block = CodeBlock(a=DoubleIn, b=precision) { Math.Floor(a/b)*b; }
dbl = Output(code_block)
