# Dynamo custom node MepSystem_DivideSystem.dyf (Dynamo 1.3.2.2480)
# category: ArupBimSF.Revit.Mep_Systems
# divides an MEP system

System = Input()
python_divide_system = Python(IN[0]=System)
# ---------- python_divide_system.python (34 lines) ----------
import clr

clr.AddReference("RevitServices")
import RevitServices
from RevitServices.Persistence import DocumentManager
from RevitServices.Transactions import TransactionManager
doc = DocumentManager.Instance.CurrentDBDocument

clr.AddReference("RevitAPI")
import Autodesk
from Autodesk.Revit.DB import *

clr.AddReference("RevitNodes")
import Revit
clr.ImportExtensions(Revit.Elements)
clr.ImportExtensions(Revit.GeometryConversion)

if isinstance(IN[0], list):
	systems = UnwrapElement(IN[0])
else:
	systems = [UnwrapElement(IN[0])]
	
listout = []
TransactionManager.Instance.EnsureInTransaction(doc)
for sys in systems:
	if sys.IsMultipeNetwork:
		ids = sys.DivideSystem(doc)
		sublist = []
		for id in ids:
			sublist.append(doc.GetElement(id).ToDSType(True))
		listout.append(sublist)
TransactionManager.Instance.TransactionTaskDone()

OUT = listout
# ----------------------------------------
Separated_Systems = Output(python_divide_system)
