# Dynamo custom node MepSystem_Is Dividable.dyf (Dynamo 1.3.2.2480)
# category: ArupBimSF.Revit.Mep_Systems
# determines whether or not a system is dividiable

System = Input()
python_is_dividable = Python(IN[0]=System)
# ---------- python_is_dividable.python (33 lines) ----------
import clr

clr.AddReference("RevitServices")
import RevitServices
from RevitServices.Persistence import DocumentManager
from RevitServices.Transactions import TransactionManager
doc = DocumentManager.Instance.CurrentDBDocument

clr.AddReference("RevitAPI")
import Autodesk
from Autodesk.Revit.DB import *

clr.AddReference("RevitNodes")
import Revit
clr.ImportExtensions(Revit.Elements)
clr.ImportExtensions(Revit.GeometryConversion)

if isinstance(IN[0], list):
	systems = UnwrapElement(IN[0])
	toggle = 0
else:
	systems = [UnwrapElement(IN[0])]
	toggle = 1
	
listout = []

for sys in systems:
	listout.append(sys.IsMultipleNetwork)

if toggle:
	OUT = listout[0]
else:
	OUT = listout
# ----------------------------------------
Bool = Output(python_is_dividable)
