# Dynamo custom node Mep_CategoriesGroups_Db.dyf (Dynamo 1.3.2.2480)
# category: ArupBimSF.Revit_Db.Categories
# A collection of MEP Categories

categories_MEP_Common = StringInput("""Spaces
HVAC Zones
Rooms""")
piping = StringInput("""Pipe Placeholders
Piping Systems
Pipe Segments
Pipes
Pipe Fittings
Pipe Accessories
Sprinklers
Plumbing Fixtures""")
mechanical = StringInput("""Duct Systems
Duct Insulations
Duct Linings
Duct Placeholders
Pipe Placeholders
Piping Systems
Pipe Segments
Air Terminals
Duct Accessories
Duct Fittings
Ducts
Mechanical Equipment
Pipes
Pipe Fittings
Pipe Accessories
Flex Pipes
Flex Ducts
Plumbing Fixtures""")
categories_MEP_Electrical = StringInput("""Conduits
Conduit Fittings
Lighting Fixtures
Wires
Cable Tray Runs
Conduit Runs
Electrical Fixtures
Electrical Circuits
Electrical Spare/Space Circuits
Switch System
Electrical Equipment
Cable Trays
Cable Tray Fittings""")
communincations = StringInput("""Data Devices
Nurse Call Devices
Security Devices
Telephone Devices
Fire Alarm Devices
Communication Devices
Lighting Devices""")
create = List.Create(categories_MEP_Common, piping, mechanical, categories_MEP_Electrical, communincations)
multilinestring_list = Custom[MultilineString➜List](String_In=create@@L1)  # converts a string with line breaks in to a list of strings
sort = List.Sort()  # unwired: arg0
map = List.Map(list=multilinestring_list, f_x=sort)
byName = Category.ByName(map@@L2)
code_block = CodeBlock(x=byName) { x[0]; x[1]; x[2]; x[3]; x[4]; }
n01_Spaces_Zones = Output(code_block.out0)  # "01_Spaces&Zones"
n22_Plumbing = Output(code_block.out1)  # "22_Plumbing"
n23_Mechanical = Output(code_block.out2)  # "23_Mechanical"
n26_Electrical = Output(code_block.out3)  # "26_Electrical"
n27_ComDevices = Output(code_block.out4)  # "27_ComDevices"
All_Categories = Output(byName)  # "➜All_Categories"
