# Dynamo custom node Mep_Categories_Db_Non-System.dyf (Dynamo 1.3.2.2480)
# category: ArupBimSF.Revit_Db.Categories
# A collection of MEP Categories

code_block = CodeBlock { "Devices"; "Equipment"; "Fixtures & Devices"; }
join = List.Join(code_block.out0, code_block.out1, code_block.out2)
Groups = Output(join)
devices = StringInput("""Communication Devices
Data Devices
Nurse Call Devices
Security Devices
Telephone Devices
Fire Alarm Devices
Lighting Devices""")
equipment = StringInput("""Electrical Equipment
Mechanical Equipment""")
fixtures_terminals = StringInput("""Lighting Fixtures
Electrical Fixtures
Plumbing Fixtures
Sprinklers
Air Terminals""")
join_2 = List.Join(devices, equipment, fixtures_terminals)
multilinestring_list = Custom[MultilineString➜List](String_In=join_2, lacing=Longest)  # converts a string with line breaks in to a list of strings
sort = List.Sort(multilinestring_list)
byName = Category.ByName(sort@L2)
Get_Group = Input(Get_Group: int=0)
getItemAtIndex = List.GetItemAtIndex(list=byName, index=Get_Group)
flatten = Flatten(getItemAtIndex)
ChosenGroup = Output(flatten)
AllGroups = Output(sort)
