# Dynamo custom node Mep_SystemTypes_Db.dyf (Dynamo 1.3.2.2480)
# category: ArupBimSF.Revit.Mep_Systems
# get Mep system Types by index and category

string = StringInput("""Controls & Comms
Electrical
Fire Prot
Hvac
Piping
Other""")
multilinestring_list = Custom[MultilineString➜List](String_In=string)  # converts a string with line breaks in to a list of strings
Groups = Output(multilinestring_list)
controls_comms = StringInput("""Communication
Controls
DataCircuit
FireAlarm
NurseCall
Security
SwitchTopology
Telephone""")
electrical = StringInput("""PowerBalanced
PowerCircuit
PowerUnBalanced
CableTrayConduit""")
fire_prot = StringInput("""FireProtectDry
FireProtectOther
FireProtectPreaction
FireProtectWet""")
HVAC = StringInput("""ExhaustAir
OtherAir
Recirculation
ReturnAir
SupplyAir
Fitting""")
piping = StringInput("""SupplyHydronic
ReturnHydronic
DomesticColdWater
DomesticHotWater
Sanitary
Storm
OtherPipe
CondensateDrain
Fitting
Vent""")
other = StringInput("""UndefinedSystemClassification
Global""")
join = List.Join(controls_comms, electrical, fire_prot, HVAC, piping, other)
multilinestring_list_2 = Custom[MultilineString➜List](String_In=join)
GetGroup = Input(GetGroup: int = 0)
getItemAtIndex = List.GetItemAtIndex(list=multilinestring_list_2, index=GetGroup)
ChosenGroup = Output(getItemAtIndex)
sort = List.Sort(getItemAtIndex)
GetType = Input(GetType: int = 0)
graph_SeqPassthru = Custom[Graph_SeqPassthru](passThrough=GetType, waitFor=sort)  # forces an operation to run in sequence.
getItemAtIndex_2 = List.GetItemAtIndex(list=sort, index=graph_SeqPassthru)
ChosenType = Output(getItemAtIndex_2)
AllTypes = Output(multilinestring_list_2)
