# Dynamo custom node Merge_Array_ToDelimString.dyf "Merge_Array➜DelimString" (Dynamo 1.3.2.2480)
# category: ArupBimSF.List Functions
# Converts a list into a comma deliminated string

Array_In = Input()
Refresh = Input(Refresh : bool = true)
code_block = CodeBlock(Array_In, Refresh)
# ---------- code_block.designscript (11 lines) ----------
list;
come;

[Imperative]

{
 if (come ==true)
  return = list;
 else
  return = list;
};
# ----------------------------------------
string_from_array = FromArray(code_block.out2)
code_block_2 = CodeBlock(t6=string_from_array) { t5 = String.Remove(t6, 0, 1); t7 = String.Length(t5); x = t7; t1 = x - 1; t8 = String.Remove(t5, t1, 1); }
String_Out = Output(code_block_2.t8)
Seperator = Input(Seperator: string = "")
AddToStart = Input(AddToStart: string = "{")
AddToEnd = Input(AddToEnd: string = "}")
join = String.Join(Seperator, AddToStart, code_block_2.t8, AddToEnd)
String = Output(join)  # "String+"
