# Dynamo custom node MultilineString_ToList.dyf "MultilineString➜List" (Dynamo 1.3.2.2480)
# category: ArupBimSF.String Functions
# converts a string with line breaks in to a list of strings

String_In = Input()
code_block = CodeBlock(t3=String_In)
# ---------- code_block.designscript (4 lines) ----------
t1 = "
";
t2 = String.Split(t3, {t1});
t4 = String.TrimWhitespace(t2);
# ----------------------------------------
List_Out = Output(code_block.t4)
