# Dynamo custom node Number_WithinRange.dyf (Dynamo 1.3.2.2480)
# category: ArupBimSF.Math
# Takes a list of numbers.  Get numbers that are almost equal determined by a set tollerance

code_block = CodeBlock()
# ---------- code_block.designscript (4 lines) ----------
def Almost1(a,b,tol){
res = Math.Abs(a - b);
return = res <= tol;
};
# ----------------------------------------
Subject = Input(Subject:var)
Field = Input(Field:var)
DefineRange = Input(DefineRange: double = 0.0001)
code_block_2 = CodeBlock(a=Subject, b=Field, tol=DefineRange) { Almost1(a,b,tol); }
bool = Output(code_block_2)
