# Dynamo custom node Number_toString.dyf "Number➜String" (Dynamo 1.3.2.2480)
# category: ArupBimSF.String Functions
# Converts a number to a string

num = Input(num:var[])
digits = Input(digits:int = null)
python_script = Python(IN[0]=num, IN[1]=digits)
# ---------- python_script.python (23 lines) ----------
# Copyright(c) 2017, Dimitar Venkov
# @5devene, dimitar.ven@gmail.com
# www.badmonkeys.net

def tolist(x):
	if hasattr(x,'__iter__'): return x
	else : return [x]

def output(x):
	if len(x) == 1: return x[0]
	else : return x

def n2s(n, digits=IN[1]):
	if digits is not None:
		n = round(n, digits)
	s1 = str(n)
	if s1[-2:] == ".0":
		s1 = s1[:-2]
	return s1

nums = tolist(IN[0])

OUT = output(map(n2s, nums) )
# ----------------------------------------
str = Output(python_script)
