# Dynamo custom node Obj_ToString_MatchLength.dyf "Obj➜String_MatchLength" (Dynamo 1.3.2.2480)
# category: ArupBimSF.List Functions
# converts input object to flat list of strings and matches the length of all strings to that of the longest item in list

List_In = Input()
string_from_object = FromObject(List_In)
flatten = Flatten(string_from_object)
length = String.Length(flatten, lacing=Longest)
maximumItem = List.MaximumItem(length)
ExtraPad = Input(ExtraPad: int =0)
code_block = CodeBlock(x=maximumItem, p=ExtraPad) { x+p; }
Pad_With = Input(Pad_With: var = " ")
string_from_object_2 = FromObject(Pad_With)
padRight = String.PadRight(string_from_object, code_block, string_from_object_2, lacing=Longest)
PadRight = Output(padRight)
padLeft = String.PadLeft(string_from_object, code_block, string_from_object_2, lacing=Longest)
PadLeft = Output(padLeft)
