# Dynamo custom node Object Is String.dyf (Dynamo 1.3.2.2480)
# category: ArupBimSF.^TestingGrounds
# boolean node to determine if input items are strings

List_In = Input(List_In : var)
code_block = CodeBlock(t3=List_In) { t2 = DSCore.Object.Type(t3); t4 = t2 == "System.String"; }
Boolean = Output(code_block.t4)
filterByBoolMask = List.FilterByBoolMask(list=List_In, mask=code_block.t4)
Elements_True = Output(filterByBoolMask.in)
Elements_False = Output(filterByBoolMask.out)
