# Dynamo custom node Object_toString.Contains_Basic.dyf "Object➜String.Contains_Basic" (Dynamo 1.3.2.2480)
# category: ArupBimSF.List Functions
# filters a list of objects for input string  values

List_In = Input()  # String
code_block = CodeBlock(items=List_In) { Flatten(DSCore.List.AddItemToFront(items,DSCore.List.Empty)); }
string_from_object = FromObject()  # unwired: arg0
Search_For = Input()  # String
string_from_object_2 = FromObject(Search_For)
code_block_2 = CodeBlock { true; }
contains = String.Contains(searchFor=string_from_object_2, ignoreCase=code_block_2)  # unwired: str
compose = ComposeFunctions(string_from_object, contains)  # "Function.Compose"
filter = List.Filter(code_block, compose)
Match = Output(filter.out0)
Others = Output(filter.out1)
