# Dynamo custom node OpenFile_FromPath_OS.dyf (Dynamo 1.3.2.2480)
# category: ArupBimSF.Directory & OS
# Open a file or folder from a designated path In its native program

FilePath_String = Input(FilePath_String:string = " ")
reset = Input(reset: bool= true)
python_script = Python(IN[0]=FilePath_String, IN[1]=reset)
# ---------- python_script.python (7 lines) ----------
a=IN[0]
import sys
sys.path.append('C:/Program Files (x86)/IronPython 2.7/Lib')
import os
os.startfile(a)
###############################
OUT = "Success! Check open files or folders"
# ----------------------------------------
data = Output(python_script)
