# Dynamo custom node Optimize_Bin Packing.dyf (Dynamo 1.3.2.2480)
# category: ArupBimSF.Patterns & Logic
# Groups a list of numeric values in bins according to the First Fit Decreasing algorithm based on a maximum cumulative value.
# This method can be used to optimize the planning of cut lengths of linear elements.
# The IndicesPerBin refer to the indices of the decreasing sorted value list, ordered per bin.

Values = Input(Values: double[])
sort = List.Sort(Values)
reverse = List.Reverse(sort)
BinSize = Input(BinSize:double)
python_script = Python(IN[0]=reverse, IN[1]=BinSize)
# ---------- python_script.python (40 lines) ----------
#In this script values are sorted into bins with a fixed maximum size.
#The sorting occurs according to the First Fit Decreasing algorithm.
#The input for "Values" need to be sorted in Decreasing order for an optimal result
#Authored by Dieter Vermeulen, Autodesk (2017)

import clr

Values=IN[0]
BinSize=IN[1]

Bin=[]  			#Array of packed bins
Waste=[]			#List of waste per bin
ValueIndices=[]	#Index of the value assigned to the bin
result=False
j=0 #Initiate counter for the sorting index

for val in Values:
	i=0  #Reset Counter for the bin assignment
	n=len(Bin)
	while (i < n):
		if Waste[i]-val >= 0:
			Bin[i].append(val)
			Waste[i]=Waste[i]-val
			ValueIndices[i].append(j)
			i=n
			result = True
		else:
			i=i+1
			result = False
			
	if not result:
			Bin.append([val])
			Waste.append(BinSize-val)
			ValueIndices.append([j])
	j=j+1	
			
	
	
#Assign your output to the OUT variable.
OUT = Bin, Waste, ValueIndices
# ----------------------------------------
code_block = CodeBlock(a=python_script)
# ---------- code_block.designscript (6 lines) ----------
//Bin Packing Result
a[0];
//Waste
a[1];
//Values indexed per bin
a[2];
# ----------------------------------------
BinPackingResult = Output(code_block.out0)
Waste = Output(code_block.out1)
IndicesPerBin = Output(code_block.out2)
