# Dynamo custom node ParameterGroups_rdb.dyf (Dynamo 1.3.2.2480)
# category: ArupBimSF.Revit.Parameters
# Outputs Revit parameter  Groups and allows you to select one at an index_#pa#rdb

python_script = Python()  # unwired: IN[0]
# ---------- python_script.python (18 lines) ----------
import clr
clr.AddReference('ProtoGeometry')
from Autodesk.DesignScript.Geometry import *

# Import DocumentManager and TransactionManager
clr.AddReference("RevitServices")
import RevitServices
from RevitServices.Persistence import DocumentManager
from RevitServices.Transactions import TransactionManager

# Import RevitAPI
clr.AddReference("RevitAPI")
import Autodesk
from Autodesk.Revit.DB import *
import System

#Assign your output to the OUT variable
OUT = System.Enum.GetValues(BuiltInParameterGroup)
# ----------------------------------------
string_from_object = FromObject()  # unwired: arg0
sortByFunction = SortByFunction(python_script, string_from_object)
Parameter_Groups = Output(sortByFunction)
Get_Group = Input(Get_Group: int = 0)
getItemAtIndex = List.GetItemAtIndex(list=sortByFunction, index=Get_Group)
Chosen_Group = Output(getItemAtIndex)
