# Dynamo custom node Parameter_ExistsInElement.dyf (Dynamo 1.3.2.2480)
# category: ArupBimSF.Revit.Parameters
# checks input elements for a parameter by name_!pa!bool!el

element = Input()
code_block = CodeBlock(item=element) { Flatten({item}); }
ParamName = Input(ParamName: string)
python_script = Python(IN[0]=code_block, IN[1]=ParamName)
# ---------- python_script.python (28 lines) ----------
# This node was originally created by Andreas Dieckmann
# and only updated by Konrad K Sobon to work with Revit 2016

# Copyright(c) 2015, Konrad K Sobon
# @arch_laboratory, http://archi-lab.net

# Modified to Clockwork coding style by Andreas Dieckmann

import clr
clr.AddReference('RevitAPI')
from Autodesk.Revit.DB import *

items = UnwrapElement(IN[0])
param = IN[1]
elementList = []

for item in items:
	try:
		params = item.Parameters
		paramNames = [i.Definition.Name for i in params]
		if param in paramNames:
			elementList.append(True)
		else:
			elementList.append(False)
	except:
		elementList.append(False)

OUT = elementList
# ----------------------------------------
python_script_2 = Python(IN[0]=code_block, IN[1]=python_script)
# ---------- python_script_2.python (4 lines) ----------
check = IN[0]
items = IN[1]
if isinstance(check, (list)): OUT = items
else: OUT = items[0]
# ----------------------------------------
bool = Output(python_script_2)
