# Dynamo custom node Parameter_UnitTypes.dyf (Dynamo 1.3.2.2480)
# category: ArupBimSF.Revit.Parameters
# All of the revit parameter Unit types

string = StringInput("""Acceleration
Angle
Area
AreaForce
AreaForcePerLength
BarDiameter
ColorTemperature
CrackWidth
Currency
DisplacementDeflection
ElectricalApparentPower
ElectricalCableTraySize
ElectricalConduitSize
ElectricalCurrent
ElectricalDemandFactor
ElectricalEfficacy
ElectricalFrequency
ElectricalIlluminance
ElectricalLuminance
ElectricalLuminousFlux
ElectricalLuminousIntensity
ElectricalPotential
ElectricalPower
ElectricalPowerDensity
ElectricalResistivity
ElectricalTemperature
ElectricalTemperatureDifference
ElectricalWattage
Energy
FamilyType
FixtureUnit
Force
ForceLengthPerAngle
ForcePerLength
HVACAirflow
HVACAirflowDensity
HVACAirflowDividedByCoolingLoad
HVACAirflowDividedByVolume
HVACAreaDividedByCoolingLoad
HVACAreaDividedByHeatingLoad
HVACCoefficientOfHeatTransfer
HVACCoolingLoad
HVACCoolingLoadDividedByArea
HVACCoolingLoadDividedByVolume
HVACCrossSection
HVACDensity
HVACDuctInsulationThickness
HVACDuctLiningThickness
HVACDuctSize
HVACEnergy
HVACFactor
HVACFriction
HVACHeatGain
HVACHeatingLoad
HVACHeatingLoadDividedByArea
HVACHeatingLoadDividedByVolume
HVACPermeability
HVACPower
HVACPowerDensity
HVACPressure
HVACRoughness
HVACSlope
HVACSpecificHeat
HVACSpecificHeatOfVaporization
HVACTemperature
HVACTemperatureDifference
HVACThermalConductivity
HVACThermalMass
HVACThermalResistance
HVACVelocity
HVACViscosity
Image
Integer
Invalid
Length
LinearForce
LinearForceLengthPerAngle
LinearForcePerLength
LinearMoment
LoadClassification
Mass
MassDensity
MassPerUnitArea
MassPerUnitLength
Material
Moment
MomentOfInertia
MultilineText
Number
NumberOfPoles
Period
PipeDimension
PipeInsulationThickness
PipeMass
PipeMassPerUnitLength
PipeSize
PipingDensity
PipingFlow
PipingFriction
PipingPressure
PipingRoughness
PipingSlope
PipingTemperature
PipingTemperatureDifference
PipingVelocity
PipingViscosity
PipingVolume
Pulsation
ReinforcementArea
ReinforcementAreaPerUnitLength
ReinforcementCover
ReinforcementLength
ReinforcementSpacing
ReinforcementVolume
Rotation
SectionArea
SectionDimension
SectionModulus
SectionProperty
Slope
Stress
StructuralFrequency
StructuralVelocity
SurfaceArea
Text
ThermalExpansion
UnitWeight
URL
Volume
WarpingConstant
Weight
WeightPerUnitLength
WireSize
YesNo""")
multilinestring_list = Custom[MultilineString➜List](String_In=string)  # converts a string with line breaks in to a list of strings
List_Out = Output(multilinestring_list)
