# Dynamo custom node PointCloud_CreateFilter.dyf (Dynamo 1.3.2.2480)
# category: ArupBimSF.Revit.Links_PointClouds

Bounding_Box = Input()
empty = List.Empty()
create = List.Create(Bounding_Box, empty)
flatten = Flatten(create)
maxPoint = BoundingBox.MaxPoint(Bounding_Box)
minPoint = BoundingBox.MinPoint(Bounding_Box)
byStartPointEndPoint = Line.ByStartPointEndPoint(startPoint=maxPoint, endPoint=minPoint)
code_block = CodeBlock { 0.5; }
pointAtParameter = Curve.PointAtParameter(curve=byStartPointEndPoint, param=code_block)
pointcloudfilter = Python(IN[0]=flatten, IN[1]=pointAtParameter)
# ---------- pointcloudfilter.python (53 lines) ----------
#Copyright(c) 2014, Jason Andersen, jason@serialnonstandard.com

# Default imports
import clr

# Import RevitAPI
clr.AddReference("RevitAPI")
import Autodesk
from Autodesk.Revit.DB import *
from Autodesk.Revit.DB.PointClouds import *
import System.Collections.Generic
from System.Collections.Generic import List

# Import DocumentManager and TransactionManager
clr.AddReference("RevitServices")
import RevitServices
from RevitServices.Persistence import DocumentManager
from RevitServices.Transactions import TransactionManager

clr.AddReference("RevitNodes")
import Revit
clr.ImportExtensions(Revit.Elements)
clr.ImportExtensions(Revit.GeometryConversion)

doc =  DocumentManager.Instance.CurrentDBDocument
app =  DocumentManager.Instance.CurrentUIApplication.Application

#elements coming in
elements = UnwrapElement(IN[0])
midpoint = UnwrapElement(IN[1])

# global variables
v_filters = []
v_planes = []

# work though each bounding box and make a filetr for each
for f in elements:

	# X boundaries
	v_planes.Add(app.Create.NewPlane(XYZ.BasisX, f.MinPoint.ToRevitType()))
	v_planes.Add(app.Create.NewPlane(-XYZ.BasisX, f.MaxPoint.ToRevitType()))
	# Y boundaries
	v_planes.Add(app.Create.NewPlane(XYZ.BasisY, f.MinPoint.ToRevitType()))
	v_planes.Add(app.Create.NewPlane(-XYZ.BasisY, f.MaxPoint.ToRevitType()))
	# Z boundaries
	v_planes.Add(app.Create.NewPlane(XYZ.BasisZ, f.MinPoint.ToRevitType()))
	v_planes.Add(app.Create.NewPlane(-XYZ.BasisZ, f.MaxPoint.ToRevitType()))	
	
	# create filters based on bounding box planes
	v_filters.append(PointCloudFilterFactory.CreateMultiPlaneFilter(v_planes))
	
# output filters
OUT = v_filters
# ----------------------------------------
PointCloudFilter = Output(pointcloudfilter)
