# Dynamo custom node PointCloud_Get Instance.dyf (Dynamo 1.3.2.2480)
# category: ArupBimSF.Revit.Links_PointClouds

PointCloudElement = Input()
empty = List.Empty()
create = List.Create(PointCloudElement, empty)
flatten = Flatten(create)
pointcloudinstance = Python(IN[0]=flatten)
# ---------- pointcloudinstance.python (43 lines) ----------
#Copyright(c) 2014, Jason Andersen, jason@serialnonstandard.com
#www.serialnonstandard.com

# Default imports
import clr

# Import RevitAPI
clr.AddReference("RevitAPI")
import Autodesk
from Autodesk.Revit.DB import *
import System.Collections.Generic
from System.Collections.Generic import List

# Import DocumentManager and TransactionManager
clr.AddReference("RevitServices")
import RevitServices
from RevitServices.Persistence import DocumentManager
from RevitServices.Transactions import TransactionManager

clr.AddReference("RevitNodes")
import Revit
clr.ImportExtensions(Revit.Elements)
clr.ImportExtensions(Revit.GeometryConversion)

doc =  DocumentManager.Instance.CurrentDBDocument
app =  DocumentManager.Instance.CurrentUIApplication.Application

#elements coming in
elements = UnwrapElement(IN[0])

#variables
v_element = []
v_name = []
v_id = []
v_uniqueid = []

#work
for f in elements:
	v_element.append(f.ToDSType(True))	
	v_name.append(f.Name)
	v_id.append(f.Id)
	v_uniqueid.append(f.UniqueId)
OUT = v_element,v_name,v_id,v_uniqueid
# ----------------------------------------
code_block = CodeBlock(element=pointcloudinstance, name=pointcloudinstance) { element[0]; name[1]; }
PointCloudInstance = Output(code_block.out0)
Name = Output(code_block.out1)
