# Dynamo custom node PointCloud_Points to Dynamo Points.dyf (Dynamo 1.3.2.2480)
# category: ArupBimSF.Revit.Links_PointClouds
# Conver PointCloud Points into Dynamo Points

PointCloudPoints = Input()
empty = List.Empty()
create = List.Create(PointCloudPoints, empty)
flatten = Flatten(create)
getRevitPoints = Python(IN[0]=flatten)
# ---------- getRevitPoints.python (39 lines) ----------
#Copyright(c) 2014, Jason Andersen, jason@serialnonstandard.com


# Default imports
import clr

# Import RevitAPI
clr.AddReference("RevitAPI")
import Autodesk
from Autodesk.Revit.DB import *
from Autodesk.Revit.DB.PointClouds import *
import System.Collections.Generic
from System.Collections.Generic import List

# Import DocumentManager and TransactionManager
clr.AddReference("RevitServices")
import RevitServices
from RevitServices.Persistence import DocumentManager
from RevitServices.Transactions import TransactionManager

clr.AddReference("RevitNodes")
import Revit
clr.ImportExtensions(Revit.Elements)
clr.ImportExtensions(Revit.GeometryConversion)

doc =  DocumentManager.Instance.CurrentDBDocument
app =  DocumentManager.Instance.CurrentUIApplication.Application

#elements coming in
elements = UnwrapElement(IN[0])

#variables
v_points = []

#work
for p in elements:
	# Process each point
	v_points.append(Autodesk.Revit.DB.XYZ(float(p.X),float(p.Y),float(p.Z)).ToPoint())
OUT = v_points
# ----------------------------------------
PointCloudInstance = Input()
empty_2 = List.Empty()
create_2 = List.Create(PointCloudInstance, empty_2)
flatten_2 = Flatten(create_2)
getTransform_vectors = Python(IN[0]=flatten_2)
# ---------- getTransform_vectors.python (49 lines) ----------
#Copyright(c) 2014, Jason Andersen, jason@serialnonstandard.com 

# Default imports
import clr

# Import RevitAPI
clr.AddReference("RevitAPI")
import Autodesk
from Autodesk.Revit.DB import *
import System.Collections.Generic
from System.Collections.Generic import List

# Import DocumentManager and TransactionManager
clr.AddReference("RevitServices")
import RevitServices
from RevitServices.Persistence import DocumentManager
from RevitServices.Transactions import TransactionManager

clr.AddReference("RevitNodes")
import Revit
clr.ImportExtensions(Revit.Elements)
clr.ImportExtensions(Revit.GeometryConversion)

doc =  DocumentManager.Instance.CurrentDBDocument
app =  DocumentManager.Instance.CurrentUIApplication.Application

#elements coming in
elements = UnwrapElement(IN[0])

#variables
v_transform = []
v_origin = []
x_axis = []
y_axis = []
z_axis = []
vector_x=[]
vector_y = []
vector_z =[]
#work
for f in elements:
	v_transform.append(f.GetTotalTransform())
	v_origin.append(v_transform[0].Origin.ToPoint())
	x_axis.append(v_transform[0].get_Basis(0))
	y_axis.append(v_transform[0].get_Basis(1))
	z_axis.append(v_transform[0].get_Basis(2))
	vector_x.append(Autodesk.Revit.DB.XYZ(float(x_axis[0].X),float(x_axis[0].Y),float(x_axis[0].Z)).ToVector())
	vector_y.append(Autodesk.Revit.DB.XYZ(float(y_axis[0].X),float(y_axis[0].Y),float(y_axis[0].Z)).ToVector())
	vector_z.append(Autodesk.Revit.DB.XYZ(float(z_axis[0].X),float(z_axis[0].Y),float(z_axis[0].Z)).ToVector())
OUT = vector_x,vector_y,vector_z
# ----------------------------------------
code_block = CodeBlock(vectorX=getTransform_vectors, vectorY=getTransform_vectors, vectorZ=getTransform_vectors) { vectorX[0]; vectorY[1]; vectorZ[2]; }
length = Vector.Length(code_block.out0)
length_2 = Vector.Length(code_block.out1)
length_3 = Vector.Length(code_block.out2)
scale = Geometry.Scale(geometry=getRevitPoints, xamount=length, yamount=length_2, zamount=length_3, lacing=Longest)
DynamoPoints = Output(scale)
