# Dynamo custom node PointCloud_Read Points.dyf (Dynamo 1.3.2.2480)
# category: ArupBimSF.Revit.Links_PointClouds

PointCloudInstance = Input()
empty = List.Empty()
create = List.Create(PointCloudInstance, empty)
flatten = Flatten(create)
PointCloudFilter = Input()
Density_of_Points_Int = Input()  # "Density of Points [Int]"
pointcloudreadpoints = Python(IN[0]=flatten, IN[1]=PointCloudFilter, IN[2]=Density_of_Points_Int)
# ---------- pointcloudreadpoints.python (48 lines) ----------
#Copyright(c) 2014, Jason Andersen, jason@serialnonstandard.com 

# Default imports
import clr

# Import RevitAPI
clr.AddReference("RevitAPI")
import Autodesk
from Autodesk.Revit.DB import *
from Autodesk.Revit.DB.PointClouds import *
import System.Collections.Generic
from System.Collections.Generic import List

# Import DocumentManager and TransactionManager
clr.AddReference("RevitServices")
import RevitServices
from RevitServices.Persistence import DocumentManager
from RevitServices.Transactions import TransactionManager

clr.AddReference("RevitNodes")
import Revit
clr.ImportExtensions(Revit.Elements)
clr.ImportExtensions(Revit.GeometryConversion)

doc =  DocumentManager.Instance.CurrentDBDocument
app =  DocumentManager.Instance.CurrentUIApplication.Application

#elements coming in
elements = UnwrapElement(IN[0])
pcFilter = UnwrapElement(IN[1])
density = UnwrapElement(IN[2])
#variables
v_points = []

#work
for f in elements:
	#local variable
	averageDistance = 0.0001
	# Get points.  Number of points is determined by the needs of the client
	points = f.GetPoints(pcFilter[0], averageDistance, density)
	v_points.append(points)   
    #for p in points:
        # Process each point
        #System.Drawing.Color color = System.Drawing.ColorTranslator.FromWin32(point.Color);
        #String pointDescription = String.Format("({0}, {1}, {2}, {3}", point.X, point.Y, point.Z, color.ToString());


OUT = v_points
# ----------------------------------------
PointCloudPoints = Output(pointcloudreadpoints)
