# Dynamo custom node Points_AccumulatedDistance.dyf (Dynamo 1.3.2.2480)
# category: ArupBimSF.Points & Coordinates
# sums up the accumulated distance from a sequence of points

Points_In = Input(Points_In: Autodesk.Point[])
create = List.Create(Points_In)
flatten = Flatten(create)
count = List.Count(flatten)
code_block = CodeBlock(n=count) { n - 1; n < 2; 0; }
takeItems = List.TakeItems(list=flatten, amount=code_block.out0)
restOfItems = List.RestOfItems(flatten)
distanceTo = Geometry.DistanceTo(geometry=takeItems, other=restOfItems)
sum = Math.Sum(distanceTo)
if_ = If(test=code_block.out1, true=code_block.out2, false=sum)
distance = Output(if_)
