# Dynamo custom node Points_DynamoToRevit.dyf "Points_Dynamo➜Revit" (Dynamo 1.3.2.2480)
# category: ArupBimSF.Points & Coordinates

DynamoPt = Input()
code_block = CodeBlock(item=DynamoPt) { Flatten({item}); }
python_script = Python(IN[0]=code_block)
# ---------- python_script.python (28 lines) ----------
import clr

# Import RevitAPI
clr.AddReference("RevitAPI")
import Autodesk

clr.AddReference("RevitNodes")
import Revit

# Import DocumentManager and TransactionManager
clr.AddReference("RevitServices")
import RevitServices
from RevitServices.Persistence import DocumentManager
from RevitServices.Transactions import TransactionManager

# Import geometry conversion extension methods
clr.ImportExtensions(Revit.GeometryConversion)

# Import Element wrapper extension methods
clr.ImportExtensions(Revit.Elements)

# Unwrap the Point, yielding a Revit XYZ in Revit unit system
xyz = []
for i in IN[0]:
	point = i.ToXyz() 
	xyz.append(point)

OUT = xyz
# ----------------------------------------
RevitPt = Output(python_script)
