# Dynamo custom node Points_PullOntoPlane.dyf (Dynamo 1.3.2.2480)
# category: ArupBimSF.Points & Coordinates
# Pulls input point(s) onto input Planes

code_block = CodeBlock()
# ---------- code_block.designscript (5 lines) ----------
def PtProj1(pt1,pl1){
l1 = Line.ByStartPointEndPoint(pt1,
pt1.Add(pl1.XAxis));
return = l1.PullOntoPlane(pl1).StartPoint;
};
# ----------------------------------------
point = Input(point:var)
plane = Input(plane:var)
code_block_2 = CodeBlock(pt=point, pl=plane) { PtProj1(pt,pl); }
point_2 = Output(code_block_2)  # "point"
code_block_3 = CodeBlock {  }
