# Dynamo custom node Points_ReplaceValue_xyz.dyf (Dynamo 1.3.2.2480)
# category: ArupBimSF.Points & Coordinates
# Takes Input Points and Replaces the x y or Z value with input values

Points_In = Input()
watch = Watch(Points_In)
deconstructPoint = Geometry.Points.DeconstructPoint(watch)
create = List.Create(deconstructPoint.out0, deconstructPoint.out1, deconstructPoint.out2)
x1_y2_z3 = Input(x1_y2_z3 : int = 1)
code_block = CodeBlock(x=x1_y2_z3) { x; x-1; }
Replace_Value = Input(Replace_Value : double = 0)
count = Count(Points_In)
cycle = List.Cycle(list=Replace_Value, amount=count)
replaceItemAtIndex = List.ReplaceItemAtIndex(list=create, index=code_block.out1, item=cycle)
code_block_2 = CodeBlock(x=replaceItemAtIndex) { x[0]; x[1]; x[2]; }
byCoordinates = Point.ByCoordinates(x=code_block_2.out0, y=code_block_2.out1, z=code_block_2.out2)
NewPoint = Output(byCoordinates)
