# Dynamo custom node Points_ToDeliminatedString+.dyf "Points➜DeliminatedString+" (Dynamo 1.3.2.2480)
# category: ArupBimSF.Points & Coordinates
# converts points to strings with an option to round off points to number of digits

points_In = Input(points_In:var[])
separator = Input(separator: string = ",")
Round_Digits = Input(Round_Digits:int = 3)
python_script = Python(IN[0]=points_In, IN[1]=separator, IN[2]=Round_Digits)
# ---------- python_script.python (24 lines) ----------
def tolist(x):
	if hasattr(x,'__iter__'): return x
	else : return [x]

def output(x):
	if len(x) == 1: return x[0]
	else : return x

def n2s(n, digits):
	if digits is not None:
		n = round(n, digits)
	s1 = str(n)
	if s1[-2:] == '.0':
		s1 = s1[:-2]
	return s1
def p2s(p, sep=IN[1], digits=IN[2]):
	x = n2s(p.X, digits)
	y = n2s(p.Y, digits)
	z = n2s(p.Z, digits)
	return ''.join( (x, sep, y, sep, z) )

pts = tolist(IN[0])

OUT = output(map(p2s, pts) )
# ----------------------------------------
string = Output(python_script)
