# Dynamo custom node PolyCurve_ThroughPoints.dyf (Dynamo 1.3.2.2480)
# category: ArupBimSF.Geometry
# creates a closed curve throuh input points

points = Input(points : Autodesk.Point[])
code_block = CodeBlock(plist=points) { PolyCurve.ByPoints(plist,true).Curves(); }
Curves = Output(code_block)
