# Dynamo custom node Quads_FromRectangularGrid.dyf (Dynamo 1.3.2.2480)
# category: ArupBimSF.Geometry

Point_List = Input()
code_block = CodeBlock { -1; }
shiftIndices = List.ShiftIndices(list=Point_List@L2, amount=code_block)
code_block_2 = CodeBlock { -1; }
shiftIndices_2 = List.ShiftIndices(list=Point_List, amount=code_block_2)
code_block_3 = CodeBlock { -1; }
shiftIndices_3 = List.ShiftIndices(list=shiftIndices_2@L2, amount=code_block_3)
create = List.Create(Point_List, shiftIndices, shiftIndices_3, shiftIndices_2)
transpose = List.Transpose(create)
transpose_2 = List.Transpose(transpose@L3)
reverse = List.Reverse(transpose_2)
restOfItems = List.RestOfItems(reverse)
reverse_2 = List.Reverse(restOfItems@L3)
restOfItems_2 = List.RestOfItems(reverse_2@L3)
Quad_Points = Output(restOfItems_2)
