# Dynamo custom node QuantifyAndSelect_ItemAtIndex+.dyf (Dynamo 1.3.2.2480)
# category: ArupBimSF.List Functions

concat = String.Concat()  # unwired: arg0, arg1
Keys_In = Input()  # group items by these categories
string_from_object = FromObject(Keys_In)
length = String.Length(string_from_object)
maximumItem = List.MaximumItem(length)
code_block = CodeBlock(x=maximumItem) { x+2; }
code_block_2 = CodeBlock { "_"; }
padRight = String.PadRight(string_from_object, code_block, code_block_2)
List_In = Input()  # Items to quantify
count = List.Count(List_In, lacing=Longest)
string_from_object_2 = FromObject(count)
length_2 = String.Length(string_from_object_2)
maximumItem_2 = List.MaximumItem(length_2)
code_block_3 = CodeBlock { "0"; }
padLeft = String.PadLeft(string_from_object_2, maximumItem_2, code_block_3)
combine = List.Combine(concat, padRight, padLeft)
Item_Count = Output(combine)
Get_Index = Input(Get_Index: int = 0)
getItemAtIndex = List.GetItemAtIndex(list=List_In, index=Get_Index)
Chosen_Index = Output(getItemAtIndex)
getItemAtIndex_2 = List.GetItemAtIndex(list=Keys_In, index=Get_Index)
Chosen_Category = Output(getItemAtIndex_2)
All_Items = Output(List_In)
