# Dynamo custom node Query_List_Any True.dyf "List_Any True" (Dynamo 1.3.2.2480)
# category: ArupBimSF.Boolean
# #Depricated use list contains item and put true or false in a code block

List_In = Input(List_In : bool[])
code_block = CodeBlock(List_In=List_In) { !(AllFalse(List_In)); }
bool = Output(code_block)
code_block_2 = CodeBlock {  }
