# Dynamo custom node Remame_FamilyType_ByStringReplace_FE.dyf (Dynamo 1.3.2.2480)
# category: ArupBimSF.Revit.FamilyEditor
# Renames a family inside of family editor_!!FE

Search = Input(Search : string)
Replace = Input(Replace : string)
rename_family_type = Python(IN[0]=Search, IN[1]=Replace)
# ---------- rename_family_type.python (40 lines) ----------
import clr

clr.AddReference("RevitServices")
import RevitServices
from RevitServices.Persistence import DocumentManager
from RevitServices.Transactions import TransactionManager
doc = DocumentManager.Instance.CurrentDBDocument

clr.AddReference("RevitAPI")
import Autodesk
from Autodesk.Revit.DB import *

clr.AddReference("RevitNodes")
import Revit
clr.ImportExtensions(Revit.Elements)
clr.ImportExtensions(Revit.GeometryConversion)

search = IN[0]
replace = IN[1]

FamilyMan = doc.FamilyManager
types = FamilyMan.Types
typenames = []

TransactionManager.Instance.EnsureInTransaction(doc)
for type in types:
	FamilyMan.CurrentType = type
	typename = FamilyMan.CurrentType.Name
	if search in typename:
		newname = typename.replace(search, replace)
		typenames.append(newname)
		FamilyMan.RenameCurrentType(newname)
	else:
		typenames.append(typename)
	
	
TransactionManager.Instance.TransactionTaskDone()
	
	
OUT = typenames
# ----------------------------------------
TypeName = Output(rename_family_type)  # "TypeName : string"
