# Dynamo custom node Rename_Parameter_FE.dyf (Dynamo 1.3.2.2480)
# category: ArupBimSF.Revit.FamilyEditor
# Renames a parameter inside of the family editor.  Must be a family parameter not a shared parameter._!!FE

Search = Input(Search : string)
Replace = Input(Replace : string)
rename_family_parameters = Python(IN[0]=Search, IN[1]=Replace)
# ---------- rename_family_parameters.python (39 lines) ----------
import clr

clr.AddReference("RevitServices")
import RevitServices
from RevitServices.Persistence import DocumentManager
from RevitServices.Transactions import TransactionManager
doc = DocumentManager.Instance.CurrentDBDocument

clr.AddReference("RevitAPI")
import Autodesk
from Autodesk.Revit.DB import *

clr.AddReference("RevitNodes")
import Revit
clr.ImportExtensions(Revit.Elements)
clr.ImportExtensions(Revit.GeometryConversion)

search = IN[0]
replace = IN[1]

FamilyMan = doc.FamilyManager
types = FamilyMan.Types
typenames = []

TransactionManager.Instance.EnsureInTransaction(doc)
for param in FamilyMan.Parameters:
	paramName = param.Definition.Name
	if search in paramName:
		newname = paramName.replace(search, replace)
		typenames.append(newname)
		FamilyMan.RenameParameter(param,newname)
	else:
		typenames.append(paramName)
	
	
TransactionManager.Instance.TransactionTaskDone()
	
	
OUT = typenames
# ----------------------------------------
Parameter_Names = Output(rename_family_parameters)
