# Dynamo custom node Return_ListOrSingleValue.dyf (Dynamo 1.3.2.2480)
# category: ArupBimSF.List Functions
# See Forum Post Regarding this node_RevitForum I think?_!LI

unknownItem = Input()
List_In = Input()
python_script = Python(IN[0]=unknownItem, IN[1]=List_In)
# ---------- python_script.python (4 lines) ----------
check = IN[0]
items = IN[1]
if isinstance(check, (list)): OUT = items
else: OUT = items[0]
# ----------------------------------------
Output = Output(python_script)  # ""
