# Dynamo custom node Rpt_InstanceParamToExcel_byCategory.dyf (Dynamo 1.3.2.2480)
# category: ArupBimSF.Revit.Reports
# Report out family instance parameters to an excel file by category

Category_In = Input(Category_In : var = "")
string_from_object = FromObject(Category_In)
byName = Category.ByName(string_from_object)
type = Object.Type(byName)
code_block = CodeBlock { "Revit.Elements.Category"; }
eq = type == code_block
string = StringInput("C:\Temp\ProjectData\")
get_ProjectNumber = Custom[Get_ProjectNumber]()  # gets the project number for the active Project
code_block_2 = CodeBlock { "_"; }
action_RunMe = Custom[Action_RunMe](Should_I=eq, ThingToDo=byName)  # Uses A boolean to determine whether to run a function or sequence.
name = Category.Name(action_RunMe)
code_block_3 = CodeBlock { "Report.xlsx"; }
code_block_4 = CodeBlock(a=string, r=get_ProjectNumber, c=code_block_2, b=name, d=code_block_3) { a+r+c+b+c+b+d; }
location = Watch(code_block_4)
action_RunMe_2 = Custom[Action_RunMe](Should_I=eq, ThingToDo=location)
code_block_5 = CodeBlock { 0; false; }
code_block_6 = CodeBlock { "Element Id"; "Element Guid"; "Family Name"; }
code_block_7 = CodeBlock { "Location"; }
LinkedDoc = Input(LinkedDoc: var = "")  # Only Use this port if you want a linked Doc. Leave open for Active Document
string_from_object_2 = FromObject(LinkedDoc)
string_2 = StringInput("Autodesk.Revit.DB.Document")
eq_2 = string_from_object_2 == string_2
get_LinkedElements_ByCategory = Custom[Get_LinkedElements_ByCategory](Linked_Doc=LinkedDoc)  # Gets all elements of chosen category from A linked RVT Model; unwired: Category_In
# note: Add Element Location, and Forced Parameters to this one!
all_elements_of_category = ElementsOfCategory(action_RunMe)
action_this_or_that = Custom[Action_This Or That](Bool_Switch=eq_2, Item1=get_LinkedElements_ByCategory, Item2=all_elements_of_category)  # toggles between two choices
connect = Flatten(action_this_or_that)
watch = Watch(connect)
parameters = Element.Parameters(watch)
code_block_8 = CodeBlock(list=parameters) { Flatten({list}); }
get_name_clockworks = Python(IN[0]=code_block_8)
# ---------- get_name_clockworks.python (17 lines) ----------
import clr
clr.AddReference('RevitAPI')
clr.AddReference('RevitAPIUI')
from Autodesk.Revit.DB import *
import Autodesk

items = IN[0]
elementlist = list()
for item in items:
	try:
		elementlist.append(item.Name)
	except:
		try:
			elementlist.append(item.get_Parameter(BuiltInParameter.SYMBOL_NAME_PARAM).AsString())
		except:
			donothing = 1
OUT = elementlist
# ----------------------------------------
code_block_9 = CodeBlock(a=get_name_clockworks, b=watch)
# ---------- code_block_9.designscript (15 lines) ----------
//Get Parameter Name
A=List.Sort(a);
B=List.UniqueItems(A);

//Get Element list*Parameter no.
C=List.Count(B);
D=List.Cycle(b,C);

//Get Parameter Name*Element no.
E=List.Count(b);
F=List.Cycle(B,E);

G=List.Sort(F);
//Get Element Parameter
I=D.GetParameterValueByName(G);
# ----------------------------------------
join = List.Join(code_block_6.out0, code_block_6.out1, code_block_6.out2, code_block_7, code_block_9.B)
create = List.Create(join)
get_element_id = Custom[Get_Element Id+](Elements=watch)  # Gets Revit element Id and GUID for input elements
code_block_10 = CodeBlock(list=watch) { Flatten({list}); }
get_name_clockworks_2 = Python(IN[0]=code_block_10)  # same code as get_name_clockworks
get_Element_Location = Custom[Get_Element_Location++](Element_List=action_this_or_that)  # Get the location of input elements. Outputs locations as geometry and as a string value for exporting.
create_2 = List.Create(get_element_id.Id_As_Integer, get_element_id.Id_As_String, get_name_clockworks_2, get_Element_Location.Loc_As_String)
code_block_11 = CodeBlock(x=code_block_9.E) { 0..x-1; x; }
sublists = List.Sublists(list=code_block_9.I, ranges=code_block_11.out0, offset=code_block_11.x)
join_2 = List.Join(create_2, sublists)
transpose = List.Transpose(join_2)
join_3 = List.Join(create, transpose)
writeToFile = Excel.WriteToFile(filePath=action_RunMe_2, sheetName=name, startRow=code_block_5.out0, startCol=code_block_5.out0, data=join_3)
Data = Output(writeToFile)
code_block_12 = CodeBlock { "Last Export Info"; }
code_block_13 = CodeBlock { list={"Version","Build","File Path","Excel Path","Time"}; }
application_version_clock_works = Python()
# ---------- application_version_clock_works.python (10 lines) ----------
import clr
clr.AddReference("RevitServices")
import RevitServices
from RevitServices.Persistence import DocumentManager

doc = DocumentManager.Instance.CurrentDBDocument
uiapp = DocumentManager.Instance.CurrentUIApplication
app = uiapp.Application

OUT = app.VersionName, app.VersionNumber, app.VersionBuild
# ----------------------------------------
code_block_14 = CodeBlock(seq=application_version_clock_works)
# ---------- code_block_14.designscript (6 lines) ----------
seq[0];
//Name;
seq[1];
//Version;
seq[2];
//Build;
# ----------------------------------------
doc_path_from_clockworks = Python()
# ---------- doc_path_from_clockworks.python (11 lines) ----------
import clr
clr.AddReference('RevitAPI')
from Autodesk.Revit.DB import *

clr.AddReference("RevitServices")
import RevitServices
from RevitServices.Persistence import DocumentManager

doc = DocumentManager.Instance.CurrentDBDocument

OUT = doc.PathName
# ----------------------------------------
string_from_object_3 = FromObject(action_RunMe_2)
now = DateTime.Now()
create_3 = List.Create(code_block_14.out0, code_block_14.out2, doc_path_from_clockworks, string_from_object_3, now)
create_4 = List.Create(code_block_13, create_3)
writeToFile_2 = Excel.WriteToFile(filePath=action_RunMe_2, sheetName=code_block_12, startRow=code_block_5.out0, startCol=code_block_5.out0, data=create_4)
FileInfo = Output(writeToFile_2)
fromPath = DirectoryObject(string)  # "Directory.FromPath"
code_block_15 = CodeBlock {  }
code_block_16 = CodeBlock {  }
code_block_17 = CodeBlock {  }
