# Dynamo custom node SaveAs_Document_ByPath.dyf (Dynamo 1.3.2.2480)
# category: ArupBimSF.Directory & OS
# Saves a document to a path of choice

SavePath = Input()
Doc = Input()
python_script = Python(IN[0]=SavePath, IN[1]=Doc)
# ---------- python_script.python (16 lines) ----------
import clr
clr.AddReference('RevitAPI')
from Autodesk.Revit.DB import *

clr.AddReference("RevitServices")
import RevitServices
from RevitServices.Persistence import DocumentManager

path = IN[0]
doc = IN[1]
try:
	for i ,j in zip(path, doc):
		j.SaveAs(i)
		OUT ='Success'
except Exception,e:
	OUT = str(e)
# ----------------------------------------
Result = Output(python_script)
