# Dynamo custom node Sched_Get Column Width.dyf (Dynamo 1.3.2.2480)
# category: ArupBimSF.Revit.Views & Sheets
# Get the Width of schedule on sheet

Sched_In = Input()
code_block = CodeBlock(a=Sched_In) { Flatten({a}); }
python_script = Python(IN[0]=code_block)
# ---------- python_script.python (27 lines) ----------
import clr
clr.AddReference('RevitAPI')
from Autodesk.Revit.DB import *

clr.AddReference("RevitServices")
import RevitServices
from RevitServices.Persistence import DocumentManager

doc = DocumentManager.Instance.CurrentDBDocument
viewsch = UnwrapElement(IN[0])
elementlist = list()
viewlist = []
for v in viewsch:
	wid=[]
	a=v.GetTableData()
	b=a.GetSectionData(SectionType.Body)
	c=b.NumberOfColumns
	n=0
	while n <= c-1:
		d=b.GetColumnWidth(n)
		wid.append(d)
		n=n+1
	
	viewlist.append(wid)
	elementlist.append(wid)

OUT = viewlist
# ----------------------------------------
DataOut = Output(python_script)
