# Dynamo custom node Sched_Get Data Columns.dyf (Dynamo 1.3.2.2480)
# category: ArupBimSF.Revit.Views & Sheets
# get the data from revit schedule columns

Sched_ViewOrName = Input(Sched_ViewOrName:var)  # Enter the Revit schedule view or the schedule name as a string. Name is case-sensitive
Column_Indexes = Input(Column_Indexes:int[]..[])  # Enter the index or indexes of the required columns. Indexes start from 0
python_script = Python(IN[0]=Sched_ViewOrName, IN[1]=Column_Indexes)
# ---------- python_script.python (52 lines) ----------
import clr

# Import DocumentManager and TransactionManager
clr.AddReference("RevitServices")
import RevitServices
from RevitServices.Persistence import DocumentManager

# Import RevitAPI
clr.AddReference("RevitAPI")
import Autodesk
from Autodesk.Revit.DB import *

doc = DocumentManager.Instance.CurrentDBDocument

scheduleName = IN[0]
columnIndexes = IN[1]

if isinstance(columnIndexes, list):
	indexList = columnIndexes
else:
	indexList = [columnIndexes]

collector = FilteredElementCollector(doc)
collector.OfClass( ViewSchedule );
elementlist = collector.ToElements()

if isinstance(scheduleName, str):
	schedule = None
	for i in elementlist:
		scheduleViewName = BuiltInParameter.VIEW_NAME
		viewName = i.get_Parameter( scheduleViewName ).AsString()
		
		if viewName == scheduleName:
			schedule = i
			break		
else:
	schedule = UnwrapElement(scheduleName)

table = schedule.GetTableData()
section = table.GetSectionData(SectionType.Body)
nRows = section.NumberOfRows
nColumns = section.NumberOfColumns

columnList = []
for column in indexList: 
	if column < nColumns:
		columnData = []
		for r in range(nRows): 
			columnData.Add( TableView.GetCellText(schedule, SectionType.Body, r, column) )
		columnList.Add( columnData )

OUT = columnList
# ----------------------------------------
Sched_DataColumn = Output(python_script)
