# Dynamo custom node Sched_Get Data Rows.dyf (Dynamo 1.3.2.2480)
# category: ArupBimSF.Revit.Views & Sheets
# get data rows from revit schedules

Sched_ViewOrName = Input(Sched_ViewOrName:var)  # Enter the Revit schedule view or the schedule name as a string. Name is case-sensitive
RowIndexes = Input(RowIndexes:int[]..[])  # Enter the index or indexes of the required rows. Indexes start from 0
python_script = Python(IN[0]=Sched_ViewOrName, IN[1]=RowIndexes)
# ---------- python_script.python (52 lines) ----------
import clr

# Import DocumentManager and TransactionManager
clr.AddReference("RevitServices")
import RevitServices
from RevitServices.Persistence import DocumentManager

# Import RevitAPI
clr.AddReference("RevitAPI")
import Autodesk
from Autodesk.Revit.DB import *

doc = DocumentManager.Instance.CurrentDBDocument

scheduleName = IN[0]
rowIndexes = IN[1]

if isinstance(rowIndexes, list):
	indexList = rowIndexes
else:
	indexList = [rowIndexes]

collector = FilteredElementCollector(doc)
collector.OfClass( ViewSchedule );
elementlist = collector.ToElements()

if isinstance(scheduleName, str):
	schedule = None
	for i in elementlist:
		scheduleViewName = BuiltInParameter.VIEW_NAME
		viewName = i.get_Parameter( scheduleViewName ).AsString()
		
		if viewName == scheduleName:
			schedule = i
			break
else:
	schedule = UnwrapElement(scheduleName)

table = schedule.GetTableData()
section = table.GetSectionData(SectionType.Body)
nRows = section.NumberOfRows
nColumns = section.NumberOfColumns

rowList = []
for row in indexList: 
	if row < nRows: 
		rowData = []
		for c in range(nColumns): 
			rowData.Add( TableView.GetCellText(schedule, SectionType.Body, row, c) )
		rowList.Add( rowData )

OUT = rowList
# ----------------------------------------
DataRows = Output(python_script)
