# Dynamo custom node Sched_Get Data.dyf (Dynamo 1.3.2.2480)
# category: ArupBimSF.Revit.Views & Sheets
# GEt revit Schedule Data as output

Sched_ViewOrName = Input(Sched_ViewOrName:var)  # Enter the Revit schedule view or the schedule name as a string. Name is case-sensitive
Remove_Headings = Input(Remove_Headings:bool=false)  # Set to True to remove the headings from the collected schedule data
python_script = Python(IN[0]=Sched_ViewOrName, IN[1]=Remove_Headings)
# ---------- python_script.python (48 lines) ----------
import clr

# Import DocumentManager and TransactionManager
clr.AddReference("RevitServices")
import RevitServices
from RevitServices.Persistence import DocumentManager

# Import RevitAPI
clr.AddReference("RevitAPI")
import Autodesk
from Autodesk.Revit.DB import *

doc = DocumentManager.Instance.CurrentDBDocument

scheduleName = IN[0]
removeHeadings = IN[1]

collector = FilteredElementCollector(doc)
collector.OfClass( ViewSchedule );
elementlist = collector.ToElements()

if isinstance(scheduleName, str):
	schedule = None
	for i in elementlist:
		scheduleViewName = BuiltInParameter.VIEW_NAME
		viewName = i.get_Parameter( scheduleViewName ).AsString()
		
		if viewName == scheduleName:
			schedule = i
			break
else:
	schedule = UnwrapElement(scheduleName)

table = schedule.GetTableData().GetSectionData(SectionType.Body)
nRows = table.NumberOfRows
nColumns = table.NumberOfColumns

dataListRow = []
for row in range(nRows): 
	dataListColumn = []
	for column in range(nColumns):
		dataListColumn.Add( TableView.GetCellText(schedule, SectionType.Body, row, column) )
	dataListRow.Add( dataListColumn );

if removeHeadings:
	OUT = dataListRow[2:]
else:
	OUT = dataListRow
# ----------------------------------------
Sched_Data = Output(python_script)
