# Dynamo custom node Sched_Get Sheets From Schedule.dyf (Dynamo 1.3.2.2480)
# category: ArupBimSF.Revit.Views & Sheets
# get the data from revit schedule columns

SheetList_Sched_ViewOrName = Input(SheetList_Sched_ViewOrName:var)  # Enter a Revit Sheet List view or the schedule name as a string
python_script = Python(IN[0]=SheetList_Sched_ViewOrName)
# ---------- python_script.python (62 lines) ----------
import clr

# Import DocumentManager and TransactionManager
clr.AddReference("RevitServices")
import RevitServices
from RevitServices.Persistence import DocumentManager

# Import RevitAPI
clr.AddReference("RevitAPI")
import Autodesk
from Autodesk.Revit.DB import *

doc = DocumentManager.Instance.CurrentDBDocument

sheetListName = IN[0]

collector = FilteredElementCollector(doc)
collector.OfClass( ViewSchedule );
elementlist = collector.ToElements()

sheetSchedule = None
if isinstance(sheetListName, str):
	schedule = None
	for i in elementlist:
		sheetViewName = BuiltInParameter.VIEW_NAME
		viewName = i.get_Parameter( sheetViewName ).AsString()
		
		if viewName == sheetListName:
			sheetSchedule = i
			break
else:
	sheetSchedule = UnwrapElement(sheetListName)


table = sheetSchedule.GetTableData()
section = table.GetSectionData(SectionType.Body)
nRows = section.NumberOfRows
nColumns = section.NumberOfColumns

columnIndex = None
for c in range(nColumns): 
	heading = TableView.GetCellText(sheetSchedule, SectionType.Body, 0, c)
	if heading == "Sheet Number":
		columnIndex = c
		break

sheetNumberList = []
for row in range(nRows)[2:]: 
	sheetNumberList.Add( TableView.GetCellText(sheetSchedule, SectionType.Body, row, columnIndex) )

collector = FilteredElementCollector(doc)
collector.OfClass( ViewSheet );
elementlist = collector.ToElements()

sheetList = []
for s in elementlist: 
	for n in sheetNumberList:
		if s.SheetNumber == n: 
			sheetList.Add(s)
			break

OUT = sheetList
# ----------------------------------------
Sheets = Output(python_script)
