# Dynamo custom node Sched_Set Column Width.dyf (Dynamo 1.3.2.2480)
# category: ArupBimSF.Revit.Views & Sheets
# SEt the Column Width of Schedules on sheets

Width_list = Input()
Sched_in = Input()
python_script = Python(IN[0]=Width_list, IN[1]=Sched_in)
# ---------- python_script.python (49 lines) ----------
import clr
clr.AddReference('ProtoGeometry')
from Autodesk.DesignScript.Geometry import *
# Import ToDSType(bool) extension method
clr.AddReference("RevitNodes")
import Revit
clr.ImportExtensions(Revit.Elements)
# Import geometry conversion extension methods
clr.ImportExtensions(Revit.GeometryConversion)
# Import DocumentManager and TransactionManager
clr.AddReference("RevitServices")
import RevitServices
from RevitServices.Persistence import DocumentManager
from RevitServices.Transactions import TransactionManager
from System.Collections.Generic import *
# Import RevitAPI
clr.AddReference("RevitAPI")
import Autodesk
from Autodesk.Revit.DB import *

doc = DocumentManager.Instance.CurrentDBDocument
uiapp = DocumentManager.Instance.CurrentUIApplication
app = uiapp.Application
uidoc=DocumentManager.Instance.CurrentUIApplication.ActiveUIDocument

elt = []
#for i in IN[0]:
#	elt.append(UnwrapElement(i))
widthlist = UnwrapElement(IN[0])
viewsch = UnwrapElement(IN[1])
#elementlist = list()
#viewlist = []

# Start Transaction
TransactionManager.Instance.EnsureInTransaction(doc)
for i,v in enumerate(viewsch):
	wl=widthlist[i]
	a=v.GetTableData()
	b=a.GetSectionData(SectionType.Body)
	c=b.NumberOfColumns
	n=0
	while n <= c-1:
		d=b.SetColumnWidth(n,wl[n])
		n=n+1
doc.Regenerate()
# End Transaction
TransactionManager.Instance.TransactionTaskDone()

OUT = viewsch
# ----------------------------------------
Sched_Out = Output(python_script)
