# Dynamo custom node Send_ToClipBoard.dyf "➜SendToClipBoard" (Dynamo 1.3.2.2480)
# category: ArupBimSF.Data Transfer
# copies the input item to clipboard

str = Input()
python_script = Python(IN[0]=str)
# ---------- python_script.python (8 lines) ----------
import clr
clr.AddReference('System.Windows.Forms')
from System.Windows.Forms import Clipboard
try:
	Clipboard.SetText(IN[0])
	OUT = IN[0]
except:
	OUT = 'Data could not be copied to clipboard'
# ----------------------------------------
str_2 = Output(python_script)  # "str"
