# Dynamo custom node Set_ElectricSystemNames_ConnectedToPanel.dyf (Dynamo 1.3.2.2480)
# category: ArupBimSF.Revit.Mep_Electrical
# sets the elec system names of systems connected to input panels

elements = Input()
parameterName = Input(parameterName: string)
refresh = Input(refresh: bool = true)
python_script = Python(IN[0]=elements, IN[1]=parameterName, IN[2]=refresh)
# ---------- python_script.python (78 lines) ----------
import clr
clr.AddReference('ProtoGeometry')
from Autodesk.DesignScript.Geometry import *

clr.AddReference("RevitNodes")
import Revit
clr.ImportExtensions(Revit.Elements)

clr.AddReference("RevitAPI")
import Autodesk
from Autodesk.Revit.DB import *

clr.AddReference("RevitServices")
import RevitServices
from RevitServices.Persistence import DocumentManager
from RevitServices.Transactions import TransactionManager

doc = DocumentManager.Instance.CurrentDBDocument

element = UnwrapElement(IN[0])
pname = IN[1]


def SetValueToElementParameterByName(e, en, ev):
		params = e.Parameters
		for param in params:
			if param.Definition.Name == en:
				try:
					t= Transaction(doc)
					t.Start("Set value to parameter")
					param.Set(ev)	
					t.Commit();
				except:
					pass
pass


def getSystem(elem):
	system = elem.MEPModel.AssignedElectricalSystems
	
	if system.Size == 0:
		return None	
	else:
		for sys in system:
			return [x for x in system]
		

listout = []	

for x in element:	
	
	try:
		systems = getSystem(x)			
		cnames = []					

		for system in systems:				
			cname = system.get_Parameter(BuiltInParameter.RBS_ELEC_CIRCUIT_NUMBER).AsString()	
			cnames.append(int(float(cname)))
			
		cnames.sort()
		cnamesstr = ""
		
		for cname in cnames:
			cnamesstr = cnamesstr + str(cname) + ", "	
				
		cnamesstr = cnamesstr[:-2]	
		SetValueToElementParameterByName(x, pname, cnamesstr)
		listout.append(cnamesstr)
	
	except:
		listout.append(None)
		
OUT = listout
	
	
	
	
	
# ----------------------------------------
elements_2 = Output(python_script)  # "elements"
