# Dynamo custom node Set_ElectricalSystemName_ToElements.dyf (Dynamo 1.3.2.2480)
# category: ArupBimSF.Revit.Mep_Electrical
# Sets an electrical system name to elements

elements = Input()
parameterName = Input(parameterName: string)
refresh = Input(refresh:bool = true)
python_script = Python(IN[0]=elements, IN[1]=parameterName, IN[2]=refresh)
# ---------- python_script.python (70 lines) ----------
import clr
clr.AddReference('ProtoGeometry')
from Autodesk.DesignScript.Geometry import *

clr.AddReference("RevitNodes")
import Revit
clr.ImportExtensions(Revit.Elements)

clr.AddReference("RevitAPI")
import Autodesk
from Autodesk.Revit.DB import *

clr.AddReference("RevitServices")
import RevitServices
from RevitServices.Persistence import DocumentManager
from RevitServices.Transactions import TransactionManager

doc = DocumentManager.Instance.CurrentDBDocument




element = UnwrapElement(IN[0])
pname = IN[1]


def SetValueToElementParameterByName(e, en, ev):
		params = e.Parameters
		for param in params:
			if param.Definition.Name == en:
				try:
					t= Transaction(doc)
					t.Start("Set value to parameter")
					param.Set(ev)	
					t.Commit();
				except:
					pass
pass


def getSystem(elem):
	system = elem.MEPModel.ElectricalSystems
	
	if system.Size == 0:
		return None
	elif system.Size == 1:	
		for sys in system:
			return sys
	else:
		for sys in system:
			return sys
		

listout = []	

for x in element:
	try:
		system = getSystem(x)			
		param = system.get_Parameter(BuiltInParameter.RBS_ELEC_CIRCUIT_NUMBER).AsString()	
		SetValueToElementParameterByName(x, pname, param)			
		listout.append(x)			
	except:
		listout.append(None)

OUT = listout
	
	
	
	
	
# ----------------------------------------
elements_2 = Output(python_script)  # "elements"
