# Dynamo custom node Set_Element Name.dyf (Dynamo 1.3.2.2480)
# category: ArupBimSF.Revit.Elements
# Sets the name of input elements_!!Set!Element

Elements_In = Input()
code_block = CodeBlock(item=Elements_In) { Flatten({item}); }
NewNames = Input()
code_block_2 = CodeBlock(item=NewNames) { Flatten({item}); }
code_block_3 = CodeBlock(seq1=code_block, seq2=code_block_2)
# ---------- code_block_3.designscript (4 lines) ----------
num = List.Count(seq1);
cond = List.Count(seq2) < 2 && num > 1;
repseq = List.OfRepeatedItem(seq2[0],num);
cond ? repseq : seq2;
# ----------------------------------------
python_script = Python(IN[0]=code_block, IN[1]=code_block_3.out3)
# ---------- python_script.python (31 lines) ----------
import clr
clr.AddReference('RevitAPI')
from Autodesk.Revit.DB import *

clr.AddReference("RevitNodes")
import Revit
clr.ImportExtensions(Revit.Elements)

clr.AddReference("RevitServices")
import RevitServices
from RevitServices.Persistence import DocumentManager
from RevitServices.Transactions import TransactionManager

doc = DocumentManager.Instance.CurrentDBDocument
items = UnwrapElement(IN[0])
names = IN[1]
goodlist = list()
badlist = list()
counter = 0

TransactionManager.Instance.EnsureInTransaction(doc)
while counter < len(items):
	try:
		items[counter].Name = names[counter]
		goodlist.append(items[counter].ToDSType(True))
	except:
		badlist.append(items[counter].ToDSType(True))
	counter += 1
TransactionManager.Instance.TransactionTaskDone()

OUT = (goodlist,badlist)
# ----------------------------------------
code_block_4 = CodeBlock(seq=python_script) { seq[0]; seq[1]; }
Success = Output(code_block_4.out0)
Fail = Output(code_block_4.out1)
