# Dynamo custom node Set_Element Rotation Angle on Axis.dyf (Dynamo 1.3.2.2480)
# category: ArupBimSF.Revit.Element_Location
# Rotates a family about an axis

ElementId = Input()
code_block = CodeBlock(ids=ElementId) { DSCore.List.Flatten({ids},10); }
Axis = Input()
code_block_2 = CodeBlock(lines=Axis) { DSCore.List.Flatten({lines},10); }
Angle = Input()
code_block_3 = CodeBlock(deg=Angle) { DSCore.List.Flatten({deg},10); }
python_script = Python(IN[0]=code_block, IN[1]=code_block_2, IN[2]=code_block_3)
# ---------- python_script.python (58 lines) ----------
import clr
clr.AddReference('ProtoGeometry')
from Autodesk.DesignScript.Geometry import *

# Import ToDSType(bool) extension method
clr.AddReference("RevitNodes")
import Revit
clr.ImportExtensions(Revit.Elements)

# Import DocumentManager and TransactionManager
clr.AddReference("RevitServices")
import RevitServices
from RevitServices.Persistence import DocumentManager
from RevitServices.Transactions import TransactionManager

from System.Collections.Generic import *

# Import RevitAPI
clr.AddReference("RevitAPI")
import Autodesk
from Autodesk.Revit.DB import *

doc = DocumentManager.Instance.CurrentDBDocument
uiapp = DocumentManager.Instance.CurrentUIApplication
app = uiapp.Application

# Import geometry conversion extension methods
clr.ImportExtensions(Revit.GeometryConversion)

#The inputs to this node will be stored as a list in the IN variable.
dataEnteringNode = IN

def toRvtId(_id):
	if isinstance(_id, int) or isinstance(_id, str):
		id = ElementId(int(_id))
		return id
	elif isinstance(_id, ElementId):
		return _id

lmntIds, axises, angles = [], [], []
for i, j in zip(IN[0], IN[1]):
	lmntIds.append(toRvtId(UnwrapElement(i)))
	axises.append(j.ToRevitType())
angles = IN[2]

# "Start" the transaction
TransactionManager.Instance.EnsureInTransaction(doc)

elements = []
for axis_, angle_, lmntId_ in zip(axises, angles, lmntIds):
	Autodesk.Revit.DB.ElementTransformUtils.RotateElement(doc, lmntId_, axis_, angle_)
	elements.append(doc.GetElement(lmntId_))

# "End" the transaction
TransactionManager.Instance.TransactionTaskDone()

#Assign your output to the OUT variable
OUT = elements
# ----------------------------------------
Family = Output(python_script)
