# Dynamo custom node Set_ElementLocation+.dyf (Dynamo 1.3.2.2480)
# category: ArupBimSF.Revit.Element_Location
# Sets the location of input point based elements to input location points.  This node allows you to set elements in 2d as well, and on sheets which the ootb node does not_#Set#Location

Elements_In = Input(Elements_In:var[])
Location_Points = Input(Location_Points:var[])
python_script = Python(IN[0]=Elements_In, IN[1]=Location_Points)
# ---------- python_script.python (68 lines) ----------
import clr

clr.AddReference("RevitServices")
import RevitServices
from RevitServices.Persistence import DocumentManager
from RevitServices.Transactions import TransactionManager
doc =  DocumentManager.Instance.CurrentDBDocument

clr.AddReference("RevitNodes")
import Revit
clr.ImportExtensions(Revit.Elements)
clr.ImportExtensions(Revit.GeometryConversion)

clr.AddReference("RevitAPI")
from Autodesk.Revit.DB import *
from Autodesk.Revit.DB.Structure import StructuralFramingUtils, StructuralType
FrU = StructuralFramingUtils

def tolist(obj1):
	if hasattr(obj1,"__iter__"): return obj1
	else: return [obj1]

def output1(l1):
	if len(l1) == 1: return l1[0]
	else: return l1

elements = UnwrapElement(tolist(IN[0]))
newloc = UnwrapElement(tolist(IN[1]))
out1, fail = [], []
framing = ("Beam", "Brace")

TransactionManager.Instance.EnsureInTransaction(doc)
for i in xrange(len(elements)):
	try:
		el_typ = elements[i].GetType().ToString()
		isWall, isBeam = False, False
		if el_typ == "Autodesk.Revit.DB.Wall":
			w_start = WallUtils.IsWallJoinAllowedAtEnd(elements[i],0)
			w_end = WallUtils.IsWallJoinAllowedAtEnd(elements[i],1)
			WallUtils.DisallowWallJoinAtEnd(elements[i],0)
			WallUtils.DisallowWallJoinAtEnd(elements[i],1)
			isWall = True
		elif el_typ == "Autodesk.Revit.DB.FamilyInstance":
			if elements[i].StructuralType.ToString() in framing:
				b_start = FrU.IsJoinAllowedAtEnd(elements[i],0)
				b_end = FrU.IsJoinAllowedAtEnd(elements[i],1)
				FrU.DisallowJoinAtEnd(elements[i],0)
				FrU.DisallowJoinAtEnd(elements[i],1)
				isBeam = True	
		newloc1 = newloc[i].ToRevitType()
		oldloc = elements[i].Location
		loc_typ = oldloc.GetType().ToString()
		if loc_typ == "Autodesk.Revit.DB.LocationCurve":
			oldloc.Curve = newloc1
		elif loc_typ == "Autodesk.Revit.DB.LocationPoint":
			oldloc.Point = newloc1
		if isWall:
			if w_start: WallUtils.AllowWallJoinAtEnd(elements[i],0)
			if w_end: WallUtils.AllowWallJoinAtEnd(elements[i],1)
		if isBeam and not isRvt14:
			if b_start: FrU.AllowJoinAtEnd(elements[i],0)
			if b_end: FrU.AllowJoinAtEnd(elements[i],1)
		out1.append(elements[i].ToDSType(True))
	except:
		out1.append(fail)
TransactionManager.Instance.TransactionTaskDone()

OUT = output1(out1)
# ----------------------------------------
element = Output(python_script)
