# Dynamo custom node Set_Fabrication_Config(Specific).dyf (Dynamo 1.3.2.2480)
# category: ArupBimSF.Revit.Fabrication
# sets the fabrication config for input elements

Config_Info_Class = Input()
Profile = Input()
set_fabrication_configuration = Python(IN[0]=Config_Info_Class, IN[1]=Profile)
# ---------- set_fabrication_configuration.python (25 lines) ----------
#Copyright(c) 2016, Nathan Chapman
# nchapman@generalheating.com

import clr
clr.AddReference("RevitAPI")
import Autodesk
from Autodesk.Revit.DB import FabricationConfiguration
clr.AddReference("RevitServices")
import RevitServices
from RevitServices.Persistence import DocumentManager
from RevitServices.Transactions import TransactionManager

Doc = DocumentManager.Instance.CurrentDBDocument
TransactionManager.Instance.EnsureInTransaction(Doc)
Inpt = UnwrapElement(IN[0])
Inpt1 = UnwrapElement(IN[1])
ItmList = list()

ConfigName = FabricationConfiguration.GetFabricationConfiguration(Doc)
Config = ConfigName.SetConfiguration(Inpt,Inpt1)
ItmList.append(Inpt.Name)

TransactionManager.Instance.TransactionTaskDone()

OUT = ItmList
# ----------------------------------------
Config_Name = Output(set_fabrication_configuration)
