# Dynamo custom node Set_FamilyName by Pre-Fix.dyf (Dynamo 1.3.2.2480)
# category: ArupBimSF.Revit.Elements_Families
# renames user defined families with a new prefix removes a user-defined number of charachters_#set#elem

Families_In = Input()
flatten = Flatten(Families_In)
uniqueItems = List.UniqueItems(flatten)
name = Element.Name(uniqueItems)
char_to_remove = Input()  # "#char to remove"
code_block = CodeBlock { true; }
string_slice_at_index = Custom[String_Slice at Index](StringIn=name, of_Characters=char_to_remove, Left_Right=code_block)  # Slices input strings at desired index
code_block_2 = CodeBlock { ""; }
desired_Prefix = Input()
join = String.Join(code_block_2, desired_Prefix)  # unwired: arg2
map = List.Map(list=string_slice_at_index, f_x=join)
flatten_2 = Flatten(map)
set_element_name = Custom[Set_Element Name](Elements_In=uniqueItems, NewNames=flatten_2)  # Sets the name of input elements
rename_Success = Output(set_element_name.Success)
rename_Fail = Output(set_element_name.Fail)
New_Names = Output(map)
