# Dynamo custom node Set_FamilyParameter_ByName_FE.dyf (Dynamo 1.3.2.2480)
# category: ArupBimSF.Revit.Elements_Families
# Sets a parameter in family editor by name and value._!FE_!SetPa

ParameterName = Input(ParameterName : string)
Parameter_Value = Input()
python_script = Python(IN[0]=ParameterName, IN[1]=Parameter_Value)
# ---------- python_script.python (31 lines) ----------
#All the credit for this node goes to Dimitar Venkov @5devene
#Thanks for all the usefull stuff you share Dimitar!

import clr
clr.AddReference('RevitAPI')
from Autodesk.Revit.DB import*

clr.AddReference('RevitServices')
from RevitServices.Persistence import DocumentManager
from RevitServices.Transactions import TransactionManager

doc = DocumentManager.Instance.CurrentDBDocument

param_name = IN[0]
param_value = IN[1]

param_list = doc.FamilyManager.GetParameters()
names = [p.Definition.Name for p in param_list]
par1 = None
if param_name in names:
	par1 = param_list[names.index(param_name)]
if par1 != None:
	TransactionManager.Instance.EnsureInTransaction(doc)
	try :
		doc.FamilyManager.Set(par1,param_value)
		OUT = 'Success'
	except:
		OUT = 'Check parameter type.'
	TransactionManager.Instance.TransactionTaskDone()
else :
	OUT = 'No parameter found by that name'
# ----------------------------------------
OUT = Output(python_script)
