# Dynamo custom node Set_FamilyType Name by Pre-Fix.dyf (Dynamo 1.3.2.2480)
# category: ArupBimSF.Revit.Elements_Families
# renames user defined families with a new prefix removes a user-defined number of charachters_#se#el

Families_In = Input()
flatten = Flatten(Families_In)
uniqueItems = List.UniqueItems(flatten)
element_get_name = Custom[Element_Get Name](Input=uniqueItems)  # Get the element name from all types of elements just like the OOTB node but this one work for system families also
char_to_remove = Input()  # "#char to remove"
code_block = CodeBlock { true; }
string_slice_at_index = Custom[String_Slice at Index](StringIn=element_get_name, of_Characters=char_to_remove, Left_Right=code_block)  # Slices input strings at desired index
code_block_2 = CodeBlock { ""; }
desired_Prefix = Input()
join = String.Join(code_block_2, desired_Prefix)  # unwired: arg2
map = List.Map(list=string_slice_at_index, f_x=join)
flatten_2 = Flatten(map)
element_set_type_name = Custom[Element_Set Type Name](Elements_In=uniqueItems, NewNames=flatten_2)  # Sets the name of input elements
rename_Success = Output(element_set_type_name.Success)
rename_Fail = Output(element_set_type_name.Fail)
New_Names = Output(map)
