# Dynamo custom node Set_FamilyType.dyf (Dynamo 1.3.2.2480)
# category: ArupBimSF.Revit.Elements_Families
# set the type of input family instances

familyInstance = Input()
code_block = CodeBlock(item=familyInstance) { Flatten({item}); }
familyType = Input()
code_block_2 = CodeBlock(item=familyType) { Flatten({item}); }
code_block_3 = CodeBlock(code_block, code_block_2)
# ---------- code_block_3.designscript (4 lines) ----------
inst = List.Count(instances);
ftypes[0] =  List.OfRepeatedItem(types[0],inst);
ftypes[1] =  types;
ftypes[inst > List.Count(types) ? 0 : 1];
# ----------------------------------------
python_script = Python(IN[0]=code_block, IN[1]=code_block_3.out3)
# ---------- python_script.python (30 lines) ----------
import clr
clr.AddReference('RevitAPI')
from Autodesk.Revit.DB import *

clr.AddReference("RevitNodes")
import Revit
clr.ImportExtensions(Revit.Elements)

clr.AddReference("RevitServices")
import RevitServices
from RevitServices.Persistence import DocumentManager
from RevitServices.Transactions import TransactionManager

doc = DocumentManager.Instance.CurrentDBDocument
faminsts = UnwrapElement(IN[0])
famsymb = UnwrapElement(IN[1])
elementlist = list()
counter = 0

TransactionManager.Instance.EnsureInTransaction(doc)
for item in faminsts:
	try:
		item.Symbol = famsymb[counter]
		elementlist.append(item.ToDSType(True))
	except:
		emptylist = list()
	counter += 1
TransactionManager.Instance.TransactionTaskDone()

OUT = elementlist
# ----------------------------------------
return_ListOrSingleValue = Custom[Return_ListOrSingleValue](unknownItem=familyInstance, List_In=python_script)  # See Forum Post Regarding this node_RevitForum I think?
familyInstance_2 = Output(return_ListOrSingleValue)  # "familyInstance"
