# Dynamo custom node Set_Linked_Element Id.dyf (Dynamo 1.3.2.2480)
# category: ArupBimSF.Revit.Elements
# det the linked element id custom command to link two elements between models

Local_Element = Input()
code_block = CodeBlock { "Linked_Element Id"; }
Linked_Element = Input()
id = Element.Id(Linked_Element)
string_from_object = FromObject(id)
setParameterByName = Element.SetParameterByName(element=Local_Element, parameterName=code_block, value=string_from_object)
ElementOut = Output(setParameterByName)
Linked_Element_Id = Output(string_from_object)
