# Dynamo custom node Set_MultipleParametersByName.dyf (Dynamo 1.3.2.2480)
# category: Rhythm.Revit.Elements.Element
# Sets multiply parameters to multiple families. There needs to be a value for each parameter name (null values will work but null will be filled in not a blank space) There also needs to be a sub list of values for each element input.

Input = Input()
number = DoubleInput(1)
chop = List.Chop(list=Input, lengths=number)
Input_2 = Input()
string_from_object = FromObject(Input_2)
count = Count(string_from_object)
cycle = List.Cycle(amount=count)  # unwired: list
map = List.Map(list=chop, f_x=cycle)
flatten = Flatten(map)
Input_3 = Input()
string_from_object_2 = FromObject(Input_3)
count_2 = Count(string_from_object_2)
cycle_2 = List.Cycle(list=string_from_object, amount=count_2)
flatten_2 = Flatten(string_from_object_2)
setParameterByName = Element.SetParameterByName(element=flatten, parameterName=cycle_2, value=flatten_2, lacing=Longest)
Output = Output(setParameterByName)  # ""
