# Dynamo custom node Set_ParameterByName_Py.dyf (Dynamo 1.3.2.2480)
# category: ArupBimSF.Revit.Parameters
# Take input elements and Sets a Prameter by Name with a python Script_!!PA_!Set_!Elem

elements = Input()
Pa_Name = Input(Pa_Name: string)
SetValue = Input()
refresh = Input(refresh: bool = true)
python_script = Python(IN[0]=elements, IN[1]=Pa_Name, IN[2]=SetValue, IN[3]=refresh)
# ---------- python_script.python (46 lines) ----------
import clr
clr.AddReference('ProtoGeometry')
from Autodesk.DesignScript.Geometry import *

clr.AddReference("RevitNodes")
import Revit
clr.ImportExtensions(Revit.Elements)

clr.AddReference("RevitAPI")
import Autodesk
from Autodesk.Revit.DB import *

clr.AddReference("RevitServices")
import RevitServices
from RevitServices.Persistence import DocumentManager
from RevitServices.Transactions import TransactionManager

doc = DocumentManager.Instance.CurrentDBDocument

elements = UnwrapElement(IN[0])
pname = UnwrapElement(IN[1])
pvalue = UnwrapElement(IN[2])


def SetValueToElementParameterByName(e, en, ev):
	params = e.Parameters
	for param in params:
		try:
			if param.Definition.Name==en:
				t= Transaction(doc)
				t.Start("Set value to parameter")
				param.Set(ev)	
				t.Commit()
		except:
			pass	
pass


for i in range(len(elements)):
	SetValueToElementParameterByName(elements[i], pname, pvalue[i])	
	
	
OUT = elements
	
	
	
# ----------------------------------------
query_IsEmptyOrNull = Custom[List_Clean+](List_In=python_script)  # "List.Query_IsEmptyOrNull"; Returns true if list item is null or empty_!Li
filterByBoolMask = List.FilterByBoolMask(list=elements, mask=query_IsEmptyOrNull.Boolean)
Success = Output(filterByBoolMask.in)
Fail = Output(filterByBoolMask.out)
Boolean = Output(query_IsEmptyOrNull.Boolean)
