# Dynamo custom node Set_ParameterByStringValue.dyf (Dynamo 1.3.2.2480)
# category: ArupBimSF.Revit.Parameters
# Allows you to set parameter values by strings instead of using project units.  Useful for using Excel to port in values or from parameters used to store values as strings_!Pa_!el^TestMe

Elements = Input()
ParameterName = Input(ParameterName : string)
Values = Input(Values : string[]..[])
python_script = Python(IN[0]=Elements, IN[1]=ParameterName, IN[2]=Values)
# ---------- python_script.python (70 lines) ----------
import clr
clr.AddReference('ProtoGeometry')
from Autodesk.DesignScript.Geometry import *
clr.AddReference('RevitAPI')
from Autodesk.Revit.DB import *

clr.AddReference("RevitServices")
import RevitServices
from RevitServices.Persistence import DocumentManager
from RevitServices.Transactions import TransactionManager
doc = DocumentManager.Instance.CurrentDBDocument
#The inputs to this node will be stored as a list in the IN variables.
toggle = 0
if isinstance(IN[0], list):
	element = UnwrapElement(IN[0])
else:
	element = [UnwrapElement(IN[0])]
name = IN[1]
if isinstance(IN[2], list):
	values = IN[2]
	toggle = 1
else:
	values = [IN[2]]
parameters = []
listout = []


def checkParameter(param):
	for p in param:
		internal = p.Definition
		if internal.BuiltInParameter != BuiltInParameter.INVALID:
			return p
	return param[0]

for e in element:
	param = e.GetParameters(name)
	if len(param) == 0:
		parameters.append(None)
	else:
		p = checkParameter(param)
		if p.StorageType == StorageType.ElementId:
			parameters.append(None)
		else:
			parameters.append(p)

if toggle == 1:
	TransactionManager.Instance.EnsureInTransaction(doc)
	for i,p in enumerate(parameters):
		if p is None:
			listout.append(None)
		else:
			p.SetValueString(values[i])
			listout.append(element[i])
	TransactionManager.Instance.TransactionTaskDone()
else:
	TransactionManager.Instance.EnsureInTransaction(doc)
	for i,p in enumerate(parameters):
		if p is None:
			listout.append(None)
		else:
			try:
				p.SetValueString(values)
				listout.append(element[i])
			except:
				p.SetValueString(values[0])
				listout.append(element[i])
	TransactionManager.Instance.TransactionTaskDone()

#Assign your output to the OUT variable.
OUT = listout
# ----------------------------------------
Elements_2 = Output(python_script)  # "Elements"
