# Dynamo custom node Set_SheetName_UpperCase.dyf (Dynamo 1.3.2.2480)
# category: ArupBimSF.Revit.Views & Sheets
# sets all document sheet  names to upper case

RunMe = Input(RunMe: bool=false)
categories = Categories("Sheets")
action_RunMe = Custom[Action_RunMe](Should_I=RunMe, ThingToDo=categories)  # Uses A boolean to determine whether to run a function or sequence.
all_elements_of_category = ElementsOfCategory(action_RunMe)
code_block = CodeBlock { "Sheet Name"; }
sheetName = Sheet.SheetName(all_elements_of_category)
toUpper = String.ToUpper(sheetName)
setParameterByName = Element.SetParameterByName(element=all_elements_of_category, parameterName=code_block, value=toUpper)
code_block_2 = CodeBlock { "Sheet Number"; }
sheetNumber = Sheet.SheetNumber(all_elements_of_category)
toUpper_2 = String.ToUpper(sheetNumber)
setParameterByName_2 = Element.SetParameterByName(element=setParameterByName, parameterName=code_block_2, value=toUpper_2)
element = Output(setParameterByName_2)
