# Dynamo custom node Set_Sheet_NameOrNumber.dyf (Dynamo 1.3.2.2480)
# category: ArupBimSF.Revit.Views & Sheets
# renumbers or renames input sheets

Sheets_In = Input(Sheets_In:Sheet[])  # Enter the Revit sheets to renumber or rename
New_Numbers = Input(New_Numbers:string[])  # Enter a list of sheet numbers to renumber the sheets
New_Names = Input(New_Names:string[]={})  # Enter a list of sheet names to rename the sheets. Leave empty to renumber only
RunMe = Input(RunMe:bool)  # Set to True renumber or rename the input sheets
python_script = Python(IN[0]=Sheets_In, IN[1]=New_Numbers, IN[2]=New_Names, IN[3]=RunMe)
# ---------- python_script.python (87 lines) ----------
import clr
clr.AddReference("RevitAPIUI")
from Autodesk.Revit.UI import TextBox
from Autodesk.Revit.UI import TaskDialog
from Autodesk.Revit.UI import TaskDialogCommonButtons

# Import DocumentManager and TransactionManager
clr.AddReference("RevitServices")
import RevitServices
from RevitServices.Persistence import DocumentManager
from RevitServices.Transactions import TransactionManager
from System.Collections.Generic import *

# Import RevitAPI
clr.AddReference("RevitAPI")
import Autodesk
from Autodesk.Revit.DB import *

doc = DocumentManager.Instance.CurrentDBDocument

def convertToList(testList):
	if isinstance(testList, list):
		return testList
	else:
		return [testList]
		
def checkInputNamesForDuplicates(newNamesList):
	if len(newNamesList) != len( set(newNamesList) ):
		TaskDialog.Show("Terminating rename process", "The list of newNumbers contains duplicates. Check your newNumbers list and ensure all new names are unique", TaskDialogCommonButtons.Ok)
		return True
		
def sheetNumbers(sheetList):
	docSheetNumbers = []
	for s in sheetList:
		docSheetNumbers.Add( s.SheetNumber )
	return docSheetNumbers
		
def renameSheet(sheets, data, param):
	for s, n in zip(sheets, data):
		numberParam = s.get_Parameter( param )
		numberParam.Set(n)
	
run = IN[3]

collector = FilteredElementCollector(doc).OfClass( ViewSheet ).OfCategory( BuiltInCategory.OST_Sheets )
elementlist = collector.ToElements()

docSheetNumbers = sheetNumbers(elementlist)

if run:
	TransactionManager.Instance.EnsureInTransaction(doc)
	
	sheets = UnwrapElement( convertToList(IN[0]) )
	newNumbers = convertToList( IN[1] )
	newNames =  convertToList( IN[2] )
	
	renameSheets = len(IN[2]) > 0
	
	inputSheetNumbers = sheetNumbers(sheets)
	checkForDuplicates = checkInputNamesForDuplicates(newNumbers)
	if checkForDuplicates:
		OUT = "Rename terminated - list of new sheet names contains duplicates. Provide unique names and try again"
	else:
		if len(sheets) == len(newNumbers):
			duplicateName = []
			for i in newNumbers:
				if i in docSheetNumbers and i not in inputSheetNumbers: 
					duplicateName.Add( i )
			if len(duplicateName) > 0: 
				TransactionManager.Instance.TransactionTaskDone()
				
				TaskDialog.Show("Terminating rename process", "The following sheet numbers already exist and cannot be used to re-number the sheets. Provide a list of unique names and try again:\n" + str(duplicateName), TaskDialogCommonButtons.Ok)
				OUT = "Rename terminated - new sheet names conflict with existing sheets in the document: " + str(duplicateName) + ". Provide unique names and try again" 
			else:
				renameSheet(sheets, [s.Id for s in sheets], BuiltInParameter.SHEET_NUMBER) 
				renameSheet(sheets, newNumbers, BuiltInParameter.SHEET_NUMBER) 
				
				if renameSheets:
					renameSheet(sheets, newNames, BuiltInParameter.SHEET_NAME)
				
				TransactionManager.Instance.TransactionTaskDone()
				OUT = "Sheets successfully renamed"
		else:
			TransactionManager.Instance.TransactionTaskDone()
			
			TaskDialog.Show("Lacing error", "The sheets and newNumbers lists are not equal in length. Ensure both lists contain an equal number of items and try again", TaskDialogCommonButtons.Ok)
			OUT = "Rename terminated - Lacing mismatch - ensure an equal number of items are in the sheets and newNumbers lists"
# ----------------------------------------
Sheets = Output(python_script)
