# Dynamo custom node Set_TextElement_Width.dyf "TextElement.SetWidth" (Dynamo 1.3.2.2480)
# category: Clockwork.Revit.Elements.TextElement.Actions
# Sets the text of a given text element (i.e. text note or model text)

element = Input()
turnIntoSingleList = Custom[TurnIntoSingleList](unknownItem=element)  # Converts a collection or items and lists into a single one dimensional List_!!Li
width = Input(width : double = 1)
turnIntoSingleList_2 = Custom[TurnIntoSingleList](unknownItem=width)
code_block = CodeBlock(seq1=turnIntoSingleList, seq2=turnIntoSingleList_2)
# ---------- code_block.designscript (4 lines) ----------
num = List.Count(seq1);
cond = List.Count(seq2) < 2 && num > 1;
repseq = List.OfRepeatedItem(seq2[0],num);
cond ? repseq : seq2;
# ----------------------------------------
python_script = Python(IN[0]=turnIntoSingleList, IN[1]=code_block.repseq)
# ---------- python_script.python (40 lines) ----------
import clr
clr.AddReference('RevitAPI')
from Autodesk.Revit.DB import *

clr.AddReference("RevitNodes")
import Revit
clr.ImportExtensions(Revit.Elements)
clr.ImportExtensions(Revit.GeometryConversion)

clr.AddReference("RevitServices")
import RevitServices
from RevitServices.Persistence import DocumentManager
from RevitServices.Transactions import TransactionManager

doc = DocumentManager.Instance.CurrentDBDocument
items = UnwrapElement(IN[0])
widths = IN[1]
goodlist = list()
badlist = list()
counter = 0

#stdsave = sys.stdout
#fout = open(’C:\Projects\output.txt’,’w’)
#sys.stdout = fout
#print “This is a message”
#…
#sys.stdout = stdsave
#fout.close()

TransactionManager.Instance.EnsureInTransaction(doc)
while counter < len(items):
	try:
		items[counter].Width = widths[counter]
		goodlist.append(items[counter])
	except:
		badlist.append(items[counter])
	counter += 1
TransactionManager.Instance.TransactionTaskDone()

OUT = (goodlist,badlist)
# ----------------------------------------
code_block_2 = CodeBlock(seq=python_script) { seq[0]; seq[1]; }
success = Output(code_block_2.out0)
fail = Output(code_block_2.out1)
watch = Watch(element)
watch_2 = Watch(width)
watch_3 = Watch(turnIntoSingleList)
watch_4 = Watch(turnIntoSingleList_2)
watch_5 = Watch(code_block.out3)
watch_6 = Watch(python_script)
watch_7 = Watch(turnIntoSingleList)
