# Dynamo custom node Set_ViewNames_UpperCase.dyf (Dynamo 1.3.2.2480)
# category: ArupBimSF.Revit.Views & Sheets
# sets all document sheet  names to upper case

RunMe = Input(RunMe: bool=false)
categories = Categories("Views")
action_RunMe = Custom[Action_RunMe](Should_I=RunMe, ThingToDo=categories)  # Uses A boolean to determine whether to run a function or sequence.
all_elements_of_category = ElementsOfCategory(action_RunMe)
# note: From Clockwork
isViewTemplate = View.IsViewTemplate(all_elements_of_category)
filterByBoolMask = List.FilterByBoolMask(list=all_elements_of_category, mask=isViewTemplate)
code_block = CodeBlock { "View Name"; }
name = Element.Name(filterByBoolMask.out)
toUpper = String.ToUpper(name)
setParameterByName = Element.SetParameterByName(element=filterByBoolMask.out, parameterName=code_block, value=toUpper)
code_block_2 = CodeBlock { "Title on Sheet"; }
getParameterValueByName = Element.GetParameterValueByName(element=setParameterByName, parameterName=code_block_2)
toUpper_2 = String.ToUpper(getParameterValueByName)
setParameterByName_2 = Element.SetParameterByName(element=setParameterByName, parameterName=code_block_2, value=toUpper_2)
element = Output(setParameterByName_2)
