# Dynamo custom node Set_ViewTemplate_ByName.dyf (Dynamo 1.3.2.2480)
# category: ArupBimSF.Revit.Views & Sheets
# apply a view template to views

ViewsIn = Input()
code_block = CodeBlock(item=ViewsIn) { Flatten({item}); }
ViewTemplateName = Input()
python_script = Python(IN[0]=code_block, IN[1]=ViewTemplateName)
# ---------- python_script.python (49 lines) ----------
#template for python nodes in dynamo 1.0
#proposed by Julien Benoit @jbenoit44 
#http://aecuandme.wordpress.com/
import clr
clr.AddReference('ProtoGeometry')
from Autodesk.DesignScript.Geometry import *
# Import ToDSType(bool) extension method
clr.AddReference("RevitNodes")
import Revit
clr.ImportExtensions(Revit.Elements)
# Import geometry conversion extension methods
clr.ImportExtensions(Revit.GeometryConversion)
# Import DocumentManager and TransactionManager
clr.AddReference("RevitServices")
import RevitServices
from RevitServices.Persistence import DocumentManager
from RevitServices.Transactions import TransactionManager
from System.Collections.Generic import *
# Import RevitAPI
clr.AddReference("RevitAPI")
import Autodesk
from Autodesk.Revit.DB import *

doc = DocumentManager.Instance.CurrentDBDocument
uiapp = DocumentManager.Instance.CurrentUIApplication
app = uiapp.Application
uidoc=DocumentManager.Instance.CurrentUIApplication.ActiveUIDocument

viewTempName = IN[1]
views = []
for i in IN[0]:
	views.append(UnwrapElement(i))

# Start Transaction
TransactionManager.Instance.EnsureInTransaction(doc)

collector = FilteredElementCollector(doc).OfClass(View)
for i in collector:
	if i.IsTemplate == True and i.Name == viewTempName:
		viewTemp = i

for i in views:
	i.ViewTemplateId = viewTemp.Id
		

# End Transaction
TransactionManager.Instance.TransactionTaskDone()

OUT=views
# ----------------------------------------
ViewsOut = Output(python_script)
