# Dynamo custom node SharedParameter_Add from txt File.dyf (Dynamo 1.3.2.2480)
# category: ArupBimSF.Revit.Parameters
# adds a shared parameter you project from input shared parameter txt file_!pa!shp!edb_^FixMe_Fix to access the linked SHP txt file by default but allow for input path as well

Category = Input()
Parameters = Input()
ParameterGroup = Input()
Is_Instance_Parameter = Input()  # "Is Instance Parameter?"
python_script = Python(IN[0]=Category, IN[1]=Parameters, IN[2]=ParameterGroup, IN[3]=Is_Instance_Parameter)
# ---------- python_script.python (63 lines) ----------
import clr
import System
clr.AddReference('RevitAPI')
from Autodesk.Revit.DB import*
clr.AddReference('RevitServices')
from RevitServices.Persistence import DocumentManager
from RevitServices.Transactions import TransactionManager
clr.AddReference('RevitAPIUI')
from Autodesk.Revit.UI import *
from Autodesk.Revit import Creation


doc = DocumentManager.Instance.CurrentDBDocument
uidoc = DocumentManager.Instance.CurrentUIDocument
app = doc.Application


if isinstance(IN[0], list):
	category = [i for i in IN[0]]
else:
	category= [IN[0]]
	
#getting list of categories
try:
	categories = [doc.Settings.Categories.get_Item(System.Enum.ToObject(BuiltInCategory, i.Id)) for i in category]
except:
	categories = [UnwrapElement(i) for i in category]
	
#creating category set
catset = app.Create.NewCategorySet()
[catset.Insert(j) for j in categories]

if isinstance(IN[1], list):
	parameters = [i for i in IN[1]]
else:
	parameters = [IN[1]]
	
try:
	group = [a for a in System.Enum.GetValues(BuiltInParameterGroup) if a == IN[2]][0]
except:
	group = [a for a in System.Enum.GetValues(BuiltInParameterGroup) if str(a) == IN[2]][0]
i = 0

TransactionManager.Instance.EnsureInTransaction(doc)

#Determining whether the parameters are type or instance
if IN[3]:
	bind = app.Create.NewInstanceBinding(catset)
else : 
	bind = app.Create.NewTypeBinding(catset)
#Adding the parameters to the project
bindmap = doc.ParameterBindings
for p in parameters:
	try:
		bindmap.Insert(p, bind, group)
		i += 1
	except:
		continue

TransactionManager.Instance.TransactionTaskDone()


OUT =  '%d shared parameters addes to project' %(i)
# ----------------------------------------
OUT = Output(python_script)
