# Dynamo custom node SharedParameters_Read from Txt File.dyf (Dynamo 1.3.2.2480)
# category: ArupBimSF.Revit.Parameters
# Reads shared parameters from input txt file._!PA!edb!Shp^Fixme combine this with the get sHP def node

FilePath = Input()
python_script = Python(IN[0]=FilePath)
# ---------- python_script.python (29 lines) ----------
import clr
clr.AddReference('RevitAPI')
from Autodesk.Revit.DB import*
clr.AddReference('RevitServices')
from RevitServices.Persistence import DocumentManager
from RevitServices.Transactions import TransactionManager
clr.AddReference('RevitAPIUI')
from Autodesk.Revit.UI import *


doc = DocumentManager.Instance.CurrentDBDocument
uidoc = DocumentManager.Instance.CurrentUIDocument
app = doc.Application

TransactionManager.Instance.EnsureInTransaction(doc)

app.SharedParametersFilename  =IN[0]
spfile = app.OpenSharedParameterFile()
gr = spfile.Groups
defp = [g.Definitions for g in gr]
defflat = [x for l in defp for x in l]
defflatname = [x.Name for x in defflat]


TransactionManager.Instance.TransactionTaskDone()



OUT = defflat , defflatname
# ----------------------------------------
code_block = CodeBlock(x=python_script) { x[0]; x[1]; }
Revit_Parameters = Output(code_block.out0)
Parameter_Names = Output(code_block.out1)
