# Dynamo custom node Solid_TopAndBottomSurface.dyf (Dynamo 1.3.2.2480)
# category: ArupBimSF.Geometry
# Gets the top and bottom surface from input geometry

Solids_In = Input()
code_block = CodeBlock(Solids_In)
# ---------- code_block.designscript (4 lines) ----------
sld = Flatten(li1).Explode();
pt = sld.PointAtParameter(0.5, 0.5).Z;
t2 = DSCore.List.SortByKey(sld<1L>, pt<1L>);
__TryGetValueFromNestedDictionaries(t2, "sorted list");
# ----------------------------------------
firstItem = List.FirstItem(code_block.out3, lacing=Longest)
bottomSurface = Output(firstItem)
lastItem = List.LastItem(code_block.out3, lacing=Longest)
topSurface = Output(lastItem)
