# Dynamo custom node Sort_BySublistAtIndex.dyf (Dynamo 1.3.2.2480)
# category: ArupBimSF.List Functions
# sort a list by the value of one of its indexes

List = Input()
code_block = CodeBlock(seq=List) { DSCore.List.Transpose(seq); }
SortIndex = Input(SortIndex : int = 0)
code_block_2 = CodeBlock { false; }
Descending = Input(Descending : bool = false)
python_script = Python(IN[0]=code_block, IN[1]=SortIndex, IN[2]=code_block_2, IN[3]=Descending)
# ---------- python_script.python (20 lines) ----------
import clr

lists = IN[0]
sortindex = int(IN[1])
caseinsensitive = IN[2]
sortdescending = IN[3]

# make sure that case-insensitive is turned of if it is not strings we're sorting
if caseinsensitive == True and isinstance(lists[0][sortindex], basestring) == False:
	caseinsensitive = False
if caseinsensitive == True:
	if sortdescending == True:
		OUT = sorted(lists, key=lambda lists:lists[sortindex].lower(), reverse=True)
	else:
		OUT = sorted(lists, key=lambda lists:lists[sortindex].lower())
else:
	if sortdescending == True:
		OUT = sorted(lists, key=lambda lists:lists[sortindex], reverse=True)
	else:
		OUT = sorted(lists, key=lambda lists:lists[sortindex])
# ----------------------------------------
code_block_3 = CodeBlock(seq=python_script) { DSCore.List.Transpose(seq); }
Sorted_List = Output(code_block_3)
