# Dynamo custom node SpaceData_Collector.dyf (Dynamo 1.3.2.2480)
# category: ArupBimSF.Revit.Mep_Spaces
# collects space data from current model

Refresh = Input(Refresh:bool=false)
categories = Categories("MEPSpaces")
all_elements_of_category = ElementsOfCategory(categories)
action_ReFresh = Custom[Action_ReFresh](Refresh=Refresh, list=all_elements_of_category)  # add to the front of a workflow to allow it to be refreshed with a boolean node
id = Element.Id(action_ReFresh)
Element_Id = Output(id)
code_block = CodeBlock()
# ---------- code_block.designscript (9 lines) ----------
"Name";
"Number";
"Level";
"Limit Offset";
"Unbounded Height";
"_Space_Type";
"_Space_MaxOcc";
"_Space_Location";
"Phase ID";
# ----------------------------------------
getParameterValueByName = Element.GetParameterValueByName(element=action_ReFresh, parameterName=code_block.out1)
Number = Output(getParameterValueByName)
getParameterValueByName_2 = Element.GetParameterValueByName(element=action_ReFresh, parameterName=code_block.out0)
Name = Output(getParameterValueByName_2)
getParameterValueByName_3 = Element.GetParameterValueByName(element=action_ReFresh, parameterName=code_block.out2)
Level = Output(getParameterValueByName_3)
getParameterValueByName_4 = Element.GetParameterValueByName(element=action_ReFresh, parameterName=code_block.out5)
Space_Type = Output(getParameterValueByName_4)
getParameterValueByName_5 = Element.GetParameterValueByName(element=action_ReFresh, parameterName=code_block.out6)
Number_of_People = Output(getParameterValueByName_5)
getParameterValueByName_6 = Element.GetParameterValueByName(element=action_ReFresh, parameterName=code_block.out3)
Limit_Offset = Output(getParameterValueByName_6)
getParameterValueByName_7 = Element.GetParameterValueByName(element=action_ReFresh, parameterName=code_block.out4)
Unbounded_Height = Output(getParameterValueByName_7)
getParameterValueByName_8 = Element.GetParameterValueByName(element=action_ReFresh, parameterName=code_block.out7)
Phase_Id = Output(getParameterValueByName_8)
