# Dynamo custom node SpaceSeperator_FromCurves.dyf (Dynamo 1.3.2.2480)
# category: ArupBimSF.Revit.Mep_Spaces
# Creates Serperation Lines from input curves

curve = Input(curve : Autodesk.Curve)
code_block = CodeBlock(item=curve) { Flatten({item}); }
sketchPlane = Input(sketchPlane : SketchPlane)
view = Input()
python_script = Python(IN[0]=code_block, IN[1]=sketchPlane, IN[2]=view)
# ---------- python_script.python (30 lines) ----------
import clr
clr.AddReference('RevitAPI')
from Autodesk.Revit.DB import *

clr.AddReference("RevitNodes")
import Revit
clr.ImportExtensions(Revit.GeometryConversion)

clr.AddReference("RevitServices")
import RevitServices
from RevitServices.Persistence import DocumentManager
from RevitServices.Transactions import TransactionManager

doc = DocumentManager.Instance.CurrentDBDocument
curves = UnwrapElement(IN[0])
sketchplane = UnwrapElement(IN[1])
view = UnwrapElement(IN[2])

TransactionManager.Instance.EnsureInTransaction(doc)
curvearray = CurveArray()
for curve in curves:
	curvearray.Append(curve.ToRevitType())
doccreation = doc.Create
separatorarray = doccreation.NewSpaceBoundaryLines(sketchplane, curvearray, view)
TransactionManager.Instance.TransactionTaskDone()

elementlist = list()
for item in separatorarray:
	elementlist.append(item)
OUT = elementlist
# ----------------------------------------
return_ListOrSingleValue = Custom[Return_ListOrSingleValue](unknownItem=curve, List_In=python_script)  # See Forum Post Regarding this node_RevitForum I think?
spaceSeparator = Output(return_ListOrSingleValue)
