# Dynamo custom node String_CleanEmptyStrings.dyf "String_Remove or Replace Empty Strings" (Dynamo 1.3.1.1736)
# category: Analyze
# removes empty strings from a list of strings

listOfStrings = Input()
code_block = CodeBlock { ""; }
eq = listOfStrings == code_block
map = List.Map(list=listOfStrings, f_x=eq)
code_block_2 = CodeBlock { true; }
allIndicesOf = List.AllIndicesOf(list=map, item=code_block_2)
Indices_Removed = Output(allIndicesOf)
filterByBoolMask = List.FilterByBoolMask(list=listOfStrings, mask=map)
ListOut = Output(filterByBoolMask.in)
