# Dynamo custom node String_SplitByCharachters+.dyf (Dynamo 1.3.2.2480)
# category: ArupBimSF.String Functions
# This node allows you to get the portion of a string after, before a defined charachter (or sequence of)  within the string. Additionally you can get combined output of the string removing only the Charachter(s) chosen_!!String.SplitByCharachter

String_List = Input(String_List : var)
string_from_object = FromObject(String_List)
TrimBy = Input(TrimBy : string)  # enter in text(string) sequence to trim list by
reset = Input(reset:bool = true)
python_script = Python(IN[0]=string_from_object, IN[1]=TrimBy, IN[2]=reset)
# ---------- python_script.python (4 lines) ----------
mainString = IN[0]
cuttingObject = IN[1]
h, m, t = mainString.partition(cuttingObject)
OUT = h, m, t
# ----------------------------------------
code_block = CodeBlock(a=python_script) { a[0]; a[1]; a[2]; }
concat = String.Concat(code_block.out0, code_block.out2)
Char_Removed = Output(concat)
Portion_Prior = Output(code_block.out0)
Portion_Post = Output(code_block.out2)
concat_2 = String.Concat(code_block.out1, code_block.out2)
TrimBefore = Output(concat_2)
concat_3 = String.Concat(code_block.out0, code_block.out1)
TrimAfter = Output(concat_3)
