# Dynamo custom node Sublist_ContainsString.DYF (Dynamo 1.3.2.2480)
# category: ArupBimSF.List Functions

list = Input(list : var[]..[])
firstItem = List.FirstItem(list@L2)
searchFor = Input(searchFor : string)
code_block = CodeBlock { true; }
contains = String.Contains(str=firstItem, searchFor=searchFor, ignoreCase=code_block)
bool = Output(contains)
