# Dynamo custom node Surface_NormalAtMidpoint.dyf (Dynamo 1.3.2.2480)
# category: ArupBimSF.Geometry
# Get Normal direction at geometry surface midpoint

surface = Input(surface : Surface)
code_block = CodeBlock { 0.5; }
normalAtParameter = Surface.NormalAtParameter(surface=surface, u=code_block, v=code_block)
Vector = Output(normalAtParameter)
pointAtParameter = Surface.PointAtParameter(surface=surface, u=code_block, v=code_block)
Point = Output(pointAtParameter)
