# Dynamo custom node TextToFile_TxtOrDoc.dyf "Text➜File_TxtOrDoc" (Dynamo 1.3.2.2480)
# category: ArupBimSF.Data Transfer
# Write input text data to a file (txt,doc,csv)

filePath = Input(filePath:string)  # File Path to write Example C:\Users\Lingkon\Desktop\Sample.txt
data = Input()
string_from_object = FromObject(data)
reset = Input(reset:bool = true)
python_script = Python(IN[0]=filePath, IN[1]=string_from_object, IN[2]=reset)
# ---------- python_script.python (11 lines) ----------
#Copyright © 2016, Lingkon
# @Lingkon, lingkonn@gmail.com
###############################
filePath =IN[0]
data = IN[1]
import sys
sys.path.append(r'C:\Program Files (x86)\IronPython 2.7\Lib')
TextFile=open(filePath,'w')
TextFile.write("\n".join(data))
TextFile.close()
OUT = ':)'
# ----------------------------------------
void = Output(python_script)
