# Dynamo custom node Topo_ToSurface.dyf "Topo➜Surface" (Dynamo 1.3.2.2480)
# category: ArupBimSF.Revit.Geometry

topography = Input(topography : Topography)
mesh = Topography.Mesh(topography)
vertexPositions = Mesh.VertexPositions(mesh)
faceIndices = Mesh.FaceIndices(mesh)
A = IndexGroup.A(faceIndices)
getItemAtIndex = List.GetItemAtIndex(list=vertexPositions, index=A)
B = IndexGroup.B(faceIndices)
getItemAtIndex_2 = List.GetItemAtIndex(list=vertexPositions, index=B)
C = IndexGroup.C(faceIndices)
getItemAtIndex_3 = List.GetItemAtIndex(list=vertexPositions, index=C)
create = List.Create(getItemAtIndex, getItemAtIndex_2, getItemAtIndex_3)
transpose = List.Transpose(create)
byPerimeterPoints = Surface.ByPerimeterPoints(transpose)
Surface = Output(byPerimeterPoints)
