# Dynamo custom node UI_BooleanData.dyf (Dynamo 1.3.2.2480)
# category: ArupBimSF.User_Interface
# UI Boolean

InputName = Input(InputName : string = "")
DefaultValue = Input(DefaultValue : bool = false)
SideText = Input(SideText : string = "Yes/No")
python_script = Python(IN[0]=InputName, IN[1]=DefaultValue, IN[2]=SideText)
# ---------- python_script.python (14 lines) ----------
class uibool():

    def __init__(self,inputname,defaultvalue,booltext):
        self.inputname = inputname
        self.defaultvalue = defaultvalue
        self.booltext = booltext
    def __repr__(self):
        return 'UI.Boolean input'
        
      
x = uibool(IN[0],IN[1],IN[2])


OUT = x
# ----------------------------------------
Boolean_input = Output(python_script)
