# Dynamo custom node UI_ColorInput_Data.dyf (Dynamo 1.3.2.2480)
# category: ArupBimSF.User_Interface
# UI Boolean

InputName = Input(InputName : string = "")
ButtonText = Input(ButtonText : string = "Select Color")
python_script = Python(IN[0]=InputName, IN[1]=ButtonText)
# ---------- python_script.python (13 lines) ----------
class uicolorpick():

    def __init__(self,inputname,buttontext):
        self.inputname = inputname
        self.buttontext = buttontext

    def __repr__(self):
        return 'UI.ColorPick input'

x = uicolorpick(IN[0],IN[1])


OUT = x
# ----------------------------------------
ColorSelection_Input = Output(python_script)
