# Dynamo custom node UI_DirectoryPath_Data.dyf (Dynamo 1.3.2.2480)
# category: ArupBimSF.User_Interface

InputName = Input(InputName : string = "")
DefaultPath = Input(DefaultPath : string = "DirectoryPath")
ButtonText = Input(ButtonText : string = "DirectoryPath")  # Is ignored if a default path is given
python_script = Python(IN[0]=InputName, IN[1]=DefaultPath, IN[2]=ButtonText)
# ---------- python_script.python (14 lines) ----------
class uidirectorypath():

    def __init__(self,inputname,defaultvalue,buttontext):
        self.inputname = inputname
        self.defaultvalue = defaultvalue
        self.buttontext = buttontext
        
    def __repr__(self):
        return 'UI.DirectoryPath input'
        
x = uidirectorypath(IN[0],IN[1],IN[2])


OUT = x
# ----------------------------------------
DirectoryPath_input = Output(python_script)
