# Dynamo custom node UI_FilePath_Data.dyf (Dynamo 1.3.2.2480)
# category: ArupBimSF.User_Interface

InputName = Input(InputName : string = "")
DefaulPath = Input(DefaulPath : string = "FilePath")
ButtonText = Input(ButtonText : string = "FilePath")  # Is ignored if a default path is given
python_script = Python(IN[0]=InputName, IN[1]=DefaulPath, IN[2]=ButtonText)
# ---------- python_script.python (14 lines) ----------
class uifilepath():

    def __init__(self,inputname,defaultvalue,buttontext):
        self.inputname = inputname
        self.defaultvalue = defaultvalue
        self.buttontext = buttontext

    def __repr__(self):
        return 'UI.FilePath input'

x = uifilepath(IN[0],IN[1],IN[2])


OUT = x
# ----------------------------------------
FilePath_input = Output(python_script)
