# Dynamo custom node UI_InputGroup_Data.dyf (Dynamo 1.3.2.2480)
# category: ArupBimSF.User_Interface
# *See Data Shapes

GroupTitle = Input(GroupTitle : string = "")
Inputs = Input()
python_script = Python(IN[0]=GroupTitle, IN[1]=Inputs)
# ---------- python_script.python (14 lines) ----------
class uigroup():

    def __init__(self,inputname,groupname,inputgroup):
    	self.inputname = inputname
        self.groupname = groupname
        self.inputgroup = inputgroup

    def __repr__(self):
        return 'UI.InputGroup'
        
x = uigroup("",IN[0],IN[1])


OUT = x
# ----------------------------------------
Input_Group = Output(python_script)
