# Dynamo custom node UI_ListView_Data.dyf (Dynamo 1.3.2.2480)
# category: ArupBimSF.User_Interface

InputName = Input(InputName : string = "")
Keys = Input()  # "Keys : []"
Values = Input()  # "Values : []"
Height_optional = Input(Height_optional : int = 200)
HighlightInView_optional = Input(HighlightInView_optional : bool = false)  # If set to true, clicking elements of the listview will highlight them in a view like Dynamo's watch node
DisplayModeOnly_optional = Input(DisplayModeOnly_optional : bool = false)  # Turns off ability to select elements. Form will not output any data for this element.
ShowElementCount_optional = Input(ShowElementCount_optional : bool = false)  # Will display the number of elements underneath the input name
DefaultValueIndices_optional = Input(DefaultValueIndices_optional : int[] = DSCore.List.Empty)
SortItems = Input(SortItems : bool = true)  # Determines wether the ListView items are sorted or not
python_script = Python(IN[0]=InputName, IN[1]=Keys, IN[2]=Values, IN[3]=Height_optional, IN[4]=HighlightInView_optional, IN[5]=DisplayModeOnly_optional, IN[6]=ShowElementCount_optional, IN[7]=DefaultValueIndices_optional, IN[8]=SortItems)
# ---------- python_script.python (59 lines) ----------
class listview():

    def __init__(self,inputname,height,highlight,display_mode,element_count,default_values,sorted):
        self.inputname = inputname
        self.height = height
        self.highlight = highlight
        self.display_mode = display_mode
        self.element_count = element_count
        self.default_values = default_values
        self.sorted = sorted

    def __setitem__(self, key, item):
        self.__dict__[key] = item

    def __getitem__(self, key):
        return self.__dict__[key]

    def __iter__(self):
        return iter(self.__dict__)

    def values(self):
        return self.__dict__.values()

    def keys(self):
        return self.__dict__.keys()

    def __repr__(self):
        return 'UI.ListView input'

if isinstance(IN[1],list):
	in1 = IN[1]
else:
	in1 = [IN[1]]

if isinstance(IN[2],list):
	in2 = IN[2]
else:
	in2 = [IN[2]]

if IN[6]:
	element_count = len(in1)
else:
	element_count = 0

x = listview(IN[0],IN[3],IN[4],IN[5],element_count,IN[7],IN[8])

for k,v in zip(in1,in2):
	try:
		try:
			x[str(k)+ '  -  id: ' + str(v.Id)] = v
		except:
			x[k.encode('utf-8').decode('utf-8') + '  -  id: ' + str(v.Id)] = v
	except:
		try:
			x[str(k)] = v
		except:
			x[k.encode('utf-8').decode('utf-8')] = v

OUT = x
# ----------------------------------------
ListView_input = Output(python_script)
