# Dynamo custom node UI_SliderData.dyf (Dynamo 1.3.2.2480)
# category: ArupBimSF.User_Interface

InputName = Input(InputName : string = "")
Minimum = Input()
Maximum = Input()
Default_Value = Input(Default_Value : var = "")
Step = Input(Step : var = 1)
python_script = Python(IN[0]=InputName, IN[1]=Minimum, IN[2]=Maximum, IN[3]=Default_Value, IN[4]=Step)
# ---------- python_script.python (16 lines) ----------
class uislider():

    def __init__(self,inputname,minimum,maximum,defaultvalue,step):
        self.inputname = inputname
        self.minimum = minimum
        self.maximum = maximum
        self.defaultvalue = defaultvalue
        self.step = step

    def __repr__(self):
        return 'UI.IntegerSlider input'
        
x = uislider(IN[0],IN[1],IN[2],IN[3],IN[4])


OUT = x
# ----------------------------------------
Slider_input = Output(python_script)
