# Dynamo custom node UI_TextBox_Data.dyf (Dynamo 1.3.2.2480)
# category: ArupBimSF.User_Interface

InputName = Input(InputName : string = "")
DefaultText = Input(DefaultText: string = "")
python_script = Python(IN[0]=InputName, IN[1]=DefaultText)
# ---------- python_script.python (13 lines) ----------
class uitext():

    def __init__(self,inputname,defaultvalue):
        self.inputname = inputname
        self.defaultvalue = defaultvalue

    def __repr__(self):
        return 'UI.Textbox input'
        
x = uitext(IN[0],IN[1])


OUT = x
# ----------------------------------------
TextBox_input = Output(python_script)
