# Dynamo custom node UnLoad_Fabrication_Services.dyf (Dynamo 1.3.2.2480)
# category: ArupBimSF.Revit.Fabrication
# unloads fab services from active doc

Service_IDs = Input()
fabrication_service_s_id = Python(IN[0]=Service_IDs)
# ---------- fabrication_service_s_id.python (15 lines) ----------
import clr
clr.AddReference("RevitAPI")
import Autodesk
from Autodesk.Revit.DB import FabricationConfiguration
clr.AddReference("RevitServices")
import RevitServices
from RevitServices.Persistence import DocumentManager
from RevitServices.Transactions import TransactionManager

Inpt = UnwrapElement(IN[0])
ItmList = list()

ItmList.append(Inpt)

OUT = ItmList
# ----------------------------------------
Service_IDsRemoved = Output(fabrication_service_s_id)
fabrication_unload_service_s = Python(IN[0]=Service_IDs)
# ---------- fabrication_unload_service_s.python (23 lines) ----------
import clr
clr.AddReference("RevitAPI")
import Autodesk
from Autodesk.Revit.DB import FabricationConfiguration
clr.AddReference("RevitServices")
import RevitServices
from RevitServices.Persistence import DocumentManager
from RevitServices.Transactions import TransactionManager

Inpt = UnwrapElement(IN[0])
ItmList= list()

Doc = DocumentManager.Instance.CurrentDBDocument
TransactionManager.Instance.EnsureInTransaction(Doc)

Config = FabricationConfiguration.GetFabricationConfiguration(Doc)
Config.ReloadConfiguration()
UnLServices = Config.UnloadServices(Inpt)
ItmList.append(Inpt)

TransactionManager.Instance.TransactionTaskDone()

OUT = ItmList
# ----------------------------------------
