# Dynamo custom node Vector_All Directions.dyf (Dynamo 1.3.2.2480)
# category: ArupBimSF.Geometry
# gets a vector at origin in all directions North East South West.  to use from a specific point you must establish a point on the geometry you want to start from and use vector by start point and direction (use this as the direction.

XAxis = Vector.XAxis()
YAxis = Vector.YAxis()
join = List.Join(XAxis, YAxis)
reverse = Vector.Reverse(join)
join_2 = List.Join(reverse, join)
reverse_2 = List.Reverse(join_2)
code_block = CodeBlock(x=reverse_2, y=reverse_2, s=reverse_2, i=reverse_2) { x[0]; y[1]; s[2]; i[3]; }
North = Output(code_block.out0)
East = Output(code_block.out1)
South = Output(code_block.out2)
West = Output(code_block.out3)
All_Directions = Output(reverse_2)
