# Dynamo custom node Vector_Visualizer.dyf (Dynamo 1.3.2.2480)
# category: ArupBimSF.Geometry
# Visualize XYZ vectors with RGB colored lines in the Dynamo canvas

origin = Input(origin : Point)
Xvector = Input(Xvector : Vector)
LineLength = Input(LineLength: double=1000)
byStartPointDirectionLength = Line.ByStartPointDirectionLength(startPoint=origin, direction=Xvector, length=LineLength)
code_block = CodeBlock { 0; 255; }
byARGB = Color.ByARGB(r=code_block.out1, g=code_block.out0, b=code_block.out0)
byGeometryColor = Display.Display.ByGeometryColor(byStartPointDirectionLength, byARGB)
X = Output(byGeometryColor)
Yvector = Input(Yvector : Vector)
byStartPointDirectionLength_2 = Line.ByStartPointDirectionLength(startPoint=origin, direction=Yvector, length=LineLength)
code_block_2 = CodeBlock { 0; 255; }
byARGB_2 = Color.ByARGB(r=code_block_2.out0, g=code_block_2.out1, b=code_block_2.out0)
byGeometryColor_2 = Display.Display.ByGeometryColor(byStartPointDirectionLength_2, byARGB_2)
Y = Output(byGeometryColor_2)
Zvector = Input(Zvector : Vector)
byStartPointDirectionLength_3 = Line.ByStartPointDirectionLength(startPoint=origin, direction=Zvector, length=LineLength)
code_block_3 = CodeBlock { 0; 255; }
byARGB_3 = Color.ByARGB(r=code_block_3.out0, g=code_block_3.out0, b=code_block_3.out1)
byGeometryColor_3 = Display.Display.ByGeometryColor(byStartPointDirectionLength_3, byARGB_3)
Z = Output(byGeometryColor_3)
