# Dynamo custom node ViewTemplate_Manager.dyf (Dynamo 1.3.2.2480)
# category: EEC.Revit.ViewTemplates, Filters
# Control, manage and deploy view templates.  Use this node to manage the Project Browser through the view templates

A_FilterBy_Index = Input(A_FilterBy_Index : var = "---")
code_block = CodeBlock { "---"; }
eq = A_FilterBy_Index == code_block
code_block_2 = CodeBlock { {"VT_Name","Rvt_ViewType"}; }
code_block_3 = CodeBlock { {"CSI_MasterFormat","Discipline_Name","View_Use","View Scale","View_Type","Discipline_Abbr","Discipline_Prefix","View_Series","View_Desc1","View_Desc2","VT_CreateViews","View_Folders"}; }
join = List.Join(code_block_2, code_block_3)
getItemAtIndex = List.GetItemAtIndex(list=join, index=A_FilterBy_Index)
if_ = If(test=eq, true=join, false=getItemAtIndex)
uniqueItems = List.UniqueItems(if_)
ParamList_A_ChosenParam = Output(uniqueItems)  # "ParamList➜A_ChosenParam"
Refresh = Input(Refresh: bool = false)
get_ViewTemplates = Custom[Get_ViewTemplates](ReFresh=Refresh)  # get all view templates not including schedules at this time
B_Partial_Or_Exact = Input(B_Partial_Or_Exact: bool = true)  # set search parameters, true = partial match, false = exact match
join_2 = List.Join()  # unwired: arg0, arg1
name = Custom[Get_Element.Name+](elements=get_ViewTemplates)  # Get the element name from all types of elements including system families_!!Get!Element
get_ViewType = Custom[Get_ViewType](View=get_ViewTemplates)  # Returns the View Type Of Input Views
create = List.Create(name, get_ViewType)
transpose = List.Transpose(create)
getParameterValueByName = Element.GetParameterValueByName(parameterName=code_block_3, lacing=Longest)  # unwired: element
map = List.Map(list=get_ViewTemplates, f_x=getParameterValueByName)
combine = List.Combine(join_2, transpose, map)
list_GetIndexFromSublists = Custom[List_GetIndexFromSublists](list=combine, desired_index=A_FilterBy_Index)  # GEt item at index mapped_!!List
string_from_object = FromObject(list_GetIndexFromSublists)
B_String_Or_Number = Input(B_String_Or_Number : var = "")  # input a search string or double to filter chosen parameter values by
string_from_object_2 = FromObject(B_String_Or_Number)
code_block_4 = CodeBlock { true; }
contains = String.Contains(str=string_from_object, searchFor=string_from_object_2, ignoreCase=code_block_4)
eq_2 = string_from_object_2 == string_from_object
if_2 = If(test=B_Partial_Or_Exact, true=contains, false=eq_2)
filterByBoolMask = List.FilterByBoolMask(list=get_ViewTemplates, mask=if_2)
B_Elements_In = Output(filterByBoolMask.in)  # "➜➜B_Elements_In"
B_Elements_Out = Output(filterByBoolMask.out)  # "➜➜B_Elements_Out"
filterByBoolMask_2 = List.FilterByBoolMask(list=list_GetIndexFromSublists, mask=if_2)
B_Values_In = Output(filterByBoolMask_2.in)  # "➜➜B_Values_In"
B_Values_Out = Output(filterByBoolMask_2.out)  # "➜➜B_Values_Out"
Set_ParamIndex = Input(Set_ParamIndex : var = "---")
code_block_5 = CodeBlock { "---"; }
eq_3 = Set_ParamIndex == code_block_5
getItemAtIndex_2 = List.GetItemAtIndex(list=join, index=Set_ParamIndex)
if_3 = If(test=eq_3, true=join, false=getItemAtIndex_2)
C_SetParamList_D_ChosenSet_Param = Output(if_3)  # "➜➜C_SetParamList➜D_ChosenSet_Param"
code_block_6 = CodeBlock { "---"; }
eq_4 = Set_ParamIndex == code_block_6
code_block_7 = CodeBlock { "---"; }
if_4 = If(test=eq_4, true=code_block_7, false=filterByBoolMask.in)
code_block_8 = CodeBlock(x=join, e=Set_ParamIndex) { x[e]; }
code_block_9 = CodeBlock { null; }
Set_Param_Value = Input(Set_Param_Value: var = "---")
if_5 = If(test=eq_4, true=code_block_9, false=Set_Param_Value)
setParameterByName = Element.SetParameterByName(element=if_4, parameterName=code_block_8, value=if_5)
removeNulls = Lists.Manage.RemoveNulls(setParameterByName)
D_Success = Output(removeNulls.out0)  # "➜➜➜D_Success"
getItemAtIndex_3 = List.GetItemAtIndex(list=setParameterByName, index=removeNulls.out1, lacing=Longest)
D_Fail = Output(getItemAtIndex_3)  # "➜➜➜D_Fail"
