# Dynamo custom node ViewTemplates_DataCollector.dyf (Dynamo 1.3.2.2480)
# category: ArupBimSF.Revit.Views & Sheets
# Collect the name and element info for all view templates in active Revit Model#VT#PrS

categories = Categories("Views")
ReFresh = Input(ReFresh : bool = true)
code_block = CodeBlock(categories, ReFresh)
# ---------- code_block.designscript (11 lines) ----------
list;
come;

[Imperative]

{
 if (come ==true)
  return = list;
 else
  return = list;
};
# ----------------------------------------
all_elements_of_category = ElementsOfCategory(code_block.out2)
removeNulls = Lists.Manage.RemoveNulls(all_elements_of_category)
isViewTemplate = View.IsViewTemplate(removeNulls)
removeNulls_2 = Lists.Manage.RemoveNulls(isViewTemplate)
removeItemAtIndex = List.RemoveItemAtIndex(list=removeNulls, indices=removeNulls_2.out1)
filterByBoolMask = List.FilterByBoolMask(list=removeItemAtIndex, mask=removeNulls_2.out0)
name = Element.Name()  # unwired: arg0
sortByFunction = SortByFunction(filterByBoolMask.in, name)
name_2 = Element.Name(sortByFunction)
n00_Names = Output(name_2)  # "00_Names"
id = Element.Id(sortByFunction)
get_ViewType = Custom[Get_ViewType](View=sortByFunction)  # Returns the View Type Of Input Views
code_block_2 = CodeBlock { "Discipline_Name"; }
getParameterValueByName = Element.GetParameterValueByName(element=sortByFunction, parameterName=code_block_2)
code_block_3 = CodeBlock { "Discipline_Sub"; }
getParameterValueByName_2 = Element.GetParameterValueByName(element=sortByFunction, parameterName=code_block_3)
code_block_4 = CodeBlock { "CSI_MasterFormat"; }
getParameterValueByName_3 = Element.GetParameterValueByName(element=sortByFunction, parameterName=code_block_4)
code_block_5 = CodeBlock { "View_Series"; }
getParameterValueByName_4 = Element.GetParameterValueByName(element=sortByFunction, parameterName=code_block_5)
code_block_6 = CodeBlock { "View_Use"; }
getParameterValueByName_5 = Element.GetParameterValueByName(element=sortByFunction, parameterName=code_block_6)
code_block_7 = CodeBlock { "View_Type"; }
getParameterValueByName_6 = Element.GetParameterValueByName(element=sortByFunction, parameterName=code_block_7)
code_block_8 = CodeBlock { "Discipline_Abbr"; }
getParameterValueByName_7 = Element.GetParameterValueByName(element=sortByFunction, parameterName=code_block_8)
code_block_9 = CodeBlock { "View_Desc1"; }
getParameterValueByName_8 = Element.GetParameterValueByName(element=sortByFunction, parameterName=code_block_9)
code_block_10 = CodeBlock { "View_Desc2"; }
getParameterValueByName_9 = Element.GetParameterValueByName(element=sortByFunction, parameterName=code_block_10)
code_block_11 = CodeBlock { "Discipline_Sub_Abbr"; }
getParameterValueByName_10 = Element.GetParameterValueByName(element=sortByFunction, parameterName=code_block_11)
code_block_12 = CodeBlock { "View_Folders"; }
getParameterValueByName_11 = Element.GetParameterValueByName(element=sortByFunction, parameterName=code_block_12)
create = List.Create(id, get_ViewType, getParameterValueByName, getParameterValueByName_2, getParameterValueByName_3, getParameterValueByName_4, getParameterValueByName_5, getParameterValueByName_6, getParameterValueByName_7, getParameterValueByName_8, getParameterValueByName_9, getParameterValueByName_10, getParameterValueByName_11)
code_block_13 = CodeBlock(x=create) { x[0]; x[1]; x[2]; x[3]; x[4]; x[5]; x[6]; x[8]; x[9]; x[10]; x[11]; x[12]; x[13]; x[14]; }
n01_Element_Id = Output(code_block_13.out0)  # "01_Element_Id"
n02_Rvt_ViewType = Output(code_block_13.out1)  # "02_Rvt_ViewType"
n03_Discipline_Name = Output(code_block_13.out2)  # "03_Discipline_Name"
n04_Discipline_Sub = Output(code_block_13.out3)  # "04_Discipline_Sub"
n05_CSI_MasterFormat = Output(code_block_13.out4)  # "05_CSI_MasterFormat"
n06_View_Use = Output(code_block_13.out5)  # "06_View_Use"
n07_View_Type = Output(code_block_13.out7)  # "07_View_Type"
n08_Discipline_Abbr = Output(code_block_13.out8)  # "08_Discipline_Abbr"
n09_View_Desc1 = Output(code_block_13.out9)  # "09_View_Desc1"
n10_View_Desc2 = Output(code_block_13.out10)  # "10_View_Desc2"
n11_Discipline_Sub_Abbr = Output(code_block_13.out11)  # "11_Discipline_Sub_Abbr"
n12_Project_Folders = Output(code_block_13.out12)  # "12_Project_Folders"
code_block_14 = CodeBlock { "VT_CreateViews"; }
getParameterValueByName_12 = Element.GetParameterValueByName(element=sortByFunction, parameterName=code_block_14)
n13_Vt_CreateViews_ByTemplate = Output(code_block_13.out13)  # "13_Vt_CreateViews_ByTemplate"
code_block_15 = CodeBlock { {"Element Id","Name","Rvt_ViewType"}; }
join = List.Join(code_block_15, code_block_2, code_block_3, code_block_4, code_block_5, code_block_6, code_block_7, code_block_8, code_block_9, code_block_10, code_block_11, code_block_12, code_block_14)
addItemToFront = List.AddItemToFront(item=join, list=create@L2, lacing=Longest)
n14_List_DataOut = Output(addItemToFront)  # "14_List_DataOut"
ElementsOut = Output(sortByFunction)  # "➜ElementsOut"
code_block_16 = CodeBlock {  }
ParameterNames_Out = Output(addItemToFront)  # "➜ParameterNames_Out"
