# Dynamo custom node Viewport_ByViewNameSearch.dyf (Dynamo 1.3.2.2480)
# category: ArupBimSF.^FixMe
# collect Viewports (views on sheets) by view name search#FixMe

code_block = CodeBlock { true; }
viewport_Collector = Custom[Viewport_Collector](RunMe=code_block)  # Collect all Viewports in active doc
SearchString = Input()
contains = String.Contains(str=viewport_Collector.ViewNames, searchFor=SearchString)
filterByBoolMask = List.FilterByBoolMask(list=viewport_Collector.Elements, mask=contains)
Viewports = Output(filterByBoolMask.in)
filterByBoolMask_2 = List.FilterByBoolMask(list=viewport_Collector.ViewNames, mask=contains)
ViewNames = Output(filterByBoolMask_2.in)
filterByBoolMask_3 = List.FilterByBoolMask(list=viewport_Collector.ViewScale_1_x, mask=contains)
ViewScale = Output(filterByBoolMask_3.in)
filterByBoolMask_4 = List.FilterByBoolMask(list=viewport_Collector.TitleOnSheet, mask=contains)
Title_On_Sheet = Output(filterByBoolMask_4.in)
