# Dynamo custom node Viewport_Collector.dyf (Dynamo 1.3.2.2480)
# category: ArupBimSF.Revit.ViewPorts and Boundaries
# Collect all Viewports in active doc

categories = Categories("Viewports")
all_elements_of_category = ElementsOfCategory(categories)
RunMe = Input(RunMe : bool = false)
filterByBoolMask = List.FilterByBoolMask(list=all_elements_of_category, mask=RunMe)
watch = Watch(filterByBoolMask.in)
Elements = Output(watch)
parameters = Element.Parameters(watch)
string_from_object = FromObject(parameters)
uniqueItems = List.UniqueItems()  # unwired: arg0
map = List.Map(list=string_from_object, f_x=uniqueItems)
code_block = CodeBlock { "View Name"; }
contains = String.Contains(str=map, searchFor=code_block)
filterByBoolMask_2 = List.FilterByBoolMask(list=map, mask=contains)
flatten = Flatten(filterByBoolMask_2.in)
code_block_2 = CodeBlock { ": "; false; }
string_remove_string_prior_to = Custom[String_Remove String Prior To Charachter](str=flatten, Character=code_block_2.out0, ignoreCase=code_block_2.out1)  # Remove String Prior To Charachter
trimWhitespace = String.TrimWhitespace(string_remove_string_prior_to)
code_block_3 = CodeBlock { "Title on Sheet"; }
getParameterValueByName = Element.GetParameterValueByName(element=watch, parameterName=code_block_3)
code_block_4 = CodeBlock { "test"; }
code_block_5 = CodeBlock { ""; }
eq = _ == code_block_5  # unwired: arg0
replaceByCondition = Replace(getParameterValueByName, code_block_4, eq)
code_block_6 = CodeBlock { 2; }
cycle = List.Cycle(amount=code_block_6)  # unwired: list
map_2 = List.Map(list=replaceByCondition, f_x=cycle)
flatten_2 = Flatten(map_2)
code_block_7 = CodeBlock { {"","test"}; }
count = List.Count(getParameterValueByName)
code_block_8 = CodeBlock(a=count) { a; }
cycle_2 = List.Cycle(list=code_block_7, amount=code_block_8)
eq_2 = flatten_2 == cycle_2
filterByBoolMask_3 = List.FilterByBoolMask(list=flatten_2, mask=eq_2)
eq_3 = trimWhitespace == filterByBoolMask_3.out
filterByBoolMask_4 = List.FilterByBoolMask(list=trimWhitespace, mask=eq_3)
ViewNames = Output(filterByBoolMask_4.out)
code_block_9 = CodeBlock { "Scale Value    1:"; }
getParameterValueByName_2 = Element.GetParameterValueByName(element=watch, parameterName=code_block_9)
ViewScale_1 = Output(getParameterValueByName_2)  # "ViewScale 1:x"
TitleOnSheet = Output(getParameterValueByName)
# note: Create a view port manager! see view template managere.....
# the things I want to control are
# Setting Min Point, CenterPoint,
# Title On Sheet.....
# Scale?  not sure if this is allowable by VP may need to acceess views instead
categories_2 = Categories("Viewports")
all_elements_of_category_2 = ElementsOfCategory(categories_2)
RunMe_2 = Input(RunMe : bool = false)
filterByBoolMask_5 = List.FilterByBoolMask(list=all_elements_of_category_2, mask=RunMe_2, lacing=Longest)
watch_2 = Watch(filterByBoolMask_5.in)
flatten_3 = Flatten(watch_2)
Elements_2 = Output(flatten_3)  # "Elements"
parameters_2 = Element.Parameters(flatten_3)
string_from_object_2 = FromObject(parameters_2)
uniqueItems_2 = List.UniqueItems()  # unwired: arg0
map_3 = List.Map(list=string_from_object_2, f_x=uniqueItems_2)
code_block_10 = CodeBlock { "View Name"; }
contains_2 = String.Contains(str=map_3, searchFor=code_block_10)
filterByBoolMask_6 = List.FilterByBoolMask(list=map_3, mask=contains_2)
flatten_4 = Flatten(filterByBoolMask_6.in)
code_block_11 = CodeBlock { ": "; false; }
string_SplitByCharachters = Custom[String_SplitByCharachters+](String_List=flatten_4, TrimBy=code_block_11.out0)  # This node allows you to get the portion of a string after, before a defined charachter (or sequence of) within the string. Additionally you can get combined output of the string removing only the Charachter(s) chosen_!!String.SplitByCharachter
trimWhitespace_2 = String.TrimWhitespace(string_SplitByCharachters.Portion_Prior)
code_block_12 = CodeBlock { "Title on Sheet"; }
getParameterValueByName_3 = Element.GetParameterValueByName(element=flatten_3, parameterName=code_block_12)
code_block_13 = CodeBlock { "test"; }
code_block_14 = CodeBlock { ""; }
eq_4 = _ == code_block_14  # unwired: arg0
replaceByCondition_2 = Replace(getParameterValueByName_3, code_block_13, eq_4)
code_block_15 = CodeBlock { 2; }
cycle_3 = List.Cycle(amount=code_block_15)  # unwired: list
map_4 = List.Map(list=replaceByCondition_2, f_x=cycle_3)
flatten_5 = Flatten(map_4)
code_block_16 = CodeBlock { {"","test"}; }
count_2 = List.Count(getParameterValueByName_3)
code_block_17 = CodeBlock(a=count_2) { a; }
cycle_4 = List.Cycle(list=code_block_16, amount=code_block_17)
eq_5 = flatten_5 == cycle_4
filterByBoolMask_7 = List.FilterByBoolMask(list=flatten_5, mask=eq_5)
eq_6 = trimWhitespace_2 == filterByBoolMask_7.out
filterByBoolMask_8 = List.FilterByBoolMask(list=trimWhitespace_2, mask=eq_6)
ViewNames_2 = Output(filterByBoolMask_8.in)  # "ViewNames"
code_block_18 = CodeBlock { "Scale Value    1:"; }
getParameterValueByName_4 = Element.GetParameterValueByName(element=flatten_3, parameterName=code_block_18)
ViewScale_1_2 = Output(getParameterValueByName_4)  # "ViewScale 1:x"
TitleOnSheet_2 = Output(getParameterValueByName_3)  # "TitleOnSheet"
