# Dynamo custom node Viewport_Get Center Point.dyf (Dynamo 1.3.2.2480)
# category: ArupBimSF.Revit.ViewPorts and Boundaries
# get the centerpoint of input views

Viewports = Input()
python_script = Python(IN[0]=Viewports)
# ---------- python_script.python (39 lines) ----------
import clr
clr.AddReference('ProtoGeometry')
from Autodesk.DesignScript.Geometry import *
# Import ToDSType(bool) extension method
clr.AddReference("RevitNodes")
import Revit
clr.ImportExtensions(Revit.Elements)
# Import geometry conversion extension methods
clr.ImportExtensions(Revit.GeometryConversion)
# Import DocumentManager and TransactionManager
clr.AddReference("RevitServices")
import RevitServices
from RevitServices.Persistence import DocumentManager
from RevitServices.Transactions import TransactionManager
from System.Collections.Generic import *
# Import RevitAPI
clr.AddReference("RevitAPI")
import Autodesk
from Autodesk.Revit.DB import *

doc = DocumentManager.Instance.CurrentDBDocument
uiapp = DocumentManager.Instance.CurrentUIApplication
app = uiapp.Application
uidoc=DocumentManager.Instance.CurrentUIApplication.ActiveUIDocument

elt = []
for i in IN[0]:
	elt.append(UnwrapElement(i))

# Start Transaction
TransactionManager.Instance.EnsureInTransaction(doc)
loc=[]
for v in elt:
	loc.append(v.GetBoxCenter().ToPoint())

# End Transaction
TransactionManager.Instance.TransactionTaskDone()

OUT=loc
# ----------------------------------------
Points = Output(python_script)
