# Dynamo custom node Viewport_Set Box Center.dyf (Dynamo 1.3.2.2480)
# category: ArupBimSF.Revit.ViewPorts and Boundaries
# Sets the location of the viewport Center point (moving the view on its sheet)

Viewport_list = Input()
Points = Input()
python_script = Python(IN[0]=Viewport_list, IN[1]=Points)
# ---------- python_script.python (43 lines) ----------
import clr
clr.AddReference('ProtoGeometry')
from Autodesk.DesignScript.Geometry import *
# Import ToDSType(bool) extension method
clr.AddReference("RevitNodes")
import Revit
clr.ImportExtensions(Revit.Elements)
# Import geometry conversion extension methods
clr.ImportExtensions(Revit.GeometryConversion)
# Import DocumentManager and TransactionManager
clr.AddReference("RevitServices")
import RevitServices
from RevitServices.Persistence import DocumentManager
from RevitServices.Transactions import TransactionManager
from System.Collections.Generic import *
# Import RevitAPI
clr.AddReference("RevitAPI")
import Autodesk
from Autodesk.Revit.DB import *

doc = DocumentManager.Instance.CurrentDBDocument
uiapp = DocumentManager.Instance.CurrentUIApplication
app = uiapp.Application
uidoc=DocumentManager.Instance.CurrentUIApplication.ActiveUIDocument

vport = []
for i in IN[0]:
	vport.append(UnwrapElement(i))
pts=[]
for i in IN[1]:
	pts.append(UnwrapElement(i).ToXyz())

# Start Transaction
TransactionManager.Instance.EnsureInTransaction(doc)

for v,p in zip(vport,pts):
	v.SetBoxCenter(p)
			
doc.Regenerate()
# End Transaction
TransactionManager.Instance.TransactionTaskDone()

OUT=IN[0]
# ----------------------------------------
OUT = Output(python_script)
