# Dynamo custom node Viewports_Center On Sheets by Points.dyf (Dynamo 1.3.2.2480)
# category: ArupBimSF.^TestingGrounds
# Center Viewports on Sheets

Sheets_In = Input()
code_block = CodeBlock(x=Sheets_In) { Flatten({x}); }
Points_In = Input()
python_script = Python(IN[0]=code_block, IN[1]=Points_In)
# ---------- python_script.python (32 lines) ----------
import clr
clr.AddReference('RevitApi')
from Autodesk.Revit.DB import*
clr.AddReference('RevitServices')
from RevitServices.Persistence import DocumentManager
from RevitServices.Transactions import TransactionManager

doc = DocumentManager.Instance.CurrentDBDocument

pts = IN[1]
sheets = []
viewports = []
centers = []

t = Transaction(doc , 'recenter views')
t.Start()

for i in IN[0]:
	sheets.append(UnwrapElement(i))
for s in sheets:
	vpid = s.GetAllViewports()
	for id in vpid:
		viewports.append(doc.GetElement(id))
for p in pts:
	centers.append(XYZ(p.X,p.Y,p.Z))

for indice,vp in enumerate(viewports):
	vp.SetBoxCenter(centers[indice])

t.Commit()

OUT = 'You have successfully recentered %d viewports.' % (len(viewports))
# ----------------------------------------
OUT = Output(python_script)
