# Dynamo custom node Wall.Type_Function.dyf (Dynamo 1.3.2.2480)
# category: ArupBimSF.Revit.SystemElements
# gets the wallType Function from

WallsIn = Input(WallsIn: WallType)
code_block = CodeBlock(item=WallsIn) { Flatten({item}); }
python_script = Python(IN[0]=code_block)
# ---------- python_script.python (17 lines) ----------
import clr
clr.AddReference('RevitAPI')
from Autodesk.Revit.DB import *

clr.AddReference("RevitNodes")
import Revit
clr.ImportExtensions(Revit.Elements)

walltypes = UnwrapElement(IN[0])
functionlist = list()

for item in walltypes:
	try:
		functionlist.append(item.get_Parameter(BuiltInParameter.FUNCTION_PARAM).AsValueString())
	except:
		functionlist.append('No Wall/Function')
OUT = functionlist
# ----------------------------------------
list_return_list_or_single_value = Custom[List_Return List or Single Value](unknownItem=WallsIn, List_In=python_script)
function = Output(list_return_list_or_single_value)
