# Dynamo custom node WriteToExcel.dyf "Write➜Excel" (Dynamo 1.3.2.2480)
# category: ArupBimSF.Data Transfer
# Writes input data to excel quickly.  Same as OOTB node with added presets for variables

File_Path = Input()
SheetName = Input(SheetName : string = "Sheet1")
StartRow = Input(StartRow : int = 1)
StartCol = Input(StartCol : int = 1)
Data_In = Input(Data_In : var[][])
OverWrite = Input(OverWrite : bool = true)
code_block = CodeBlock(t1=File_Path, t2=SheetName, t3=StartRow, t4=StartCol, t5=Data_In, t6=OverWrite) { t7 = DSOffice.Excel.WriteToFile(t1, t2, t3, t4, t5, t6); }
Data = Output(code_block)
