# Dynamo custom node Collect_Elements_ModelCategories_Python.dyf (Dynamo 1.3.2.2480)
# category: Revit.Elements
# Collects all modeled/Placed elements in the active document. I have removed the Detail Items and Lines as they are included in the Annotation elements Node instead

string = StringInput(" | ")
join = String.Join(string)  # unwired: arg1, arg2
python_script = Python()  # unwired: IN[0]
# ---------- python_script.python (29 lines) ----------
import clr
clr.AddReference('RevitAPI')
from Autodesk.Revit.DB import *

clr.AddReference("RevitNodes")
import Revit
clr.ImportExtensions(Revit.Elements)
clr.ImportExtensions(Revit.GeometryConversion)

clr.AddReference("RevitServices")
import RevitServices
from RevitServices.Persistence import DocumentManager
from RevitServices.Transactions import TransactionManager

doc = DocumentManager.Instance.CurrentDBDocument
categories = doc.Settings.Categories

model_cat = []
anno_cat = []
ana_cat = []
internal_cat = []

for c in categories:
	if c.CategoryType == CategoryType.Model:
		if c.SubCategories.Size > 0 or c.CanAddSubcategory:
			model_cat.append(Revit.Elements.Category.ById(c.Id.IntegerValue))
		

OUT = model_cat
# ----------------------------------------
string_from_object = FromObject()  # unwired: arg0
sortByFunction = SortByFunction(arg1=string_from_object)  # unwired: arg0
map = List.Map(list=python_script, f_x=sortByFunction)
ReFresh = Input(ReFresh : bool=true)
code_block = CodeBlock(map, ReFresh)
# ---------- code_block.designscript (11 lines) ----------
list;
come;

[Imperative]

{
 if (come ==true)
  return = list;
 else
  return = list;
};
# ----------------------------------------
code_block_2 = CodeBlock { ".dwg"; }
object_string_contains_basic = Custom[Object➜String.Contains_Basic](List_In=code_block.out2, Search_For=code_block_2)  # filters a list of objects for input string values
string_2 = StringInput("""Detail Items
Filled region
Masking Region
Lines
Raster Images""")
code_block_3 = CodeBlock(t3=string_2)
# ---------- code_block_3.designscript (4 lines) ----------
t1 = "
";
t2 = String.Split(t3, {t1});
t4 = String.TrimWhitespace(t2);
# ----------------------------------------
string_from_object_2 = FromObject(object_string_contains_basic.Others)
indexOf = IndexOf(string_from_object_2)  # unwired: arg1
map_2 = List.Map(list=code_block_3.t4, f_x=indexOf)
code_block_4 = CodeBlock { 0; }
ge = _ >= code_block_4  # unwired: arg0
filter = List.Filter(map_2, ge)
removeItemAtIndex = List.RemoveItemAtIndex(list=object_string_contains_basic.Others, indices=filter)
all_elements_of_category = ElementsOfCategory(removeItemAtIndex)
isEmpty = List.IsEmpty(all_elements_of_category, lacing=Longest)
filterByBoolMask = List.FilterByBoolMask(list=object_string_contains_basic.Others, mask=isEmpty)
string_from_object_3 = FromObject(filterByBoolMask.out)
length = String.Length(string_from_object_3)
maximumItem = List.MaximumItem(length)
code_block_5 = CodeBlock(x=maximumItem) { x; }
padRight = String.PadRight(string_from_object_3, code_block_5)
boolean = BoolSelector(false)
clean = List.Clean(list=all_elements_of_category, preserveIndices=boolean)
count = List.Count()  # unwired: arg0
map_3 = List.Map(list=clean, f_x=count)
string_from_object_4 = FromObject(map_3)
code_block_6 = CodeBlock { 4; }
code_block_7 = CodeBlock { "0"; }
padLeft = String.PadLeft(string_from_object_4, code_block_6, code_block_7)
combine = List.Combine(join, padRight, padLeft)
Category_ItemCount = Output(combine)  # "Category | ItemCount"
Get_Index = Input(Get_Index: int = 0)
getItemAtIndex = List.GetItemAtIndex(list=clean, index=Get_Index)
Chosen_Index = Output(getItemAtIndex)
join_2 = List.Join(filterByBoolMask.out, clean)
All_Elements = Output(join_2)
