# Dynamo custom node Get_Element_Parameters+.dyf (Dynamo 1.3.2.2480)
# category: ArupBimSF.Revit.Elements
# Get all parameters availible for an element or list of elements.  This Node Also only shows unique values and sorts parameters A-Z

elements = Input()
ReFresh = Input(ReFresh : bool = false)
code_block = CodeBlock(elements, ReFresh)
# ---------- code_block.designscript (11 lines) ----------
list;
come;

[Imperative]

{
 if (come ==true)
  return = list;
 else
  return = list;
};
# ----------------------------------------
parameters = Element.Parameters(code_block.out2, lacing=Longest)
name = Parameter.Name(parameters)
duplicateItemIndicies = archilab.Lists.Lists.DuplicateItemIndicies(name@L2, lacing=Longest)
getItemAtIndex = List.GetItemAtIndex(list=parameters, index=duplicateItemIndicies)
name_2 = Parameter.Name(getItemAtIndex)
sortByKey = List.SortByKey(list=getItemAtIndex, keys=name_2)
Parameters = Output(sortByKey.sorted_list)
Names = Output(sortByKey.sorted_keys)
value = Parameter.Value(sortByKey.sorted_list)
Values = Output(value)
hasValue = Parameter.HasValue(sortByKey.sorted_list)
string_from_object = FromObject(sortByKey.sorted_list)
code_block_2 = CodeBlock { "---"; }
concat = String.Concat(arg1=code_block_2)  # unwired: arg0
map = List.Map(list=string_from_object, f_x=concat)
if_ = If(test=hasValue, true=string_from_object, false=map)
code_block_3 = CodeBlock { " : "; }
concat_2 = String.Concat(arg1=code_block_3)  # unwired: arg0
map_2 = List.Map(list=sortByKey.sorted_keys, f_x=concat_2)
split = String.Split(if_, map_2, lacing=Longest)
flatten = Flatten(split)
ForcedValues_AsString = Output(flatten)
