# Dynamo custom node Get_LinkedRevitDoc++.dyf (Dynamo 1.3.2.2480)
# category: ArupBimSF.Revit.Links & Imports
# Get Link instance, Doc, Name & Path. Use With Get Docs or Get Loaded RVT Links To get a link from a list of links.  Use the all link names output to review the linked file names and chose the one you want by entering the index number of the desired link_#Lnk

empty = List.Empty()
Refresh = Input(Refresh : bool = true)
code_block = CodeBlock(empty, Refresh)
# ---------- code_block.designscript (11 lines) ----------
list;
come;

[Imperative]

{
 if (come ==true)
  return = list;
 else
  return = list;
};
# ----------------------------------------
python_script = Python(IN[0]=code_block.out2)
# ---------- python_script.python (44 lines) ----------
import clr
clr.AddReference('ProtoGeometry')
from Autodesk.DesignScript.Geometry import *

# Import DocumentManager and TransactionManager
clr.AddReference("RevitServices")
import RevitServices
from RevitServices.Persistence import DocumentManager
from RevitServices.Transactions import TransactionManager

from System.Collections.Generic import *

# Import RevitAPI
clr.AddReference("RevitAPI")
import Autodesk
from Autodesk.Revit.DB import *
from Autodesk.Revit.DB.Analysis import *

doc = DocumentManager.Instance.CurrentDBDocument
uiapp = DocumentManager.Instance.CurrentUIApplication
app = uiapp.Application

# Import ToDSType(bool) extension method
clr.AddReference("RevitNodes")
import Revit
clr.ImportExtensions(Revit.Elements)

#The inputs to this node will be stored as a list in the IN variable.
dataEnteringNode = IN

collector = Autodesk.Revit.DB.FilteredElementCollector(doc)
linkInstances = collector.OfClass(Autodesk.Revit.DB.RevitLinkInstance)

linkDoc, linkName, linkPath = [], [], []
for i in linkInstances:
	linkDoc.append(i.GetLinkDocument())
	linkName.append(i.Name)
	try:
		linkPath.append(i.GetLinkDocument().PathName)
	except:
		linkPath.append(None)
		pass

OUT = linkDoc, linkName, linkInstances, linkPath
# ----------------------------------------
number = DoubleInput(1)
getItemAtIndex = List.GetItemAtIndex(list=python_script, index=number)
All_Link_Names = Output(getItemAtIndex)
number_2 = DoubleInput(0)
getItemAtIndex_2 = List.GetItemAtIndex(list=python_script, index=number_2)
number_3 = DoubleInput(2)
getItemAtIndex_3 = List.GetItemAtIndex(list=python_script, index=number_3)
number_4 = DoubleInput(3)
getItemAtIndex_4 = List.GetItemAtIndex(list=python_script, index=number_4)
create = List.Create(getItemAtIndex_2, getItemAtIndex, getItemAtIndex_3, getItemAtIndex_4)
Index_Or_SearchString = Input(Index_Or_SearchString : var = 0)
type = Object.Type(Index_Or_SearchString)
code_block_2 = CodeBlock { "System.String"; }
eq = type == code_block_2
code_block_3 = CodeBlock { 1; }
object_string_contains = Custom[Filter_ByStringContains+](List_In=getItemAtIndex, Extra_In=getItemAtIndex, SearchString=Index_Or_SearchString, Partial_Or_Exact=code_block_3)  # Filters an input list by imput sting contains plus an extra list to run through the same filter._!!Filter
code_block_4 = CodeBlock { true; }
indexOf = IndexOf(object_string_contains.4_Bool, code_block_4, lacing=Longest)
if_ = If(test=eq, true=indexOf, false=Index_Or_SearchString)
list_GetIndexFromSublists = Custom[List_GetIndexFromSublists](list=create, desired_index=if_)  # GEt item at index mapped_!!List
code_block_5 = CodeBlock { 0; 1; 2; 3; }
getItemAtIndex_5 = List.GetItemAtIndex(list=list_GetIndexFromSublists, index=code_block_5.out1)
Link_Name = Output(getItemAtIndex_5)
getItemAtIndex_6 = List.GetItemAtIndex(list=list_GetIndexFromSublists, index=code_block_5.out0)
Document = Output(getItemAtIndex_6)
getItemAtIndex_7 = List.GetItemAtIndex(list=list_GetIndexFromSublists, index=code_block_5.out2)
Link_Instance = Output(getItemAtIndex_7)
getItemAtIndex_8 = List.GetItemAtIndex(list=list_GetIndexFromSublists, index=code_block_5.out3)
Link_Path = Output(getItemAtIndex_8)
code_block_6 = CodeBlock {  }
code_block_7 = CodeBlock {  }
