# Dynamo custom node Get_RefElements_ByCategory++.dyf (Dynamo 1.3.2.2480)
# category: ArupBimSF.Revit.Reference Objects
# Gets reference elements from active doc

string = StringInput("""Grids
Levels
Matchline
Scope Boxes
Crop Boundaries
Reference Planes
Plan Region
Callout Boundary""")
Refresh = Input(Refresh: bool = true)
code_block = CodeBlock(string, Refresh)
# ---------- code_block.designscript (11 lines) ----------
list;
come;

[Imperative]

{
 if (come ==true)
  return = list;
 else
  return = list;
};
# ----------------------------------------
multilinestring_list = Custom[MultilineString➜List](String_In=code_block.out2)  # converts a string with line breaks in to a list of strings
byName = Category.ByName(multilinestring_list)
all_elements_of_category = ElementsOfCategory(byName)
list_CleanOutput = Custom[List_CleanOutput+](List_In=all_elements_of_category)  # Removes and or places nulls and empties up to 2 dimentional_!!List
removeItemAtIndex = List.RemoveItemAtIndex(list=byName, indices=list_CleanOutput.IndicesOut)
n0_Categories = Output(removeItemAtIndex)  # "0_Categories"
n1_Elements = Output(list_CleanOutput.Cleaned)  # "1_Elements"
getItemAtIndex = List.GetItemAtIndex(list=byName, index=list_CleanOutput.IndicesOut)
n2_Categories_NoneElem = Output(getItemAtIndex)  # "2_Categories_NoneElem"
code_block_2 = CodeBlock(a=byName, b=list_CleanOutput.Cleaned, d=removeItemAtIndex) { a+b+d; }
graph_SeqPassthru = Custom[Graph_SeqPassthru](passThrough=code_block_2, waitFor=removeItemAtIndex)  # forces an operation to run in sequence.
code_block_3 = CodeBlock(x=graph_SeqPassthru) { x[0]; x[1]; x[2]; }
Get_Category = Input(Get_Category : var = "")
type = Object.Type(Get_Category)
code_block_4 = CodeBlock { "System.String"; }
eq = type == code_block_4
string_from_object = FromObject(code_block_3.out0)
code_block_5 = CodeBlock { 0; }
list_FilterByStringMatch = Custom[List_FilterByStringMatch](list=string_from_object, SearchString=Get_Category, Contains_Or_Equals=code_block_5)  # Filters a list of elements by whether or not they contain a search string. I added an option to run it by string match as well._!fi!Li
code_block_6 = CodeBlock { true; }
allIndicesOf = List.AllIndicesOf(list=list_FilterByStringMatch.Bool, item=code_block_6)
if_ = If(test=eq, true=allIndicesOf, false=Get_Category)
getItemAtIndex_2 = List.GetItemAtIndex(list=code_block_3.out1, index=if_)
n3_Chosen_Elements = Output(getItemAtIndex_2)  # "3➜Chosen_Elements"
getItemAtIndex_3 = List.GetItemAtIndex(list=code_block_3.out2, index=if_)
n4_Chosen_Category = Output(getItemAtIndex_3)  # "4➜Chosen_Category"
name = Element.Name(getItemAtIndex_2)
n5_TypeNames = Output(name)  # "5➜➜TypeNames"
code_block_7 = CodeBlock(a=code_block_3.out0, b=getItemAtIndex_2) { a+b; a; b; }
graph_SeqPassthru_2 = Custom[Graph_SeqPassthru](passThrough=code_block_7.out0, waitFor=removeItemAtIndex)
code_block_8 = CodeBlock(x=graph_SeqPassthru_2) { x[0]; x[1]; }
Get_Type = Input(Get_Type : var = "")
type_2 = Object.Type(Get_Type)
code_block_9 = CodeBlock { "System.String"; }
eq_2 = type_2 == code_block_9
code_block_10 = CodeBlock { 1; }
list_FilterByStringMatch_2 = Custom[List_FilterByStringMatch](list=code_block_8.out0, SearchString=Get_Type, Contains_Or_Equals=code_block_10)
code_block_11 = CodeBlock { true; }
allIndicesOf_2 = List.AllIndicesOf(list=list_FilterByStringMatch_2.Bool, item=code_block_11)
if_2 = If(test=eq_2, true=allIndicesOf_2, false=Get_Type)
getItemAtIndex_4 = List.GetItemAtIndex(list=code_block_8.out1, index=if_2)
n6_Chosen_Type = Output(getItemAtIndex_4)  # "6➜➜➜Chosen_Type"
code_block_12 = CodeBlock {  }
