# Dynamo custom node Get_ReferenceElements_ByCategoryAtIndex+.dyf (Dynamo 1.3.2.2480)
# category: ArupBimSF.Revit.Reference Objects
# Gets reference elements from active doc

string = StringInput("""Grids
Levels
Matchline
Scope Boxes
Crop Boundaries
Reference Planes
Plan Region
Callout Boundary""")
Refresh = Input(Refresh: bool = true)
code_block = CodeBlock(string, Refresh)
# ---------- code_block.designscript (11 lines) ----------
list;
come;

[Imperative]

{
 if (come ==true)
  return = list;
 else
  return = list;
};
# ----------------------------------------
multilinestring_list = Custom[MultilineString➜List](String_In=code_block.out2)  # converts a string with line breaks in to a list of strings
byName = Category.ByName(multilinestring_list)
all_elements_of_category = ElementsOfCategory(byName)
list_CleanOutput = Custom[List_CleanOutput+](List_In=all_elements_of_category)  # Removes and or places nulls and empties up to 2 dimentional_!!List
removeItemAtIndex = List.RemoveItemAtIndex(list=byName, indices=list_CleanOutput.IndicesOut)
n0_Categories = Output(removeItemAtIndex)  # "0_Categories"
n1_Elements = Output(list_CleanOutput.Cleaned)  # "1_Elements"
getItemAtIndex = List.GetItemAtIndex(list=byName, index=list_CleanOutput.IndicesOut)
n2_Categories_NoneElem = Output(getItemAtIndex)  # "2_Categories_NoneElem"
Get_Category = Input(Get_Category : var = "")
type = Object.Type(Get_Category)
code_block_2 = CodeBlock { "System.String"; }
eq = type == code_block_2
code_block_3 = CodeBlock { 1; }
list_FilterByStringMatch = Custom[List_FilterByStringMatch](list=multilinestring_list, SearchString=Get_Category, Contains_Or_Equals=code_block_3)  # Filters a list of elements by whether or not they contain a search string. I added an option to run it by string match as well._!fi!Li
code_block_4 = CodeBlock { true; }
indexOf = IndexOf(list_FilterByStringMatch.Bool, code_block_4)
if_ = If(test=eq, true=indexOf, false=Get_Category)
getItemAtIndex_2 = List.GetItemAtIndex(list=list_CleanOutput.Cleaned, index=if_)
n3_Chosen_Elements = Output(getItemAtIndex_2)  # "3➜Chosen_Elements"
getItemAtIndex_3 = List.GetItemAtIndex(list=removeItemAtIndex, index=if_)
n4_Chosen_Category = Output(getItemAtIndex_3)  # "4➜Chosen_Category"
name = Element.Name(getItemAtIndex_2)
n5_TypeNames = Output(name)  # "5➜➜TypeNames"
Get_Type = Input(Get_Type : var = "")
type_2 = Object.Type(Get_Type)
code_block_5 = CodeBlock { "System.String"; }
eq_2 = type_2 == code_block_5
code_block_6 = CodeBlock { 1; }
list_FilterByStringMatch_2 = Custom[List_FilterByStringMatch](list=multilinestring_list, SearchString=Get_Type, Contains_Or_Equals=code_block_6)
code_block_7 = CodeBlock { true; }
indexOf_2 = IndexOf(list_FilterByStringMatch_2.Bool, code_block_7)
if_2 = If(test=eq_2, true=indexOf_2, false=Get_Type)
getItemAtIndex_4 = List.GetItemAtIndex(list=getItemAtIndex_2, index=if_2)
n6_Chosen_Type = Output(getItemAtIndex_4)  # "6➜➜➜Chosen_Type"
